# Grasshopper definition Parametric Energy Modelling Tool-Testing.gh (Grasshopper 1.0.7)
# plug-ins: PollinationGH, ItemSelector, Human, Ironbug.LBHB_Legacy, MetaHopper, Ironbug.Grasshopper, Colibri, TT Toolbox

panel = Panel("""0
45
90
135""")
panel_2 = Panel("""0
1
2
3""")
lng = ListLength(List=panel)
repeat = RepeatData(Data=graft(panel_2), Length=lng)  # -> flatten(Data)
repeat_2 = RepeatData(Data=panel, Length="16")
ft2m = Ft2m(ft="290")
ft2m_2 = Ft2m(ft="53")
ft2m_3 = Ft2m(ft="188")
ft2m_4 = Ft2m(ft="53")
rectangle = Rectangle(Plane=PlaneXY(0, 0, 0), XSize=ft2m, YSize=ft2m_2, Radius=0)  # -> Rectangle, Length
rectangle_2 = Rectangle(Plane=PlaneXY(0, 0, 0), XSize=ft2m_3, YSize=ft2m_4, Radius=0)  # -> Rectangle, Length
row_house = Curve(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)
davidson = Curve(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)
panel_3 = Panel("""2
4
2
2""")
pt = Point(Point(0, 0, 0))
panel_4 = Panel("""8.65
8.65
8.65
10""")
panel_5 = Panel("""4
18
8
6""")
ft2m_5 = Ft2m(ft="8")
neg = Negative(Value=ft2m_5)
Z = UnitZ(Factor=neg)
row_house_context = Curve([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])
panel_6 = Panel("""38
32""")
avg_apartment_size = Panel("500")
project_name = Panel("NYCHA")
# Instructions: Select 'Cross Referencing' scheme to cross reference all variables. Even by linking some facade properties to reduce the total number of options, this scheme can still quickly produce a lot of alternatives.
# 
# Select the 'Unique ECM' scheme to limit the number of alteratives by simulating each of the various parameter lists in isolation compared to the 'base' option, which is considered to be the product of the first parameter of each list.
parametric_scheme = ValueList({"Cross Referencing Scheme": 0, "Unique ECM Scheme": 1}, selected="Cross Referencing Scheme")
# Special Boundary Conditions/Wall Types (optional)
# Glazing and Shading Geometry Parameters
# Global Glazing Controls
# Instructions: Choose glazing method from pulldown menu:
# 
# Autogenerate Windows - will autogenerate windows on exterior walls based on the WWR percentage specified by orientation in the WWR panels. These windows can be fixed or parametrically controlled. If it is desired to exclude autogenerated glazing on certain exterior walls, draw a surface on each of those walls and reference to the ‘Exclude Surface’ Brep container.
# 
# Custom Window Surfaces – Draw custom surface on exterior walls representing the windows and reference in the ‘Custom Window Surfaces’ Brep container.
# 
# Combination of Both – This allows a combination of fixed custom windows and autogenerated parametric windows. You MUST use the ‘Exclude Surface’ methodology to prevent parametric windows being generated on surfaces where custom window surfaces will be utilized.
panel_7 = Panel()

# ---- group: Reference Zones of This Program Type
zones_closed_brep = Brep()

zones_closed_brep_2 = Brep()

zones_closed_brep_3 = Brep()

# ---- group: Baseline Properties
# Instructions: If a baseline comparison is desired, use this section to select the compliance standard from the pulldown. Adjust the construction types as required to pull in the correct baseline load and envelope properties.
climatezones = HBClimateZones({"1 - Very Hot": "1", "2 - Hot": "2", "3 - Warm": "3", "4 - Mixed": "4", "5 - Cool": "5", "6 - Cold": "6", "7 - Very Cold": "7", "8 - Subarctic": "8"}, selected="4 - Mixed")
constructiontypes = HBConstructionTypes({"SteelFramed", "WoodFramed", "Mass", "Metal Building"}, selected="SteelFramed")
leed_baseline = HBBuildingVintages({"ASHRAE 90.1 2019  |  IECC 2021": "2019", "ASHRAE 90.1 2016  |  IECC 2018": "2016", "ASHRAE 90.1 2013  |  IECC 2015": "2013", "ASHRAE 90.1 2010  |  IECC 2012": "2010", "ASHRAE 90.1 2007  |  IECC 2009": "2007", "ASHRAE 90.1 2004  |  IECC 2006": "2004", "1980-2004 (CBECS)": "1980_2004", "Pre-1980 (CBECS)": "pre_1980"}, selected="ASHRAE 90.1 2010  |  IECC 2012")
code_baseline = HBBuildingVintages({"ASHRAE 90.1 2019  |  IECC 2021": "2019", "ASHRAE 90.1 2016  |  IECC 2018": "2016", "ASHRAE 90.1 2013  |  IECC 2015": "2013", "ASHRAE 90.1 2010  |  IECC 2012": "2010", "ASHRAE 90.1 2007  |  IECC 2009": "2007", "ASHRAE 90.1 2004  |  IECC 2006": "2004", "1980-2004 (CBECS)": "1980_2004", "Pre-1980 (CBECS)": "pre_1980"}, selected="ASHRAE 90.1 2016  |  IECC 2018")

# ---- group: Baseline Parameters / Set Simulation Type
simulation_type = ValueList({"Shoebox": 0, "Typical Floor": 1, "Whole Building": 2}, selected="Whole Building")

# ---- group: Use These Only to Write Results to a Custom Spreadsheet
record_parametric_run_in_page = Slider(2, range=2..10)
set_path_to_custom_results_excel_file = FilePath("C:\Users\useg03905\Desktop\Test.xlsx")
result_file_location = Panel(set_path_to_custom_results_excel_file)
addition = Addition(A=record_parametric_run_in_page)
write_column_headers_to_file = Button()

# ---- group: Default Internal Loads and Ventilation Overrides
number_of_people_per_area = Panel("0.005")
lighting_density_per_area = Panel("1")
equipment_power_density = Panel("0.75")
gas_power_density = Panel("")
hot_water_density = Panel("")
ventilation_per_person = Panel("")
ventilation_per_area = Panel("")
daylight_control = Slider(0, range=0..1)

number_of_people_per_area_2 = Panel("0.005")
equipment_power_density_2 = Panel("0.75")
lighting_density_per_area_2 = Panel("1")
gas_power_density_2 = Panel("")
hot_water_density_2 = Panel("")
ventilation_per_person_2 = Panel("")
ventilation_per_area_2 = Panel("")
daylight_control_2 = Slider(0, range=0..1)

# ----
# Simulation Output Parameters
# Set Location for Recorded Results
# Instructions: First specify if the location for the detailed Energy Plus results from each parametric run should be in the default Ladybug folder or with the metadata result file. It is recommended to use the default location unless the file path to the metadata file is completely free of spaces; Energy Plus will not run otherwise.
# 
# Next, specify the option to write the parametric results to. By selecting "Write Results to Energy Comparison Spreadsheet", the script will automatically make a copy of the template to the folder where this script is located and record the results there. No other inputs required.
# 
# A custom Excel file can also be used to record the results with the additional components defining the path and page to write to.
detailed_energy_plus_results_file_locati = ValueList({"Default Location (C:\ladybug) (Recommended)": 0, "Place in Folder with Result File": 1}, selected="Default Location (C:\ladybug) (Recommended)")  # "Detailed Energy Plus Results File Location"

metadata_results = ValueList({"Write Results to Energy Comparison Speadsheet": 0, "Write Results to Custom Spreadsheet": 1}, selected="Write Results to Energy Comparison Speadsheet")

# ---- group: Default Internal Loads and Ventilation Overrides
number_of_people_per_area_3 = Panel("0.005")
equipment_power_density_3 = Panel("0.75")
lighting_density_per_area_3 = Panel("1")
gas_power_density_3 = Panel("")
hot_water_density_3 = Panel("")
ventilation_per_person_3 = Panel("")
ventilation_per_area_3 = Panel("")
daylight_control_3 = Slider(0, range=0..1)

number_of_people_per_area_4 = Panel("0.005")
equipment_power_density_4 = Panel("0.46")
lighting_density_per_area_4 = Panel("0.68")
gas_power_density_4 = Panel("")
hot_water_density_4 = Panel("0")
ventilation_per_person_4 = Panel("0")
ventilation_per_area_4 = Panel("0")
daylight_control_4 = Slider(0, range=0..1)

# ----
# Envelope Thermal Parameters
# Parametric Scheme
parametric_envelope_thermal_master_optio = ValueList({"Cross Reference Opaque and Glass Properties": 0, "Define Specific Envelope Scenarios": 1}, selected="Cross Reference Opaque and Glass Properties")  # "Parametric Envelope Thermal Master Option"

# ---- group: Select Glazing Method
glazing_method = ValueList({"Autogenerate Windows": 0, "Custom Window Surfaces": 1, "Combination of Both": 2}, selected="Autogenerate Windows")

# ---- group: Add Custom Windows (Optional)
custom_window_surfaces = Brep([<brep referenced from the Rhino model> x1174])

# ---- group: Default Schedule Overrides
occupancy = Panel("")
lighting = Panel("")
equipment = Panel("")
gas_equipment = Panel("")
hot_water = Panel("")
ventilation = Panel("")
activity = Panel("")

occupancy_2 = Panel("")
ventilation_2 = Panel("")
activity_2 = Panel("")
lighting_2 = Panel("")
equipment_2 = Panel("")
gas_equipment_2 = Panel("")
hot_water_2 = Panel("")

occupancy_3 = Panel("")
activity_3 = Panel("")
lighting_3 = Panel("")
equipment_3 = Panel("")
gas_equipment_3 = Panel("")
hot_water_3 = Panel("")
ventilation_3 = Panel("")

occupancy_4 = Panel("")
activity_4 = Panel("")
lighting_4 = Panel("")
equipment_4 = Panel("")
gas_equipment_4 = Panel("")
hot_water_4 = Panel("")
ventilation_4 = Panel("")

# ---- group: Reference Surfaces to Exclude Window Autocreation (Optional)
exclude_surfaces = Brep(<brep referenced from the Rhino model>)

# ----
# Instructions: Set boolean to "False" while making changes to geometry and thermal parameters. Set to "True" when changes are done.
build_model = BooleanToggle(True)

# ---- group: Baseline Parameters / Utility Costs
fuel = ValueList({"Electricity", "Gas", "DistrictCooling", "DistrictHeating", "FuelOil#1", "FuelOil#2"}, selected="Electricity")
fuel_2 = ValueList({"Electricity", "Gas", "DistrictCooling", "DistrictHeating", "FuelOil#1", "FuelOil#2"}, selected="Gas")
fuel_3 = ValueList({"Electricity", "Gas", "DistrictCooling", "DistrictHeating", "FuelOil#1", "FuelOil#2"}, selected="DistrictCooling")
fuel_4 = ValueList({"Electricity", "Gas", "DistrictCooling", "DistrictHeating", "FuelOil#1", "FuelOil#2"}, selected="DistrictHeating")
fuel_5 = ValueList({"Electricity", "Gas", "DistrictCooling", "DistrictHeating", "FuelOil#1", "FuelOil#2"}, selected="FuelOil#1")
units = ValueList({"kWh", "Therm", "MMBtu", "MJ", "kBtu", "MCF", "CCF"}, selected="kWh")
units_2 = ValueList({"kWh", "Therm", "MMBtu", "MJ", "kBtu", "MCF", "CCF"}, selected="kWh")
units_3 = ValueList({"kWh", "Therm", "MMBtu", "MJ", "kBtu", "MCF", "CCF"}, selected="kWh")
units_4 = ValueList({"kWh", "Therm", "MMBtu", "MJ", "kBtu", "MCF", "CCF"}, selected="kWh")
units_5 = ValueList({"kWh", "Therm", "MMBtu", "MJ", "kBtu", "MCF", "CCF"}, selected="kWh")
energy_cost = EnergyCost(fuel=fuel, energy_units=units, unit_energy_cost="0.18", energy_cost_weekends_off_peak=Toggle(True))
energy_cost_2 = EnergyCost(fuel=fuel_2, energy_units=units_2, unit_energy_cost="0.05", energy_cost_weekends_off_peak=Toggle(False))
energy_cost_3 = EnergyCost(fuel=fuel_3, energy_units=units_3, unit_energy_cost="0.10", energy_cost_weekends_off_peak=Toggle(False))
energy_cost_4 = EnergyCost(fuel=fuel_4, energy_units=units_4, unit_energy_cost="0.05", energy_cost_weekends_off_peak=Toggle(False))
energy_cost_5 = EnergyCost(fuel=fuel_5, energy_units=units_5, unit_energy_cost="0.05", energy_cost_weekends_off_peak=Toggle(False))

# ---- group: Baseline
panel_8 = Panel("4")
panel_9 = Panel("1")
panel_10 = Panel("6")
panel_11 = Panel("0.82")

# ---- group: Reference Zones of This Program Type
zones_closed_brep_4 = Brep()

zones_closed_brep_5 = Brep()

zones_closed_brep_6 = Brep()

# ---- group: Geometry Checks
# Run Energy Simulation
# Final Visual Checks
visualize_model = ValueList({"None": 0, "Proposed": 1, "Baseline": 2}, selected="Proposed")
highlight_element = ValueList({"None": 0, "External Walls": 1, "Internal Walls": 2, "Exterior Windows": 4, "Roofs": 7, "Ceilings": 8, "Floors": 9, "Exposed Floors": 10, "Ground Floors": 11}, selected="None")
display_elements = ValueList({"Exterior Walls": 0, "Interior Walls": 1, "Roofs": 2, "Ceilings": 3, "Exterior Floors": 4, "Interior Floors": 5, "Air Walls": 6, "Exterior Windows and Skylights": 7, "Interior Windows": 8, "Doors": 9, "Interior Doors": 10, "Shades and Context": 11}, selected=["Exterior Walls", "Interior Walls", "Roofs", "Ceilings", "Exterior Floors", "Interior Floors", "Air Walls", "Exterior Windows and Skylights", "Interior Windows", "Doors", "Interior Doors", "Shades and Context"])

# ---- group: Zone and Surface Attributes
ep_display = ValueList({"None": 0, "Zone Attributes": 1, "Opaque Surface Attributes": 2, "Window Surface Attributes": 3}, selected="Zone Attributes")
text_scale = Slider(0.7, range=0.1..2)
roomattr = HBRoomAttributes({"Display Name": "display_name", "Simulation Name (Identifier)": "identifier", "Multiplier": "multiplier", "Story": "story", "Volume": "volume", "Gross Floor Area": "floor_area", "Exposed Area": "exposed_area", "Exterior Wall Area": "exterior_wall_area", "Exterior Aperture Area": "exterior_aperture_area", "Average Floor Elevation": "average_floor_height"}, selected="Display Name")
faceattr = HBFaceAttributes({"Display Name": "display_name", "Simulation Name (Identifier)": "identifier", "Boundary Condition": "boundary_condition", "Has Parent": "has_parent", "Parent": "parent", "Area": "area", "Perimeter": "perimeter", "Face Type": "type", "Aperture Is Operable": "is_operable", "Door Is Glass": "is_glass"}, selected="Display Name")

# ---- group: Visualize Schedules
program_type = Slider(1, range=1..8)
# Export Only
schedule_to_view = ValueList({"None": 0, "Occupancy": 1, "Activity": 2, "Lighting": 3, "Equipment": 4, "Ventilation": 6}, selected="None")

# ---- group: Air Walls
# Instructions: Reference surfaces that overlap with air wall surfaces.
air_walls = Brep([<brep referenced from the Rhino model> x8])

# ---- group: Open Studio
# Instructions: To export the model to Open Studio or GBXML rather than running it, use these components.
export_proposed_to_open_studio = Button()
export_baseline_to_open_studio = Button()

# ----
# Autogenerated Window WWR Parameters
# Instructions: Select Autogeneration method from pulldown menu:
# 
# Cross Reference All WWR Options by Orientation - will generate all combinations of window to wall ratios for each orientation individually. This will generate more combinations but demonstrate performance of orientation dependent strategies
# 
# Use Same WWR for Each Orientation - will generate the same WWR for each orientation
# 
# Provide one value in each panel for a fixed value, or a list of values for parametric study of each variable
parametric_wwr_option = ValueList({"Cross Reference All WWR Options by Orientation": 0, "Use Same WWR for Each Orientation": 1}, selected="Use Same WWR for Each Orientation")
all_wwr = Panel("0.2")
panel_12 = Panel("""0.6
0.5
0.4""")
panel_13 = Panel("""0.6
0.5
0.4
0.3""")
panel_14 = Panel("""0.6
0.5
0.4
0.3""")

# ---- group: Default Internal Loads and Ventilation Overrides
number_of_people_per_area_5 = Panel("0.005")
equipment_power_density_5 = Panel("0.75")
lighting_density_per_area_5 = Panel("1")
gas_power_density_5 = Panel("")
hot_water_density_5 = Panel("")
ventilation_per_person_5 = Panel("")
ventilation_per_area_5 = Panel("")
daylight_control_5 = Slider(0, range=0..1)

number_of_people_per_area_6 = Panel("0.005")
lighting_density_per_area_6 = Panel("1")
equipment_power_density_6 = Panel("0.75")
daylight_control_6 = Slider(0, range=0..1)
gas_power_density_6 = Panel("")
hot_water_density_6 = Panel("")
ventilation_per_person_6 = Panel("")
ventilation_per_area_6 = Panel("")

number_of_people_per_area_7 = Panel("0.005")
lighting_density_per_area_7 = Panel("1")
equipment_power_density_7 = Panel("0.75")
daylight_control_7 = Slider(0, range=0..1)
gas_power_density_7 = Panel("")
hot_water_density_7 = Panel("")
ventilation_per_person_7 = Panel("")
ventilation_per_area_7 = Panel("")

number_of_people_per_area_8 = Panel("")
lighting_density_per_area_8 = Panel("")
equipment_power_density_8 = Panel("")
daylight_control_8 = Slider(0, range=0..1)
gas_power_density_8 = Panel("")
hot_water_density_8 = Panel("0")
ventilation_per_person_8 = Panel("")
ventilation_per_area_8 = Panel("")

# ---- group: GBXML
export_proposed_to_gbxml = Button()
export_baseline_to_gbxml = Button()

# ----
# Simulation Parameters
solar_distribution = ValueList({"Minimal Shadowing": 0, "Full Exterior": 1, "Full Interior And Exterior": 2, "Full Exterior With Reflections": 3, "Full Interior And Exterior With Reflections": 4}, selected="Full Exterior")
terrain = ValueList({"Ocean", "Country", "Suburbs", "Urban", "City"}, selected="City")
first_day_of_simulation = ValueList({"Sunday", "Monday", "Tuesday", "Wednesday", "Thursday", "Friday", "Saturday"}, selected="Sunday")

# ----
# Run Simulations
run_mode = ValueList({"Ideal Air Loads": 0, "HB HVAC Template": 0, "Ironbug HVAC": 1}, selected="Ironbug HVAC")

# ---- group: Baseline Run
baseline = ValueList({"LEED Baseline": 0, "Code Baseline": 1}, selected="LEED Baseline")
rotation = Slider(1, range=1..4)
run_0_baseline_simulation = Button()
run_all_baseline_rotations = Button()

# ---- group: Proposed Run
option = Slider(53, range=1..65)
run_current_option_only = Button()
run_all_options = FalseStartToggle(False)

# ---- group: Default Schedule Overrides
occupancy_5 = Panel("")
ventilation_5 = Panel("")
activity_5 = Panel("")
lighting_5 = Panel("")
equipment_5 = Panel("")
gas_equipment_5 = Panel("")
hot_water_5 = Panel("")

# ---- group: Set Building Infiltration Rate
infiltration_rate_type = ValueList({"Exterior Facade Area": 0, "ACH": 1}, selected="Exterior Facade Area")
infiltration_rate_cfm_ft²_facade = Panel("0.056102")

# ---- group: Default Schedule Overrides
occupancy_6 = Panel("")
equipment_6 = Panel("")
gas_equipment_6 = Panel("")
hot_water_6 = Panel("")
ventilation_6 = Panel("")
activity_6 = Panel("")
lighting_6 = Panel("")

occupancy_7 = Panel("")
equipment_7 = Panel("")
gas_equipment_7 = Panel("")
hot_water_7 = Panel("")
ventilation_7 = Panel("")
activity_7 = Panel("")
lighting_7 = Panel("")

# ----
panel_15 = Panel(energy_cost)

# ---- group: Reference Zones of This Program Type
zones_closed_brep_7 = Brep()

zones_closed_brep_8 = Brep()

zones_closed_brep_9 = Brep()

zones_closed_brep_10 = Brep()

# ---- group: Set Ranges for Color Scale
panel_16 = Panel("All Surfaces Energy Flow (kBtu/ft²)")
panel_17 = Panel("Glazing Surfaces Energy Flow (kBtu/ft²)")
panel_18 = Panel("Opaque Surfaces Energy Flow (kBtu/ft²)")
panel_19 = Panel("Cooling (kBtu/ft²)")
panel_20 = Panel("Lighting (kBtu/ft²)")
panel_21 = Panel("Heating (kBtu/ft²)")
panel_22 = Panel("Energy Use (kBtu/ft²)")
min = Panel("40")
min_2 = Panel("18")
min_3 = Panel("5")
min_4 = Panel("10")
min_5 = Panel("-60")
min_6 = Panel("-40")
min_7 = Panel("-50")
max = Panel("80")
max_2 = Panel("30")
max_3 = Panel("20")
max_4 = Panel("15")
max_5 = Panel("60")
max_6 = Panel("40")
max_7 = Panel("50")

# ---- group: Load Balance Diagram
view_load_balance_diagram = BooleanToggle(False)
min_8 = Panel("-20")
max_8 = Panel("20")

# ----
# Exterior Lighting
# Instructions: Select the calculation method to account for elevator energy.
# 
# Option 1 is to enter the installed exterior lighting power. The annual consumption will be calculated based on 12 hours of daily usage. This calculation is done inside of Energy Plus, so it can take account of time of use energy charges.
# 
# Option 2 is to enter annual energy use calculated externally
exterior_lighting_energy_option = ValueList({"None": 0, "Calculate Exterior Lighting Energy Use": 1, "Enter Exterior Lighting Use from Outside Calculation": 2}, selected="None")
panel_23 = Panel("5000")
panel_24 = Panel("")
panel_25 = Panel("4000")
panel_26 = Panel("")

# ----
# Shading Type and Ratio Parameters
# Instructions: Select Autogeneration method from pulldown menu:
# 
# Cross Reference All Shading Options by Orientation - will generate all combinations of shading ratios for each orientation individually. This will generate more combinations but demonstrate performance of orientation dependent strategies
# 
# Use Same Shading Ratio for Each Orientation - will generate the same shading ratio for each orientation
# 
# Select shading type(s)to be studied for each orientation.
# 
# Provide one value in each panel for a fixed value, or a list of values for parametric study of each variable. Enter 0 for no shading
all_type = ValueList({"Horizontal": 0, "Vertical": 1, "Combined": 2}, selected="Horizontal")
all_shading = Panel("""0
1
2
3""")
panel_27 = Panel("0")
value_list = ValueList({"Horizontal": 0, "Vertical": 1, "Combined": 2}, selected="Horizontal")
panel_28 = Panel("0.5")
value_list_2 = ValueList({"Horizontal": 0, "Vertical": 1, "Combined": 2}, selected="Horizontal")
panel_29 = Panel("0")
value_list_3 = ValueList({"Horizontal": 0, "Vertical": 1, "Combined": 2}, selected="Horizontal")

fixed_shading = Brep([<brep referenced from the Rhino model> x4])

# ---- group: Default Internal Loads and Ventilation Overrides
equipment_power_density_9 = Panel("0.75")
number_of_people_per_area_9 = Panel("0.005")
lighting_density_per_area_9 = Panel("1")
gas_power_density_9 = Panel("")
hot_water_density_9 = Panel("")
ventilation_per_person_9 = Panel("")
ventilation_per_area_9 = Panel("")
daylight_control_9 = Slider(0, range=0..1)

number_of_people_per_area_10 = Panel("0.005")
lighting_density_per_area_10 = Panel("1")
equipment_power_density_10 = Panel("0.75")
daylight_control_10 = Slider(0, range=0..1)
gas_power_density_10 = Panel("")
hot_water_density_10 = Panel("")
ventilation_per_person_10 = Panel("")
ventilation_per_area_10 = Panel("")

number_of_people_per_area_11 = Panel("0.005")
lighting_density_per_area_11 = Panel("1")
equipment_power_density_11 = Panel("0.75")
daylight_control_11 = Slider(0, range=0..1)
gas_power_density_11 = Panel("")
hot_water_density_11 = Panel("")
ventilation_per_person_11 = Panel("")
ventilation_per_area_11 = Panel("")

number_of_people_per_area_12 = Panel("0.005")
lighting_density_per_area_12 = Panel("1")
equipment_power_density_12 = Panel("0.75")
daylight_control_12 = Slider(0, range=0..1)
gas_power_density_12 = Panel("")
hot_water_density_12 = Panel("")
ventilation_per_person_12 = Panel("")
ventilation_per_area_12 = Panel("")

# ---- group: Vertical Glazing / Frame Derating
frame_type = ValueList({"Aluminum W/Break": 5.678, "Aluminum Flush": 3.968922, "Wood": 2.2712, "Vinyl": 1.697722}, selected="Aluminum W/Break")
percentage_frame = Panel("0.15")

# ----
parametric_shading_ratio_option = ValueList({"Cross Reference All Shading Options by Orientation": 0, "Use Same Shading Ratio for Each Orientation": 1}, selected="Use Same Shading Ratio for Each Orientation")

# ----
# Instructions: Once the energy results have been completed, these controls can be used to visualize results and perform thermal comfort analysis. Select the result set to load for both, and use the sliders to the left to select the option to visualize.
# 
# Set the vertical  resolution and location to save any automatically extracted images.
visualize_result_set = ValueList({"None": 0, "Proposed": 1, "Baseline": 2}, selected="Proposed")
image_resolution = Panel("5000")
image_location = Panel("C:\ladybug")

# ---- group: Default Schedule Overrides
occupancy_8 = Panel("")
activity_8 = Panel("")
lighting_8 = Panel("")
equipment_8 = Panel("")
gas_equipment_8 = Panel("")
hot_water_8 = Panel("")
ventilation_8 = Panel("")

occupancy_9 = Panel("")
equipment_9 = Panel("")
gas_equipment_9 = Panel("")
hot_water_9 = Panel("")
ventilation_9 = Panel("")
activity_9 = Panel("")
lighting_9 = Panel("")

occupancy_10 = Panel("")
gas_equipment_10 = Panel("")
hot_water_10 = Panel("")
ventilation_10 = Panel("")
activity_10 = Panel("")
lighting_10 = Panel("")
equipment_10 = Panel("")

occupancy_11 = Panel("")
gas_equipment_11 = Panel("")
hot_water_11 = Panel("")
ventilation_11 = Panel("")
activity_11 = Panel("")
lighting_11 = Panel("")
equipment_11 = Panel("")

# ----
# Miscellaneous End Use 1
misc_end_use_1_name = Panel("Misc 1")
misc_end_use_1_energy_kwh = Panel("0")
misc_1_fuel_source = ValueList({"Electricity": 0, "Gas": 1, "Additional Fuel": 2, "District Cooling": 3, "District Heating": 4}, selected="Electricity")

# ----
# Miscellaneous End Use 2
misc_2_fuel_source = ValueList({"Electricity": 0, "Gas": 1, "Additional Fuel": 2, "District Cooling": 3, "District Heating": 4}, selected="Electricity")
misc_end_use_2_name = Panel("Misc 2")
misc_end_use_2_energy_kwh = Panel("0")

# ---- group: Doors
# Instructions: Reference surfaces that represent the doors.
door_surfaces = Brep(<brep referenced from the Rhino model>)

# ---- group: Reference Zones of This Program Type
zones_closed_brep_11 = Brep()

zones_closed_brep_12 = Brep()

zones_closed_brep_13 = Brep()

zones_closed_brep_14 = Brep()

# ---- group: Run Options
select_metric_s_to_run_read = ValueList({"PMV": 0, "Adaptive Comfort": 1, "UTCI": 2}, selected=["PMV", "Adaptive Comfort"])
run_option = ValueList({"Run Selected Metrics for Current Option": 0, "Run Selected Metrics for All Options": 1}, selected="Run Selected Metrics for Current Option")
run_selected_thermal_comfort_metrics = Button()

# ---- group: Extract Images
extract_option = ValueList({"Extract Images for Current Option at All Times for Displayed Metric": 0, "Extract Images for All Options at All Times for Displayed Metric": 1}, selected="Extract Images for Current Option at All Times for Displayed Metric")
capture_screen_image_of_all_study_times = Button()

# ----
# Parametric Options
panel_30 = Panel("65")

# ---- group: Default Internal Loads and Ventilation Overrides
number_of_people_per_area_13 = Panel("0.005")
lighting_density_per_area_13 = Panel("1")
equipment_power_density_13 = Panel("0.75")
daylight_control_13 = Slider(0, range=0..1)
gas_power_density_13 = Panel("")
hot_water_density_13 = Panel("")
ventilation_per_person_13 = Panel("")
ventilation_per_area_13 = Panel("")

number_of_people_per_area_14 = Panel("0.005")
lighting_density_per_area_14 = Panel("1")
equipment_power_density_14 = Panel("0.75")
ventilation_per_person_14 = Panel("")
ventilation_per_area_14 = Panel("")
daylight_control_14 = Slider(0, range=0..1)
gas_power_density_14 = Panel("")
hot_water_density_14 = Panel("")

number_of_people_per_area_15 = Panel("0.005")
lighting_density_per_area_15 = Panel("1")
equipment_power_density_15 = Panel("0.75")
ventilation_per_person_15 = Panel("")
ventilation_per_area_15 = Panel("")
daylight_control_15 = Slider(0, range=0..1)
gas_power_density_15 = Panel("")
hot_water_density_15 = Panel("")

number_of_people_per_area_16 = Panel("0.005")
lighting_density_per_area_16 = Panel("1")
equipment_power_density_16 = Panel("0.75")
ventilation_per_person_16 = Panel("")
ventilation_per_area_16 = Panel("")
daylight_control_16 = Slider(0, range=0..1)
gas_power_density_16 = Panel("")
hot_water_density_16 = Panel("")

# ----
# Instructions: Reference surfaces and BReps that overlap with the window model surfaces to assign them as operable. Add values to componext to specify the conditions under which the windows will open.
# 
# Specify the percentage of the window area that is operable and the percentage of the window height that is operable
operable_window_s_or_guide_surface_s = Brep(<brep referenced from the Rhino model>)
ventcontrol = HBVentilationControl()  # -> vent_cntrl; plug-in component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
fraction_area_operable = Slider(0, range=0..1)
fraction_height_operable = Slider(0, range=0..1)

# ---- group: Default Schedule Overrides
occupancy_12 = Panel("")
equipment_12 = Panel("")
gas_equipment_12 = Panel("")
hot_water_12 = Panel("")
ventilation_12 = Panel("")
activity_12 = Panel("")
lighting_12 = Panel("")

occupancy_13 = Panel("")
lighting_13 = Panel("")
equipment_13 = Panel("")
gas_equipment_13 = Panel("")
hot_water_13 = Panel("")
ventilation_13 = Panel("")
activity_13 = Panel("")

occupancy_14 = Panel("")
lighting_14 = Panel("")
equipment_14 = Panel("")
gas_equipment_14 = Panel("")
hot_water_14 = Panel("")
ventilation_14 = Panel("")
activity_14 = Panel("")

occupancy_15 = Panel("")
lighting_15 = Panel("")
equipment_15 = Panel("")
gas_equipment_15 = Panel("")
hot_water_15 = Panel("")
ventilation_15 = Panel("")
activity_15 = Panel("")

# ---- group: Reference Zones of This Program Type
zones_closed_brep_15 = Brep()

zones_closed_brep_16 = Brep()

zones_closed_brep_17 = Brep()

zones_closed_brep_18 = Brep()

# ---- group: Default Internal Loads and Ventilation Overrides
number_of_people_per_area_17 = Panel("0.005")
lighting_density_per_area_17 = Panel("1")
equipment_power_density_17 = Panel("0.75")
ventilation_per_area_17 = Panel("")
daylight_control_17 = Slider(0, range=0..1)
gas_power_density_17 = Panel("")
hot_water_density_17 = Panel("")
ventilation_per_person_17 = Panel("")

number_of_people_per_area_18 = Panel("0.005")
lighting_density_per_area_18 = Panel("1")
equipment_power_density_18 = Panel("0.75")
gas_power_density_18 = Panel("")
hot_water_density_18 = Panel("")
ventilation_per_person_18 = Panel("")
ventilation_per_area_18 = Panel("")
daylight_control_18 = Slider(0, range=0..1)

number_of_people_per_area_19 = Panel("0.005")
lighting_density_per_area_19 = Panel("1")
equipment_power_density_19 = Panel("0.75")
gas_power_density_19 = Panel("")
hot_water_density_19 = Panel("")
ventilation_per_person_19 = Panel("")
ventilation_per_area_19 = Panel("")
daylight_control_19 = Slider(0, range=0..1)

number_of_people_per_area_20 = Panel("0.005")
lighting_density_per_area_20 = Panel("1")
equipment_power_density_20 = Panel("0.75")
gas_power_density_20 = Panel("")
hot_water_density_20 = Panel("")
ventilation_per_person_20 = Panel("")
ventilation_per_area_20 = Panel("")
daylight_control_20 = Slider(0, range=0..1)

# ---- group: Default Schedule Overrides
occupancy_16 = Panel("")
equipment_16 = Panel("")
gas_equipment_16 = Panel("")
hot_water_16 = Panel("")
ventilation_16 = Panel("")
activity_16 = Panel("")
lighting_16 = Panel("")

occupancy_17 = Panel("")
activity_17 = Panel("")
lighting_17 = Panel("")
equipment_17 = Panel("")
gas_equipment_17 = Panel("")
hot_water_17 = Panel("")
ventilation_17 = Panel("")

occupancy_18 = Panel("")
lighting_18 = Panel("")
equipment_18 = Panel("")
gas_equipment_18 = Panel("")
hot_water_18 = Panel("")
ventilation_18 = Panel("")
activity_18 = Panel("")

occupancy_19 = Panel("")
activity_19 = Panel("")
lighting_19 = Panel("")
equipment_19 = Panel("")
gas_equipment_19 = Panel("")
hot_water_19 = Panel("")
ventilation_19 = Panel("")

# ----
list = ValueList({"Individual ECMs": 0, "Initial Studies": 1, "All Pathways": 2}, selected="Individual ECMs")
filter = StreamFilter(Gate=list, Stream0="Sensitivity")
# About: Parametric Energy Modelling Tool
# Version: 2.1
# Date: 6/9/22
# By: EJG
# Plug-ins Required: Honeybee, TT Toolbox, Metahopper, BE Custom Tools
# 
# This Grasshopper script is meant for parametric simulation of various facade parameters for multizone models.
# Project Parameters
# Instructions: Input project name for simulations. Result files will use this project name
# 
# Verify that detected model units are as expected. If not, adjust units in Rhino and recompute Grasshopper solution to update
# 
# Reference climate file, adjust north arrow direction if required, and reference contextural shading.
# 
# Please note that in the past,specifying a network paths for climate files did not permit the simulation to run. However, this script has been configured to automatically download the climate file locally should a network location be specified. Please make sure DIVA is installed because it will place the EPW file in the Weather file subfolder of the DIVA file structure.
# 
# Indicate whether simulation is a shoebox, typical floor, or whole building. Selecting shoebox typical floor will automatically make the floor and roof surfaces adiabatic (you must specify which walls are adiabatic). Typical floor and whole building will save unique result files for each iteration, shoebox model will not
# 
# Input utility costs, fuel sources, and carbon factors as applicable. Use the instructions in the input prompts of the energy cost components to define either simple flat costs or detailed tariff structures
concat = Concatenate(FragmentA=project_name, FragmentB=filter, JoinSeparator="_")

# ---- group: Baseline Parameters / Project Information
project_name_2 = Panel(concat)
units_6 = BE_RhinoUnitRetriever()  # -> Units, Code
# ---------- units_6: Python ----------
import rhinoscriptsyntax as rs

RhCode = rs.UnitSystem()
if RhCode == 8: 
 Units = "Inches" 
 Code = 0
elif RhCode == 9: 
 Units = "Feet" 
 Code = 1
elif RhCode == 2: 
 Units = "Millimeters" 
 Code = 2
elif RhCode == 3: 
 Units = "Centimeters" 
 Code = 3
elif RhCode == 4: 
 Units = "Meters" 
 Code = 4
else:
    Units = "Unknown"
    Code = 5
# ---------- end units_6 ----------
input_units = ValueList({"Default Based on Model Units": 0, "SI": 1, "IP": 2}, selected="IP")
output_units = ValueList({"Default Based on Model Units": 0, "SI": 1, "IP": 2}, selected="IP")
detected_model_units = Panel(units_6.Units)

# ----
all_mechanical_pathways = FilePath()
initial_runs = FilePath("\\ENNYCCIFS01\Projects\N22\01860---NYCHA_REDD_Integrated_Design_Study_Task_1\ENG-BE\22_Energy_Carbon\22.05.31_InitialStudies_Indexed.xlsx")
expression = Expression(x=list, Expression="IF(x=0,0,1)")
filter_2 = StreamFilter(Gate=list, Stream1=initial_runs, Stream2=all_mechanical_pathways)
readxl = ReadExcelSheet(Run=Toggle(True), FilePath=filter_2, Worksheet="1", Listen=False)  # -> UserMessages, Columns, Rows
join = TextJoin(Text=readxl.Rows, Join=",")  # -> flatten(Result)

# ---- group: Units
# Back End
# Primary Data
scale_factor_selection = Integer(units_6.Code)
expression_2 = Expression(x=scale_factor_selection, Expression="IF(x=0,1,IF(x=1,1,0))")
filter_3 = StreamFilter(Gate=input_units, Stream0=expression_2, Stream1="0", Stream2="1")
filter_4 = StreamFilter(Gate=output_units, Stream0=expression_2, Stream1="0", Stream2="1")
report_units_selection = Integer(filter_4)
input_units_selection = Integer(filter_3)

# ----
cull_i = CullIndex(List=join, Indices="0", Wrap=True)

# ---- group: Update Script
versioner = LBVersioner(update=Toggle(False))  # -> Vviiiiiz; plug-in component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
syncghfile = LBSyncGrasshopperFile(sync=Toggle(False))  # -> report; plug-in component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

# ----
series = Series(Start="0", Step=1, Count="16")
series_2 = Series(Start="0", Step=1, Count="5")
series_3 = Series(Start="0", Step=1, Count="16")
series_4 = Series(Start="0", Step=1, Count="4")
series_5 = Series(Start="0", Step=1, Count="7")
series_6 = Series(Start="0", Step=1, Count="2")
filter_5 = StreamFilter(Gate=expression, Stream0=series, Stream1=cull_i)
filter_6 = StreamFilter(Gate=expression, Stream0=series_2)
filter_7 = StreamFilter(Gate=expression, Stream0=series_3)
filter_8 = StreamFilter(Gate=expression, Stream0=series_4)
filter_9 = StreamFilter(Gate=expression, Stream0=series_5)
filter_10 = StreamFilter(Gate=expression, Stream0=series_6)
expression_3 = Expression(x=expression, Expression="IF(x=0,1,0)")

# ---- group: Fly Through Baseline Rotations
filter_11 = StreamFilter(Gate=run_all_baseline_rotations, Stream1=run_all_baseline_rotations)
fly = Ladybug_fly(inputSliders=rotation, fly=filter_11)  # -> Vviiiiiiiiiizzz; plug-in component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

# ---- group: Fly Through Options
fly_2 = Ladybug_fly(inputSliders=option, fly=run_all_options)  # -> Vviiiiiiiiiizzz; plug-in component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

# ----
glass_u_values = Panel("""1.00
0.21
0.25
0.18""")
frame_u_values_ip = Panel("""1.4
1.1
0.95
0.4
0.34""")
router = Router(data=air_walls)
uip2usi = Ladybug_uIP2uSI(U_IP=frame_u_values_ip)  # -> U_SI; plug-in component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

# ---- group: Unit Labels
# Units and Conversions
u_value = Panel("""W/m²·K
Btu/h·ft²·F""")
energy = Panel("""kWh
kBtu""")
eui = Panel("""kWh/m²
kBtu/ft²""")
carbon = Panel("""kg CO₂
lbs CO₂""")
area = Panel("""m²
ft²""")
water_volume = Panel("""Liters
Gallon""")
temperature = Panel("""°C
°F""")

# ----
r_value = Panel("""m²·K/W
ft²·h·F/Btu""")
peak = Panel("""kW
kBtuh""")
normalized_peak = Panel("""W/m²
Btuh/ft²""")

# ---- group: Conversion Factors (by Division)
volume_conversion_factors_to_ft3_or_m3 = Panel("""1728
1
1000000000
1000000
1""")
volume_conversion_factors_to_m3 = Panel("""61023.7
35.3146412031104
1000000000
1000000
1""")
convert_from_decimal_to = Panel("100")
area_conversion_factors_to_ft² = Panel("""144
1
92903
929.03
0.092903""")
area_conversion_factors_to_m² = Panel("""1550.0031
10.7639
1000000
1000
1""")
item = ListItem(List=area_conversion_factors_to_ft², Index=scale_factor_selection, Wrap=True)
item_2 = ListItem(List=area_conversion_factors_to_m², Index=scale_factor_selection, Wrap=True)
item_3 = ListItem(List=volume_conversion_factors_to_ft3_or_m3, Index=scale_factor_selection, Wrap=True)
item_4 = ListItem(List=volume_conversion_factors_to_m3, Index=scale_factor_selection, Wrap=True)

# ---- group: Unit Labels / Input Prompt
item_5 = ListItem(List=u_value, Index=input_units_selection, Wrap=True)
item_6 = ListItem(List=r_value, Index=input_units_selection, Wrap=True)
item_7 = ListItem(List=energy, Index=input_units_selection, Wrap=True)
item_8 = ListItem(List=eui, Index=input_units_selection, Wrap=True)
item_9 = ListItem(List=peak, Index=input_units_selection, Wrap=True)
item_10 = ListItem(List=normalized_peak, Index=input_units_selection, Wrap=True)
item_11 = ListItem(List=carbon, Index=input_units_selection, Wrap=True)
item_12 = ListItem(List=area, Index=input_units_selection, Wrap=True)
item_13 = ListItem(List=water_volume, Index=input_units_selection, Wrap=True)
item_14 = ListItem(List=temperature, Index=input_units_selection, Wrap=True)

# ---- group: Zone Temperature and Humidity Settings
heating_setpoint = Panel("")
heating_setback = Panel("")
units_7 = Panel(item_14)
cooling_setpoint = Panel("")
cooling_setback = Panel("")
humidify_setpoint = Panel("")
dehumidfy_setpoint = Panel("")
units_8 = Panel("%")

cooling_setpoint_2 = Panel("")
cooling_setback_2 = Panel("")
heating_setpoint_2 = Panel("")
heating_setback_2 = Panel("")
humidify_setpoint_2 = Panel("")
dehumidfy_setpoint_2 = Panel("")

cooling_setpoint_3 = Panel("")
cooling_setback_3 = Panel("")
heating_setpoint_3 = Panel("")
heating_setback_3 = Panel("")
humidify_setpoint_3 = Panel("")
dehumidfy_setpoint_3 = Panel("")

cooling_setpoint_4 = Panel("")
cooling_setback_4 = Panel("")
heating_setpoint_4 = Panel("")
heating_setback_4 = Panel("")
humidify_setpoint_4 = Panel("")
dehumidfy_setpoint_4 = Panel("")

# ----
units_15 = Panel(item_5)

# ---- group: Zone Temperature and Humidity Settings
cooling_setpoint_5 = Panel("")
cooling_setback_5 = Panel("")
heating_setpoint_5 = Panel("")
heating_setback_5 = Panel("")
humidify_setpoint_5 = Panel("")
dehumidfy_setpoint_5 = Panel("")

heating_setback_6 = Panel("")
cooling_setpoint_6 = Panel("")
cooling_setback_6 = Panel("")
heating_setpoint_6 = Panel("")
humidify_setpoint_6 = Panel("")
dehumidfy_setpoint_6 = Panel("")

heating_setback_7 = Panel("")
cooling_setpoint_7 = Panel("")
cooling_setback_7 = Panel("")
heating_setpoint_7 = Panel("")
humidify_setpoint_7 = Panel("")
dehumidfy_setpoint_7 = Panel("")

heating_setback_8 = Panel("")
cooling_setpoint_8 = Panel("")
cooling_setback_8 = Panel("")
heating_setpoint_8 = Panel("")
humidify_setpoint_8 = Panel("")
dehumidfy_setpoint_8 = Panel("")

cooling_setpoint_9 = Panel("")
cooling_setback_9 = Panel("")
heating_setpoint_9 = Panel("")
heating_setback_9 = Panel("")
dehumidfy_setpoint_9 = Panel("")
humidify_setpoint_9 = Panel("")

heating_setback_10 = Panel("")
cooling_setpoint_10 = Panel("")
cooling_setback_10 = Panel("")
heating_setpoint_10 = Panel("")
humidify_setpoint_10 = Panel("")
dehumidfy_setpoint_10 = Panel("")

heating_setback_11 = Panel("")
cooling_setpoint_11 = Panel("")
cooling_setback_11 = Panel("")
heating_setpoint_11 = Panel("")
humidify_setpoint_11 = Panel("")
dehumidfy_setpoint_11 = Panel("")

heating_setback_12 = Panel("")
cooling_setpoint_12 = Panel("")
cooling_setback_12 = Panel("")
heating_setpoint_12 = Panel("")
humidify_setpoint_12 = Panel("")
dehumidfy_setpoint_12 = Panel("")

heating_setback_13 = Panel("")
cooling_setpoint_13 = Panel("")
cooling_setback_13 = Panel("")
heating_setpoint_13 = Panel("")
humidify_setpoint_13 = Panel("")
dehumidfy_setpoint_13 = Panel("")

heating_setpoint_14 = Panel("")
heating_setback_14 = Panel("")
cooling_setpoint_14 = Panel("")
cooling_setback_14 = Panel("")
humidify_setpoint_14 = Panel("")
dehumidfy_setpoint_14 = Panel("")

heating_setpoint_15 = Panel("")
heating_setback_15 = Panel("")
cooling_setpoint_15 = Panel("")
cooling_setback_15 = Panel("")
humidify_setpoint_15 = Panel("")
dehumidfy_setpoint_15 = Panel("")

heating_setpoint_16 = Panel("")
heating_setback_16 = Panel("")
cooling_setpoint_16 = Panel("")
cooling_setback_16 = Panel("")
humidify_setpoint_16 = Panel("")
dehumidfy_setpoint_16 = Panel("")

heating_setback_17 = Panel("")
cooling_setpoint_17 = Panel("")
cooling_setback_17 = Panel("")
heating_setpoint_17 = Panel("")
humidify_setpoint_17 = Panel("")
dehumidfy_setpoint_17 = Panel("")

cooling_setback_18 = Panel("")
heating_setpoint_18 = Panel("")
heating_setback_18 = Panel("")
cooling_setpoint_18 = Panel("")
humidify_setpoint_18 = Panel("")
dehumidfy_setpoint_18 = Panel("")

cooling_setback_19 = Panel("")
heating_setpoint_19 = Panel("")
heating_setback_19 = Panel("")
cooling_setpoint_19 = Panel("")
humidify_setpoint_19 = Panel("")
dehumidfy_setpoint_19 = Panel("")

cooling_setback_20 = Panel("")
heating_setpoint_20 = Panel("")
heating_setback_20 = Panel("")
cooling_setpoint_20 = Panel("")
humidify_setpoint_20 = Panel("")
dehumidfy_setpoint_20 = Panel("")

# ---- group: Unit Labels / Output Label
item_15 = ListItem(List=u_value, Index=report_units_selection, Wrap=True)
item_16 = ListItem(List=r_value, Index=report_units_selection, Wrap=True)
item_17 = ListItem(List=energy, Index=report_units_selection, Wrap=True)
item_18 = ListItem(List=eui, Index=report_units_selection, Wrap=True)
item_19 = ListItem(List=peak, Index=report_units_selection, Wrap=True)
item_20 = ListItem(List=normalized_peak, Index=report_units_selection, Wrap=True)
item_21 = ListItem(List=carbon, Index=report_units_selection, Wrap=True)
item_22 = ListItem(List=area, Index=report_units_selection, Wrap=True)

# ---- group: Formatting
panel_31 = Panel("{0:0.0}")

# ----
filter_12 = StreamFilter(Gate=report_units_selection, Stream0=item_2, Stream1=item)
panel_32 = Panel("\\dcame200dat01\BuiltEcology\02 Practice Areas\C Design Analytics\Tools\Baseline Libraries\")

# ---- group: Typical Colors
swatch = ColourSwatch(SwatchColor=RGB(255, 249, 89))
swatch_2 = ColourSwatch(SwatchColor=RGB(117, 117, 116))
swatch_3 = ColourSwatch(SwatchColor=RGBA(255, 255, 255, 0))

# ----
swatch_4 = ColourSwatch(SwatchColor=RGBA(171, 135, 255, 150))
filter_13 = StreamFilter(Gate=baseline)

# ---- group: WWR Group
filter_14 = StreamFilter(Gate=glazing_method, Stream0=swatch_4, Stream1=swatch_2, Stream2=swatch_4)

# ---- group: Program Group 2
filter_15 = StreamFilter(
    Gate=0,
    Stream0=swatch_2,
    Stream1=swatch_4,
    Stream2=swatch_4,
    Stream3=swatch_4,
    Stream4=swatch_4,
    Stream5=swatch_4,
    Stream6=swatch_4,
    Stream7=swatch_4)

# ---- group: Program Group 3
filter_16 = StreamFilter(
    Gate=0,
    Stream0=swatch_2,
    Stream1=swatch_2,
    Stream2=swatch_4,
    Stream3=swatch_4,
    Stream4=swatch_4,
    Stream5=swatch_4,
    Stream6=swatch_4,
    Stream7=swatch_4)

# ---- group: Program Group 4
filter_17 = StreamFilter(
    Gate=0,
    Stream0=swatch_2,
    Stream1=swatch_2,
    Stream2=swatch_2,
    Stream3=swatch_4,
    Stream4=swatch_4,
    Stream5=swatch_4,
    Stream6=swatch_4,
    Stream7=swatch_4)

# ----
searchmats = HBSearchMaterials(keywords="Plaster")  # -> opaque_mats, window_mats; plug-in component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

# ---- group: Shading Type Header
panel_33 = Panel("""N Type
All Type""")
panel_34 = Panel("""W Type
N/A""")
connected = GetConnectedObjects(Objects=all_type)
connected_2 = GetConnectedObjects(Objects=value_list_3)
item_23 = ListItem(List=panel_33, Index=parametric_shading_ratio_option, Wrap=True)
item_24 = ListItem(List=panel_34, Index=parametric_shading_ratio_option, Wrap=True)
rename = RenameObject(Objects=connected, Names=item_23)
rename_2 = RenameObject(Objects=connected_2, Names=item_24)
panel_35 = Panel("""E Type
N/A""")
panel_36 = Panel("""S Type
N/A""")
connected_3 = GetConnectedObjects(Objects=value_list_2)
connected_4 = GetConnectedObjects(Objects=value_list)
item_25 = ListItem(List=panel_36, Index=parametric_shading_ratio_option, Wrap=True)
item_26 = ListItem(List=panel_35, Index=parametric_shading_ratio_option, Wrap=True)
rename_3 = RenameObject(Objects=connected_3, Names=item_25)
rename_4 = RenameObject(Objects=connected_4, Names=item_26)

# ----
searchmats_2 = HBSearchMaterials(keywords="concrete")  # -> opaque_mats, window_mats; plug-in component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
volume = Number(panel_9)
panel_37 = Panel("B:\02 Practice Areas\C Design Analytics\Tools\Open Studio Measures\ReduceSpaceInfiltrationByPercentage")
ladybug = Ladybug_Ladybug()  # -> Vviiiiiiiiiizzz; plug-in component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
roof_coverage = Slider(0.5, range=0..1)
panel_38 = Panel("""0
0.10
0.30
0.05""")
panel_39 = Panel("""0
0.05""")
md_slider = MDSlider(SliderMode=0, slider_value=Point(0.5, 0.5, 0.5), x_domain=Domain(0, 1), y_domain=Domain(0, 1), z_domain=Domain(0, 1))
reduce_space_infiltration_by_percentage = ReduceSpaceInfiltrationByPercentage(
    measure_path=panel_37,
    space_infiltration_reduction_percent="0",
    constant_coefficient="0",
    temperature_coefficient="0",
    wind_speed_coefficient="0.224",
    wind_speed_squared_coefficient="0")  # -> report, measure; plug-in component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

# ---- group: Exterior Lighting
panel_40 = Panel("""Installed Proposed Exterior Lighting (W)
Installed Baseline Exterior Lighting (W)
Enter Proposed Annual Exterior Lighting Energy (kWh)
Enter Baseline Annual Exterior Lighting Energy (kWh)""")
panel_41 = Panel("""0
1
2
3""")
panel_42 = Panel("""2
3""")
panel_43 = Panel("""0
1""")
filter_18 = StreamFilter(Gate=exterior_lighting_energy_option, Stream0=panel_41, Stream1=panel_42, Stream2=panel_43)
merge = Merge(Data1=swatch, Data2=swatch, Data3=swatch, Data4=swatch)
connected_5 = GetConnectedObjects(Objects=panel_26)
connected_6 = GetConnectedObjects(Objects=panel_24)
connected_7 = GetConnectedObjects(Objects=panel_25)
connected_8 = GetConnectedObjects(Objects=panel_23)
replace = ReplaceItems(List=panel_40, Item="N/A", Indices=filter_18, Wrap=False)
replace_2 = ReplaceItems(List=merge, Item=swatch_2, Indices=filter_18, Wrap=False)
merge_2 = Merge(Data1=connected_8, Data2=connected_7, Data3=connected_6, Data4=connected_5)
setpanel = SetPanelProperties(Panel=merge_2, NickName=replace, Color=replace_2)

# ----
Z_2 = UnitZ(Factor="0.5")
panel_44 = Panel("""Null
PV_Array
SHW_Collector
BIPV""")

# ---- group: Exterior Lighting Calculation
expression_4 = Expression(x=exterior_lighting_energy_option, Expression="IF(x=0,False,True)")
end_use = ValueList({"Exterior Lighting": 0, "Elevators": 1, "Exterior Equipment": 1}, selected="Exterior Lighting")
fuel_6 = ValueList({"Electricity", "Gas", "DistrictCooling", "DistrictHeating"}, selected="Electricity")
repeat_3 = RepeatData(Data="1", Length="24")
series_7 = Series(Start="7", Step=1, Count="12")
replace_3 = ReplaceItems(List=repeat_3, Item="0", Indices=series_7, Wrap=False)
annualschedule = Honeybee_AnnualSchedule(
    sun=replace_3,
    mon=replace_3,
    tue=replace_3,
    wed=replace_3,
    thu=replace_3,
    fri=replace_3,
    sat=replace_3,
    holiday=replace_3,
    scheduleName="Exterior Lighting",
    runIt=expression_4)  # -> readMe, port, schedule, port_2, weekSched, schedIDFText; plug-in component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
exterior_energy = ExteriorEnergy(
    exterior_equipment_type=end_use,
    name="Exterior Lighting",
    fuel=fuel_6,
    schedule_name=annualschedule.schedule,
    peak_watts=panel_23)
exterior_energy_2 = ExteriorEnergy(
    exterior_equipment_type=end_use,
    name="Exterior Lighting",
    fuel=fuel_6,
    schedule_name=annualschedule.schedule,
    peak_watts=panel_25)
filter_19 = StreamFilter(Gate=exterior_lighting_energy_option, Stream2=panel_24)
filter_20 = StreamFilter(Gate=exterior_lighting_energy_option, Stream1=exterior_energy)
filter_21 = StreamFilter(Gate=exterior_lighting_energy_option, Stream2=panel_26)
filter_22 = StreamFilter(Gate=exterior_lighting_energy_option, Stream1=exterior_energy_2)

# ----
panel_45 = Panel("""Heating - Electricity
Heating - Natural Gas
Heating - Additional Fuel
Heating - District Heating
Cooling - Electricity
Cooling - District Cooling
Interior Lighting
Exterior Lighting
Interior Equipment
Exterior Equipment
Fans
Pumps
Heat Rejection
Humidification
Heat Recovery
Water Systems - Electricity
Water Systems - Natural Gas
Water Systems - Additional Fuel
Water Systems - District Heating
Refrigeration
Generators
Misc 1
Misc 2""")
iterator = ColibriIterator(RemoteFly=True, ignoreAllWarningMsg=False)  # -> Option, IterationGenome, RemoteCtrl

# ---- group: Simulation Namer
panel_46 = Panel("""LEED
Code""")
panel_47 = Panel("""0
90
180
270""")
item_27 = ListItem(List=panel_47, Index=expr("x-1", rotation), Wrap=True)
item_28 = ListItem(List=panel_46, Index=baseline, Wrap=True)
concat_2 = Concatenate(
    FragmentA=project_name_2,
    FragmentB=item_28,
    FragmentC="Baseline",
    FragmentD=item_27,
    FragmentE="Rotation",
    JoinSeparator="_")

# ----
run_mode_2 = ValueList({"Normal (Button Trigger)": 0, "Diagnostic Mode without Write to Excel (Boolean Toogle)": 1, "Diagnostic Mode with Write to Excel (Boolean Toogle)": 2}, selected="Normal (Button Trigger)")
run_mode_3 = ValueList({"Normal (Button Trigger)": 0, "Diagnostic Mode without Write to Excel (Boolean Toogle)": 1, "Diagnostic Mode with Write to Excel (Boolean Toogle)": 2}, selected="Diagnostic Mode without Write to Excel (Boolean Toogle)")

# ---- group: Simulation Namer
round = Round(Number=option)  # -> Nearest, Floor, Ceiling
concat_3 = Concatenate(FragmentA=project_name_2, FragmentB="Opt", FragmentC=round.Nearest, JoinSeparator="_")
filter_23 = StreamFilter(Gate=simulation_type, Stream0=project_name_2, Stream1=concat_3, Stream2=concat_3)

# ----
filter_24 = StreamFilter(Gate=run_current_option_only, Stream0=run_all_options, Stream1=run_current_option_only)
panel_48 = Panel("""1.156973684
0.530526316""")
searchschs = HBSearchSchedules(keywords="cook")  # -> schedules, type_limits; plug-in component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
panel_49 = Panel("""0.3
0.4""")
panel_50 = Panel("""0.2
0.3""")
searchschs_2 = HBSearchSchedules(keywords="elevator")  # -> schedules, type_limits; plug-in component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
filter_25 = StreamFilter(Gate=run_all_baseline_rotations, Stream0=run_0_baseline_simulation, Stream1=run_all_baseline_rotations)
toggle = FalseStartToggle(False)
toggle_2 = FalseStartToggle(False)
filter_26 = StreamFilter(Gate=run_mode_2, Stream0=filter_25, Stream1=toggle, Stream2=toggle)
filter_27 = StreamFilter(Gate=run_mode_3, Stream0=filter_24, Stream1=toggle_2, Stream2=toggle_2)
item_29 = ListItem(List=searchschs.schedules, Index=0, Wrap=True)
item_30 = ListItem(List=searchschs_2.schedules, Index=0, Wrap=True)
filter_28 = StreamFilter(Gate=export_proposed_to_open_studio, Stream0=filter_27, Stream1=export_proposed_to_open_studio)
filter_29 = StreamFilter(Gate=export_baseline_to_open_studio, Stream0=filter_26, Stream1=export_baseline_to_open_studio)
# Proposed Simulation Engine
# (Multiple Options)
panel_51 = Panel("program")
panel_52 = Panel("""Option
Results Path
Timestamp""")
setup_runs = SetupRuns()
read_mode = ValueList({"Normal (Dynamic)": 0, "Diagnostic Mode (Static)": 1}, selected="Normal (Dynamic)")
units_49 = Number(input_units_selection)
baseline_efficiency = Number(panel_11)
read_mode_2 = ValueList({"Normal (Dynamic)": 0, "Diagnostic Mode (Static)": 1}, selected="Diagnostic Mode (Static)")
toggle_3 = BooleanToggle(True)
outputparams = Ironbug_OutputParams(WaterUseConnectionsHotWaterTemperature=toggle_3, WaterUseConnectionsTotalMassFlowRate=toggle_3, outputFrequency=1)

path = FilePath("B:\02 Practice Areas\C Design Analytics\Tools\Templates\Energy Comparison Tool\Working File\Energy Results Comparison.xlsx")
result_spreadsheet = BE_EPWLocalizer(Method=metadata_results, TemplatePath=path, ProjName=project_name_2)  # -> out, ResultsFilePath
# ---------- result_spreadsheet: Python ----------
import Grasshopper as gh
import os
import os.path
import shutil
from shutil import copyfile
from sys import exit

#get folder location of current gh file name from specified network path 

ghfile = ghenv.Component.OnPingDocument().FilePath
pathelements = os.path.split(ghfile)
ghfolder = pathelements[0]

#name of template file

Template = os.path.split(TemplatePath)

#variables for renaming

ResultsFile = ProjName + "_" + Template[1]
ResultsFilePath = os.path.join(ghfolder,ResultsFile) 

#test if local copy exists and if not copy to local file

if(Method == 0):
    if os.path.isfile(ResultsFilePath):
        print ("File Exists")

    else:
        shutil.copyfile(TemplatePath,ResultsFilePath)
        print ("File Copied to Local Directory")
else:
    print ("Custom Spreadsheet is Being Used")
# ---------- end result_spreadsheet ----------
filter_30 = StreamFilter(Gate=metadata_results, Stream0=result_spreadsheet.ResultsFilePath, Stream1=set_path_to_custom_results_excel_file)
# Write  Baseline Data to Excel
filter_31 = StreamFilter(Gate=metadata_results, Stream0="4", Stream1=addition)
filter_32 = StreamFilter(Gate=metadata_results, Stream0="3", Stream1="1")

# ---- group: Detailed Results Location Namer
file_directory_finder = FileDirectoryFinder(option_for_result_placement=detailed_energy_plus_results_file_locati, results_location=filter_30)

# ----
concat_4 = Concatenate(
    FragmentA=file_directory_finder,
    FragmentB=concat_2,
    FragmentC="\",
    FragmentD="OpenStudio",
    FragmentE="\",
    FragmentF="run\eplustbl.htm")
concat_5 = Concatenate(
    FragmentA=file_directory_finder,
    FragmentB=filter_23,
    FragmentC="\",
    FragmentD="OpenStudio",
    FragmentE="\",
    FragmentF="run\run\eplustbl.htm")

# ---- group: Pull in Result File by Option
# Import Results
filter_33 = StreamFilter(Gate=visualize_result_set, Stream1=concat_5, Stream2=concat_4)
rep = ReplaceText(Text=filter_33, Find="eplustbl.htm", Replace="eplusout.sql", RecursiveReplace=False)
preview = CustomPreview(Shader=ColourSwatch(SwatchColor=RGB(0, 0, 0)))

# ---- group: W/ft2
multiplication = Multiplication(A="50", B="0.293")

# ---- group: Simulation Namer
filter_34 = StreamFilter(Gate=visualize_result_set, Stream1=filter_23, Stream2=concat_2)
concat_6 = Concatenate(FragmentA=filter_34, FragmentB="_Comfort")

# ----
panel_53 = Panel("""0
375""")
panel_54 = Panel("make higher")
concat_7 = Concatenate(FragmentA=file_directory_finder, FragmentB=filter_34)
panel_55 = Panel("""1
3.5
3.531652989""")
panel_56 = Panel("""1
3.5
3.6625""")
diffuser = Ironbug_AirTerminalSingleDuctConstantVolumeNoReheat(dupNum=False)
subtraction = Subtraction(A="11", B="1")
division = Division(A="1", B=subtraction)
series_8 = Series(Start=0, Step=division, Count="11")

# ---- group: Set Building and Space Program
bldgprograms = HBBuildingPrograms({"LargeOffice", "MediumOffice", "SmallOffice", "MidriseApartment", "HighriseApartment", "Retail", "StripMall", "PrimarySchool", "SecondarySchool", "SmallHotel", "LargeHotel", "Hospital", "Outpatient", "Laboratory", "Warehouse", "SuperMarket", "FullServiceRestaurant", "QuickServiceRestaurant", "Courthouse", "LargeDataCenterHighITE", "LargeDataCenterLowITE", "SmallDataCenterHighITE", "SmallDataCenterLowITE"}, selected="LargeOffice")

bldgprograms_2 = HBBuildingPrograms({"LargeOffice", "MediumOffice", "SmallOffice", "MidriseApartment", "HighriseApartment", "Retail", "StripMall", "PrimarySchool", "SecondarySchool", "SmallHotel", "LargeHotel", "Hospital", "Outpatient", "Laboratory", "Warehouse", "SuperMarket", "FullServiceRestaurant", "QuickServiceRestaurant", "Courthouse", "LargeDataCenterHighITE", "LargeDataCenterLowITE", "SmallDataCenterHighITE", "SmallDataCenterLowITE"}, selected="LargeOffice")

# ----
zone_type_name_override_optional = Panel("")
conditioned = BooleanToggle(True)
searchprog = HBSearchPrograms(bldg_prog=bldgprograms)  # -> room_prog; plug-in component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

# ---- group: Set Building and Space Program (continued)
space_program = Honeybee_ItemSelector(
    searchprog,
    {"2019::LargeOffice::Attic", "2019::LargeOffice::BreakRoom", "2019::LargeOffice::Classroom", "2019::LargeOffice::ClosedOffice", "2019::LargeOffice::Conference", "2019::LargeOffice::Corridor", "2019::LargeOffice::Dining", "2019::LargeOffice::Elec/MechRoom", "2019::LargeOffice::Elevator Lobby", "2019::LargeOffice::Elevator Machine Room", "2019::LargeOffice::Elevator Shaft", "2019::LargeOffice::IT_Room", "2019::LargeOffice::Lobby", "2019::LargeOffice::Main Electrical", "2019::LargeOffice::Main Mechanical", "2019::LargeOffice::OfficeLarge Data Center", "2019::LargeOffice::OfficeLarge Main Data Center", "2019::LargeOffice::OpenOffice", "2019::LargeOffice::PrintRoom", "2019::LargeOffice::Restroom", "2019::LargeOffice::Stair", "2019::LargeOffice::Storage", "2019::LargeOffice::Vending"}, selected="2019::LargeOffice::Attic")

# ----
program_type_inputs_calculator = ProgramTypeInputsCalculator(
    units=input_units_selection,
    zone_name=zone_type_name_override_optional,
    zone_program=space_program,
    leed_baseline=leed_baseline,
    code_baseline=code_baseline,
    number_of_people_per_area=number_of_people_per_area,
    lighting_density_per_area=lighting_density_per_area,
    equipment_load_per_area=equipment_power_density,
    gas_equipment_load_per_area=gas_power_density,
    hot_water_load_per_area=hot_water_density,
    ventilation_per_person=ventilation_per_person,
    ventilation_per_area=ventilation_per_area,
    of_lights_with_daylight_control=daylight_control,
    conditioned=conditioned,
    heating_setpoint=heating_setpoint,
    heating_setback=heating_setback,
    cooling_setpoint=cooling_setpoint,
    cooling_setback=cooling_setback,
    humidity_setpoint=humidify_setpoint,
    dehumidifysetback=dehumidfy_setpoint,
    occupancy_schedule=occupancy,
    activity_schedule=activity,
    lighting_schedule=lighting,
    equipment_schedule=equipment,
    gas_equipment_schedule=gas_equipment,
    hot_water_schedule=hot_water,
    ventilation_schedule=ventilation)  # -> load_catagories_2, loads_2, leed_baseline_loads_2, code_baseline_loads_2, program_schedules, program_properties_2, i

# ---- group: Program Loads
load_type = Panel(program_type_inputs_calculator.load_catagories_2)
proposed = Panel(program_type_inputs_calculator.loads_2)
leed = Panel(program_type_inputs_calculator.leed_baseline_loads_2)
code = Panel(program_type_inputs_calculator.code_baseline_loads_2)
schedule = Panel(program_type_inputs_calculator.program_schedules)

# ---- group: Set Building and Space Program
bldgprograms_3 = HBBuildingPrograms({"LargeOffice", "MediumOffice", "SmallOffice", "MidriseApartment", "HighriseApartment", "Retail", "StripMall", "PrimarySchool", "SecondarySchool", "SmallHotel", "LargeHotel", "Hospital", "Outpatient", "Laboratory", "Warehouse", "SuperMarket", "FullServiceRestaurant", "QuickServiceRestaurant", "Courthouse", "LargeDataCenterHighITE", "LargeDataCenterLowITE", "SmallDataCenterHighITE", "SmallDataCenterLowITE"}, selected="LargeOffice")

# ----
zone_type_name_override_optional_2 = Panel("")
conditioned_2 = BooleanToggle(True)
searchprog_2 = HBSearchPrograms(bldg_prog=bldgprograms_2)  # -> room_prog; plug-in component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

# ---- group: Set Building and Space Program (continued)
space_program_2 = Honeybee_ItemSelector(
    searchprog_2,
    {"2019::LargeOffice::Attic", "2019::LargeOffice::BreakRoom", "2019::LargeOffice::Classroom", "2019::LargeOffice::ClosedOffice", "2019::LargeOffice::Conference", "2019::LargeOffice::Corridor", "2019::LargeOffice::Dining", "2019::LargeOffice::Elec/MechRoom", "2019::LargeOffice::Elevator Lobby", "2019::LargeOffice::Elevator Machine Room", "2019::LargeOffice::Elevator Shaft", "2019::LargeOffice::IT_Room", "2019::LargeOffice::Lobby", "2019::LargeOffice::Main Electrical", "2019::LargeOffice::Main Mechanical", "2019::LargeOffice::OfficeLarge Data Center", "2019::LargeOffice::OfficeLarge Main Data Center", "2019::LargeOffice::OpenOffice", "2019::LargeOffice::PrintRoom", "2019::LargeOffice::Restroom", "2019::LargeOffice::Stair", "2019::LargeOffice::Storage", "2019::LargeOffice::Vending"}, selected="2019::LargeOffice::Attic")

# ----
program_type_inputs_calculator_2 = ProgramTypeInputsCalculator(
    units=input_units_selection,
    zone_name=zone_type_name_override_optional_2,
    zone_program=space_program_2,
    leed_baseline=leed_baseline,
    code_baseline=code_baseline,
    number_of_people_per_area=number_of_people_per_area_2,
    lighting_density_per_area=lighting_density_per_area_2,
    equipment_load_per_area=equipment_power_density_2,
    gas_equipment_load_per_area=gas_power_density_2,
    hot_water_load_per_area=hot_water_density_2,
    ventilation_per_person=ventilation_per_person_2,
    ventilation_per_area=ventilation_per_area_2,
    of_lights_with_daylight_control=daylight_control_2,
    conditioned=conditioned_2,
    heating_setpoint=heating_setpoint_2,
    heating_setback=heating_setback_2,
    cooling_setpoint=cooling_setpoint_2,
    cooling_setback=cooling_setback_2,
    humidity_setpoint=humidify_setpoint_2,
    dehumidifysetback=dehumidfy_setpoint_2,
    occupancy_schedule=occupancy_2,
    activity_schedule=activity_2,
    lighting_schedule=lighting_2,
    equipment_schedule=equipment_2,
    gas_equipment_schedule=gas_equipment_2,
    hot_water_schedule=hot_water_2,
    ventilation_schedule=ventilation_2)  # -> load_catagories_2, loads_2, leed_baseline_loads_2, code_baseline_loads_2, program_schedules, program_properties_2, i

# ---- group: Program Loads
load_type_2 = Panel(program_type_inputs_calculator_2.load_catagories_2)
proposed_2 = Panel(program_type_inputs_calculator_2.loads_2)
leed_2 = Panel(program_type_inputs_calculator_2.leed_baseline_loads_2)
code_2 = Panel(program_type_inputs_calculator_2.code_baseline_loads_2)
schedule_2 = Panel(program_type_inputs_calculator_2.program_schedules)

# ---- group: Set Building and Space Program
bldgprograms_4 = HBBuildingPrograms({"LargeOffice", "MediumOffice", "SmallOffice", "MidriseApartment", "HighriseApartment", "Retail", "StripMall", "PrimarySchool", "SecondarySchool", "SmallHotel", "LargeHotel", "Hospital", "Outpatient", "Laboratory", "Warehouse", "SuperMarket", "FullServiceRestaurant", "QuickServiceRestaurant", "Courthouse", "LargeDataCenterHighITE", "LargeDataCenterLowITE", "SmallDataCenterHighITE", "SmallDataCenterLowITE"}, selected="MidriseApartment")

# ----
zone_type_name_override_optional_3 = Panel("")
conditioned_3 = BooleanToggle(True)
searchprog_3 = HBSearchPrograms(bldg_prog=bldgprograms_3)  # -> room_prog; plug-in component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

# ---- group: Set Building and Space Program (continued)
space_program_3 = Honeybee_ItemSelector(
    searchprog_3,
    {"2019::LargeOffice::Attic", "2019::LargeOffice::BreakRoom", "2019::LargeOffice::Classroom", "2019::LargeOffice::ClosedOffice", "2019::LargeOffice::Conference", "2019::LargeOffice::Corridor", "2019::LargeOffice::Dining", "2019::LargeOffice::Elec/MechRoom", "2019::LargeOffice::Elevator Lobby", "2019::LargeOffice::Elevator Machine Room", "2019::LargeOffice::Elevator Shaft", "2019::LargeOffice::IT_Room", "2019::LargeOffice::Lobby", "2019::LargeOffice::Main Electrical", "2019::LargeOffice::Main Mechanical", "2019::LargeOffice::OfficeLarge Data Center", "2019::LargeOffice::OfficeLarge Main Data Center", "2019::LargeOffice::OpenOffice", "2019::LargeOffice::PrintRoom", "2019::LargeOffice::Restroom", "2019::LargeOffice::Stair", "2019::LargeOffice::Storage", "2019::LargeOffice::Vending"}, selected="2019::LargeOffice::Attic")

# ----
program_type_inputs_calculator_3 = ProgramTypeInputsCalculator(
    units=input_units_selection,
    zone_name=zone_type_name_override_optional_3,
    zone_program=space_program_3,
    leed_baseline=leed_baseline,
    code_baseline=code_baseline,
    number_of_people_per_area=number_of_people_per_area_3,
    lighting_density_per_area=lighting_density_per_area_3,
    equipment_load_per_area=equipment_power_density_3,
    gas_equipment_load_per_area=gas_power_density_3,
    hot_water_load_per_area=hot_water_density_3,
    ventilation_per_person=ventilation_per_person_3,
    ventilation_per_area=ventilation_per_area_3,
    of_lights_with_daylight_control=daylight_control_3,
    conditioned=conditioned_3,
    heating_setpoint=heating_setpoint_3,
    heating_setback=heating_setback_3,
    cooling_setpoint=cooling_setpoint_3,
    cooling_setback=cooling_setback_3,
    humidity_setpoint=humidify_setpoint_3,
    dehumidifysetback=dehumidfy_setpoint_3,
    occupancy_schedule=occupancy_3,
    activity_schedule=activity_3,
    lighting_schedule=lighting_3,
    equipment_schedule=equipment_3,
    gas_equipment_schedule=gas_equipment_3,
    hot_water_schedule=hot_water_3,
    ventilation_schedule=ventilation_3)  # -> load_catagories_2, loads_2, leed_baseline_loads_2, code_baseline_loads_2, program_schedules, program_properties_2, i

# ---- group: Program Loads
load_type_3 = Panel(program_type_inputs_calculator_3.load_catagories_2)
proposed_3 = Panel(program_type_inputs_calculator_3.loads_2)
leed_3 = Panel(program_type_inputs_calculator_3.leed_baseline_loads_2)
code_3 = Panel(program_type_inputs_calculator_3.code_baseline_loads_2)
schedule_3 = Panel(program_type_inputs_calculator_3.program_schedules)

# ----
# Zone Geometry, Internal Load, and HVAC System Assignment By Space Program
# Instructions: Reference closed Brep zones to containers by space type and define the building and space program. The script will automatically solve for intersections and split faces that have multiple boundary conditions.
# 
# Floor multiplier will automatically add one additional instance of the referenced zones above for each floor specified.
# 
# Adjust internal loads, schedules, and setpoints if necessary.
zone_type_name_override_optional_4 = Panel("")
conditioned_4 = BooleanToggle(True)
searchprog_4 = HBSearchPrograms(bldg_prog=bldgprograms_4)  # -> room_prog; plug-in component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

# ---- group: Set Building and Space Program (continued)
space_program_4 = Honeybee_ItemSelector(
    searchprog_4,
    {"2019::MidriseApartment::Apartment", "2019::MidriseApartment::Corridor", "2019::MidriseApartment::Office"}, selected="2019::MidriseApartment::Apartment")

# ----
program_type_inputs_calculator_4 = ProgramTypeInputsCalculator(
    units=input_units_selection,
    zone_name=zone_type_name_override_optional_4,
    zone_program=space_program_4,
    leed_baseline=leed_baseline,
    code_baseline=code_baseline,
    number_of_people_per_area=number_of_people_per_area_4,
    lighting_density_per_area=lighting_density_per_area_4,
    equipment_load_per_area=equipment_power_density_4,
    gas_equipment_load_per_area=gas_power_density_4,
    hot_water_load_per_area=hot_water_density_4,
    ventilation_per_person=ventilation_per_person_4,
    ventilation_per_area=ventilation_per_area_4,
    of_lights_with_daylight_control=daylight_control_4,
    conditioned=conditioned_4,
    heating_setpoint=heating_setpoint_4,
    heating_setback=heating_setback_4,
    cooling_setpoint=cooling_setpoint_4,
    cooling_setback=cooling_setback_4,
    humidity_setpoint=humidify_setpoint_4,
    dehumidifysetback=dehumidfy_setpoint_4,
    occupancy_schedule=occupancy_4,
    activity_schedule=activity_4,
    lighting_schedule=lighting_4,
    equipment_schedule=equipment_4,
    gas_equipment_schedule=gas_equipment_4,
    hot_water_schedule=hot_water_4,
    ventilation_schedule=ventilation_4)  # -> load_catagories_2, loads_2, leed_baseline_loads_2, code_baseline_loads_2, program_schedules, program_properties_2, i

# ---- group: Program Loads
load_type_4 = Panel(program_type_inputs_calculator_4.load_catagories_2)
proposed_4 = Panel(program_type_inputs_calculator_4.loads_2)
leed_4 = Panel(program_type_inputs_calculator_4.leed_baseline_loads_2)
code_4 = Panel(program_type_inputs_calculator_4.code_baseline_loads_2)
schedule_4 = Panel(program_type_inputs_calculator_4.program_schedules)

# ----
item_31 = ListItem(List=schedule_4, Index=0, Wrap=True)

# ---- group: Default Schedule Overrides
occupancy_20 = Panel(item_31)
equipment_20 = Panel("")
gas_equipment_20 = Panel("")
hot_water_20 = Panel("")
ventilation_20 = Panel("")
activity_20 = Panel("")
lighting_20 = Panel("")

# ---- group: Baseline Parameters / Site Information
set_climate_file = FilePath("C:\DIVA\WeatherData\USA_NY_New.York.City-Central.Park.744860_TMY2.epw")
north_arrow_rotation_deg_clockwise = Panel("0")
visualize_north_arrow = BooleanToggle(True)

# ---- group: epw File Localizer
localizer = BE_EPWLocalizer(NPathEPW=set_climate_file, LDir="C:\DIVA\WeatherData")  # -> out, LPathEPW, LPathDDY
# ---------- localizer: Python ----------
import os.path
import shutil
from shutil import copyfile
from sys import exit

#get file name from specified network path 

epwfile = os.path.split(NPathEPW)

#generate network file path for .ddy file and get file name

NPathDDY = NPathEPW.replace('epw','ddy')

ddyfile = os.path.split(NPathDDY)

#create local copy file path

LPathEPW = os.path.join(LDir,epwfile[1])

LPathDDY = os.path.join(LDir,ddyfile[1])

#test if local copy exists and if not copy to local file

if os.path.isfile(LPathEPW):
    print ("File Exists")

else:
    shutil.copyfile(NPathEPW,LPathEPW)
    shutil.copyfile(NPathDDY,LPathDDY)
    print ("File Copied to Local Directory")
# ---------- end localizer ----------
epwtoddy = LBEPWToDDY(epw_file=localizer.LPathEPW, folder="C:\DIVA\WeatherData", write=Toggle(True))  # -> ddy_file; plug-in component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

# ---- group: Climate Info
importepw = LBImportEPW(epw_file=localizer.LPathEPW)  # -> location, dry_bulb_temperature, dew_point_temperature, relative_humidity, wind_speed, wind_direction, direct_normal_rad, diffuse_horizontal_rad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; plug-in component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
decnstrloc = LBDeconstructLocation(location=importepw.location)  # -> name, latitude, longitude, time_zone, elevation; plug-in component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

# ---- group: North Arrow
neg_2 = Negative(Value=north_arrow_rotation_deg_clockwise)
compass = LBCompass(north=neg_2)  # -> compass; plug-in component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
filter_35 = StreamFilter(Gate=visualize_north_arrow, Stream1=compass)
preview_2 = CustomPreview(Geometry=filter_35, Shader=ColourSwatch(SwatchColor=RGB(0, 0, 0)))

# ---- group: Baseline Parameters / Site Information (continued)
panel_57 = Panel(importepw.location)

# ----
# Misc End Uses (optional)
# Service Hot Water Calculation
# Instructions: Select the methodology to take into account hot water usage. The necessary inputs for each option will be highlighted.
# 
# 'Configure Inputs for Energy Plus through Ironbug' is the most accurate and puts a hot water systen into the energy model (the other options simply add the end use to the post processing of results to acco0unt for energy use and cost/carbon.
# 
# The Total Daily Usage can be entered based on the suggestion provided given the building type and unit number or from the LEED water credit calculation. This will be converted to a peak flow in m3/s for E+ based on the schedule. The schedule will be automatically selected from the default ASHRAE SHW schedules by the building type, but custom schedules can be provided.
# 
# The 'Ironbug SHW Definitions' cluster contains a SHW system for both the Proposed and Baseline; connect the outputs to the plant loop inputs in the respective Ironbug HVAC component. Double click on the cluster to make alterations to the base configuration as required.
# Tank Volume (enter 0 to autosize):
# Water Heater Efficiency (Fraction):
service_hot_water_energy_option = ValueList({"None": 0, "Configure Inputs for Energy Plus through Ironbug": 1, "Calculate SHW Energy Use (Simple Calculation)": 2, "Enter SHW Energy Use from Outside Calculation": 3}, selected="Configure Inputs for Energy Plus through Ironbug")
building_type = ValueList({"Office": 0, "Apartment house, with 20 or less apartments": 1, "Apartment house, from 21 to 49 apartments": 2, "Apartment house, from 50 to 74 apartments": 3, "Apartment house, from 75 to 99 apartments": 4, "Apartment house, from 100 to 199 apartments": 5, "Apartment house, more than 200 apartments": 6, "Hotel/motel with 20 or less rooms": 7, "Hotel/motel from 21 to 60 rooms": 8, "Hotel/motel from 61 to 99 rooms": 9, "Hotel/motel more than 100 rooms": 10, "Full meal restaurants, cafeterias": 11, "Drive-ins, grilles, luncheonettes, sandwich, snack shops": 12, "Primary school": 13, "Junior and senior high school": 14, "Men's dormitory": 15, "Women's dormitory": 16, "Hospital": 17, "Nursing home": 18, "Factory": 19}, selected="Office")
heater_fuel_type = ValueList({"Electricity", "NaturalGas", "FuelOil#1", "FuelOil#2", "Coal", "Diesel", "Gasoline", "Steam", "DistrictHeating", "OtherFuel1", "OtherFuel2"}, selected="NaturalGas")
panel_58 = Panel("Delivery Temperature:")
apply_to = ValueList({"Weekdays Only": 0, "Weekdays and Weekends": 1}, selected="Weekdays Only")
# Instructions: Use these tools to take into account additional end uses which may affect the relative impact of the various facade options on total energy use
panel_59 = Panel("87")
units_50 = ValueList({"Liters": 0, "Gallons": 1, "Cubic Meters": 2}, selected="Cubic Meters")

# ---- group: Unit Prompts
# SHW Calculation
panel_61 = Panel("Number of ")
panel_62 = Panel("""Occupants
Apartment Units
Apartment Units
Apartment Units
Apartment Units
Apartment Units
Apartment Units
Rooms
Rooms
Rooms
Rooms
Meals Per Day
Meals Per Day
Occupants
Occupants
Occupants
Occupants
Occupants
Beds
Occupants""")
item_32 = ListItem(List=panel_62, Index=building_type, Wrap=True)
concat_8 = Concatenate(FragmentA="Total Daily Usage (", FragmentB=item_13, FragmentC="):")
concat_9 = Concatenate(FragmentA="Water Usage Per Day Per Unit (", FragmentB=item_13, FragmentC="):")
filter_36 = StreamFilter(Gate=service_hot_water_energy_option, Stream0="N/A", Stream1=concat_8, Stream2="N/A", Stream3="N/A")
concat_10 = Concatenate(FragmentA=panel_61, FragmentB=item_32, FragmentC=":")
filter_37 = StreamFilter(Gate=service_hot_water_energy_option, Stream0="N/A", Stream1="N/A", Stream2=concat_9, Stream3="N/A")
filter_38 = StreamFilter(
    Gate=service_hot_water_energy_option,
    Stream0="N/A",
    Stream1="N/A",
    Stream2="N/A",
    Stream3="Total Annual SWH Energy Usage (kWh):")

# ----
expression_5 = Expression(x=heater_fuel_type, Expression="IF(x=\"Electricity\",0,IF(x=\"NaturalGas\",1,IF(x=\"DistrictHeating\",4,2)))")

# ---- group: Delivery Temperature
delivery_temperature = Number("140")
f2c = Ladybug_F2C(F=delivery_temperature)  # -> C; plug-in component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
filter_39 = StreamFilter(Gate=input_units_selection, Stream0=delivery_temperature, Stream1=f2c)

# ----
supply_temp = Number("140")
f2c_2 = Ladybug_F2C(F=supply_temp)  # -> C; plug-in component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
filter_40 = StreamFilter(Gate=units_49, Stream0=supply_temp, Stream1=f2c_2)
spm_scheduled = Ironbug_SetpointManagerScheduled(Temperature=filter_40, ControlVariable="Temperature", dupNum=False)

# ---- group: DHW Plant Loop / Loop Properties
panel_63 = Panel("DHW Loop")
objparams = IB_ObjParams(
    LoadDistributionScheme="Optimal",
    MaximumLoopFlowRate="0.000440",
    MaximumLoopTemperature=filter_40,
    MinimumLoopTemperature="10",
    Name=panel_63,
    DataFieldSetType="Ironbug.HVAC.IB_PlantLoop_FieldSet")

# ----
# E+ Simulation Outputs
# Instructions: This section will define the variables that Energy Plus outputs in a .csv file. These variables will be useful for a variety of purposes such as troubleshooting results, performing thermal comfort analysis, and visualizing results.
# 
# Check the categories in the 'Output Options' list to add groups of variables. Custom variables can be added in the 'Enter Custom Variables' list below.
# 
# The variables that are being passed to Energy Plus with be displayed in the top panel.
output_options = ValueList({"Zone Energy Use": 0, "HVAC Energy Use": 1, "Gains and Losses": 2, "Comfort Metrics": 3, "Surface Temperature": 4, "Surfaces Energy Flow": 5, "Custom Variables": 6}, selected=[])
enter_custom_variables = Panel("""Air System Mixed Air Mass Flow Rate
Air System Outdoor Air Mass Flow Rate
Air System Total Heating Energy
Air System Total Cooling Energy
Boiler Gas Rate
Chiller Electric Power
Pump Electric Power
Zone Air Temperature
Air System Gas Energy
Air System Hot Water Energy
Air System Heating Coil Hot Water Energy
Air System Heating Coil Total Heating Energy
Air System DX Heating Coil Electric Energy
Air System Electric Energy
Air System Heating Coil Total Heating Energy
Air System Heating Coil Electric Energy
Air System Heat Exchanger Total Heating Energy
Air System Humidifier Electric Energy
Air System Fan Air Heating Energy
Air System Fan Electric Energy
Boiler Heating Energy
Air System DX Cooling Coil Electric Energy
Air System Cooling Coil Chilled Water Energy
Air System Cooling Coil Total Cooling Energy
Air System Total Cooling Energy
Chiller COP
Chiller Evaporator Cooling Energy
Chiller Electric Energy
Cooling Tower Mass Flow Rate
Cooling Tower Heat Transfer Rate
Cooling Tower Water Evaporation Volume 
Cooling Tower Fan Electric Energy
Cooling Tower Inlet Temperature
Cooling Tower Outlet Temperature
Zone Infiltration Mass Flow Rate
Site Outdoor Air Drybulb Temperature
Chiller Part Load Ratio
Boiler Part Load Ratio""")
timestep = ValueList({"Hourly", "Daily", "Monthly", "Annual"}, selected="Hourly")

# ---- group: .csv Outputs
repeat_4 = RepeatData(Data="False", Length="7")
replace_4 = ReplaceItems(List=repeat_4, Item="True", Indices=output_options, Wrap=False)
item_33 = ListItem(List=replace_4, Index=0, Wrap=True)  # -> Item, Item1, Item2, Item3, Item4, Item5, Item6
simoutput = HBSimulationOutput(
    zone_energy_use=item_33.Item,
    hvac_energy_use=item_33.Item1,
    gains_and_losses=item_33.Item2,
    comfort_metrics=item_33.Item3,
    surface_temperature=item_33.Item4,
    surface_energy_flow=item_33.Item5,
    report_frequency=timestep)  # -> report, sim_output; plug-in component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
customoutput = HBCustomSimulationOutput(output_names=enter_custom_variables, report_frequency=timestep)  # -> report, sim_output; plug-in component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
merge_3 = Merge(Data1=flatten(simoutput.sim_output), Data2=flatten(customoutput.sim_output))
filter_41 = StreamFilter(Gate=item_33.Item6, Stream0=simoutput.sim_output, Stream1=merge_3)

# ----
e_variables_for_output = Panel(filter_41)

# ---- group: Simulation Parameters
shadowcalc = HBShadowCalculation(solar_dist=solar_distribution)  # -> shadow_calc; plug-in component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
sizingpar = HBSizingParameter(ddy_file=epwtoddy)  # -> sizing; plug-in component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
neg_3 = Negative(Value=north_arrow_rotation_deg_clockwise)
simpar = HBSimulationParameter(
    north=neg_3,
    output=filter_41,
    start_dow=first_day_of_simulation,
    timestep=6,
    terrain=terrain,
    shadow_calc=shadowcalc,
    sizing=sizingpar)  # -> sim_par; plug-in component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

# ----
panel_64 = Panel(concat_10)
panel_65 = Panel(filter_38)
panel_66 = Panel(filter_36)
panel_67 = Panel(filter_37)

units_51 = Panel(item_5)
parametric_opaque_assembly_option = ValueList({"Cross Reference Properties": 0, "List of Envelope Properties": 1}, selected="Cross Reference Properties")
wall = Panel("""0
1
2
3
4
5
6""")
thermal_bridge = Panel("0.5")
units_53 = Panel(item_5)
roof = Panel("""0
1
2
3""")
units_54 = Panel(item_5)
exposed_floor = Panel("0.036378")
slab_on_grade = Panel("0.174549")

# ---- group: Proposed
panel_68 = Panel("0.82")
panel_69 = Panel("1")
panel_70 = Panel("3")

# ----
volume_2 = Number(panel_69)
entwine = Entwine(Branch01=panel_68, Branch02=panel_11, FlattenInputs=True)
proposed_efficiency = Number(panel_68)
merge_4 = Merge(Data1=proposed_efficiency, Data2=baseline_efficiency)

# ---- group: Set Building and Space Program
bldgprograms_5 = HBBuildingPrograms({"LargeOffice", "MediumOffice", "SmallOffice", "MidriseApartment", "HighriseApartment", "Retail", "StripMall", "PrimarySchool", "SecondarySchool", "SmallHotel", "LargeHotel", "Hospital", "Outpatient", "Laboratory", "Warehouse", "SuperMarket", "FullServiceRestaurant", "QuickServiceRestaurant", "Courthouse", "LargeDataCenterHighITE", "LargeDataCenterLowITE", "SmallDataCenterHighITE", "SmallDataCenterLowITE"}, selected="LargeOffice")

bldgprograms_6 = HBBuildingPrograms({"LargeOffice", "MediumOffice", "SmallOffice", "MidriseApartment", "HighriseApartment", "Retail", "StripMall", "PrimarySchool", "SecondarySchool", "SmallHotel", "LargeHotel", "Hospital", "Outpatient", "Laboratory", "Warehouse", "SuperMarket", "FullServiceRestaurant", "QuickServiceRestaurant", "Courthouse", "LargeDataCenterHighITE", "LargeDataCenterLowITE", "SmallDataCenterHighITE", "SmallDataCenterLowITE"}, selected="LargeOffice")

# ----
zone_type_name_override_optional_5 = Panel("")
conditioned_5 = BooleanToggle(True)
searchprog_5 = HBSearchPrograms(bldg_prog=bldgprograms_5)  # -> room_prog; plug-in component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

# ---- group: Set Building and Space Program (continued)
space_program_5 = Honeybee_ItemSelector(
    searchprog_5,
    {"2019::LargeOffice::Attic", "2019::LargeOffice::BreakRoom", "2019::LargeOffice::Classroom", "2019::LargeOffice::ClosedOffice", "2019::LargeOffice::Conference", "2019::LargeOffice::Corridor", "2019::LargeOffice::Dining", "2019::LargeOffice::Elec/MechRoom", "2019::LargeOffice::Elevator Lobby", "2019::LargeOffice::Elevator Machine Room", "2019::LargeOffice::Elevator Shaft", "2019::LargeOffice::IT_Room", "2019::LargeOffice::Lobby", "2019::LargeOffice::Main Electrical", "2019::LargeOffice::Main Mechanical", "2019::LargeOffice::OfficeLarge Data Center", "2019::LargeOffice::OfficeLarge Main Data Center", "2019::LargeOffice::OpenOffice", "2019::LargeOffice::PrintRoom", "2019::LargeOffice::Restroom", "2019::LargeOffice::Stair", "2019::LargeOffice::Storage", "2019::LargeOffice::Vending"}, selected="2019::LargeOffice::Attic")

# ----
program_type_inputs_calculator_5 = ProgramTypeInputsCalculator(
    units=input_units_selection,
    zone_name=zone_type_name_override_optional_5,
    zone_program=space_program_5,
    leed_baseline=leed_baseline,
    code_baseline=code_baseline,
    number_of_people_per_area=number_of_people_per_area_5,
    lighting_density_per_area=lighting_density_per_area_5,
    equipment_load_per_area=equipment_power_density_5,
    gas_equipment_load_per_area=gas_power_density_5,
    hot_water_load_per_area=hot_water_density_5,
    ventilation_per_person=ventilation_per_person_5,
    ventilation_per_area=ventilation_per_area_5,
    of_lights_with_daylight_control=daylight_control_5,
    conditioned=conditioned_5,
    heating_setpoint=heating_setpoint_5,
    heating_setback=heating_setback_5,
    cooling_setpoint=cooling_setpoint_5,
    cooling_setback=cooling_setback_5,
    humidity_setpoint=humidify_setpoint_5,
    dehumidifysetback=dehumidfy_setpoint_5,
    occupancy_schedule=occupancy_5,
    activity_schedule=activity_5,
    lighting_schedule=lighting_5,
    equipment_schedule=equipment_5,
    gas_equipment_schedule=gas_equipment_5,
    hot_water_schedule=hot_water_5,
    ventilation_schedule=ventilation_5)  # -> load_catagories_2, loads_2, leed_baseline_loads_2, code_baseline_loads_2, program_schedules, program_properties_2, i

# ---- group: Program Loads
load_type_5 = Panel(program_type_inputs_calculator_5.load_catagories_2)
proposed_5 = Panel(program_type_inputs_calculator_5.loads_2)
leed_5 = Panel(program_type_inputs_calculator_5.leed_baseline_loads_2)
code_5 = Panel(program_type_inputs_calculator_5.code_baseline_loads_2)
schedule_5 = Panel(program_type_inputs_calculator_5.program_schedules)

# ---- group: Set Building and Space Program
bldgprograms_7 = HBBuildingPrograms({"LargeOffice", "MediumOffice", "SmallOffice", "MidriseApartment", "HighriseApartment", "Retail", "StripMall", "PrimarySchool", "SecondarySchool", "SmallHotel", "LargeHotel", "Hospital", "Outpatient", "Laboratory", "Warehouse", "SuperMarket", "FullServiceRestaurant", "QuickServiceRestaurant", "Courthouse", "LargeDataCenterHighITE", "LargeDataCenterLowITE", "SmallDataCenterHighITE", "SmallDataCenterLowITE"}, selected="LargeOffice")

# ----
zone_type_name_override_optional_6 = Panel("")
conditioned_6 = BooleanToggle(True)
searchprog_6 = HBSearchPrograms(bldg_prog=bldgprograms_6)  # -> room_prog; plug-in component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

# ---- group: Set Building and Space Program (continued)
space_program_6 = Honeybee_ItemSelector(
    searchprog_6,
    {"2019::LargeOffice::Attic", "2019::LargeOffice::BreakRoom", "2019::LargeOffice::Classroom", "2019::LargeOffice::ClosedOffice", "2019::LargeOffice::Conference", "2019::LargeOffice::Corridor", "2019::LargeOffice::Dining", "2019::LargeOffice::Elec/MechRoom", "2019::LargeOffice::Elevator Lobby", "2019::LargeOffice::Elevator Machine Room", "2019::LargeOffice::Elevator Shaft", "2019::LargeOffice::IT_Room", "2019::LargeOffice::Lobby", "2019::LargeOffice::Main Electrical", "2019::LargeOffice::Main Mechanical", "2019::LargeOffice::OfficeLarge Data Center", "2019::LargeOffice::OfficeLarge Main Data Center", "2019::LargeOffice::OpenOffice", "2019::LargeOffice::PrintRoom", "2019::LargeOffice::Restroom", "2019::LargeOffice::Stair", "2019::LargeOffice::Storage", "2019::LargeOffice::Vending"}, selected="2019::LargeOffice::Attic")

# ----
program_type_inputs_calculator_6 = ProgramTypeInputsCalculator(
    units=input_units_selection,
    zone_name=zone_type_name_override_optional_6,
    zone_program=space_program_6,
    leed_baseline=leed_baseline,
    code_baseline=code_baseline,
    number_of_people_per_area=number_of_people_per_area_6,
    lighting_density_per_area=lighting_density_per_area_6,
    equipment_load_per_area=equipment_power_density_6,
    gas_equipment_load_per_area=gas_power_density_6,
    hot_water_load_per_area=hot_water_density_6,
    ventilation_per_person=ventilation_per_person_6,
    ventilation_per_area=ventilation_per_area_6,
    of_lights_with_daylight_control=daylight_control_6,
    conditioned=conditioned_6,
    heating_setpoint=heating_setpoint_6,
    heating_setback=heating_setback_6,
    cooling_setpoint=cooling_setpoint_6,
    cooling_setback=cooling_setback_6,
    humidity_setpoint=humidify_setpoint_6,
    dehumidifysetback=dehumidfy_setpoint_6,
    occupancy_schedule=occupancy_6,
    activity_schedule=activity_6,
    lighting_schedule=lighting_6,
    equipment_schedule=equipment_6,
    gas_equipment_schedule=gas_equipment_6,
    hot_water_schedule=hot_water_6,
    ventilation_schedule=ventilation_6)  # -> load_catagories_2, loads_2, leed_baseline_loads_2, code_baseline_loads_2, program_schedules, program_properties_2, i

# ---- group: Program Loads
load_type_6 = Panel(program_type_inputs_calculator_6.load_catagories_2)
proposed_6 = Panel(program_type_inputs_calculator_6.loads_2)
leed_6 = Panel(program_type_inputs_calculator_6.leed_baseline_loads_2)
code_6 = Panel(program_type_inputs_calculator_6.code_baseline_loads_2)
schedule_6 = Panel(program_type_inputs_calculator_6.program_schedules)

# ---- group: Set Building and Space Program
bldgprograms_8 = HBBuildingPrograms({"LargeOffice", "MediumOffice", "SmallOffice", "MidriseApartment", "HighriseApartment", "Retail", "StripMall", "PrimarySchool", "SecondarySchool", "SmallHotel", "LargeHotel", "Hospital", "Outpatient", "Laboratory", "Warehouse", "SuperMarket", "FullServiceRestaurant", "QuickServiceRestaurant", "Courthouse", "LargeDataCenterHighITE", "LargeDataCenterLowITE", "SmallDataCenterHighITE", "SmallDataCenterLowITE"}, selected="MediumOffice")

# ----
zone_type_name_override_optional_7 = Panel("")
conditioned_7 = BooleanToggle(True)
searchprog_7 = HBSearchPrograms(bldg_prog=bldgprograms_7)  # -> room_prog; plug-in component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

# ---- group: Set Building and Space Program (continued)
space_program_7 = Honeybee_ItemSelector(
    searchprog_7,
    {"2019::LargeOffice::Attic", "2019::LargeOffice::BreakRoom", "2019::LargeOffice::Classroom", "2019::LargeOffice::ClosedOffice", "2019::LargeOffice::Conference", "2019::LargeOffice::Corridor", "2019::LargeOffice::Dining", "2019::LargeOffice::Elec/MechRoom", "2019::LargeOffice::Elevator Lobby", "2019::LargeOffice::Elevator Machine Room", "2019::LargeOffice::Elevator Shaft", "2019::LargeOffice::IT_Room", "2019::LargeOffice::Lobby", "2019::LargeOffice::Main Electrical", "2019::LargeOffice::Main Mechanical", "2019::LargeOffice::OfficeLarge Data Center", "2019::LargeOffice::OfficeLarge Main Data Center", "2019::LargeOffice::OpenOffice", "2019::LargeOffice::PrintRoom", "2019::LargeOffice::Restroom", "2019::LargeOffice::Stair", "2019::LargeOffice::Storage", "2019::LargeOffice::Vending"}, selected="2019::LargeOffice::Attic")

# ----
program_type_inputs_calculator_7 = ProgramTypeInputsCalculator(
    units=input_units_selection,
    zone_name=zone_type_name_override_optional_7,
    zone_program=space_program_7,
    leed_baseline=leed_baseline,
    code_baseline=code_baseline,
    number_of_people_per_area=number_of_people_per_area_7,
    lighting_density_per_area=lighting_density_per_area_7,
    equipment_load_per_area=equipment_power_density_7,
    gas_equipment_load_per_area=gas_power_density_7,
    hot_water_load_per_area=hot_water_density_7,
    ventilation_per_person=ventilation_per_person_7,
    ventilation_per_area=ventilation_per_area_7,
    of_lights_with_daylight_control=daylight_control_7,
    conditioned=conditioned_7,
    heating_setpoint=heating_setpoint_7,
    heating_setback=heating_setback_7,
    cooling_setpoint=cooling_setpoint_7,
    cooling_setback=cooling_setback_7,
    humidity_setpoint=humidify_setpoint_7,
    dehumidifysetback=dehumidfy_setpoint_7,
    occupancy_schedule=occupancy_7,
    activity_schedule=activity_7,
    lighting_schedule=lighting_7,
    equipment_schedule=equipment_7,
    gas_equipment_schedule=gas_equipment_7,
    hot_water_schedule=hot_water_7,
    ventilation_schedule=ventilation_7)  # -> load_catagories_2, loads_2, leed_baseline_loads_2, code_baseline_loads_2, program_schedules, program_properties_2, i

# ---- group: Program Loads
load_type_7 = Panel(program_type_inputs_calculator_7.load_catagories_2)
proposed_7 = Panel(program_type_inputs_calculator_7.loads_2)
leed_7 = Panel(program_type_inputs_calculator_7.leed_baseline_loads_2)
code_7 = Panel(program_type_inputs_calculator_7.code_baseline_loads_2)
schedule_7 = Panel(program_type_inputs_calculator_7.program_schedules)

# ----
zone_type_name_override_optional_8 = Panel("")
conditioned_8 = BooleanToggle(False)
searchprog_8 = HBSearchPrograms(bldg_prog=bldgprograms_8)  # -> room_prog; plug-in component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

# ---- group: Set Building and Space Program (continued)
space_program_8 = Honeybee_ItemSelector(
    searchprog_8,
    {"2019::MediumOffice::Breakroom", "2019::MediumOffice::Classroom", "2019::MediumOffice::ClosedOffice", "2019::MediumOffice::Conference", "2019::MediumOffice::Corridor", "2019::MediumOffice::Dining", "2019::MediumOffice::Elec/MechRoom", "2019::MediumOffice::Lobby", "2019::MediumOffice::OpenOffice", "2019::MediumOffice::Restroom", "2019::MediumOffice::Stair", "2019::MediumOffice::Storage"}, selected="2019::MediumOffice::Elec/MechRoom")

# ----
program_type_inputs_calculator_8 = ProgramTypeInputsCalculator(
    units=input_units_selection,
    zone_name=zone_type_name_override_optional_8,
    zone_program=space_program_8,
    leed_baseline=leed_baseline,
    code_baseline=code_baseline,
    number_of_people_per_area=number_of_people_per_area_8,
    lighting_density_per_area=lighting_density_per_area_8,
    equipment_load_per_area=equipment_power_density_8,
    gas_equipment_load_per_area=gas_power_density_8,
    hot_water_load_per_area=hot_water_density_8,
    ventilation_per_person=ventilation_per_person_8,
    ventilation_per_area=ventilation_per_area_8,
    of_lights_with_daylight_control=daylight_control_8,
    conditioned=conditioned_8,
    heating_setpoint=heating_setpoint_8,
    heating_setback=heating_setback_8,
    cooling_setpoint=cooling_setpoint_8,
    cooling_setback=cooling_setback_8,
    humidity_setpoint=humidify_setpoint_8,
    dehumidifysetback=dehumidfy_setpoint_8,
    occupancy_schedule=occupancy_20,
    activity_schedule=activity_20,
    lighting_schedule=lighting_20,
    equipment_schedule=equipment_20,
    gas_equipment_schedule=gas_equipment_20,
    hot_water_schedule=hot_water_20,
    ventilation_schedule=ventilation_20)  # -> load_catagories_2, loads_2, leed_baseline_loads_2, code_baseline_loads_2, program_schedules, program_properties_2, i

# ---- group: Program Loads
load_type_8 = Panel(program_type_inputs_calculator_8.load_catagories_2)
proposed_8 = Panel(program_type_inputs_calculator_8.loads_2)
leed_8 = Panel(program_type_inputs_calculator_8.leed_baseline_loads_2)
code_8 = Panel(program_type_inputs_calculator_8.code_baseline_loads_2)
schedule_8 = Panel(program_type_inputs_calculator_8.program_schedules)
# ---- group: Hint
panel_71 = Panel("-")
panel_72 = Panel("-")

# ----
# Opaque Assemblies U-Values
# Instructions: Select opaque assembly option from pulldown menu:
# 
# Cross Reference Properties - will generate all combinations of properties specified in panels. This can help identify the most important parameters but will generate more combinations
# 
# List of Envelope Properties - using this to define different envelope scenarios. The simulations will connect the item indexes in each list to each other
# 
# Specify values for parametric study for the walls, roofs, and exposed floors
# 
# Provide one value in each panel for a fixed value, or a list of values for parametric study of each variable
# Instructions: These items are not parameterized, although they may need to be definined in some cases.
below_grade_walls = Panel("0.5")
underground_slab = Panel("0.5")

# ---- group: Baseline Parameters / Carbon Factors
electricity_co₂_kwh = Panel("0.396")
additional_fuel_co₂_kwh = Panel("1.2")
district_cooling_co₂_kwh = Panel("1.25")
district_heating_co₂_kwh = Panel("1.5")
carbon_units = Panel(item_11)

# ---- group: Set Building and Space Program
bldgprograms_9 = HBBuildingPrograms({"LargeOffice", "MediumOffice", "SmallOffice", "MidriseApartment", "HighriseApartment", "Retail", "StripMall", "PrimarySchool", "SecondarySchool", "SmallHotel", "LargeHotel", "Hospital", "Outpatient", "Laboratory", "Warehouse", "SuperMarket", "FullServiceRestaurant", "QuickServiceRestaurant", "Courthouse", "LargeDataCenterHighITE", "LargeDataCenterLowITE", "SmallDataCenterHighITE", "SmallDataCenterLowITE"}, selected="LargeOffice")

bldgprograms_10 = HBBuildingPrograms({"LargeOffice", "MediumOffice", "SmallOffice", "MidriseApartment", "HighriseApartment", "Retail", "StripMall", "PrimarySchool", "SecondarySchool", "SmallHotel", "LargeHotel", "Hospital", "Outpatient", "Laboratory", "Warehouse", "SuperMarket", "FullServiceRestaurant", "QuickServiceRestaurant", "Courthouse", "LargeDataCenterHighITE", "LargeDataCenterLowITE", "SmallDataCenterHighITE", "SmallDataCenterLowITE"}, selected="LargeOffice")

# ----
zone_type_name_override_optional_9 = Panel("")
conditioned_9 = BooleanToggle(True)
searchprog_9 = HBSearchPrograms(bldg_prog=bldgprograms_9)  # -> room_prog; plug-in component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

# ---- group: Set Building and Space Program (continued)
space_program_9 = Honeybee_ItemSelector(
    searchprog_9,
    {"2019::LargeOffice::Attic", "2019::LargeOffice::BreakRoom", "2019::LargeOffice::Classroom", "2019::LargeOffice::ClosedOffice", "2019::LargeOffice::Conference", "2019::LargeOffice::Corridor", "2019::LargeOffice::Dining", "2019::LargeOffice::Elec/MechRoom", "2019::LargeOffice::Elevator Lobby", "2019::LargeOffice::Elevator Machine Room", "2019::LargeOffice::Elevator Shaft", "2019::LargeOffice::IT_Room", "2019::LargeOffice::Lobby", "2019::LargeOffice::Main Electrical", "2019::LargeOffice::Main Mechanical", "2019::LargeOffice::OfficeLarge Data Center", "2019::LargeOffice::OfficeLarge Main Data Center", "2019::LargeOffice::OpenOffice", "2019::LargeOffice::PrintRoom", "2019::LargeOffice::Restroom", "2019::LargeOffice::Stair", "2019::LargeOffice::Storage", "2019::LargeOffice::Vending"}, selected="2019::LargeOffice::Attic")

# ----
program_type_inputs_calculator_9 = ProgramTypeInputsCalculator(
    units=input_units_selection,
    zone_name=zone_type_name_override_optional_9,
    zone_program=space_program_9,
    leed_baseline=leed_baseline,
    code_baseline=code_baseline,
    number_of_people_per_area=number_of_people_per_area_9,
    lighting_density_per_area=lighting_density_per_area_9,
    equipment_load_per_area=equipment_power_density_9,
    gas_equipment_load_per_area=gas_power_density_9,
    hot_water_load_per_area=hot_water_density_9,
    ventilation_per_person=ventilation_per_person_9,
    ventilation_per_area=ventilation_per_area_9,
    of_lights_with_daylight_control=daylight_control_9,
    conditioned=conditioned_9,
    heating_setpoint=heating_setpoint_9,
    heating_setback=heating_setback_9,
    cooling_setpoint=cooling_setpoint_9,
    cooling_setback=cooling_setback_9,
    humidity_setpoint=humidify_setpoint_9,
    dehumidifysetback=dehumidfy_setpoint_9,
    occupancy_schedule=occupancy_8,
    activity_schedule=activity_8,
    lighting_schedule=lighting_8,
    equipment_schedule=equipment_8,
    gas_equipment_schedule=gas_equipment_8,
    hot_water_schedule=hot_water_8,
    ventilation_schedule=ventilation_8)  # -> load_catagories_2, loads_2, leed_baseline_loads_2, code_baseline_loads_2, program_schedules, program_properties_2, i

# ---- group: Program Loads
load_type_9 = Panel(program_type_inputs_calculator_9.load_catagories_2)
proposed_9 = Panel(program_type_inputs_calculator_9.loads_2)
leed_9 = Panel(program_type_inputs_calculator_9.leed_baseline_loads_2)
code_9 = Panel(program_type_inputs_calculator_9.code_baseline_loads_2)
schedule_9 = Panel(program_type_inputs_calculator_9.program_schedules)

# ---- group: Set Building and Space Program
bldgprograms_11 = HBBuildingPrograms({"LargeOffice", "MediumOffice", "SmallOffice", "MidriseApartment", "HighriseApartment", "Retail", "StripMall", "PrimarySchool", "SecondarySchool", "SmallHotel", "LargeHotel", "Hospital", "Outpatient", "Laboratory", "Warehouse", "SuperMarket", "FullServiceRestaurant", "QuickServiceRestaurant", "Courthouse", "LargeDataCenterHighITE", "LargeDataCenterLowITE", "SmallDataCenterHighITE", "SmallDataCenterLowITE"}, selected="LargeOffice")

# ----
zone_type_name_override_optional_10 = Panel("")
conditioned_10 = BooleanToggle(True)
searchprog_10 = HBSearchPrograms(bldg_prog=bldgprograms_10)  # -> room_prog; plug-in component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

# ---- group: Set Building and Space Program (continued)
space_program_10 = Honeybee_ItemSelector(
    searchprog_10,
    {"2019::LargeOffice::Attic", "2019::LargeOffice::BreakRoom", "2019::LargeOffice::Classroom", "2019::LargeOffice::ClosedOffice", "2019::LargeOffice::Conference", "2019::LargeOffice::Corridor", "2019::LargeOffice::Dining", "2019::LargeOffice::Elec/MechRoom", "2019::LargeOffice::Elevator Lobby", "2019::LargeOffice::Elevator Machine Room", "2019::LargeOffice::Elevator Shaft", "2019::LargeOffice::IT_Room", "2019::LargeOffice::Lobby", "2019::LargeOffice::Main Electrical", "2019::LargeOffice::Main Mechanical", "2019::LargeOffice::OfficeLarge Data Center", "2019::LargeOffice::OfficeLarge Main Data Center", "2019::LargeOffice::OpenOffice", "2019::LargeOffice::PrintRoom", "2019::LargeOffice::Restroom", "2019::LargeOffice::Stair", "2019::LargeOffice::Storage", "2019::LargeOffice::Vending"}, selected="2019::LargeOffice::Attic")

# ----
program_type_inputs_calculator_10 = ProgramTypeInputsCalculator(
    units=input_units_selection,
    zone_name=zone_type_name_override_optional_10,
    zone_program=space_program_10,
    leed_baseline=leed_baseline,
    code_baseline=code_baseline,
    number_of_people_per_area=number_of_people_per_area_10,
    lighting_density_per_area=lighting_density_per_area_10,
    equipment_load_per_area=equipment_power_density_10,
    gas_equipment_load_per_area=gas_power_density_10,
    hot_water_load_per_area=hot_water_density_10,
    ventilation_per_person=ventilation_per_person_10,
    ventilation_per_area=ventilation_per_area_10,
    of_lights_with_daylight_control=daylight_control_10,
    conditioned=conditioned_10,
    heating_setpoint=heating_setpoint_10,
    heating_setback=heating_setback_10,
    cooling_setpoint=cooling_setpoint_10,
    cooling_setback=cooling_setback_10,
    humidity_setpoint=humidify_setpoint_10,
    dehumidifysetback=dehumidfy_setpoint_10,
    occupancy_schedule=occupancy_9,
    activity_schedule=activity_9,
    lighting_schedule=lighting_9,
    equipment_schedule=equipment_9,
    gas_equipment_schedule=gas_equipment_9,
    hot_water_schedule=hot_water_9,
    ventilation_schedule=ventilation_9)  # -> load_catagories_2, loads_2, leed_baseline_loads_2, code_baseline_loads_2, program_schedules, program_properties_2, i

# ---- group: Program Loads
load_type_10 = Panel(program_type_inputs_calculator_10.load_catagories_2)
proposed_10 = Panel(program_type_inputs_calculator_10.loads_2)
leed_10 = Panel(program_type_inputs_calculator_10.leed_baseline_loads_2)
code_10 = Panel(program_type_inputs_calculator_10.code_baseline_loads_2)
schedule_10 = Panel(program_type_inputs_calculator_10.program_schedules)

# ---- group: Set Building and Space Program
bldgprograms_12 = HBBuildingPrograms({"LargeOffice", "MediumOffice", "SmallOffice", "MidriseApartment", "HighriseApartment", "Retail", "StripMall", "PrimarySchool", "SecondarySchool", "SmallHotel", "LargeHotel", "Hospital", "Outpatient", "Laboratory", "Warehouse", "SuperMarket", "FullServiceRestaurant", "QuickServiceRestaurant", "Courthouse", "LargeDataCenterHighITE", "LargeDataCenterLowITE", "SmallDataCenterHighITE", "SmallDataCenterLowITE"}, selected="LargeOffice")

# ----
zone_type_name_override_optional_11 = Panel("")
conditioned_11 = BooleanToggle(True)
searchprog_11 = HBSearchPrograms(bldg_prog=bldgprograms_11)  # -> room_prog; plug-in component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

# ---- group: Set Building and Space Program (continued)
space_program_11 = Honeybee_ItemSelector(
    searchprog_11,
    {"2019::LargeOffice::Attic", "2019::LargeOffice::BreakRoom", "2019::LargeOffice::Classroom", "2019::LargeOffice::ClosedOffice", "2019::LargeOffice::Conference", "2019::LargeOffice::Corridor", "2019::LargeOffice::Dining", "2019::LargeOffice::Elec/MechRoom", "2019::LargeOffice::Elevator Lobby", "2019::LargeOffice::Elevator Machine Room", "2019::LargeOffice::Elevator Shaft", "2019::LargeOffice::IT_Room", "2019::LargeOffice::Lobby", "2019::LargeOffice::Main Electrical", "2019::LargeOffice::Main Mechanical", "2019::LargeOffice::OfficeLarge Data Center", "2019::LargeOffice::OfficeLarge Main Data Center", "2019::LargeOffice::OpenOffice", "2019::LargeOffice::PrintRoom", "2019::LargeOffice::Restroom", "2019::LargeOffice::Stair", "2019::LargeOffice::Storage", "2019::LargeOffice::Vending"}, selected="2019::LargeOffice::Attic")

# ----
program_type_inputs_calculator_11 = ProgramTypeInputsCalculator(
    units=input_units_selection,
    zone_name=zone_type_name_override_optional_11,
    zone_program=space_program_11,
    leed_baseline=leed_baseline,
    code_baseline=code_baseline,
    number_of_people_per_area=number_of_people_per_area_11,
    lighting_density_per_area=lighting_density_per_area_11,
    equipment_load_per_area=equipment_power_density_11,
    gas_equipment_load_per_area=gas_power_density_11,
    hot_water_load_per_area=hot_water_density_11,
    ventilation_per_person=ventilation_per_person_11,
    ventilation_per_area=ventilation_per_area_11,
    of_lights_with_daylight_control=daylight_control_11,
    conditioned=conditioned_11,
    heating_setpoint=heating_setpoint_11,
    heating_setback=heating_setback_11,
    cooling_setpoint=cooling_setpoint_11,
    cooling_setback=cooling_setback_11,
    humidity_setpoint=humidify_setpoint_11,
    dehumidifysetback=dehumidfy_setpoint_11,
    occupancy_schedule=occupancy_10,
    activity_schedule=activity_10,
    lighting_schedule=lighting_10,
    equipment_schedule=equipment_10,
    gas_equipment_schedule=gas_equipment_10,
    hot_water_schedule=hot_water_10,
    ventilation_schedule=ventilation_10)  # -> load_catagories_2, loads_2, leed_baseline_loads_2, code_baseline_loads_2, program_schedules, program_properties_2, i

# ---- group: Program Loads
load_type_11 = Panel(program_type_inputs_calculator_11.load_catagories_2)
proposed_11 = Panel(program_type_inputs_calculator_11.loads_2)
leed_11 = Panel(program_type_inputs_calculator_11.leed_baseline_loads_2)
code_11 = Panel(program_type_inputs_calculator_11.code_baseline_loads_2)
schedule_11 = Panel(program_type_inputs_calculator_11.program_schedules)

# ----
zone_type_name_override_optional_12 = Panel("")
conditioned_12 = BooleanToggle(True)
searchprog_12 = HBSearchPrograms(bldg_prog=bldgprograms_12)  # -> room_prog; plug-in component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

# ---- group: Set Building and Space Program (continued)
space_program_12 = Honeybee_ItemSelector(
    searchprog_12,
    {"2019::LargeOffice::Attic", "2019::LargeOffice::BreakRoom", "2019::LargeOffice::Classroom", "2019::LargeOffice::ClosedOffice", "2019::LargeOffice::Conference", "2019::LargeOffice::Corridor", "2019::LargeOffice::Dining", "2019::LargeOffice::Elec/MechRoom", "2019::LargeOffice::Elevator Lobby", "2019::LargeOffice::Elevator Machine Room", "2019::LargeOffice::Elevator Shaft", "2019::LargeOffice::IT_Room", "2019::LargeOffice::Lobby", "2019::LargeOffice::Main Electrical", "2019::LargeOffice::Main Mechanical", "2019::LargeOffice::OfficeLarge Data Center", "2019::LargeOffice::OfficeLarge Main Data Center", "2019::LargeOffice::OpenOffice", "2019::LargeOffice::PrintRoom", "2019::LargeOffice::Restroom", "2019::LargeOffice::Stair", "2019::LargeOffice::Storage", "2019::LargeOffice::Vending"}, selected="2019::LargeOffice::Corridor")

# ----
program_type_inputs_calculator_12 = ProgramTypeInputsCalculator(
    units=input_units_selection,
    zone_name=zone_type_name_override_optional_12,
    zone_program=space_program_12,
    leed_baseline=leed_baseline,
    code_baseline=code_baseline,
    number_of_people_per_area=number_of_people_per_area_12,
    lighting_density_per_area=lighting_density_per_area_12,
    equipment_load_per_area=equipment_power_density_12,
    gas_equipment_load_per_area=gas_power_density_12,
    hot_water_load_per_area=hot_water_density_12,
    ventilation_per_person=ventilation_per_person_12,
    ventilation_per_area=ventilation_per_area_12,
    of_lights_with_daylight_control=daylight_control_12,
    conditioned=conditioned_12,
    heating_setpoint=heating_setpoint_12,
    heating_setback=heating_setback_12,
    cooling_setpoint=cooling_setpoint_12,
    cooling_setback=cooling_setback_12,
    humidity_setpoint=humidify_setpoint_12,
    dehumidifysetback=dehumidfy_setpoint_12,
    occupancy_schedule=occupancy_11,
    activity_schedule=activity_11,
    lighting_schedule=lighting_11,
    equipment_schedule=equipment_11,
    gas_equipment_schedule=gas_equipment_11,
    hot_water_schedule=hot_water_11,
    ventilation_schedule=ventilation_11)  # -> load_catagories_2, loads_2, leed_baseline_loads_2, code_baseline_loads_2, program_schedules, program_properties_2, i

# ---- group: Program Loads
load_type_12 = Panel(program_type_inputs_calculator_12.load_catagories_2)
proposed_12 = Panel(program_type_inputs_calculator_12.loads_2)
leed_12 = Panel(program_type_inputs_calculator_12.leed_baseline_loads_2)
code_12 = Panel(program_type_inputs_calculator_12.code_baseline_loads_2)
schedule_12 = Panel(program_type_inputs_calculator_12.program_schedules)

# ----
# Visualize Results
# Instructions: These controls can be used to color code the zones based on energy results.
# 
# Please note that if the energy models were run with ideal loads versus an HVAC system, the energy use numbers will be skewed since the heating and cooling will reflect the thermal load and not the energy consumed to meet the load. Please supply a overall COP value for heating and cooling to give an approximate estimate of energy use. If an HVAC system was used, provide a COP of 1 for both.
# 
# First, select the metric to visualize. For the zone based metrics, chose to color code the entire zone or the floor plane only (the latter may be helpful for reviewing interior zones).
# 
# By default, the results will be calculated as totals for the entire year, but the analysis period component can be used to constrain the results to a segment of the year.
# 
# Modify the min and max for each metric to adjust the scales.
# 
# Use the button to export images of all the options for the selected metric.
visualize_results = ValueList({"None": 0, "Energy Use": 1, "Cooling Load": 2, "Heating Load": 3, "Lighting Load": 4, "All Surfaces Energy Flow": 5, "Opaque Surfaces Energy Flow": 6, "Glazing Surfaces Energy Flow": 7}, selected="Glazing Surfaces Energy Flow")
capture_screen_image_of_all_options = Button()
zone_results = ValueList({"Color Zone": 0, "Color Floor Only": 1}, selected="Color Zone")
normalize_by_floor_area = BooleanToggle(True)
cooling_cop = Panel("1")
heating_cop = Panel("1")
analysisperiod = LBAnalysisPeriod(start_month=1, start_day=1, start_hour=0)  # -> period, hoys, dates; plug-in component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

# ---- group: Energy Visualization Ranges
panel_73 = Panel("""Energy Use
Cooling
Heating
Lighting
All Surfaces Energy Flow
Opaque Surfaces Energy Flow
Glazing Surfaces Energy Flow""")
filter_42 = StreamFilter(Gate=normalize_by_floor_area, Stream0=item_17, Stream1=item_18)
concat_11 = Concatenate(FragmentA=graft(panel_73), FragmentC=" (", FragmentD=filter_42, FragmentE=")")  # -> flatten(Result)
item_34 = ListItem(List=panel_73, Index=visualize_results, Wrap=True)
connected_9 = GetConnectedObjects(Objects=[panel_22, panel_19, panel_21, panel_20, panel_16, panel_18, panel_17])
setpanel_2 = SetPanelProperties(Panel=connected_9, Color=swatch_3, Content=concat_11)

# ---- group: Export Thermal Comfort Images
concat_12 = Concatenate(FragmentB=item_34, JoinSeparator="_")
fly_3 = Ladybug_fly(inputSliders=option, fly=capture_screen_image_of_all_options)  # -> Vviiiiiiiiiizzz; plug-in component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
captureview = LBCaptureView(file_name=concat_12, folder=image_location, height=image_resolution, capture=capture_screen_image_of_all_options)  # -> file; plug-in component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

# ----
# Elevators
# Instructions: Select the calculation method to account for elevator energy.
# 
# Option 1 is to enter the number of elevators and peak load per elevator. Adjust the elevator schedule accordingly to calculate an annual consumption. This calculation is done inside of Energy Plus, so it can take account of time of use energy charges.
# 
# Option 2 is to enter annual energy use calculated externally (www.thyssenkruppelevator.com/Tools/energy-calculator) is a good resource.
elevator_energy_option = ValueList({"None": 0, "Calculate Elevator Energy Use": 1, "Enter Elevator Energy Use from Outside Calculation": 2}, selected="Calculate Elevator Energy Use")
elevator_schedule = Honeybee_ItemSelector({"HOSPITAL BLDG ELEVATORS", "HOSPITAL BLDG ELEVATORS DEFAULT SCHEDULE", "HOSPITAL BLDG ELEVATORS RULE 1 DAY SCHEDULE", "HOSPITAL BLDG ELEVATORS RULE 2 DAY SCHEDULE", "HOSPITAL BLDG ELEVATORS SUMMER DESIGN DAY", "HOSPITAL BLDG ELEVATORS WINTER DESIGN DAY", "LARGE OFFICE BLDG ELEVATORS", "LARGE OFFICE BLDG ELEVATORS DEFAULT SCHEDULE", "LARGE OFFICE BLDG ELEVATORS SUMMER DESIGN DAY", "LARGE OFFICE BLDG ELEVATORS WINTER DESIGN DAY"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}, selected="MIDRISEAPARTMENT BLDG ELEVATORS")
panel_74 = Panel()
peak_load_per_elevator_kw = Panel("20")

# ---- group: Vertical Glazing
units_56 = Panel(item_5)
glass_u_value = Panel("""0
1
2
3""")
parametric_glass_option = ValueList({"Cross Reference Glass Properties": 0, "List of Glass Properties (based on specific glass)": 1}, selected="List of Glass Properties (based on specific glass)")
glass_shgc = Panel("""0.60
0.3
0.27
0.25""")
input = ValueList({"VLT": 0, "LSG": 1}, selected="VLT")
glass_vlt = Panel("""0.7
0.7
0.7
0.7""")

# ---- group: Parametric Engine
parametric_engine = ParametricEngine(
    global_parametric_scheme=expression_3,
    glazing_method=glazing_method,
    parsch=parametric_wwr_option,
    shading_parametric_scheme=parametric_shading_ratio_option,
    master_envelopethermal_parametric_scheme=parametric_envelope_thermal_master_optio,
    assembly_parametric_scheme=parametric_opaque_assembly_option,
    glass_parametric_scheme=parametric_glass_option,
    north_wwr=all_wwr,
    east_wwr=panel_14,
    sourth_wwr=panel_13,
    west_wwr=panel_12,
    north_shadingtype=all_type,
    north_shading_ratio=all_shading,
    east_shadingtype=value_list_3,
    east_shading_ratio=panel_27,
    south_shadingtype=value_list_2,
    sourth_shading_ratio=panel_28,
    west_shadingtype=value_list,
    west_shading_ratio=panel_29,
    wall_u_value=wall,
    wall2_u_value=thermal_bridge,
    roof_u_value=roof,
    exposed_floor_u_value=exposed_floor,
    ground_floor_u_value=slab_on_grade,
    glass_u_value=glass_u_value,
    glass_shgc=glass_shgc,
    glass_vlt=glass_vlt,
    infiltration_rate=infiltration_rate_cfm_ft²_facade,
    custom_variable_1=filter_5,
    custom_variable_2=filter_6,
    custom_variable_3=filter_7,
    custom_variable_4=filter_6,
    custom_variable_5=filter_8,
    custom_variable_6=filter_9,
    custom_variable_7=filter_10,
    custom_variable_8=filter_10,
    option_to_select=option)  # -> number_of_options, north_wwr_2, east_wwr_2, south_wwr, west_wwr_2, north_shading_type, north_shading_ratio_2, east_shading_type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

# ----
split = TextSplit(Text=parametric_engine.custom_variable_1_2, Separators=",")
cull_i_2 = CullIndex(List=split, Indices="0", Wrap=True)
item_35 = ListItem(List=cull_i_2, Index=0, Wrap=True)  # -> Item, Item1, Item2, Item3, Item4, Item5, Item6, Item7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
filter_43 = StreamFilter(Gate=expression, Stream0=parametric_engine.custom_variable_1_2, Stream1=item_35.Item)
filter_44 = StreamFilter(Gate=expression, Stream0=parametric_engine.wall_u_value_2, Stream1=item_35.Item1)
filter_45 = StreamFilter(Gate=expression, Stream0=parametric_engine.roof_u_value_2, Stream1=item_35.Item2)
filter_46 = StreamFilter(Gate=expression, Stream0=parametric_engine.glass_u_value_2, Stream1=item_35.Item3)
filter_47 = StreamFilter(Gate=expression, Stream0=parametric_engine.custom_variable_2_2, Stream1=item_35.Item4)
filter_48 = StreamFilter(Gate=expression, Stream0=parametric_engine.north_shading_ratio_2, Stream1=item_35.Item5)
filter_49 = StreamFilter(Gate=expression, Stream0=parametric_engine.custom_variable_3_2, Stream1=item_35.Item6)
filter_50 = StreamFilter(Gate=expression, Stream0=parametric_engine.custom_variable_4_2, Stream1=item_35.Item7)
filter_51 = StreamFilter(Gate=expression, Stream0=parametric_engine.custom_variable_5_2, Stream1=item_35.Item8)
filter_52 = StreamFilter(Gate=expression, Stream0=parametric_engine.custom_6, Stream1=item_35.Item9)
filter_53 = StreamFilter(Gate=expression, Stream0=parametric_engine.custom_7, Stream1=item_35.Item10)
filter_54 = StreamFilter(Gate=expression, Stream0=parametric_engine.custom_8, Stream1=item_35.Item11)
decision_0_typology = Integer(filter_43)
item_36 = ListItem(List=repeat_2, Index=decision_0_typology, Wrap=True)
item_37 = ListItem(List=repeat, Index=decision_0_typology, Wrap=True)
filter_55 = StreamFilter(Gate=item_37, Stream0=rectangle.Rectangle, Stream1=rectangle_2.Rectangle, Stream2=davidson, Stream3=row_house)
rad = Radians(Degrees=item_36)
item_38 = ListItem(List=panel_3, Index=item_37, Wrap=True)
rotate = Rotate(Geometry=filter_55, Angle=rad, Plane=pt)  # -> Geometry, Transform
item_39 = ListItem(List=panel_4, Index=item_37, Wrap=True)
ft2m_6 = Ft2m(ft=item_39)
item_40 = ListItem(List=panel_5, Index=item_37, Wrap=True)
Z_3 = UnitZ(Factor=ft2m_6)
area_2 = Area(Geometry=rotate.Geometry)  # -> Area, Centroid
boundary = BoundarySurfaces(Edges=rotate.Geometry)
number_of_floors = Number(item_40)
multiplication_2 = Multiplication(A=ft2m_6, B=number_of_floors)
Z_4 = UnitZ(Factor=multiplication_2)
extr = Extrude(Base=boundary, Direction=Z_3)
extr_2 = Extrude(Base=boundary, Direction=Z)
extr_3 = Extrude(Base=boundary, Direction=Z_4)
multiplication_3 = Multiplication(A=area_2.Area, B="10.7639")
debrep = DeconstructBrep(Brep=extr_2)  # -> Faces, Edges, Vertices
num = Number(item_37)
perimcore = BE_PerimeterAndCore(brep_of_floor=extr, perimeter_zone_depth=Slider(5, range=0..10))  # -> perimeter_and_core_zones, interior_walls
debrep_2 = DeconstructBrep(Brep=extr_3)  # -> Faces, Edges, Vertices
expression_6 = Expression(x=num, Expression="If(x=3,1,0)")
area_3 = Area(Geometry=debrep.Faces)  # -> Area, Centroid
series_9 = Series(Start=0, Step=ft2m_6, Count=number_of_floors)
pdecon = Deconstruct(Point=area_3.Centroid)  # -> XComponent, YComponent, ZComponent
Z_5 = UnitZ(Factor=series_9)
repeat_5 = RepeatData(Data="False", Length=expr("x-3", number_of_floors))  # -> flatten(Data)
filter_56 = StreamFilter(Gate=expression_6, Stream0=perimcore.perimeter_and_core_zones, Stream1=extr)
sort = SortList(Keys=pdecon.ZComponent, ValuesA=debrep.Faces)  # -> Keys, ValuesA
rev = ReverseList(List=sort.ValuesA)
expression_7 = Expression(x=number_of_floors, Expression="IF(x>3,1,0)")
move = Move(Geometry=graft(filter_56), Motion=Z_5)  # -> Geometry, Transform
merge_5 = Merge(Data1="True", Data2="True", Data3=repeat_5, Data4="True")
multiplication_4 = Multiplication(A=ft2m_6, B=number_of_floors)
cull_i_3 = CullIndex(List=rev, Indices=Slider(0, range=0..5), Wrap=True)
rotate_2 = Rotate(Geometry=row_house_context, Angle=rad, Plane=pt)  # -> Geometry, Transform
subtraction_2 = Subtraction(A=multiplication_4, B="0.125")
dispatch = Dispatch(List=move.Geometry, DispatchPattern=merge_5)  # -> ListA, ListB
boundary_2 = BoundarySurfaces(Edges=rotate_2.Geometry)
Z_6 = UnitZ(Factor=subtraction_2)
extr_4 = Extrude(Base=boundary_2, Direction=Z_6)
filter_57 = StreamFilter(Gate=expression_7, Stream0=move.Geometry, Stream1=dispatch.ListA)  # -> flatten(Stream)
sunion = SolidUnion(Breps=flatten(dispatch.ListB))

# ---- group: Floor Multiplier
cull_i_4 = CullIndex(List=merge_5, Indices="0", Wrap=True)
lng_2 = ListLength(List=filter_57)
repeat_6 = RepeatData(Data=cull_i_4, Length=lng_2)
expression_8 = Expression(x=repeat_6, y="True", z=number_of_floors, Expression="IF(x=y,1,z-2)")

# ----
filter_58 = StreamFilter(Gate=item_37, Stream3=extr_4)
fmerge = MergeFaces(Brep=sunion)  # -> Breps, Before, After
merge_6 = Merge(Data1=fmerge.Breps, Data2=filter_58)
area_4 = Area(B=move.Geometry, G=input_units_selection, _0=item_2, _1=item)  # -> area_2, area_by_zone, units
division_2 = Division(A=area_4.area_by_zone, B=avg_apartment_size)
division_3 = Division(A=area_4.area_2, B=avg_apartment_size)
cull = CullPattern(List=division_2, CullPattern=merge_5)
cull_2 = CullPattern(List=area_4.area_by_zone, CullPattern=merge_5)

# ---- group: Reference Zones of This Program Type
zones_closed_brep_19 = Brep(filter_57)

# ---- group: Baseline Parameters / Site Information (continued)
contextural_shading = Brep(merge_6)

# ---- group: Adiabatic Conditions
# Instructions: Reference surfaces and BReps that represent the area of  adiabatic conditions touching the exterior envelope such as a conditioned building zone not modelled or adjacent buildings.
adiabatic_surfaces = Brep(merge_6)

# ---- group: Reference Zones of This Program Type
zones_closed_brep_20 = Brep(extr_2)

# ----
peak_load_per_elevator_kw_2 = Panel(item_38)

# ---- group: Ground Adjacent Areas
# Instructions: Reference surfaces and BReps that represent the area of an alternate wall of floor condition that is ground adjacent.
ground_adj_areas = Brep(cull_i_3)

# ---- group: Network and Count Zones
entwine_2 = Entwine(
    Branch00=zones_closed_brep_19,
    Branch01=zones_closed_brep_20,
    Branch02=zones_closed_brep_10,
    Branch03=zones_closed_brep_14,
    Branch04=zones_closed_brep_18,
    Branch05=zones_closed_brep,
    Branch06=zones_closed_brep_4,
    Branch07=zones_closed_brep_7,
    Branch08=zones_closed_brep_11,
    Branch09=zones_closed_brep_15,
    Branch010=zones_closed_brep_2,
    Branch011=zones_closed_brep_5,
    Branch012=zones_closed_brep_8,
    Branch013=zones_closed_brep_12,
    Branch014=zones_closed_brep_16,
    Branch015=zones_closed_brep_3,
    Branch016=zones_closed_brep_6,
    Branch017=zones_closed_brep_9,
    Branch018=zones_closed_brep_13,
    Branch019=zones_closed_brep_17,
    FlattenInputs=True)
null = NullItem(Item=entwine_2)  # -> NullFlags, InvalidFlags, Description
cull_3 = CullPattern(List=entwine_2, CullPattern=invert(null.NullFlags))  # -> simplify(List)
lng_3 = ListLength(List=cull_3)
ma = MassAddition(Input=flatten(lng_3))  # -> Result, PartialResults
number_of_zones_by_program_type = Number(lng_3)
total_number_of_zones = Number(ma.Result)

# ----
decision_1_facade = Integer(filter_44)
decision_2_roof = Integer(filter_45)
decision_3_glass = Integer(filter_46)
decision_4_frame_type = Integer(filter_47)
decision_5_shading = Integer(filter_48)
decision_6_hvac_system = Integer(filter_49)

# ---- group: Thermal Bridge for Through Wall Louver
explode = Explode(Curve=rotate.Geometry, Recursive=True)  # -> Segments, Vertices
len = Length(Curve=explode.Segments)
division_4 = Division(A=len, B="2")
expression_9 = Expression(x=decision_6_hvac_system, Expression="if(x=8,0.5,if(x=9,0.2,0))")
expression_10 = Expression(x=decision_6_hvac_system, Expression="if(x=8,1,if(x=9,0.2,0))")
divide = DivideCurve(Curve=explode.Segments, Count=division_4, Kinks=False)  # -> Points, Tangents, Parameters
shatter = Shatter(Curve=graft(explode.Segments), Parameters=divide.Parameters)
curvepoint = PointOnCurve(shatter, parameter=0.5)
ft2m_7 = Ft2m(ft=expression_9)
ft2m_8 = Ft2m(ft=expression_10)
extr_5 = Extrude(Base=explode.Segments, Direction=Z_3)  # -> graft(Extrusion)
division_5 = Division(A=ft2m_8, B="2")
division_6 = Division(A=ft2m_7, B="2")
Z_7 = UnitZ(Factor=division_6)
move_2 = Move(Geometry=curvepoint, Motion=Z_7)  # -> Geometry, Transform
neg_4 = Negative(Value=division_5)
neg_5 = Negative(Value=division_6)
srf_cp = SurfaceClosestPoint(Point=move_2.Geometry, Surface=extr_5)  # -> Point, UVPoint, Distance
dom = ConstructDomain(DomainStart=neg_4, DomainEnd=division_5)
dom_2 = ConstructDomain(DomainStart=neg_5, DomainEnd=division_6)
evalsrf = EvaluateSurface(Surface=extr_5, Point=srf_cp.UVPoint)  # -> Point, Normal, UDirection, VDirection, Frame
dispatch_2 = Dispatch(List=Z_5, DispatchPattern=merge_5)  # -> ListA, ListB
rectangle_3 = Rectangle(Plane=evalsrf.Frame, XSize=dom, YSize=dom_2, Radius=0)  # -> Rectangle, Length
boundary_3 = BoundarySurfaces(Edges=rectangle_3.Rectangle)  # -> flatten(Surfaces)
expression_11 = Expression(x=decision_6_hvac_system, Expression="if(x=8,1,if(x=9,2,0))")
Z_8 = UnitZ(Factor=dispatch_2.ListA)
move_3 = Move(Geometry=boundary_3, Motion=graft(Z_8))  # -> flatten(Geometry), Transform
filter_59 = StreamFilter(Gate=expression_11, Stream1=move_3.Geometry, Stream2=move_3.Geometry)

# ---- group: Alternate Wall/Thermal Bridge Areas
# Instructions: Reference surfaces and BReps that represent the area of an alternate wall condition or thermal bridge area. These surfaces should be overlaid on the surface of the enclosed zones.
# 
# Please note that for thermal bridge areas, you will have to assign these surfaces to the 'Exclude Surface' container in the Global Glazing Controls below to prevent windows from being autogenerated on these surfaces.
alt_wall_areas = Brep(filter_59)

# ---- group: Intersect Masses
adiabatic_conditions = Brep(flatten(adiabatic_surfaces))
ground_adjacent = Brep(flatten(ground_adj_areas))
alternative_wall = Brep(flatten(alt_wall_areas))
doors = Brep(flatten(door_surfaces))
null_2 = NullItem(Item=adiabatic_conditions)  # -> NullFlags, InvalidFlags, Description
null_3 = NullItem(Item=ground_adjacent)  # -> NullFlags, InvalidFlags, Description
null_4 = NullItem(Item=doors)  # -> NullFlags, InvalidFlags, Description
null_5 = NullItem(Item=alternative_wall)  # -> NullFlags, InvalidFlags, Description
combined_zones = Brep(flatten(cull_3))
cull_4 = CullPattern(List=adiabatic_conditions, CullPattern=invert(null_2.NullFlags))  # -> simplify(List)
cull_5 = CullPattern(List=ground_adjacent, CullPattern=invert(null_3.NullFlags))  # -> simplify(List)
cull_6 = CullPattern(List=doors, CullPattern=invert(null_4.NullFlags))  # -> simplify(List)
cull_7 = CullPattern(List=alternative_wall, CullPattern=invert(null_5.NullFlags))  # -> simplify(List)
merge_7 = Merge(Data1=combined_zones, Data2=cull_4, Data3=cull_5, Data4=cull_7)
intsolid = HBIntersectSolids(solids=flatten(merge_7), run=Toggle(True))  # -> int_solids; plug-in component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
split_2 = SplitList(List=intsolid, Index=ma.Result)  # -> ListA, ListB

# ----
decision_7_dhw_system = Integer(filter_50)
decision_8_renewable_energy = Integer(filter_51)
decision_9_ventilation = Integer(filter_52)
decision_10_plumbing_fixtures = Integer(filter_53)
item_41 = ListItem(List=panel_6, Index=decision_10_plumbing_fixtures, Wrap=True)
gallons_per_apt_per_day = Panel(item_41)
multiplication_5 = Multiplication(A=division_3, B=gallons_per_apt_per_day)  # -> flatten(Result)

# ---- group: Proposed (continued)
panel_75 = Panel(multiplication_5)

# ----
shw_format = SHWFormat(
    units=input_units_selection,
    proposed_daily_total=panel_75,
    baseline_daily_total=panel_8,
    building_use=building_type,
    weekends=apply_to)  # -> proposed_peak_flow_2, baseline_peak_flow_2, weekday_schedule_2, weekend_schedule_2

# ---- group: Use this Cluster to Customize SHW System
ironbug_shw_definitions = IronbugSHWDefinitions(
    units=input_units_selection,
    fuel=heater_fuel_type,
    supply_temp="140",
    proposed_peak_flow=shw_format.proposed_peak_flow_2,
    proposed_efficiency=panel_68,
    baseline_peak_flow=shw_format.baseline_peak_flow_2,
    baseline_efficiency=panel_11,
    weekday_schedule=shw_format.weekday_schedule_2,
    weekend_schedule=shw_format.weekend_schedule_2,
    tank_units=units_50,
    tank_volume="0")  # -> proposed_shw_system, baseline_shw_system

# ----
decision_11_cooking = Integer(filter_54)
item_42 = ListItem(List=glass_shgc, Index=decision_4_frame_type, Wrap=True)
item_43 = ListItem(List=glass_vlt, Index=decision_4_frame_type, Wrap=True)
item_44 = ListItem(List=glass_u_values, Index=decision_3_glass, Wrap=True)

# ---- group: Air Curtains
expression_12 = Expression(x=decision_9_ventilation, Expression="if(x=2,1,if(x=4,1,if(x=6,1,0)))")
air_curtains = Integer(expression_12)
expression_13 = Expression(x=air_curtains, Expression="if(x=1,0.98,1)")

# ----
item_45 = ListItem(List=uip2usi, Index=decision_4_frame_type, Wrap=True)

# ---- group: Added Inflitration for Through the Wall Units
expression_14 = Expression(x=decision_6_hvac_system, Expression="if(x=9,1.05,if(x=10,1.1,1))")

# ---- group: Base Infiltration Rate Based on Facade
expression_15 = Expression(x=decision_1_facade, Expression="if(x=0,0,1)")
panel_76 = Panel("""0.4
0.056102""")
item_46 = ListItem(List=panel_76, Index=expression_15, Wrap=True)

# ---- group: Infiltration Based on Window Type
expression_16 = Expression(x=decision_4_frame_type, y=parametric_engine.north_wwr_2, Expression="if(x=2,0.1,if(x=4,0.1,0.2))")
expression_17 = Expression(x=item_46, y=parametric_engine.north_wwr_2, z=expression_16, Expression="(x*(1-y))+(y*z)")

# ----
merge_8 = Merge(
    Data1=flatten(decision_0_typology),
    Data2=flatten(decision_1_facade),
    Data3=flatten(decision_2_roof),
    Data4=flatten(decision_3_glass),
    Data5=flatten(decision_4_frame_type),
    Data6=flatten(decision_5_shading),
    Data7=flatten(decision_6_hvac_system),
    Data8=flatten(decision_7_dhw_system),
    Data9=flatten(decision_8_renewable_energy),
    Data10=flatten(decision_9_ventilation),
    Data11=flatten(decision_10_plumbing_fixtures),
    Data12=flatten(decision_11_cooking))
multiplication_6 = Multiplication(A=expression_17, B=expression_14, C=expression_13)

# ---- group: Automatically Update Option Slider Max
# Metahopper Controls
connected_10 = GetConnectedObjects(Objects=option)
dom_3 = ConstructDomain(DomainStart="1", DomainEnd=parametric_engine.number_of_options)
set_slider = SetSliderProperties(Slider=connected_10, Range=dom_3, Type=1)

# ----
roomsolid = HBRoomFromSolid(geo=flatten(move.Geometry), conditioned=True)  # -> report, rooms; plug-in component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
solveadj = HBSolveAdjacency(rooms=flatten(roomsolid.rooms), run=build_model)  # -> report, adj_rooms; plug-in component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

# ---- group: Generate Window Surfaces by WWR
north_wwr = Number(parametric_engine.north_wwr_2)
east_wwr = Number(parametric_engine.east_wwr_2)
south_wwr = Number(parametric_engine.south_wwr)
west_wwr = Number(parametric_engine.west_wwr_2)
merge_9 = Merge(Data1=flatten(north_wwr), Data2=flatten(east_wwr), Data3=flatten(south_wwr), Data4=flatten(west_wwr))
aperturesbyratio = HBAperturesByRatio(hb_objs=flatten(solveadj.adj_rooms), ratio=merge_9, subdivide=Toggle(True), win_height="1.5", horiz_separ="2")  # -> report, hb_objs; plug-in component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
decnstrobj = HBDeconstructObject(hb_obj=aperturesbyratio.hb_objs)  # -> faces, apertures, doors, shades; plug-in component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
vizwiref = HBVisualizeWireframe(hb_objs=flatten(decnstrobj.apertures))  # -> geo; plug-in component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
boundary_4 = BoundarySurfaces(Edges=vizwiref)

# ---- group: Exterior Wall
number_slider = Slider(0.8, range=0..1)
subtraction_3 = Subtraction(A="1", B=number_slider)
merge_10 = Merge(Data1=subtraction_3, Data2=number_slider)
panel_77 = Panel("""1
1
2
3
4
4
4""")
panel_78 = Panel("""0.150
0.044""")
panel_79 = Panel("""680
25""")
panel_80 = Panel("""1200
880""")
num_2 = Number(merge_10)
item_47 = ListItem(List=panel_77, Index=parametric_engine.wall_u_value_2, Wrap=True)
in2m = In2m(in="2.5")
in2m_2 = In2m(in="1")
num_3 = Number(panel_78)
num_4 = Number(panel_80)
num_5 = Number(panel_79)
in2m_3 = In2m(in="10")
searchmats_3 = HBSearchMaterials(keywords="Gypsum")  # -> opaque_mats, window_mats; plug-in component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
in2m_4 = In2m(in=item_47)
rep_2 = ReplaceText(Text="Xin_MineralWool ", Find="X", Replace=item_47, RecursiveReplace=False)
wav = WeightedAverage(Input=num_3, Weights=num_2)
wav_2 = WeightedAverage(Input=num_5, Weights=num_2)
wav_3 = WeightedAverage(Input=num_4, Weights=num_2)
panel_81 = Panel("0.035")
panel_82 = Panel("35")
panel_83 = Panel("1000")
opaquemat = HBOpaqueMaterial(name="10in_Masonry", thickness=in2m_3, conductivity="0.380", density="1200", spec_heat="800")  # -> mat; plug-in component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
opaquemat_2 = HBOpaqueMaterial(name=rep_2, thickness=in2m_4, conductivity=panel_81, density=panel_82, spec_heat=panel_83)  # -> mat; plug-in component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
opaquemat_3 = HBOpaqueMaterial(name="2.5in_FramingWithBatt", thickness=in2m, conductivity=wav, density=wav_2, spec_heat=wav_3)  # -> mat; plug-in component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
opaquemat_4 = HBOpaqueMaterial(name="1in_FoamInsulation", thickness=in2m_2, conductivity="0.024", density="30", spec_heat="1400")  # -> mat; plug-in component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
item_48 = ListItem(List=searchmats_3.opaque_mats, Index="2", Wrap=True)
merge_11 = Merge(Data1=flatten(opaquemat), Data2=flatten(searchmats.opaque_mats))
merge_12 = Merge(Data1=flatten(opaquemat_2), Data2=flatten(opaquemat), Data3=flatten(searchmats.opaque_mats))
merge_13 = Merge(Data1=flatten(opaquemat), Data2=flatten(searchmats.opaque_mats), Data3=flatten(opaquemat_3), Data4=flatten(item_48))
merge_14 = Merge(
    Data1=flatten(opaquemat),
    Data2=flatten(searchmats.opaque_mats),
    Data3=flatten(opaquemat_4),
    Data4=flatten(opaquemat_3),
    Data5=flatten(item_48))
opaqueconstr = HBOpaqueConstruction(name="Existing_Wall", materials=merge_11)  # -> constr; plug-in component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
opaqueconstr_2 = HBOpaqueConstruction(name="Added_Ext_Ins", materials=merge_12)  # -> constr; plug-in component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
opaqueconstr_3 = HBOpaqueConstruction(name="Added_Int_Ins_01", materials=merge_13)  # -> constr; plug-in component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
opaqueconstr_4 = HBOpaqueConstruction(name="Added_Int_Ins_02", materials=merge_14)  # -> constr; plug-in component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
filter_60 = StreamFilter(
    Gate=parametric_engine.wall_u_value_2,
    Stream0=opaqueconstr,
    Stream1=opaqueconstr_2,
    Stream2=opaqueconstr_2,
    Stream3=opaqueconstr_2,
    Stream4=opaqueconstr_2,
    Stream5=opaqueconstr_3,
    Stream6=opaqueconstr_4)
decnstrconstr = HBDeconstructConstruction(constr=filter_60)  # -> materials, layers, r_val_si, r_val_ip, u_fac_si, u_fac_ip, shgc, t_sol, t_vis; plug-in component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

# ---- group: Roof Materials
expression_18 = Expression(x=parametric_engine.roof_u_value_2, Expression="If(x=1,1,0)")
in2m_5 = In2m(in="6")
in2m_6 = In2m(in="1.5")
in2m_7 = In2m(in="6")
panel_84 = Panel("""0.7
0.3""")
searchmats_4 = HBSearchMaterials(keywords="8 Concrete")  # -> opaque_mats, window_mats; plug-in component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
item_49 = ListItem(List=panel_84, Index=expression_18, Wrap=True)
opaquemat_5 = HBOpaqueMaterial(name="CI_Above_Deck", thickness=in2m_5, conductivity="0.026", density="25", spec_heat="1400", sol_absp="0.3")  # -> mat; plug-in component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
opaquemat_6 = HBOpaqueMaterial(name="Existing_Roof_Ins", thickness=in2m_6, conductivity="0.031", density="25", spec_heat="1400", sol_absp=item_49)  # -> mat; plug-in component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
opaquemat_7 = HBOpaqueMaterial(name="6in_MineralWool ", thickness=in2m_7, conductivity=panel_81, density=panel_82, spec_heat=panel_83)  # -> mat; plug-in component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
item_50 = ListItem(List=searchmats_4.opaque_mats, Index="5", Wrap=True)
panel_85 = Panel("""Existing_Roof
Existing_Roof_Improved_SRI""")
merge_15 = Merge(Data1=flatten(opaquemat_6), Data2=flatten(item_50))
item_51 = ListItem(List=panel_85, Index=expression_18, Wrap=True)
merge_16 = Merge(Data1=flatten(opaquemat_5), Data2=flatten(item_50))
merge_17 = Merge(Data1=flatten(opaquemat_6), Data2=flatten(item_50), Data3=flatten(opaquemat_7))
opaqueconstr_5 = HBOpaqueConstruction(name=item_51, materials=merge_15)  # -> constr; plug-in component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
opaqueconstr_6 = HBOpaqueConstruction(name="Above_Deck_Improved_Roof", materials=merge_16)  # -> constr; plug-in component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
opaqueconstr_7 = HBOpaqueConstruction(name="Below_Deck_Improved_Roof", materials=merge_17)  # -> constr; plug-in component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
filter_61 = StreamFilter(
    Gate=parametric_engine.roof_u_value_2,
    Stream0=opaqueconstr_5,
    Stream1=opaqueconstr_5,
    Stream2=opaqueconstr_6,
    Stream3=opaqueconstr_7)
decnstrconstr_2 = HBDeconstructConstruction(constr=filter_61)  # -> materials, layers, r_val_si, r_val_ip, u_fac_si, u_fac_ip, shgc, t_sol, t_vis; plug-in component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

# ---- group: Combo Panel
connected_11 = GetConnectedObjects(Objects=panel_30)
setpanel_3 = SetPanelProperties(Panel=connected_11, Color=swatch_3, Font="Arial", Content=parametric_engine.number_of_options, FontSize="150")

# ---- group: Exclude Windows from Certain Surfaces
merge_18 = Merge(Data1=flatten(exclude_surfaces), Data2=flatten(adiabatic_surfaces), Data3=flatten(ground_adj_areas))
winmod = WinMod(window_surfaces=boundary_4, surfaces=merge_18)  # -> windows, boolean_pattern

# ---- group: Glass Panel
panel_86 = Panel("""Glass VLT
Glass LSG""")
connected_12 = GetConnectedObjects(Objects=glass_vlt)
item_52 = ListItem(List=panel_86, Index=input, Wrap=True)
setpanel_4 = SetPanelProperties(Panel=connected_12, NickName=item_52)

# ---- group: Selects Window Surfaces to Add
merge_19 = Merge(Data1=flatten(winmod.windows), Data2=flatten(custom_window_surfaces))
filter_62 = StreamFilter(Gate=glazing_method, Stream0=winmod.windows, Stream1=custom_window_surfaces, Stream2=merge_19)

# ----
elements = BE_GeometryElementSeperator(brep=filter_62, roof_angle="45")  # -> wall_surfaces, wall_frame, wall_normal, roof_surfaces, roof_frame, roof_normal, floor_surfaces

# ---- group: Door Surfaces
door = HBDoor(geo=cull_6)  # -> report, doors; plug-in component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
null_6 = NullItem(Item=door.doors)  # -> NullFlags, InvalidFlags, Description
cull_8 = CullPattern(List=door.doors, CullPattern=invert(null_6.NullFlags))

# ---- group: Window Surfaces
lng_4 = ListLength(List=filter_62)
colom = CollisionOneMany(Collider=operable_window_s_or_guide_surface_s, Obstacles=filter_62)  # -> Collision, Index
repeat_7 = RepeatData(Data="False", Length=lng_4)
replace_5 = ReplaceItems(List=repeat_7, Item="True", Indices=colom.Index, Wrap=False)
aperture = HBAperture(geo=filter_62, operable=replace_5)  # -> report, apertures; plug-in component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

# ---- group: Construction U-Values
wall_u_value = Number(parametric_engine.wall_u_value_2)
wall_2_u_value = Number(parametric_engine.wall2_u_value_2)
roof_u_value = Number(parametric_engine.roof_u_value_2)
exposed_floor_u_value = Number(parametric_engine.floor_u_value)
glass_u_value_2 = Number(item_44)
skylight_u_value = Number(parametric_engine.glass_u_value_2)
below_grade_wall = Number(below_grade_walls)
slab_on_grade_2 = Number(parametric_engine.ground_floor_u_value_2)
panel_87 = Panel("Btu/h-ft2-F")
panel_88 = Panel("W/m2-K")
merge_20 = Merge(
    Data1=flatten(wall_u_value),
    Data2=flatten(wall_2_u_value),
    Data3=flatten(roof_u_value),
    Data4=flatten(exposed_floor_u_value),
    Data5=flatten(glass_u_value_2),
    Data6=flatten(skylight_u_value),
    Data7=flatten(below_grade_wall),
    Data8=flatten(slab_on_grade_2))
units_57 = LBUnitConverter(values=merge_20, from_u=panel_87, to_u=panel_88)  # -> all_u, values; plug-in component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
filter_63 = StreamFilter(Gate=input_units_selection, Stream0=merge_20, Stream1=units_57.values)
item_53 = ListItem(List=filter_63, Index=0, Wrap=True)  # -> Item, Item1, Item2, Item3, Item4, Item5, Item6, Item7

# ----
division_7 = Division(A="1.5", B=decision_5_shading)
division_8 = Division(A="1.5", B=parametric_engine.east_sr)
division_9 = Division(A="1.5", B=parametric_engine.south_shading_ratio)
division_10 = Division(A="1.5", B=parametric_engine.west_shading_ratio_2)

# ---- group: Glass Window Framing Derating List
units_58 = LBUnitConverter(values=frame_type, from_u=panel_88, to_u=panel_87)  # -> all_u, values; plug-in component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
filter_64 = StreamFilter(Gate=input_units_selection, Stream0=frame_type, Stream1=units_58.values)
expression_19 = Expression(x=percentage_frame, y=filter_64, z=item_45, Expression="(x*y)+((1-x)*z)")

# ----
assembly_u_value = Panel(expression_19)
expression_20 = Expression(x=decision_6_hvac_system, Expression="if(x=8,1,IF(x=11,2,IF(x=12,3,IF(x=13,3,0))))")
nullrep = ReplaceNulls(Items=division_7, Replacements="0")  # -> Items, Count
nullrep_2 = ReplaceNulls(Items=division_8, Replacements="0")  # -> Items, Count
nullrep_3 = ReplaceNulls(Items=division_9, Replacements="0")  # -> Items, Count
nullrep_4 = ReplaceNulls(Items=division_10, Replacements="0")  # -> Items, Count

# ---- group: Sort Windows By Orientation
sort_2 = Sort(north_vector_rotation=north_arrow_rotation_deg_clockwise, surfaces=filter_62)  # -> north_surfaces, east_surfaces, south_surfaces, west_surfaces

# ----
ft2m_9 = Ft2m(ft=nullrep.Items)
ft2m_10 = Ft2m(ft=nullrep_2.Items)
ft2m_11 = Ft2m(ft=nullrep_3.Items)
ft2m_12 = Ft2m(ft=nullrep_4.Items)

# ---- group: Elevator and Escalator
panel_89 = Panel("""Enter Annual Elevator Energy (kWh)
Number of Elevators
Peak Load Per Elevator (kW)""")
panel_90 = Panel("""0
1
2""")
panel_91 = Panel("""1
2""")
connected_13 = GetConnectedObjects(Objects=peak_load_per_elevator_kw_2)
connected_14 = GetConnectedObjects(Objects=peak_load_per_elevator_kw)
connected_15 = GetConnectedObjects(Objects=panel_74)
filter_65 = StreamFilter(Gate=elevator_energy_option, Stream0=panel_90, Stream1="0", Stream2=panel_91)
merge_21 = Merge(Data1=swatch, Data2=swatch, Data3=swatch)
merge_22 = Merge(Data1=connected_15, Data2=connected_13, Data3=connected_14)
replace_6 = ReplaceItems(List=panel_89, Item="N/A", Indices=filter_65, Wrap=False)
replace_7 = ReplaceItems(List=merge_21, Item=swatch_2, Indices=filter_65, Wrap=False)
setpanel_5 = SetPanelProperties(Panel=merge_22, NickName=replace_6, Color=replace_7)

# ----
item_54 = ListItem(List=panel_38, Index=expression_20, Wrap=True)

# ---- group: Skylight Window Construction
glass_shgc_2 = Number(item_42)
glass_vlt_2 = Number(item_43)
expression_21 = Expression(x=percentage_frame, y=frame_type, z=item_53.Item5, Expression="(x*y)+((1-x)*z)")
multiplication_7 = Multiplication(A=glass_shgc_2, B=glass_vlt_2)
filter_66 = StreamFilter(Gate=input, Stream0=glass_vlt_2, Stream1=multiplication_7)
windowmat = HBWindowMaterial(name="Skylight_Glass", u_factor=expression_21, shgc=glass_shgc_2, t_vis=filter_66)  # -> mat; plug-in component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
windowconstr = HBWindowConstruction(name="Skylight_Glass", materials=windowmat)  # -> constr; plug-in component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

# ---- group: Glass Window Construction
glass_shgc_3 = Number(item_42)
glass_vlt_3 = Number(item_43)
multiplication_8 = Multiplication(A=glass_shgc_3, B=glass_vlt_3)
expression_22 = Expression(x=percentage_frame, y=item_45, z=item_53.Item4, Expression="(x*y)+((1-x)*z)")
filter_67 = StreamFilter(Gate=input, Stream0=glass_vlt_3, Stream1=multiplication_8)
division_11 = Division(A=filter_67, B=glass_shgc_3)
windowmat_2 = HBWindowMaterial(name="Glass_Window", u_factor=expression_22, shgc=glass_shgc_3, t_vis=filter_67)  # -> mat; plug-in component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
windowconstr_2 = HBWindowConstruction(name="Glass_Window", materials=windowmat_2)  # -> constr; plug-in component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

# ----
sort_3 = Sort(north_vector_rotation=north_arrow_rotation_deg_clockwise, surfaces=boundary_4)  # -> north_surfaces, east_surfaces, south_surfaces, west_surfaces
sort_4 = Sort(north_vector_rotation=north_arrow_rotation_deg_clockwise, surfaces=debrep_2.Faces)  # -> north_surfaces, east_surfaces, south_surfaces, west_surfaces

# ---- group: Opaque Wall 2 / Thermal Bridge Thermal Construction
division_12 = Division(A="1", B=item_53.Item1)
opaquematnomass = HBOpaqueMaterialNoMass(name="Opaque_Wall_2", r_value=division_12)  # -> mat; plug-in component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
opaqueconstr_8 = HBOpaqueConstruction(name="Opaque_Wall_2", materials=opaquematnomass)  # -> constr; plug-in component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

# ---- group: Opaque Wall Thermal Construction
division_13 = Division(A="1", B=item_53.Item)
opaquematnomass_2 = HBOpaqueMaterialNoMass(name="Opaque_Wall", r_value=division_13)  # -> mat; plug-in component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
opaqueconstr_9 = HBOpaqueConstruction(name="Opaque_Wall", materials=opaquematnomass_2)  # -> constr; plug-in component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

# ---- group: Roof Thermal Construction
division_14 = Division(A="1", B=item_53.Item2)
opaquematnomass_3 = HBOpaqueMaterialNoMass(name="Roof", r_value=division_14)  # -> mat; plug-in component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
opaqueconstr_10 = HBOpaqueConstruction(name="Roof", materials=opaquematnomass_3)  # -> constr; plug-in component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

# ---- group: Exposed Floor Thermal Construction
division_15 = Division(A="1", B=item_53.Item3)
opaquematnomass_4 = HBOpaqueMaterialNoMass(name="Floor", r_value=division_15)  # -> mat; plug-in component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
opaqueconstr_11 = HBOpaqueConstruction(name="Floor", materials=opaquematnomass_4)  # -> constr; plug-in component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

# ---- group: Below Grade Wall Thermal Construction
division_16 = Division(A="1", B=item_53.Item6)
opaquematnomass_5 = HBOpaqueMaterialNoMass(name="Below_Grade_Wall", r_value=division_16)  # -> mat; plug-in component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
opaqueconstr_12 = HBOpaqueConstruction(name="Below_Grade_Wall", materials=opaquematnomass_5)  # -> constr; plug-in component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

# ---- group: Slab on Grade Thermal Construction
division_17 = Division(A="1", B=item_53.Item7)
opaquematnomass_6 = HBOpaqueMaterialNoMass(name="Slab_On_Grade", r_value=division_17)  # -> mat; plug-in component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
opaqueconstr_13 = HBOpaqueConstruction(name="Slab_On_Grade", materials=opaquematnomass_6)  # -> constr; plug-in component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

# ----
evalsrf_2 = EvaluateSurface(Surface=sort_4.south_surfaces, Point=md_slider)  # -> Point, Normal, UDirection, VDirection, Frame
evalsrf_3 = EvaluateSurface(Surface=sort_3.south_surfaces, Point=md_slider)  # -> Point, Normal, UDirection, VDirection, Frame
amp = Amplitude(Vector=evalsrf_2.Normal, Amplitude=".125")
move_4 = Move(Geometry=sort_4.south_surfaces, Motion=amp)  # -> Geometry, Transform
amp_2 = Amplitude(Vector=evalsrf_3.Normal, Amplitude=1)
extr_6 = Extrude(Base=sort_3.south_surfaces, Direction=amp_2)
trim = TrimSolid(Shape=move_4.Geometry, Cutters=extr_6)
expression_23 = Expression(x=decision_8_renewable_energy, Expression="if(x=3,1,0)")
subfacesubset = HBSubfaceSubset(window=windowconstr_2, skylight=windowconstr)  # -> subface_set; plug-in component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
exteriorsubset = HBExteriorConstructionSubset(exterior_wall=filter_60, exterior_roof=filter_61, exposed_floor=opaqueconstr_11)  # -> exterior_set; plug-in component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
groundsubset = HBGroundConstructionSubset(ground_wall=opaqueconstr_12, ground_floor=opaqueconstr_13)  # -> ground_set; plug-in component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
item_55 = ListItem(List=panel_44, Index=decision_8_renewable_energy, Wrap=True)

# ---- group: Elevator Calculation
end_use_2 = ValueList({"Exterior Lighting": 0, "Elevators": 1, "Exterior Equipment": 1}, selected="Exterior Equipment")
panel_92 = Panel("Elevators")
fuel_7 = ValueList({"Electricity", "Gas", "DistrictCooling", "DistrictHeating"}, selected="Electricity")
expression_24 = Expression(x=peak_load_per_elevator_kw_2, y=peak_load_per_elevator_kw, Expression="x*y*1000")
exterior_energy_3 = ExteriorEnergy(exterior_equipment_type=end_use_2, name=panel_92, fuel=fuel_7, peak_watts=expression_24)
filter_68 = StreamFilter(Gate=elevator_energy_option, Stream2=panel_74)
filter_69 = StreamFilter(Gate=elevator_energy_option, Stream1=exterior_energy_3)

# ----
panel_93 = Panel(filter_69)
expression_25 = Expression(x=decision_11_cooking, Expression="if(x=1,\"Electricity\",\"NaturalGas\")")
item_56 = ListItem(List=panel_48, Index=decision_11_cooking, Wrap=True)
item_57 = ListItem(List=panel_49, Index=decision_11_cooking, Wrap=True)
item_58 = ListItem(List=panel_50, Index=decision_11_cooking, Wrap=True)
multiplication_9 = Multiplication(A=cull_2, B=item_56)
user_inputs = UserInputs(user_input_1=decision_0_typology)
# Read and Calculate Results
setup_runs_2 = SetupRuns(
    AllToBuildings_="buildings-only",
    ExistingToContext_="existing-to-context",
    SeparateTopBottom_="separate-top-bottom",
    ShadeDist_="50m",
    Units_="si",
    Use_multiplier_="False",
    WindowRatio_="0.4",
    _user_inputs_=user_inputs,
    Owner="ladybug-tools",
    RecipeJsonString="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",
    project="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")
weekday_schedule = Number(shw_format.weekday_schedule_2)
proposed_peak_flow = Number(shw_format.proposed_peak_flow_2)
pollinate = Pollinate(_runs=flatten(setup_runs_2), CPUNumber=6, IfEnabledRemoteRun=False, RunLocal=False, liveUpdateStatus=True)

# ---- group: Schedules
toggle_4 = BooleanToggle(True)
toggle_5 = BooleanToggle(True)
objparams_2 = IB_ObjParams(
    ApplyFriday=toggle_4,
    ApplyMonday=toggle_4,
    ApplySaturday=toggle_4,
    ApplySunday=toggle_4,
    ApplyThursday=toggle_4,
    ApplyTuesday=toggle_4,
    ApplyWednesday=toggle_4,
    DataFieldSetType="Ironbug.HVAC.Schedules.IB_ScheduleRule_FieldSet")
objparams_3 = IB_ObjParams(
    ApplyFriday=toggle_5,
    ApplyMonday=toggle_5,
    ApplySaturday=toggle_5,
    ApplySunday=toggle_5,
    ApplyThursday=toggle_5,
    ApplyTuesday=toggle_5,
    ApplyWednesday=toggle_5,
    DataFieldSetType="Ironbug.HVAC.Schedules.IB_ScheduleRule_FieldSet")
schedulerule = Ironbug_ScheduleRule(Values=weekday_schedule, Parameters_=objparams_2, dupNum=False)
schedulerule_2 = Ironbug_ScheduleRule(Values=filter_40, Parameters_=objparams_3, dupNum=False)
schedule_13 = Ironbug_Schedule(ScheduleName="Hot Supply Temp Sched", ValuesOrRules=schedulerule_2)
schedule_14 = Ironbug_Schedule(ScheduleName="DHW", ValuesOrRules=schedulerule)
objparams_4 = IB_ObjParams(HotWaterSupplyTemperatureSchedule=schedule_13, DataFieldSetType="Ironbug.HVAC.IB_WaterUseConnections_FieldSet")
objparams_5 = IB_ObjParams(FlowRateFractionSchedule=schedule_14, DataFieldSetType="Ironbug.HVAC.IB_WaterUseEquipment_FieldSet")

# ---- group: Water Demand
wateruseload = Ironbug_WaterUseEquipmentDefinition(PeakFlowRate=proposed_peak_flow, dupNum=False)
wateruseequipment = Ironbug_WaterUseEquipment(WaterUseLoad=wateruseload, Parameters_=objparams_5, dupNum=False)
wateruseconnections = Ironbug_WaterUseConnections(WaterUseEquipment=wateruseequipment, Parameters_=[objparams_4, outputparams], dupNum=False)

# ---- group: Exhaust Ventilation
cfm_per_apartment = Panel("100")
multiplication_10 = Multiplication(A=cfm_per_apartment, B=cull)
cfm2m3s = Ladybug_Cfm2M3s(cfm=multiplication_10)  # -> m3_s; plug-in component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

# ----
panel_94 = Panel("""DHW Heat Pump
Electric Instantaneous Water Heater""")
ma_2 = MassAddition(Input=cull)  # -> Result, PartialResults
round_2 = Round(Number=ma_2.Result)  # -> Nearest, Floor, Ceiling
item_59 = ListItem(List=panel_94, Index=0, Wrap=True)  # -> Item, Item1
series_10 = Series(Start="1", Step=1, Count=round_2.Nearest)
concat_13 = Concatenate(FragmentA="Tenant", FragmentB=item_59.Item, FragmentC=series_10, JoinSeparator=" ")
concat_14 = Concatenate(FragmentA="Tenant", FragmentB=item_59.Item1, FragmentC=series_10, JoinSeparator=" ")

# ---- group: Gas Boiler Efficiency Curves
objparams_6 = IB_ObjParams(
    MaximumValueofx="1",
    MaximumValueofy="20",
    MinimumValueofx="0.1",
    MinimumValueofy="20",
    Name="NonCondensingBoilerEff",
    DataFieldSetType="Ironbug.HVAC.Curves.IB_CurveBicubic_FieldSet")
panel_95 = Panel("""1.111720116
0.078614078
-0.400425756
0.0
-0.000156783
0.009384599
0.234257955
1.32927E-06
-0.004446701
-1.22498E-05""")
expression_26 = Expression(x=decision_6_hvac_system, Expression="if(x=7,0,1)")
curvebicubic = IB_CurveBicubic(Coefficients=panel_95, Parameters_=objparams_6, dupNum=False)
filter_70 = StreamFilter(Gate=expression_26, Stream1=curvebicubic)

# ---- group: Central Dedicated DHW Boiler
expression_27 = Expression(x=decision_7_dhw_system, Expression="if(x=2,\"New Electric DHW Boiler\",\"New Natural Gas DHW Boiler\")")
expression_28 = Expression(x=decision_7_dhw_system, Expression="if(x=2,\"Electricity\",\"NaturalGas\")")
expression_29 = Expression(x=decision_7_dhw_system, Expression="if(x=2,1,0.96)")
objparams_7 = IB_ObjParams(
    FuelType=expression_28,
    Name=expression_27,
    NominalThermalEfficiency=expression_29,
    DataFieldSetType="Ironbug.HVAC.IB_BoilerHotWater_FieldSet")
boiler = Ironbug_BoilerHotWater(Parameters_=objparams_7, dupNum=False)

# ----
expression_30 = Expression(x=decision_6_hvac_system, Expression="if(x=0,1,0)")
expression_31 = Expression(x=decision_9_ventilation, Expression="if(x=1,1,if(x=2,1,0))")
expression_32 = Expression(x=decision_6_hvac_system, Expression="if(x=3,300,600)")

# ---- group: Individual Tankless
objparams_8 = IB_ObjParams(
    HeaterFuelType="Electricity",
    HeaterThermalEfficiency="1",
    Name=concat_14,
    TankVolume="0",
    DataFieldSetType="Ironbug.HVAC.IB_WaterHeaterMixed_FieldSet")  # -> graft(HVACObjParams)
waterheatermixed = IB_WaterHeaterMixed(Parameters_=objparams_8, dupNum=False)

# ---- group: Area (ft2)
multiplication_11 = Multiplication(A=multiplication_3, B=number_of_floors)

# ----
multiplication_12 = Multiplication(A=multiplication_11, B=multiplication)
filter_71 = StreamFilter(Gate=expression_30, Stream1=multiplication_12)
expression_33 = Expression(x=decision_6_hvac_system, Expression="if(x=8,1,if(x=11,2,0))")
filter_72 = StreamFilter(Gate=expression_33, Stream1="True", Stream2="False")
item_60 = ListItem(List=panel_55, Index=expression_33, Wrap=True)
item_61 = ListItem(List=panel_56, Index=expression_33, Wrap=True)

# ---- group: VRF
vrf_condenser = VRFCondenser(heatpumpwasteheatrecovery=filter_72, cocop=item_60, hecop=item_61)  # -> graft(params)

# ----
objparams_9 = IB_ObjParams(Multiplier=expression_8, DataFieldSetType="Ironbug.HVAC.BaseClass.IB_ThermalZone_FieldSet")
expression_34 = Expression(x=decision_9_ventilation, Expression="if(x=3,1,0)")

# ---- group: Set Building and Space Program
bldgprograms_13 = HBBuildingPrograms({"LargeOffice", "MediumOffice", "SmallOffice", "MidriseApartment", "HighriseApartment", "Retail", "StripMall", "PrimarySchool", "SecondarySchool", "SmallHotel", "LargeHotel", "Hospital", "Outpatient", "Laboratory", "Warehouse", "SuperMarket", "FullServiceRestaurant", "QuickServiceRestaurant", "Courthouse", "LargeDataCenterHighITE", "LargeDataCenterLowITE", "SmallDataCenterHighITE", "SmallDataCenterLowITE"}, selected="LargeOffice")

bldgprograms_14 = HBBuildingPrograms({"LargeOffice", "MediumOffice", "SmallOffice", "MidriseApartment", "HighriseApartment", "Retail", "StripMall", "PrimarySchool", "SecondarySchool", "SmallHotel", "LargeHotel", "Hospital", "Outpatient", "Laboratory", "Warehouse", "SuperMarket", "FullServiceRestaurant", "QuickServiceRestaurant", "Courthouse", "LargeDataCenterHighITE", "LargeDataCenterLowITE", "SmallDataCenterHighITE", "SmallDataCenterLowITE"}, selected="LargeOffice")

bldgprograms_15 = HBBuildingPrograms({"LargeOffice", "MediumOffice", "SmallOffice", "MidriseApartment", "HighriseApartment", "Retail", "StripMall", "PrimarySchool", "SecondarySchool", "SmallHotel", "LargeHotel", "Hospital", "Outpatient", "Laboratory", "Warehouse", "SuperMarket", "FullServiceRestaurant", "QuickServiceRestaurant", "Courthouse", "LargeDataCenterHighITE", "LargeDataCenterLowITE", "SmallDataCenterHighITE", "SmallDataCenterLowITE"}, selected="LargeOffice")

# ----
zone_type_name_override_optional_13 = Panel("")
conditioned_13 = BooleanToggle(True)
searchprog_13 = HBSearchPrograms(bldg_prog=bldgprograms_13)  # -> room_prog; plug-in component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

# ---- group: Set Building and Space Program (continued)
space_program_13 = Honeybee_ItemSelector(
    searchprog_13,
    {"2019::LargeOffice::Attic", "2019::LargeOffice::BreakRoom", "2019::LargeOffice::Classroom", "2019::LargeOffice::ClosedOffice", "2019::LargeOffice::Conference", "2019::LargeOffice::Corridor", "2019::LargeOffice::Dining", "2019::LargeOffice::Elec/MechRoom", "2019::LargeOffice::Elevator Lobby", "2019::LargeOffice::Elevator Machine Room", "2019::LargeOffice::Elevator Shaft", "2019::LargeOffice::IT_Room", "2019::LargeOffice::Lobby", "2019::LargeOffice::Main Electrical", "2019::LargeOffice::Main Mechanical", "2019::LargeOffice::OfficeLarge Data Center", "2019::LargeOffice::OfficeLarge Main Data Center", "2019::LargeOffice::OpenOffice", "2019::LargeOffice::PrintRoom", "2019::LargeOffice::Restroom", "2019::LargeOffice::Stair", "2019::LargeOffice::Storage", "2019::LargeOffice::Vending"}, selected="2019::LargeOffice::Attic")

# ----
program_type_inputs_calculator_13 = ProgramTypeInputsCalculator(
    units=input_units_selection,
    zone_name=zone_type_name_override_optional_13,
    zone_program=space_program_13,
    leed_baseline=leed_baseline,
    code_baseline=code_baseline,
    number_of_people_per_area=number_of_people_per_area_13,
    lighting_density_per_area=lighting_density_per_area_13,
    equipment_load_per_area=equipment_power_density_13,
    gas_equipment_load_per_area=gas_power_density_13,
    hot_water_load_per_area=hot_water_density_13,
    ventilation_per_person=ventilation_per_person_13,
    ventilation_per_area=ventilation_per_area_13,
    of_lights_with_daylight_control=daylight_control_13,
    conditioned=conditioned_13,
    heating_setpoint=heating_setpoint_13,
    heating_setback=heating_setback_13,
    cooling_setpoint=cooling_setpoint_13,
    cooling_setback=cooling_setback_13,
    humidity_setpoint=humidify_setpoint_13,
    dehumidifysetback=dehumidfy_setpoint_13,
    occupancy_schedule=occupancy_12,
    activity_schedule=activity_12,
    lighting_schedule=lighting_12,
    equipment_schedule=equipment_12,
    gas_equipment_schedule=gas_equipment_12,
    hot_water_schedule=hot_water_12,
    ventilation_schedule=ventilation_12)  # -> load_catagories_2, loads_2, leed_baseline_loads_2, code_baseline_loads_2, program_schedules, program_properties_2, i

# ---- group: Program Loads
load_type_13 = Panel(program_type_inputs_calculator_13.load_catagories_2)
proposed_13 = Panel(program_type_inputs_calculator_13.loads_2)
leed_13 = Panel(program_type_inputs_calculator_13.leed_baseline_loads_2)
code_13 = Panel(program_type_inputs_calculator_13.code_baseline_loads_2)
schedule_15 = Panel(program_type_inputs_calculator_13.program_schedules)

# ---- group: Set Building and Space Program
bldgprograms_16 = HBBuildingPrograms({"LargeOffice", "MediumOffice", "SmallOffice", "MidriseApartment", "HighriseApartment", "Retail", "StripMall", "PrimarySchool", "SecondarySchool", "SmallHotel", "LargeHotel", "Hospital", "Outpatient", "Laboratory", "Warehouse", "SuperMarket", "FullServiceRestaurant", "QuickServiceRestaurant", "Courthouse", "LargeDataCenterHighITE", "LargeDataCenterLowITE", "SmallDataCenterHighITE", "SmallDataCenterLowITE"}, selected="LargeOffice")

# ----
zone_type_name_override_optional_14 = Panel("")
conditioned_14 = BooleanToggle(True)
searchprog_14 = HBSearchPrograms(bldg_prog=bldgprograms_14)  # -> room_prog; plug-in component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

# ---- group: Set Building and Space Program (continued)
space_program_14 = Honeybee_ItemSelector(
    searchprog_14,
    {"2019::LargeOffice::Attic", "2019::LargeOffice::BreakRoom", "2019::LargeOffice::Classroom", "2019::LargeOffice::ClosedOffice", "2019::LargeOffice::Conference", "2019::LargeOffice::Corridor", "2019::LargeOffice::Dining", "2019::LargeOffice::Elec/MechRoom", "2019::LargeOffice::Elevator Lobby", "2019::LargeOffice::Elevator Machine Room", "2019::LargeOffice::Elevator Shaft", "2019::LargeOffice::IT_Room", "2019::LargeOffice::Lobby", "2019::LargeOffice::Main Electrical", "2019::LargeOffice::Main Mechanical", "2019::LargeOffice::OfficeLarge Data Center", "2019::LargeOffice::OfficeLarge Main Data Center", "2019::LargeOffice::OpenOffice", "2019::LargeOffice::PrintRoom", "2019::LargeOffice::Restroom", "2019::LargeOffice::Stair", "2019::LargeOffice::Storage", "2019::LargeOffice::Vending"}, selected="2019::LargeOffice::Attic")

# ----
program_type_inputs_calculator_14 = ProgramTypeInputsCalculator(
    units=input_units_selection,
    zone_name=zone_type_name_override_optional_14,
    zone_program=space_program_14,
    leed_baseline=leed_baseline,
    code_baseline=code_baseline,
    number_of_people_per_area=number_of_people_per_area_14,
    lighting_density_per_area=lighting_density_per_area_14,
    equipment_load_per_area=equipment_power_density_14,
    gas_equipment_load_per_area=gas_power_density_14,
    hot_water_load_per_area=hot_water_density_14,
    ventilation_per_person=ventilation_per_person_14,
    ventilation_per_area=ventilation_per_area_14,
    of_lights_with_daylight_control=daylight_control_14,
    conditioned=conditioned_14,
    heating_setpoint=heating_setpoint_14,
    heating_setback=heating_setback_14,
    cooling_setpoint=cooling_setpoint_14,
    cooling_setback=cooling_setback_14,
    humidity_setpoint=humidify_setpoint_14,
    dehumidifysetback=dehumidfy_setpoint_14,
    occupancy_schedule=occupancy_13,
    activity_schedule=activity_13,
    lighting_schedule=lighting_13,
    equipment_schedule=equipment_13,
    gas_equipment_schedule=gas_equipment_13,
    hot_water_schedule=hot_water_13,
    ventilation_schedule=ventilation_13)  # -> load_catagories_2, loads_2, leed_baseline_loads_2, code_baseline_loads_2, program_schedules, program_properties_2, i

# ---- group: Program Loads
load_type_14 = Panel(program_type_inputs_calculator_14.load_catagories_2)
proposed_14 = Panel(program_type_inputs_calculator_14.loads_2)
leed_14 = Panel(program_type_inputs_calculator_14.leed_baseline_loads_2)
code_14 = Panel(program_type_inputs_calculator_14.code_baseline_loads_2)
schedule_16 = Panel(program_type_inputs_calculator_14.program_schedules)

# ----
zone_type_name_override_optional_15 = Panel("")
conditioned_15 = BooleanToggle(True)
searchprog_15 = HBSearchPrograms(bldg_prog=bldgprograms_15)  # -> room_prog; plug-in component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

# ---- group: Set Building and Space Program (continued)
space_program_15 = Honeybee_ItemSelector(
    searchprog_15,
    {"2019::LargeOffice::Attic", "2019::LargeOffice::BreakRoom", "2019::LargeOffice::Classroom", "2019::LargeOffice::ClosedOffice", "2019::LargeOffice::Conference", "2019::LargeOffice::Corridor", "2019::LargeOffice::Dining", "2019::LargeOffice::Elec/MechRoom", "2019::LargeOffice::Elevator Lobby", "2019::LargeOffice::Elevator Machine Room", "2019::LargeOffice::Elevator Shaft", "2019::LargeOffice::IT_Room", "2019::LargeOffice::Lobby", "2019::LargeOffice::Main Electrical", "2019::LargeOffice::Main Mechanical", "2019::LargeOffice::OfficeLarge Data Center", "2019::LargeOffice::OfficeLarge Main Data Center", "2019::LargeOffice::OpenOffice", "2019::LargeOffice::PrintRoom", "2019::LargeOffice::Restroom", "2019::LargeOffice::Stair", "2019::LargeOffice::Storage", "2019::LargeOffice::Vending"}, selected="2019::LargeOffice::Attic")

# ----
program_type_inputs_calculator_15 = ProgramTypeInputsCalculator(
    units=input_units_selection,
    zone_name=zone_type_name_override_optional_15,
    zone_program=space_program_15,
    leed_baseline=leed_baseline,
    code_baseline=code_baseline,
    number_of_people_per_area=number_of_people_per_area_15,
    lighting_density_per_area=lighting_density_per_area_15,
    equipment_load_per_area=equipment_power_density_15,
    gas_equipment_load_per_area=gas_power_density_15,
    hot_water_load_per_area=hot_water_density_15,
    ventilation_per_person=ventilation_per_person_15,
    ventilation_per_area=ventilation_per_area_15,
    of_lights_with_daylight_control=daylight_control_15,
    conditioned=conditioned_15,
    heating_setpoint=heating_setpoint_15,
    heating_setback=heating_setback_15,
    cooling_setpoint=cooling_setpoint_15,
    cooling_setback=cooling_setback_15,
    humidity_setpoint=humidify_setpoint_15,
    dehumidifysetback=dehumidfy_setpoint_15,
    occupancy_schedule=occupancy_14,
    activity_schedule=activity_14,
    lighting_schedule=lighting_14,
    equipment_schedule=equipment_14,
    gas_equipment_schedule=gas_equipment_14,
    hot_water_schedule=hot_water_14,
    ventilation_schedule=ventilation_14)  # -> load_catagories_2, loads_2, leed_baseline_loads_2, code_baseline_loads_2, program_schedules, program_properties_2, i

# ---- group: Program Loads
load_type_15 = Panel(program_type_inputs_calculator_15.load_catagories_2)
proposed_15 = Panel(program_type_inputs_calculator_15.loads_2)
leed_15 = Panel(program_type_inputs_calculator_15.leed_baseline_loads_2)
code_15 = Panel(program_type_inputs_calculator_15.code_baseline_loads_2)
schedule_17 = Panel(program_type_inputs_calculator_15.program_schedules)

# ----
zone_type_name_override_optional_16 = Panel("")
conditioned_16 = BooleanToggle(True)
searchprog_16 = HBSearchPrograms(bldg_prog=bldgprograms_16)  # -> room_prog; plug-in component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

# ---- group: Set Building and Space Program (continued)
space_program_16 = Honeybee_ItemSelector(
    searchprog_16,
    {"2019::LargeOffice::Attic", "2019::LargeOffice::BreakRoom", "2019::LargeOffice::Classroom", "2019::LargeOffice::ClosedOffice", "2019::LargeOffice::Conference", "2019::LargeOffice::Corridor", "2019::LargeOffice::Dining", "2019::LargeOffice::Elec/MechRoom", "2019::LargeOffice::Elevator Lobby", "2019::LargeOffice::Elevator Machine Room", "2019::LargeOffice::Elevator Shaft", "2019::LargeOffice::IT_Room", "2019::LargeOffice::Lobby", "2019::LargeOffice::Main Electrical", "2019::LargeOffice::Main Mechanical", "2019::LargeOffice::OfficeLarge Data Center", "2019::LargeOffice::OfficeLarge Main Data Center", "2019::LargeOffice::OpenOffice", "2019::LargeOffice::PrintRoom", "2019::LargeOffice::Restroom", "2019::LargeOffice::Stair", "2019::LargeOffice::Storage", "2019::LargeOffice::Vending"}, selected="2019::LargeOffice::Attic")

# ----
program_type_inputs_calculator_16 = ProgramTypeInputsCalculator(
    units=input_units_selection,
    zone_name=zone_type_name_override_optional_16,
    zone_program=space_program_16,
    leed_baseline=leed_baseline,
    code_baseline=code_baseline,
    number_of_people_per_area=number_of_people_per_area_16,
    lighting_density_per_area=lighting_density_per_area_16,
    equipment_load_per_area=equipment_power_density_16,
    gas_equipment_load_per_area=gas_power_density_16,
    hot_water_load_per_area=hot_water_density_16,
    ventilation_per_person=ventilation_per_person_16,
    ventilation_per_area=ventilation_per_area_16,
    of_lights_with_daylight_control=daylight_control_16,
    conditioned=conditioned_16,
    heating_setpoint=heating_setpoint_16,
    heating_setback=heating_setback_16,
    cooling_setpoint=cooling_setpoint_16,
    cooling_setback=cooling_setback_16,
    humidity_setpoint=humidify_setpoint_16,
    dehumidifysetback=dehumidfy_setpoint_16,
    occupancy_schedule=occupancy_15,
    activity_schedule=activity_15,
    lighting_schedule=lighting_15,
    equipment_schedule=equipment_15,
    gas_equipment_schedule=gas_equipment_15,
    hot_water_schedule=hot_water_15,
    ventilation_schedule=ventilation_15)  # -> load_catagories_2, loads_2, leed_baseline_loads_2, code_baseline_loads_2, program_schedules, program_properties_2, i

# ---- group: Program Loads
load_type_16 = Panel(program_type_inputs_calculator_16.load_catagories_2)
proposed_16 = Panel(program_type_inputs_calculator_16.loads_2)
leed_16 = Panel(program_type_inputs_calculator_16.leed_baseline_loads_2)
code_16 = Panel(program_type_inputs_calculator_16.code_baseline_loads_2)
schedule_18 = Panel(program_type_inputs_calculator_16.program_schedules)

# ---- group: Display Options
read_selected_thermal_comfort_metrics = BooleanToggle(False)
show_node_values = ValueList({"Yes": 0, "No": 1}, selected="Yes")

# ----
# Instructions: These controls can be used to perform a spatial thermal comfort analysis of each option and can automatically extract images of all the different hours and design options.
# 
# The grid size, number of metrics, options, and number of zones affect the calculation time for each thermal comfort spatial map. The number of images affect the total calculation time.
# 
# First, select the zones on which the spatial thermal analysis to be performed.
# 
# Specify the grid size and offset distance from floor in model units.
# 
# Provide a list of hours to study for the hourly thermal analysis metrics in the format month,day,hour.
# 
# Select the metrics to simulate. Then select if the metrics should be run for the current option or all of the parametric options. Hit the button the simulate options.
# 
# Toggle the Read Selected Thermal Conmfort Metrics to 'True' to load the results. Choose the selected metric to display.
# 
# Addjust the color range if required.
# 
# Select if the automatic image extraction should cycle through all times for the current option or all options (For annual metrics, there will only be one image per option)
display_metric = ValueList({"None": 0, "Operative Temperature (PMV)": 1, "Operative Temperature (Adaptive)": 2, "Universal Thermal Comfort Index (UTCI)": 3, "Condition (PMV)": 4, "Condition (Adaptive)": 5, "Condition (UTCI)": 6, "PMV (PMV)": 7, "Degrees from Neutral (Adaptive)": 8, "Category (UTCI)": 9, "Thermal Comfort Percent (PMV Annual)": 10, "Thermal Comfort Percent (Adaptive Annual)": 11, "Thermal Comfort Percent (UTCI Annual)": 12, "Heat Sensation Percent (PMV Annual)": 13, "Heat Sensation Percent (Adaptive Annual)": 14, "Heat Sensation Percent (UTCI Annual)": 15, "Cold Sensation Percent (PMV Annual)": 16, "Cold Sensation Percent (Adaptive Annual)": 17, "Cold Sensation Percent (UTCI Annual)": 18}, selected="None")
display_hour = Slider(0, range=0..8)
# Run Thermal Comfort Analysis
zones_to_include = Brep(<brep referenced from the Rhino model>)
grid_size = Panel("1")
grid_offset_from_floor = Panel("1")
list_of_study_times_m_d_h = Panel("""6,21,9
6,21,12
6,21,15
9,21,9
9,21,12
9,21,15
12,21,9
12,21,12
12,21,15""")
min_9 = Panel("65")
max_9 = Panel("85")
max_10 = Panel("1")
max_11 = Panel("5")

# ---- group: Thermal Comfort Times
lng_5 = ListLength(List=list_of_study_times_m_d_h)
dom_4 = ConstructDomain(DomainStart=0, DomainEnd=expr("x-1", lng_5))
connected_16 = GetConnectedObjects(Objects=display_hour)
set_slider_2 = SetSliderProperties(Slider=connected_16, Range=dom_4)

# ---- group: Thermal Comfort Visualization Ranges
panel_96 = Panel("""PMV
Degrees Out of Range
Temperature""")
concat_15 = Concatenate(FragmentA=graft(" ("), FragmentB=item_14, FragmentC=")")  # -> flatten(Result)
merge_23 = Merge(Data1=" ", Data2=concat_15, Data3=concat_15)
neg_6 = Negative(Value=max_11)
neg_7 = Negative(Value=max_10)
concat_16 = Concatenate(FragmentA=panel_96, FragmentB=merge_23)
connected_17 = GetConnectedObjects(Objects=["PMV ", "Degrees Out of Range (°F)", "Temperature (°F)"])
setpanel_6 = SetPanelProperties(Panel=connected_17, Color=swatch_3, Content=concat_16)

# ----
min_10 = Panel(neg_7)
min_11 = Panel(neg_6)

# ---- group: Skylight Glass (if applicable)
# Instructions: These items are not parameterized, although they will need to be definined when applicable.
units_59 = Panel(item_5)
skylight_u_value_2 = Panel("0.3")

# ---- group: Set Building and Space Program
bldgprograms_17 = HBBuildingPrograms({"LargeOffice", "MediumOffice", "SmallOffice", "MidriseApartment", "HighriseApartment", "Retail", "StripMall", "PrimarySchool", "SecondarySchool", "SmallHotel", "LargeHotel", "Hospital", "Outpatient", "Laboratory", "Warehouse", "SuperMarket", "FullServiceRestaurant", "QuickServiceRestaurant", "Courthouse", "LargeDataCenterHighITE", "LargeDataCenterLowITE", "SmallDataCenterHighITE", "SmallDataCenterLowITE"}, selected="LargeOffice")

bldgprograms_18 = HBBuildingPrograms({"LargeOffice", "MediumOffice", "SmallOffice", "MidriseApartment", "HighriseApartment", "Retail", "StripMall", "PrimarySchool", "SecondarySchool", "SmallHotel", "LargeHotel", "Hospital", "Outpatient", "Laboratory", "Warehouse", "SuperMarket", "FullServiceRestaurant", "QuickServiceRestaurant", "Courthouse", "LargeDataCenterHighITE", "LargeDataCenterLowITE", "SmallDataCenterHighITE", "SmallDataCenterLowITE"}, selected="LargeOffice")

bldgprograms_19 = HBBuildingPrograms({"LargeOffice", "MediumOffice", "SmallOffice", "MidriseApartment", "HighriseApartment", "Retail", "StripMall", "PrimarySchool", "SecondarySchool", "SmallHotel", "LargeHotel", "Hospital", "Outpatient", "Laboratory", "Warehouse", "SuperMarket", "FullServiceRestaurant", "QuickServiceRestaurant", "Courthouse", "LargeDataCenterHighITE", "LargeDataCenterLowITE", "SmallDataCenterHighITE", "SmallDataCenterLowITE"}, selected="LargeOffice")

# ----
zone_type_name_override_optional_17 = Panel("")
conditioned_17 = BooleanToggle(True)
searchprog_17 = HBSearchPrograms(bldg_prog=bldgprograms_17)  # -> room_prog; plug-in component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

# ---- group: Set Building and Space Program (continued)
space_program_17 = Honeybee_ItemSelector(
    searchprog_17,
    {"2019::LargeOffice::Attic", "2019::LargeOffice::BreakRoom", "2019::LargeOffice::Classroom", "2019::LargeOffice::ClosedOffice", "2019::LargeOffice::Conference", "2019::LargeOffice::Corridor", "2019::LargeOffice::Dining", "2019::LargeOffice::Elec/MechRoom", "2019::LargeOffice::Elevator Lobby", "2019::LargeOffice::Elevator Machine Room", "2019::LargeOffice::Elevator Shaft", "2019::LargeOffice::IT_Room", "2019::LargeOffice::Lobby", "2019::LargeOffice::Main Electrical", "2019::LargeOffice::Main Mechanical", "2019::LargeOffice::OfficeLarge Data Center", "2019::LargeOffice::OfficeLarge Main Data Center", "2019::LargeOffice::OpenOffice", "2019::LargeOffice::PrintRoom", "2019::LargeOffice::Restroom", "2019::LargeOffice::Stair", "2019::LargeOffice::Storage", "2019::LargeOffice::Vending"}, selected="2019::LargeOffice::Attic")

# ----
program_type_inputs_calculator_17 = ProgramTypeInputsCalculator(
    units=input_units_selection,
    zone_name=zone_type_name_override_optional_17,
    zone_program=space_program_17,
    leed_baseline=leed_baseline,
    code_baseline=code_baseline,
    number_of_people_per_area=number_of_people_per_area_17,
    lighting_density_per_area=lighting_density_per_area_17,
    equipment_load_per_area=equipment_power_density_17,
    gas_equipment_load_per_area=gas_power_density_17,
    hot_water_load_per_area=hot_water_density_17,
    ventilation_per_person=ventilation_per_person_17,
    ventilation_per_area=ventilation_per_area_17,
    of_lights_with_daylight_control=daylight_control_17,
    conditioned=conditioned_17,
    heating_setpoint=heating_setpoint_17,
    heating_setback=heating_setback_17,
    cooling_setpoint=cooling_setpoint_17,
    cooling_setback=cooling_setback_17,
    humidity_setpoint=humidify_setpoint_17,
    dehumidifysetback=dehumidfy_setpoint_17,
    occupancy_schedule=occupancy_16,
    activity_schedule=activity_16,
    lighting_schedule=lighting_16,
    equipment_schedule=equipment_16,
    gas_equipment_schedule=gas_equipment_16,
    hot_water_schedule=hot_water_16,
    ventilation_schedule=ventilation_16)  # -> load_catagories_2, loads_2, leed_baseline_loads_2, code_baseline_loads_2, program_schedules, program_properties_2, i

# ---- group: Program Loads
load_type_17 = Panel(program_type_inputs_calculator_17.load_catagories_2)
proposed_17 = Panel(program_type_inputs_calculator_17.loads_2)
leed_17 = Panel(program_type_inputs_calculator_17.leed_baseline_loads_2)
code_17 = Panel(program_type_inputs_calculator_17.code_baseline_loads_2)
schedule_19 = Panel(program_type_inputs_calculator_17.program_schedules)

# ---- group: Set Building and Space Program
bldgprograms_20 = HBBuildingPrograms({"LargeOffice", "MediumOffice", "SmallOffice", "MidriseApartment", "HighriseApartment", "Retail", "StripMall", "PrimarySchool", "SecondarySchool", "SmallHotel", "LargeHotel", "Hospital", "Outpatient", "Laboratory", "Warehouse", "SuperMarket", "FullServiceRestaurant", "QuickServiceRestaurant", "Courthouse", "LargeDataCenterHighITE", "LargeDataCenterLowITE", "SmallDataCenterHighITE", "SmallDataCenterLowITE"}, selected="LargeOffice")

# ----
zone_type_name_override_optional_18 = Panel("")
conditioned_18 = BooleanToggle(True)
searchprog_18 = HBSearchPrograms(bldg_prog=bldgprograms_18)  # -> room_prog; plug-in component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

# ---- group: Set Building and Space Program (continued)
space_program_18 = Honeybee_ItemSelector(
    searchprog_18,
    {"2019::LargeOffice::Attic", "2019::LargeOffice::BreakRoom", "2019::LargeOffice::Classroom", "2019::LargeOffice::ClosedOffice", "2019::LargeOffice::Conference", "2019::LargeOffice::Corridor", "2019::LargeOffice::Dining", "2019::LargeOffice::Elec/MechRoom", "2019::LargeOffice::Elevator Lobby", "2019::LargeOffice::Elevator Machine Room", "2019::LargeOffice::Elevator Shaft", "2019::LargeOffice::IT_Room", "2019::LargeOffice::Lobby", "2019::LargeOffice::Main Electrical", "2019::LargeOffice::Main Mechanical", "2019::LargeOffice::OfficeLarge Data Center", "2019::LargeOffice::OfficeLarge Main Data Center", "2019::LargeOffice::OpenOffice", "2019::LargeOffice::PrintRoom", "2019::LargeOffice::Restroom", "2019::LargeOffice::Stair", "2019::LargeOffice::Storage", "2019::LargeOffice::Vending"}, selected="2019::LargeOffice::Attic")

# ----
program_type_inputs_calculator_18 = ProgramTypeInputsCalculator(
    units=input_units_selection,
    zone_name=zone_type_name_override_optional_18,
    zone_program=space_program_18,
    leed_baseline=leed_baseline,
    code_baseline=code_baseline,
    number_of_people_per_area=number_of_people_per_area_18,
    lighting_density_per_area=lighting_density_per_area_18,
    equipment_load_per_area=equipment_power_density_18,
    gas_equipment_load_per_area=gas_power_density_18,
    hot_water_load_per_area=hot_water_density_18,
    ventilation_per_person=ventilation_per_person_18,
    ventilation_per_area=ventilation_per_area_18,
    of_lights_with_daylight_control=daylight_control_18,
    conditioned=conditioned_18,
    heating_setpoint=heating_setpoint_18,
    heating_setback=heating_setback_18,
    cooling_setpoint=cooling_setpoint_18,
    cooling_setback=cooling_setback_18,
    humidity_setpoint=humidify_setpoint_18,
    dehumidifysetback=dehumidfy_setpoint_18,
    occupancy_schedule=occupancy_17,
    activity_schedule=activity_17,
    lighting_schedule=lighting_17,
    equipment_schedule=equipment_17,
    gas_equipment_schedule=gas_equipment_17,
    hot_water_schedule=hot_water_17,
    ventilation_schedule=ventilation_17)  # -> load_catagories_2, loads_2, leed_baseline_loads_2, code_baseline_loads_2, program_schedules, program_properties_2, i

# ---- group: Program Loads
load_type_18 = Panel(program_type_inputs_calculator_18.load_catagories_2)
proposed_18 = Panel(program_type_inputs_calculator_18.loads_2)
leed_18 = Panel(program_type_inputs_calculator_18.leed_baseline_loads_2)
code_18 = Panel(program_type_inputs_calculator_18.code_baseline_loads_2)
schedule_20 = Panel(program_type_inputs_calculator_18.program_schedules)

# ----
zone_type_name_override_optional_19 = Panel("")
conditioned_19 = BooleanToggle(True)
searchprog_19 = HBSearchPrograms(bldg_prog=bldgprograms_19)  # -> room_prog; plug-in component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

# ---- group: Set Building and Space Program (continued)
space_program_19 = Honeybee_ItemSelector(
    searchprog_19,
    {"2019::LargeOffice::Attic", "2019::LargeOffice::BreakRoom", "2019::LargeOffice::Classroom", "2019::LargeOffice::ClosedOffice", "2019::LargeOffice::Conference", "2019::LargeOffice::Corridor", "2019::LargeOffice::Dining", "2019::LargeOffice::Elec/MechRoom", "2019::LargeOffice::Elevator Lobby", "2019::LargeOffice::Elevator Machine Room", "2019::LargeOffice::Elevator Shaft", "2019::LargeOffice::IT_Room", "2019::LargeOffice::Lobby", "2019::LargeOffice::Main Electrical", "2019::LargeOffice::Main Mechanical", "2019::LargeOffice::OfficeLarge Data Center", "2019::LargeOffice::OfficeLarge Main Data Center", "2019::LargeOffice::OpenOffice", "2019::LargeOffice::PrintRoom", "2019::LargeOffice::Restroom", "2019::LargeOffice::Stair", "2019::LargeOffice::Storage", "2019::LargeOffice::Vending"}, selected="2019::LargeOffice::Attic")

# ----
program_type_inputs_calculator_19 = ProgramTypeInputsCalculator(
    units=input_units_selection,
    zone_name=zone_type_name_override_optional_19,
    zone_program=space_program_19,
    leed_baseline=leed_baseline,
    code_baseline=code_baseline,
    number_of_people_per_area=number_of_people_per_area_19,
    lighting_density_per_area=lighting_density_per_area_19,
    equipment_load_per_area=equipment_power_density_19,
    gas_equipment_load_per_area=gas_power_density_19,
    hot_water_load_per_area=hot_water_density_19,
    ventilation_per_person=ventilation_per_person_19,
    ventilation_per_area=ventilation_per_area_19,
    of_lights_with_daylight_control=daylight_control_19,
    conditioned=conditioned_19,
    heating_setpoint=heating_setpoint_19,
    heating_setback=heating_setback_19,
    cooling_setpoint=cooling_setpoint_19,
    cooling_setback=cooling_setback_19,
    humidity_setpoint=humidify_setpoint_19,
    dehumidifysetback=dehumidfy_setpoint_19,
    occupancy_schedule=occupancy_18,
    activity_schedule=activity_18,
    lighting_schedule=lighting_18,
    equipment_schedule=equipment_18,
    gas_equipment_schedule=gas_equipment_18,
    hot_water_schedule=hot_water_18,
    ventilation_schedule=ventilation_18)  # -> load_catagories_2, loads_2, leed_baseline_loads_2, code_baseline_loads_2, program_schedules, program_properties_2, i

# ---- group: Program Loads
load_type_19 = Panel(program_type_inputs_calculator_19.load_catagories_2)
proposed_19 = Panel(program_type_inputs_calculator_19.loads_2)
leed_19 = Panel(program_type_inputs_calculator_19.leed_baseline_loads_2)
code_19 = Panel(program_type_inputs_calculator_19.code_baseline_loads_2)
schedule_21 = Panel(program_type_inputs_calculator_19.program_schedules)

# ----
zone_type_name_override_optional_20 = Panel("")
conditioned_20 = BooleanToggle(True)
searchprog_20 = HBSearchPrograms(bldg_prog=bldgprograms_20)  # -> room_prog; plug-in component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

# ---- group: Set Building and Space Program (continued)
space_program_20 = Honeybee_ItemSelector(
    searchprog_20,
    {"2019::LargeOffice::Attic", "2019::LargeOffice::BreakRoom", "2019::LargeOffice::Classroom", "2019::LargeOffice::ClosedOffice", "2019::LargeOffice::Conference", "2019::LargeOffice::Corridor", "2019::LargeOffice::Dining", "2019::LargeOffice::Elec/MechRoom", "2019::LargeOffice::Elevator Lobby", "2019::LargeOffice::Elevator Machine Room", "2019::LargeOffice::Elevator Shaft", "2019::LargeOffice::IT_Room", "2019::LargeOffice::Lobby", "2019::LargeOffice::Main Electrical", "2019::LargeOffice::Main Mechanical", "2019::LargeOffice::OfficeLarge Data Center", "2019::LargeOffice::OfficeLarge Main Data Center", "2019::LargeOffice::OpenOffice", "2019::LargeOffice::PrintRoom", "2019::LargeOffice::Restroom", "2019::LargeOffice::Stair", "2019::LargeOffice::Storage", "2019::LargeOffice::Vending"}, selected="2019::LargeOffice::Attic")

# ----
program_type_inputs_calculator_20 = ProgramTypeInputsCalculator(
    units=input_units_selection,
    zone_name=zone_type_name_override_optional_20,
    zone_program=space_program_20,
    leed_baseline=leed_baseline,
    code_baseline=code_baseline,
    number_of_people_per_area=number_of_people_per_area_20,
    lighting_density_per_area=lighting_density_per_area_20,
    equipment_load_per_area=equipment_power_density_20,
    gas_equipment_load_per_area=gas_power_density_20,
    hot_water_load_per_area=hot_water_density_20,
    ventilation_per_person=ventilation_per_person_20,
    ventilation_per_area=ventilation_per_area_20,
    of_lights_with_daylight_control=daylight_control_20,
    conditioned=conditioned_20,
    heating_setpoint=heating_setpoint_20,
    heating_setback=heating_setback_20,
    cooling_setpoint=cooling_setpoint_20,
    cooling_setback=cooling_setback_20,
    humidity_setpoint=humidify_setpoint_20,
    dehumidifysetback=dehumidfy_setpoint_20,
    occupancy_schedule=occupancy_19,
    activity_schedule=activity_19,
    lighting_schedule=lighting_19,
    equipment_schedule=equipment_19,
    gas_equipment_schedule=gas_equipment_19,
    hot_water_schedule=hot_water_19,
    ventilation_schedule=ventilation_19)  # -> load_catagories_2, loads_2, leed_baseline_loads_2, code_baseline_loads_2, program_schedules, program_properties_2, i

# ---- group: Program Loads
load_type_20 = Panel(program_type_inputs_calculator_20.load_catagories_2)
proposed_20 = Panel(program_type_inputs_calculator_20.loads_2)
leed_20 = Panel(program_type_inputs_calculator_20.leed_baseline_loads_2)
code_20 = Panel(program_type_inputs_calculator_20.code_baseline_loads_2)
schedule_22 = Panel(program_type_inputs_calculator_20.program_schedules)

# ---- group: Generate List of Inputs
entwine_3 = Entwine(
    Branch00=program_type_inputs_calculator_4.program_properties_2,
    Branch01=program_type_inputs_calculator_8.program_properties_2,
    Branch02=program_type_inputs_calculator_12.program_properties_2,
    Branch03=program_type_inputs_calculator_16.program_properties_2,
    Branch04=program_type_inputs_calculator_20.program_properties_2,
    Branch05=program_type_inputs_calculator.program_properties_2,
    Branch06=program_type_inputs_calculator_5.program_properties_2,
    Branch07=program_type_inputs_calculator_9.program_properties_2,
    Branch08=program_type_inputs_calculator_13.program_properties_2,
    Branch09=program_type_inputs_calculator_17.program_properties_2,
    Branch010=program_type_inputs_calculator_2.program_properties_2,
    Branch011=program_type_inputs_calculator_6.program_properties_2,
    Branch012=program_type_inputs_calculator_10.program_properties_2,
    Branch013=program_type_inputs_calculator_14.program_properties_2,
    Branch014=program_type_inputs_calculator_18.program_properties_2,
    Branch015=program_type_inputs_calculator_3.program_properties_2,
    Branch016=program_type_inputs_calculator_7.program_properties_2,
    Branch017=program_type_inputs_calculator_11.program_properties_2,
    Branch018=program_type_inputs_calculator_15.program_properties_2,
    Branch019=program_type_inputs_calculator_19.program_properties_2,
    FlattenInputs=True)
input_list_generator = InputListGenerator(program_information=entwine_3, program_structure=number_of_zones_by_program_type)  # -> zone_name_2, zone_program_2, number_of_people_per_area_2, lighting_density_per_area_2, equipment_load_per_area_2, gas_equipment_load_per_area_2, hot_water_load_per_area_2, ventilation_per_person_2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

# ---- group: Name Zones
series_11 = Series(Start="1", Step=1, Count=total_number_of_zones)
eval = Evaluate(F="Format(\"{0:000}\",x)", x=series_11)
concat_17 = Concatenate(FragmentA="ZONE_", FragmentB=eval, FragmentC="_", FragmentD=input_list_generator.zone_name_2)

# ---- group: Schedule Visualization
# Schedule Visualization
filter_73 = StreamFilter(
    Gate=expr("x-1", program_type),
    Stream0=program_type_inputs_calculator_4.program_schedules,
    Stream1=program_type_inputs_calculator_8.program_schedules,
    Stream2=program_type_inputs_calculator_12.program_schedules,
    Stream3=program_type_inputs_calculator_16.program_schedules,
    Stream4=program_type_inputs_calculator_20.program_schedules,
    Stream5=program_type_inputs_calculator.program_schedules,
    Stream6=program_type_inputs_calculator_5.program_schedules,
    Stream7=program_type_inputs_calculator_9.program_schedules,
    Stream8=program_type_inputs_calculator_13.program_schedules,
    Stream9=program_type_inputs_calculator_17.program_schedules,
    Stream10=program_type_inputs_calculator_2.program_schedules,
    Stream11=program_type_inputs_calculator_6.program_schedules,
    Stream12=program_type_inputs_calculator_10.program_schedules,
    Stream13=program_type_inputs_calculator_14.program_schedules,
    Stream14=program_type_inputs_calculator_18.program_schedules,
    Stream15=program_type_inputs_calculator_3.program_schedules,
    Stream16=program_type_inputs_calculator_7.program_schedules,
    Stream17=program_type_inputs_calculator_11.program_schedules,
    Stream18=program_type_inputs_calculator_15.program_schedules,
    Stream19=program_type_inputs_calculator_19.program_schedules)
merge_24 = Merge(Data1="0", Data2=filter_73)
item_62 = ListItem(List=merge_24, Index=schedule_to_view, Wrap=True)
schtodata = HBScheduleToData(schedule=item_62)  # -> data; plug-in component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
hourlyplot = LBHourlyPlot(data=schtodata)  # -> report, mesh, legend, borders, labels, title; plug-in component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

# ---- group: Build Model
roomsolid_2 = HBRoomFromSolid(
    geo=flatten(split_2.ListA),
    name=concat_17,
    program=input_list_generator.zone_program_2,
    conditioned=input_list_generator.conditioned_2)  # -> report, rooms; plug-in component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
router_2 = Router(data=cull_4)
guidesurface = HBPropertiesByGuideSurface(rooms=roomsolid_2.rooms, guide=cull_4, bc="Adiabatic")  # -> rooms; plug-in component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
filter_74 = StreamFilter(Gate=router_2, Stream0=roomsolid_2.rooms, Stream1=guidesurface)
guidesurface_2 = HBPropertiesByGuideSurface(rooms=filter_74, guide=cull_5, bc="Ground")  # -> rooms; plug-in component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
router_3 = Router(data=cull_5)
filter_75 = StreamFilter(Gate=router_3, Stream0=filter_74, Stream1=guidesurface_2)

# ----
guidesurface_3 = HBPropertiesByGuideSurface(rooms=filter_75, guide=air_walls, type="AirBoundary")  # -> rooms; plug-in component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
filter_76 = StreamFilter(Gate=router, Stream0=filter_75, Stream1=guidesurface_3)

# ---- group: Build Model (continued)
solveadj_2 = HBSolveAdjacency(rooms=flatten(filter_76), run=build_model)  # -> report, adj_rooms; plug-in component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

# ---- group: Set Setpoints
applysetpointvals = HBApplySetpointValues(
    room_or_program=flatten(solveadj_2.adj_rooms),
    cooling_setpt=input_list_generator.heating_setpoint_2,
    heating_setpt=input_list_generator.cooling_setpoint_2,
    humid_setpt=input_list_generator.humidify_setpoint_2,
    dehumid_setpt=input_list_generator.dehumidity_setpoint_2)  # -> report, mod_obj; plug-in component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

# ---- group: Element Visualization
vizbytype = HBVisualizeByType(hb_objs=solveadj_2.adj_rooms)  # -> walls, interior_walls, roofs, ceilings, exterior_floors, interior_floors, air_walls, apertures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; plug-in component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

# ---- group: Apply Baseline Loads
filter_77 = StreamFilter(Gate=baseline, Stream0=input_list_generator.leed_baseline_lpd_2, Stream1=input_list_generator.code_baseline_lpd_2)
filter_78 = StreamFilter(
    Gate=baseline,
    Stream0=input_list_generator.leed_baseline_hot_water_2,
    Stream1=input_list_generator.code_baseline_hot_water_2)
panel_97 = Panel("0.000285")
applyloadvals = HBApplyLoadValues(
    room_or_program=flatten(applysetpointvals.mod_obj),
    people_per_floor=input_list_generator.number_of_people_per_area_2,
    lighting_per_floor=filter_77,
    electric_per_floor=input_list_generator.equipment_load_per_area_2,
    gas_per_floor=input_list_generator.gas_equipment_load_per_area_2,
    hot_wtr_per_floor=filter_78,
    infilt_per_exterior=panel_97,
    vent_per_floor=input_list_generator.ventilation_per_area_2,
    vent_per_person=input_list_generator.ventilation_per_person_2)  # -> report, mod_obj; plug-in component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
applyroomsch = HBApplyRoomSchedules(
    room_or_program=flatten(applyloadvals.mod_obj),
    occupancy_sch=input_list_generator.occupancy_schedule_2,
    activity_sch=input_list_generator.activity_schedule_2,
    lighting_sch=input_list_generator.lighting_schedule_2,
    electric_equip_sch=input_list_generator.equipment_schedule_2)  # -> report, mod_obj; plug-in component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

# ---- group: Skylight Scaling
concat_18 = Concatenate(FragmentA=panel_32, FragmentB="Skylights.csv")
file = ReadFile(File=concat_18, PerLineParse=True)
split_3 = TextSplit(Text=file, Separators=",")  # -> simplify(Result)
split_4 = SplitTree(Data=split_3, Masks=flatten("{0}"))  # -> Positive, Negative
area_5 = Area(Geometry=flatten(elements.roof_surfaces))  # -> Area, Centroid
area_6 = Area(Geometry=flatten(vizbytype.roofs))  # -> Area, Centroid
ma_3 = MassAddition(Input=area_5.Area)  # -> Result, PartialResults
ma_4 = MassAddition(Input=area_6.Area)  # -> Result, PartialResults
mindex = MemberIndex(Set=split_4.Positive, Member=filter_13)  # -> Index, Count
division_18 = Division(A=ma_3.Result, B=ma_4.Result)
item_63 = ListItem(List=split_4.Negative, Index=mindex.Index, Wrap=True)
min_12 = Minimum(A=division_18, B=item_63)
division_19 = Division(A=min_12, B=division_18)
sqrt = SquareRoot(Value=division_19)
scale = Scale(Geometry=flatten(elements.roof_surfaces), Center=area_5.Centroid, Factor=sqrt)  # -> Geometry, Transform

# ---- group: Infiltration
infiltration_rate = Number(multiplication_6)
item_64 = ListItem(List=area_conversion_factors_to_m², Index="1", Wrap=True)
multiplication_13 = Multiplication(A=infiltration_rate, B=item_64)
cfm2m3s_2 = Ladybug_Cfm2M3s(cfm=multiplication_13)  # -> m3_s; plug-in component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
filter_79 = StreamFilter(Gate=input_units_selection, Stream0=infiltration_rate, Stream1=cfm2m3s_2)

# ---- group: Convert Infiltration Iput in ACH to m3/s per m2 of Facade
volume_3 = Volume(Geometry=split_2.ListA)  # -> Volume, Centroid
area_7 = Area(Geometry=vizbytype.walls)  # -> Area, Centroid
division_20 = Division(A=volume_3.Volume, B=item_4)
ma_5 = MassAddition(Input=area_7.Area)  # -> flatten(Result), PartialResults
multiplication_14 = Multiplication(A=division_20, B=infiltration_rate)
division_21 = Division(A=multiplication_14, B="3600")
division_22 = Division(A=ma_5.Result, B=item_2)
division_23 = Division(A=division_21, B=division_22)

# ---- group: Infiltration (continued)
filter_80 = StreamFilter(Gate=infiltration_rate_type, Stream0=filter_79, Stream1=division_23)

# ---- group: Apply Proposed Loads
applyloadvals_2 = HBApplyLoadValues(
    room_or_program=flatten(applysetpointvals.mod_obj),
    people_per_floor=input_list_generator.number_of_people_per_area_2,
    lighting_per_floor=input_list_generator.lighting_density_per_area_2,
    electric_per_floor=input_list_generator.equipment_load_per_area_2,
    gas_per_floor=input_list_generator.gas_equipment_load_per_area_2,
    hot_wtr_per_floor=input_list_generator.hot_water_load_per_area_2,
    infilt_per_exterior=filter_80,
    vent_per_floor=input_list_generator.ventilation_per_area_2,
    vent_per_person=input_list_generator.ventilation_per_person_2)  # -> report, mod_obj; plug-in component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
applyroomsch_2 = HBApplyRoomSchedules(
    room_or_program=flatten(applyloadvals_2.mod_obj),
    occupancy_sch=input_list_generator.occupancy_schedule_2,
    activity_sch=input_list_generator.activity_schedule_2,
    lighting_sch=input_list_generator.lighting_schedule_2,
    electric_equip_sch=input_list_generator.equipment_schedule_2)  # -> report, mod_obj; plug-in component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
daylightcontrol = HBApplyDaylightControl(rooms=flatten(applyroomsch_2.mod_obj), control_fract=input_list_generator.of_lights_with_daylight_control_2)  # -> report, rooms; plug-in component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

# ---- group: Window Scaling
concat_19 = Concatenate(FragmentA=panel_32, FragmentB="Window to Wall Ratio.csv")
file_2 = ReadFile(File=concat_19, PerLineParse=True)
split_5 = TextSplit(Text=file_2, Separators=",")  # -> simplify(Result)
split_6 = SplitTree(Data=split_5, Masks=flatten("{0}"))  # -> Positive, Negative
flip = FlipMatrix(Data=split_5)
mindex_2 = MemberIndex(Set=split_6.Positive, Member=filter_13)  # -> Index, Count
tstat = TreeStatistics(Tree=flip)  # -> Paths, Length, Count
item_65 = ListItem(List=tstat.Paths, Index=mindex_2.Index, Wrap=True)
item_66 = ListItem(List=split_5, Index=0, Wrap=True)  # -> flatten(Item)
zone_program = Data()
area_8 = Area(Geometry=elements.wall_surfaces)  # -> Area, Centroid
branch = TreeBranch(Tree=flip, Path=item_65, MaintainPaths=True)
mindex_3 = MemberIndex(Set=item_66, Member=zone_program)  # -> Index, Count
ma_6 = MassAddition(Input=area_8.Area)  # -> Result, PartialResults
item_67 = ListItem(List=branch, Index=mindex_3.Index, Wrap=True)
division_24 = Division(A=ma_6.Result, B=area_7.Area)
min_13 = Minimum(A=division_24, B="0.4")
division_25 = Division(A=min_13, B=division_24)
sqrt_2 = SquareRoot(Value=division_25)
scale_2 = Scale(Geometry=elements.wall_surfaces, Center=area_8.Centroid, Factor=sqrt_2)  # -> Geometry, Transform

# ---- group: Apply Baseline Glazing
aperture_2 = HBAperture(geo=scale_2.Geometry)  # -> report, apertures; plug-in component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
aperture_3 = HBAperture(geo=scale.Geometry)  # -> report, apertures; plug-in component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
merge_25 = Merge(Data1=aperture_2.apertures, Data2=aperture_3.apertures)
null_7 = NullItem(Item=merge_25)  # -> NullFlags, InvalidFlags, Description
cull_9 = CullPattern(List=merge_25, CullPattern=invert(null_7.NullFlags))
addsubface = HBAddSubface(hb_obj=flatten(applyroomsch.mod_obj), sub_faces=flatten(cull_9))  # -> hb_obj; plug-in component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

# ----
addsubface_2 = HBAddSubface(hb_obj=flatten(daylightcontrol.rooms), sub_faces=flatten(aperture.apertures))  # -> hb_obj; plug-in component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

# ---- group: Natural Ventilation Properties
windowopen = HBWindowOpening(
    rooms=flatten(addsubface_2),
    vent_cntrl=ventcontrol,
    fract_area_oper=fraction_area_operable,
    fract_height_oper=fraction_height_operable)  # -> report, rooms; plug-in component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

# ---- group: Alt Wall/Thermal Bridge Surfaces
lng_6 = ListLength(List=cull_7)
guidesurface_4 = HBPropertiesByGuideSurface(rooms=windowopen.rooms, guide=cull_7, ep_constr=opaqueconstr_8)  # -> rooms; plug-in component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
expression_35 = Expression(x=lng_6, Expression="IF(x=0,0,1)")
filter_81 = StreamFilter(Gate=expression_11, Stream0=windowopen.rooms, Stream1=guidesurface_4, Stream2=guidesurface_4)

# ---- group: Apply Constructions
constructionset = HBConstructionSet(
    name="Proposed_Construction_Set",
    exterior_subset=exteriorsubset,
    ground_subset=groundsubset,
    subface_subset=subfacesubset)  # -> constr_set; plug-in component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
applyconstrset = HBApplyConstructionSet(rooms=filter_81, constr_set=flatten(constructionset))  # -> rooms; plug-in component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

# ---- group: Typical Floor Adiabatic Control
filter_82 = StreamFilter(Gate=simulation_type, Stream0="True", Stream1="True", Stream2="False")
filter_83 = StreamFilter(Gate=simulation_type, Stream0="True", Stream1="True", Stream2="False")
adiabaticbytype = HBAdiabaticByType(hb_objs=flatten(applyconstrset), roofs=filter_82, exposed_floors=filter_83, interior_floors=filter_83)  # -> hb_objs; plug-in component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

# ----
data = Data(adiabaticbytype)
partition = PartitionList(List=data, Size=flatten(number_of_zones_by_program_type))
bang = ExplodeTree(Data=partition)  # -> Branch0, Branch1
process = HBProcessLoad(
    rooms=flatten(bang.Branch0),
    name="Cooking",
    watts=multiplication_9,
    schedule=item_29,
    fuel_type=expression_25,
    use_category="Cooking",
    radiant_fract=item_57,
    latent_fract=item_58)  # -> report, rooms; plug-in component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
process_2 = HBProcessLoad(
    rooms=flatten(bang.Branch1),
    name=panel_92,
    watts=expression_24,
    schedule=item_30,
    fuel_type=fuel_7,
    use_category="Exterior Equipment",
    lost_fract="1")  # -> report, rooms; plug-in component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
# Simulation Components
roomsbyattr = HBRoomsByAttribute(rooms=flatten(adiabaticbytype), attribute=panel_51)  # -> values, rooms; plug-in component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
merge_26 = Merge(Data1=flatten(process.rooms), Data2=flatten(process_2.rooms))
lng_7 = ListLength(List=bang.Branch0)
thermalzone = IB_ThermalZone(_HBRooms=bang.Branch1, IsAirTerminalPriorToZoneEquipments=True, dupNum=False)

# ---- group: WSHP
average_cop = Panel("4.8")
average_cop_2 = Panel("2.930832356")
objparams_10 = IB_ObjParams(
    CoolingPowerConsumptionCoefficient1="-5.0667958848300998",
    CoolingPowerConsumptionCoefficient2="0.75350511666759001",
    CoolingPowerConsumptionCoefficient3="5.0079443059233997",
    CoolingPowerConsumptionCoefficient4="0.16197987365787",
    CoolingPowerConsumptionCoefficient5="-0.060292098227899001",
    NominalTimeforCondensateRemovaltoBegin="0",
    RatedCoolingCoefficientofPerformance=average_cop_2,
    RatioofInitialMoistureEvaporationRateandSteadyStateLatentCapacity="0",
    SensibleCoolingCapacityCoefficient1="5.0963939105853999",
    SensibleCoolingCapacityCoefficient2="16.568568739604",
    SensibleCoolingCapacityCoefficient3="-20.595652687699001",
    SensibleCoolingCapacityCoefficient4="-0.83487786402689002",
    SensibleCoolingCapacityCoefficient5="0.49740289248604003",
    SensibleCoolingCapacityCoefficient6="0.020492322180551002",
    TotalCoolingCapacityCoefficient1="-1.765167890284",
    TotalCoolingCapacityCoefficient2="5.1698553518085",
    TotalCoolingCapacityCoefficient3="-2.4255080704749998",
    TotalCoolingCapacityCoefficient4="0.053923830802203997",
    TotalCoolingCapacityCoefficient5="0.021865323814079001",
    DataFieldSetType="Ironbug.HVAC.IB_CoilCoolingWaterToAirHeatPumpEquationFit_FieldSet")
objparams_11 = IB_ObjParams(
    HeatingCapacityCoefficient1="-3.9737962092033001",
    HeatingCapacityCoefficient2="-0.69845390755282",
    HeatingCapacityCoefficient3="5.5677296907254004",
    HeatingCapacityCoefficient4="0.023064576567237999",
    HeatingCapacityCoefficient5="0.020307740072918998",
    HeatingPowerConsumptionCoefficient1="-7.3223736279046001",
    HeatingPowerConsumptionCoefficient2="6.2777607952035996",
    HeatingPowerConsumptionCoefficient3="1.9562922990141001",
    HeatingPowerConsumptionCoefficient4="-0.049646929622782998",
    HeatingPowerConsumptionCoefficient5="0.011152413899637999",
    RatedHeatingCoefficientofPerformance=average_cop,
    DataFieldSetType="Ironbug.HVAC.IB_CoilHeatingWaterToAirHeatPumpEquationFit_FieldSet")
schedulerule_3 = Ironbug_ScheduleRule(Values="0", dupNum=False)
objparams_12 = IB_ObjParams(FanEfficiency="0.75", MotorEfficiency="0.9", PressureRise="430", DataFieldSetType="Ironbug.HVAC.IB_FanOnOff_FieldSet")
schedule_23 = Ironbug_Schedule(ValuesOrRules=schedulerule_3)
coilhtn_watertoair = Ironbug_CoilHeatingWaterToAirHeatPumpEquationFit(Parameters_=objparams_11, dupNum=False)  # -> CoilHeatingWaterToAirHeatPumpEquationFit, ToWaterLoop
coilhtn_watertoair_2 = Ironbug_CoilCoolingWaterToAirHeatPumpEquationFit(Parameters_=objparams_10, dupNum=False)  # -> CoilCoolingWaterToAirHeatPumpEquationFit, ToWaterLoop
fanonoff = Ironbug_FanOnOff(Parameters_=objparams_12, dupNum=False)
objparams_13 = IB_ObjParams(
    OutdoorAirFlowRateDuringCoolingOperation="0",
    OutdoorAirFlowRateDuringHeatingOperation="0",
    OutdoorAirFlowRateWhenNoCoolingorHeatingisNeeded="0",
    SupplyAirFanOperatingModeSchedule=schedule_23,
    SupplyAirFlowRateWhenNoCoolingorHeatingisNeeded="0",
    DataFieldSetType="Ironbug.HVAC.IB_ZoneHVACWaterToAirHeatPump_FieldSet")
duplicate = Ironbug_Duplicate(Reference=coilhtn_watertoair.CoilHeatingWaterToAirHeatPumpEquationFit, Amount=lng_7)  # -> Objects, graft(ToWaterLoop)
duplicate_2 = Ironbug_Duplicate(Reference=coilhtn_watertoair_2.CoilCoolingWaterToAirHeatPumpEquationFit, Amount=lng_7)  # -> Objects, graft(ToWaterLoop)
duplicate_3 = Ironbug_Duplicate(Reference=fanonoff, Amount=lng_7)  # -> Objects, graft(port)
waterairheatpump = Ironbug_ZoneHVACWaterToAirHeatPump(
    HeatingCoil=duplicate.Objects,
    CoolingCoil=duplicate_2.Objects,
    Fan_=duplicate_3.Objects,
    Parameters_=objparams_13,
    dupNum=False)

# ---- group: PTHP & HPAC 2.0
expression_36 = Expression(x=decision_6_hvac_system, Expression="if(x=9,1,0)")
panel_98 = Panel("""3.0
3.37""")
f2c_3 = Ladybug_F2C(F="32")  # -> C; plug-in component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
item_68 = ListItem(List=panel_98, Index=expression_36, Wrap=True)
panel_99 = Panel("""3.311840563
3.487690504""")
objparams_14 = IB_ObjParams(
    MaximumOutdoorDryBulbTemperatureforDefrostOperation=f2c_3,
    RatedCOP=item_68,
    DataFieldSetType="Ironbug.HVAC.IB_CoilHeatingDXSingleSpeed_FieldSet")
item_69 = ListItem(List=panel_99, Index=expression_36, Wrap=True)
objparams_15 = IB_ObjParams(PressureRise="300", DataFieldSetType="Ironbug.HVAC.IB_FanConstantVolume_FieldSet")
objparams_16 = IB_ObjParams(RatedCOP=item_69, DataFieldSetType="Ironbug.HVAC.IB_CoilCoolingDXSingleSpeed_FieldSet")
coilhtn_dx1 = Ironbug_CoilHeatingDXSingleSpeed(Parameters_=objparams_14, dupNum=False)
coilclndx1 = Ironbug_CoilCoolingDXSingleSpeed(Parameters_=objparams_16, dupNum=False)
fanconstant = Ironbug_FanConstantVolume(Parameters_=objparams_15, dupNum=False)
pt_heatpump = Ironbug_ZoneHVACPackagedTerminalHeatPump(HeatingCoil=coilhtn_dx1, CoolingCoil=coilclndx1, Fan_=fanconstant, dupNum=False)
duplicate_4 = Ironbug_Duplicate(Reference=pt_heatpump, Amount=lng_7)  # -> Objects, port

# ---- group: Existing Heating
objparams_17 = IB_ObjParams(
    FractionofAutosizedHeatingDesignCapacity="1.5",
    DataFieldSetType="Ironbug.HVAC.IB_CoilHeatingWaterBaseboardRadiant_FieldSet")
coilhtn_baseboardrad = Ironbug_CoilHeatingWaterBaseboardRadiant(Parameters_=objparams_17, dupNum=False)  # -> CoilHeatingWaterBaseboardRadiant, graft(WaterSide_CoilHeatingWater)
duplicate_5 = Ironbug_Duplicate(Reference=coilhtn_baseboardrad.CoilHeatingWaterBaseboardRadiant, Amount=lng_7)  # -> Objects, graft(WaterSide_CoilHeatingWater)
baseboardwaterradc = Ironbug_ZoneHVACBaseboardRadiantConvectiveWater(CoilHeatingWaterBaseboardRadiant=duplicate_5.Objects, dupNum=False)

# ---- group: Ground Source Heat Pump
objparams_18 = IB_ObjParams(
    RatedCoolingCoefficientofPerformance="6.45",
    DataFieldSetType="Ironbug.HVAC.IB_CoilCoolingWaterToAirHeatPumpEquationFit_FieldSet")
objparams_19 = IB_ObjParams(
    RatedHeatingCoefficientofPerformance="4",
    DataFieldSetType="Ironbug.HVAC.IB_CoilHeatingWaterToAirHeatPumpEquationFit_FieldSet")
objparams_20 = IB_ObjParams(FanEfficiency="0.75", MotorEfficiency="0.9", PressureRise="430", DataFieldSetType="Ironbug.HVAC.IB_FanOnOff_FieldSet")
objparams_21 = IB_ObjParams(
    OutdoorAirFlowRateDuringCoolingOperation="0",
    OutdoorAirFlowRateDuringHeatingOperation="0",
    OutdoorAirFlowRateWhenNoCoolingorHeatingisNeeded="0",
    SupplyAirFlowRateWhenNoCoolingorHeatingisNeeded="0",
    DataFieldSetType="Ironbug.HVAC.IB_ZoneHVACWaterToAirHeatPump_FieldSet")
coilhtn_watertoair_3 = Ironbug_CoilCoolingWaterToAirHeatPumpEquationFit(Parameters_=objparams_18, dupNum=False)  # -> CoilCoolingWaterToAirHeatPumpEquationFit, ToWaterLoop
coilhtn_watertoair_4 = Ironbug_CoilHeatingWaterToAirHeatPumpEquationFit(Parameters_=objparams_19, dupNum=False)  # -> CoilHeatingWaterToAirHeatPumpEquationFit, ToWaterLoop
fanonoff_2 = Ironbug_FanOnOff(Parameters_=objparams_20, dupNum=False)
duplicate_6 = Ironbug_Duplicate(Reference=coilhtn_watertoair_4.CoilHeatingWaterToAirHeatPumpEquationFit, Amount=lng_7)  # -> Objects, graft(ToWaterLoop)
duplicate_7 = Ironbug_Duplicate(Reference=coilhtn_watertoair_3.CoilCoolingWaterToAirHeatPumpEquationFit, Amount=lng_7)  # -> Objects, graft(ToWaterLoop)
duplicate_8 = Ironbug_Duplicate(Reference=fanonoff_2, Amount=lng_7)  # -> Objects, graft(port)
waterairheatpump_2 = Ironbug_ZoneHVACWaterToAirHeatPump(
    HeatingCoil=duplicate_6.Objects,
    CoolingCoil=duplicate_7.Objects,
    Fan_=duplicate_8.Objects,
    Parameters_=objparams_21,
    dupNum=False)

# ---- group: VRF Terminals
objparams_22 = IB_ObjParams(
    RatedTotalHeatingCapacitySizingRatio="6",
    DataFieldSetType="Ironbug.HVAC.IB_ZoneHVACTerminalUnitVariableRefrigerantFlow_FieldSet")
vrfterminal = Ironbug_ZoneHVACTerminalUnitVariableRefrigerantFlow(Parameters_=objparams_22, airloop=False, dupNum=False)  # -> VRFUnit_In, VRFUnit_Out
duplicate_9 = Ironbug_Duplicate(Reference=vrfterminal.VRFUnit_In, Amount=lng_7)  # -> Objects, ZoneHVACTerminalUnitVariableRefrigerantFlow

# ----
filter_84 = StreamFilter(
    Gate=decision_6_hvac_system,
    Stream0=baseboardwaterradc,
    Stream1=baseboardwaterradc,
    Stream2=baseboardwaterradc,
    Stream3=baseboardwaterradc,
    Stream4=baseboardwaterradc,
    Stream5=baseboardwaterradc,
    Stream6=baseboardwaterradc,
    Stream7=baseboardwaterradc,
    Stream8=duplicate_9.Objects,
    Stream9=duplicate_4.Objects,
    Stream10=duplicate_4.Objects,
    Stream11=duplicate_9.Objects,
    Stream12=waterairheatpump,
    Stream13=waterairheatpump,
    Stream14=waterairheatpump_2,
    Stream15=waterairheatpump_2)
vrfsystem = Ironbug_AirConditionerVariableRefrigerantFlow(_terminals=duplicate_9.ZoneHVACTerminalUnitVariableRefrigerantFlow, Parameters_=vrf_condenser, dupNum=False)
vrfsystem_2 = Ironbug_AirConditionerVariableRefrigerantFlow(_terminals=graft(duplicate_9.ZoneHVACTerminalUnitVariableRefrigerantFlow), Parameters_=vrf_condenser, dupNum=False)  # -> flatten(AirConditionerVariableRefrigerantFlow)
duplicate_10 = Ironbug_Duplicate(Reference=diffuser, Amount=lng_7)  # -> Objects, graft(port)
filter_85 = StreamFilter(Gate=expression_33, Stream1=vrfsystem, Stream2=vrfsystem_2)

panel_100 = Panel("""Passive house:
Tight building:
ASHRAE 90.1-2013:
Average building:
Leaky building:""")
panel_101 = Panel("""0.000071
0.0001
0.000285
0.0003
0.0006""")
m3s2cfm = Ladybug_M3s2Cfm(m3_s=panel_101)  # -> cfm; plug-in component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

multiplication_15 = Multiplication(A=m3s2cfm, B="0.092903")

filter_86 = StreamFilter(Gate=input_units_selection, Stream0=panel_101, Stream1=multiplication_15)
concat_20 = Concatenate(FragmentA=panel_100, FragmentB=filter_86, JoinSeparator=" ")

# ----
# Glass Assembly Parameters
# Instructions: Select glass option from pulldown menu:
# 
# Cross Reference Glass Properties - will generate all combinations of glass properties specified. This can help identify the most important parameter but will generate more combinations and perhaps create unrealistic glass property combinations. Specify LSG instead of VLT in this case to eliminate unrealistic relationship of SHGC and VLT
# 
# List of Glass Properties - using real glass specifications, provide a value of glass properties across each panel. The simulations will connect the item indexes in each list to each other
# 
# Provide one value in each panel for a fixed value, or a list of values for parametric study of each variable
# 
# Specify the u-value of the glass and the percentage frame to calculate the assembly u-value. In the case where the assembly u-value is entered, zero out the percentage of frame
reference_cfm_ft²_facade = Panel(concat_20)

# ---- group: Infiltration Header
panel_102 = Panel("""m³/s/m² facade
CFM/ft² facade""")
item_70 = ListItem(List=panel_102, Index=input_units_selection, Wrap=True)
filter_87 = StreamFilter(Gate=infiltration_rate_type, Stream0=item_70, Stream1="ACH")
connected_18 = GetConnectedObjects(Objects=infiltration_rate_cfm_ft²_facade)
concat_21 = Concatenate(FragmentA="Infiltration Rate (", FragmentB=filter_87, FragmentC=")")
setpanel_7 = SetPanelProperties(Panel=connected_18, NickName=concat_21)
connected_19 = GetConnectedObjects(Objects=reference_cfm_ft²_facade)
concat_22 = Concatenate(FragmentA="Reference (", FragmentB=item_70, FragmentC=")")
setpanel_8 = SetPanelProperties(Panel=connected_19, NickName=concat_22, Color=swatch_3)

# ---- group: WWR Panels
panel_103 = Panel("""All WWR
N/A
N/A
N/A""")
merge_27 = Merge(Data1=swatch, Data2=swatch, Data3=swatch, Data4=swatch)
merge_28 = Merge(Data1=swatch, Data2=swatch_2, Data3=swatch_2, Data4=swatch_2)
connected_20 = GetConnectedObjects(Objects=[all_wwr, panel_12, panel_13, panel_14])
filter_88 = StreamFilter(Gate=parametric_wwr_option, Stream0=merge_27, Stream1=merge_28)

# ---- group: Carbon Panels
panel_104 = Panel("""0.181082
0.39921747361""")
item_71 = ListItem(List=panel_104, Index=input_units_selection, Wrap=True)

# ---- group: Baseline Parameters / Carbon Factors (continued)
gas_co₂_kwh = Panel(item_71)

# ---- group: Carbon Panels (continued)
connected_21 = GetConnectedObjects(Objects=gas_co₂_kwh)
setpanel_9 = SetPanelProperties(Panel=connected_21, Color=swatch_3, Justification=1)

# ---- group: Shading Panels
panel_105 = Panel("""All Shading 
N/A
N/A
N/A""")
merge_29 = Merge(Data1=swatch, Data2=swatch, Data3=swatch, Data4=swatch)
merge_30 = Merge(Data1=swatch, Data2=swatch_2, Data3=swatch_2, Data4=swatch_2)
connected_22 = GetConnectedObjects(Objects=[all_shading, panel_29, panel_28, panel_27])
filter_89 = StreamFilter(Gate=parametric_shading_ratio_option, Stream0=merge_29, Stream1=merge_30)

# ---- group: Service Hot Water
connected_23 = GetConnectedObjects(Objects=[panel_75, panel_8])
connected_24 = GetConnectedObjects(Objects=[panel_69, panel_9])
connected_25 = GetConnectedObjects(Objects=[panel_65, panel_72])
connected_26 = GetConnectedObjects(Objects=[panel_70, panel_10])
panel_106 = Panel("""0
4
4
4""")
panel_107 = Panel("""0
0
4
8""")
item_72 = ListItem(List=panel_106, Index=service_hot_water_energy_option, Wrap=True)
item_73 = ListItem(List=panel_107, Index=service_hot_water_energy_option, Wrap=True)
merge_31 = Merge(Data1=swatch_3, Data2=swatch_3, Data3=swatch, Data4=swatch)
series_12 = Series(Start=item_73, Step=1, Count=item_72)

# ---- group: Volume Per Day Proposed
gallons_to_liters = Panel("3.785412")

# ----
multiplication_16 = Multiplication(A=volume, B=gallons_to_liters)
multiplication_17 = Multiplication(A=volume_2, B=gallons_to_liters)

# ---- group: Volume Per Day Baseline
filter_90 = StreamFilter(Gate=input_units_selection, Stream0=volume, Stream1=multiplication_16)

# ---- group: Volume Per Day Proposed (continued)
filter_91 = StreamFilter(Gate=input_units_selection, Stream0=volume_2, Stream1=multiplication_17)

# ---- group: Simplified Service Hot Water Calculation
expression_37 = Expression(x=service_hot_water_energy_option, Expression="IF(x=0,False,True)")
number_of_units = Number(panel_59)
entwine_4 = Entwine(Branch01=filter_91, Branch02=filter_90, FlattenInputs=True)
commercialpublicapartmenthotwater = Ladybug_CommercialPublicApartmentHotWater(
    epwFile=localizer.LPathEPW,
    buildingType=building_type,
    numberOfUnits=number_of_units,
    litersPerUnitPerDay=entwine_4,
    deliveryWaterTemperature=filter_39,
    runIt=expression_37)  # -> readMe, port, heatingLoadPerHour, hotWaterPerHour, hotWaterPerYear, averageDailyHotWaterPerYear, maximumDailyConsumption, maximumConsumptionDay, minimumDailyConsumption, minimumConsumptionDay; plug-in component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
strnum = Ladybug_SeparateData(inputList=flatten(commercialpublicapartmenthotwater.heatingLoadPerHour))  # -> numbers, strings; plug-in component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
division_26 = Division(A=commercialpublicapartmenthotwater.maximumDailyConsumption, B=gallons_to_liters)
filter_92 = StreamFilter(Gate=input_units_selection, Stream0=commercialpublicapartmenthotwater.maximumDailyConsumption, Stream1=division_26)
ma_7 = MassAddition(Input=strnum.numbers)  # -> Result, PartialResults
bang_2 = ExplodeTree(Data=filter_92)  # -> flatten(Branch0), Branch1, Branch2
division_27 = Division(A=ma_7.Result, B=entwine)
division_28 = Division(A=bang_2.Branch0, B=number_of_units)
bang_3 = ExplodeTree(Data=division_27)  # -> Branch0, Branch1, Branch2

# ---- group: Hint (continued)
panel_108 = Panel(bang_2.Branch0)
panel_109 = Panel(division_28)

# ---- group: Color Code Non-Input Panels
connected_27 = GetConnectedObjects(Objects=[units_51, units_53, units_54, units_56, panel_64, result_file_location, panel_57, panel_7, panel_108, panel_71])
setpanel_10 = SetPanelProperties(Panel=connected_27, Color=swatch_3)

# ---- group: Service Hot Water (continued)
connected_28 = GetConnectedObjects(Objects=[panel_66, panel_108])
connected_29 = GetConnectedObjects(Objects=[panel_67, panel_109])
merge_32 = Merge(
    Data1=flatten(connected_28),
    Data2=flatten(connected_23),
    Data3=flatten(connected_29),
    Data4=flatten(connected_24),
    Data5=flatten(connected_25),
    Data6=flatten(connected_26))
lng_8 = ListLength(List=merge_32)
repeat_8 = RepeatData(Data=swatch_2, Length=lng_8)
replace_8 = ReplaceItems(List=repeat_8, Item=merge_31, Indices=series_12, Wrap=False)
setpanel_11 = SetPanelProperties(Panel=merge_32, Color=replace_8)

# ----
filter_93 = StreamFilter(Gate=service_hot_water_energy_option, Stream2=bang_3.Branch2, Stream3=panel_10)
filter_94 = StreamFilter(Gate=service_hot_water_energy_option, Stream2=bang_3.Branch1, Stream3=panel_70)

# ---- group: Shade Surfaces
num_6 = Number(ft2m_9)
num_7 = Number(ft2m_10)
num_8 = Number(ft2m_11)
num_9 = Number(ft2m_12)
shade = Shade(window_surfaces=sort_2.north_surfaces, shade_type=parametric_engine.north_shading_type, shade_ratio=num_6)
shade_2 = Shade(window_surfaces=sort_2.east_surfaces, shade_type=parametric_engine.east_shading_type, shade_ratio=num_7)
shade_3 = Shade(window_surfaces=sort_2.south_surfaces, shade_type=parametric_engine.south_shading_type, shade_ratio=num_8)
shade_4 = Shade(window_surfaces=sort_2.west_surfaces, shade_type=parametric_engine.west_shading_type, shade_ratio=num_9)
merge_33 = Merge(Data1=contextural_shading, Data2=shade, Data3=shade_2, Data4=shade_3, Data5=shade_4, Data6=fixed_shading)

# ----
null_8 = NullItem(Item=merge_33)  # -> NullFlags, InvalidFlags, Description
cull_10 = CullPattern(List=merge_33, CullPattern=invert(null_8.NullFlags))

# ---- group: Shade Surfaces (continued)
shade_5 = HBShade(geo=cull_10)  # -> report, shades; plug-in component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
null_9 = NullItem(Item=shade_5.shades)  # -> NullFlags, InvalidFlags, Description
cull_11 = CullPattern(List=shade_5.shades, CullPattern=invert(null_9.NullFlags))

# ----
model = HBModel(rooms=flatten(merge_26), shades=flatten(cull_11), name=concat_3)  # -> report, model; plug-in component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
dumpgbxml = HBDumpGbXML(model=model.model, dump=export_proposed_to_gbxml)  # -> report, gbxml; plug-in component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

# ---- group: Baseline Construction Set
merge_34 = Merge(Data1=leed_baseline, Data2=code_baseline)
constrsetclimate = HBConstructionSetByClimate(climate_zone=climatezones, vintage=merge_34, constr_type=constructiontypes)  # -> constr_set; plug-in component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
decnstrconstrset = HBDeconstructConstructionSet(constr_set=constrsetclimate)  # -> exterior_wall, exterior_roof, exposed_floor, ground_wall, ground_roof, ground_floor, window, skylight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; plug-in component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
item_74 = ListItem(List=constrsetclimate, Index=baseline, Wrap=True)
entwine_5 = Entwine(
    Branch00=decnstrconstrset.exterior_wall,
    Branch01=decnstrconstrset.exterior_roof,
    Branch02=decnstrconstrset.exposed_floor,
    Branch03=decnstrconstrset.ground_wall,
    Branch04=decnstrconstrset.ground_roof,
    Branch05=decnstrconstrset.ground_floor,
    Branch06=decnstrconstrset.window,
    Branch07=decnstrconstrset.skylight,
    Branch08=decnstrconstrset.operable,
    Branch09=decnstrconstrset.exterior_door,
    Branch010=decnstrconstrset.overhead_door,
    Branch011=decnstrconstrset.glass_door,
    FlattenInputs=True)
panel_110 = Panel("""{0;6}
{0;7}
{0;11}""")

# ----
decnstrconstr_3 = HBDeconstructConstruction(constr=entwine_5)  # -> materials, layers, r_val_si, r_val_ip, u_fac_si, u_fac_ip, shgc, t_sol, t_vis; plug-in component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
branch_2 = TreeBranch(Tree=decnstrconstr_3.shgc, Path=panel_110, MaintainPaths=True)

# ---- group: Baseline Construction Set (continued)
filter_95 = StreamFilter(Gate=input_units_selection, Stream0=decnstrconstr_3.u_fac_si, Stream1=decnstrconstr_3.u_fac_ip)
item_75 = ListItem(List=branch_2, Index=baseline, Wrap=True)
item_76 = ListItem(List=filter_95, Index=baseline, Wrap=True)
bang_4 = ExplodeTree(Data=filter_95)  # -> Branch0, Branch1, Branch2, Branch3, Branch4, Branch5, Branch6, Branch7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
bang_5 = ExplodeTree(Data=item_76)  # -> Branch0, Branch1, Branch2, Branch3, Branch4, Branch5, Branch6, Branch7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
bang_6 = ExplodeTree(Data=branch_2)  # -> Branch0, Branch1, Branch2
bang_7 = ExplodeTree(Data=item_75)  # -> Branch0, Branch1, Branch2

# ----
baseline_s = Panel(bang_4.Branch0)
baseline_s_2 = Panel(bang_4.Branch1)
baseline_s_3 = Panel(bang_4.Branch2)
baseline_s_4 = Panel(bang_4.Branch5)

baseline_s_5 = Panel(bang_4.Branch3)

# ---- group: Vertical Glazing (continued)
baseline_2 = Panel(bang_4.Branch6)
baseline_3 = Panel(bang_6.Branch0)

# ---- group: Skylight Glass (if applicable) (continued)
baseline_4 = Panel(bang_4.Branch7)
baseline_5 = Panel(bang_6.Branch1)

# ----
applyconstrset_2 = HBApplyConstructionSet(rooms=addsubface, constr_set=item_74)  # -> rooms; plug-in component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
adiabaticbytype_2 = HBAdiabaticByType(hb_objs=flatten(applyconstrset_2), roofs=filter_82, exposed_floors=filter_83, interior_floors=filter_83)  # -> hb_objs; plug-in component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
model_2 = HBModel(rooms=flatten(adiabaticbytype_2), shades=flatten(cull_11), name=concat_2)  # -> report, model; plug-in component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
dumpgbxml_2 = HBDumpGbXML(model=model_2.model, dump=export_baseline_to_gbxml)  # -> report, gbxml; plug-in component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

# ---- group: Zone Data
# Thermal Comfort Analysis and Visualization
filter_96 = StreamFilter(Gate=visualize_result_set, Stream1=adiabaticbytype, Stream2=adiabaticbytype_2)
volume_4 = Volume(Geometry=split_2.ListA)  # -> Volume, Centroid
brepinc = PointInBrep(Brep=graft(zones_to_include), Point=volume_4.Centroid, Strict=False)
cull_12 = CullPattern(List=filter_96, CullPattern=brepinc)  # -> flatten(List)

# ---- group: Shade
cull_13 = CullPattern(List=split_2.ListA, CullPattern=invert(brepinc))  # -> flatten(List)
sunion_2 = SolidUnion(Breps=cull_13)
filter_97 = StreamFilter(Gate=visualize_result_set, Stream1=cull_11, Stream2=contextural_shading)
fmerge_2 = MergeFaces(Brep=sunion_2)  # -> Breps, Before, After
merge_35 = Merge(Data1=filter_97, Data2=fmerge_2.Breps)
null_10 = NullItem(Item=merge_35)  # -> NullFlags, InvalidFlags, Description
cull_14 = CullPattern(List=merge_35, CullPattern=invert(null_10.NullFlags))
shade_6 = HBShade(geo=cull_14)  # -> report, shades; plug-in component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

# ----
gridrooms = HBSensorGridFromRooms(rooms=cull_12, grid_size=grid_size, dist_floor=grid_offset_from_floor)  # -> grid, points, mesh; plug-in component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
model_3 = HBModel(rooms=flatten(cull_12), shades=flatten(shade_6.report), name=concat_6)  # -> report, model; plug-in component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
assigngridsviews = HBAssignGridsAndViews(model=model_3.model, grids=flatten(gridrooms.grid))  # -> model; plug-in component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

# ---- group: Thermal Comfort Simulation
repeat_9 = RepeatData(Data="False", Length="3")
replace_9 = ReplaceItems(List=repeat_9, Item="True", Indices=select_metric_s_to_run_read, Wrap=False)
filter_98 = StreamFilter(Gate=read_selected_thermal_comfort_metrics, Stream1=read_selected_thermal_comfort_metrics)
item_77 = ListItem(List=replace_9, Index=0, Wrap=True)  # -> Item, Item1, Item2
recipesettings = HBRecipeSettings(folder=concat_7, reload_old=filter_98)  # -> settings; plug-in component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
and = GateAnd(A=item_77.Item, B=read_selected_thermal_comfort_metrics)
and_2 = GateAnd(A=item_77.Item1, B=read_selected_thermal_comfort_metrics)
and_3 = GateAnd(A=item_77.Item2, B=read_selected_thermal_comfort_metrics)
gate = StreamGate(Stream=run_selected_thermal_comfort_metrics, Gate=run_option)  # -> Target0, Target1
fly_4 = Ladybug_fly(inputSliders=option, fly=gate.Target1)  # -> Vviiiiiiiiiizzz; plug-in component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
pmvmap = HBPMVComfortMap(model=assigngridsviews, epw=localizer.LPathEPW, ddy=epwtoddy, north=neg_3, run_settings=recipesettings, run=and)  # -> report, temperature, condition, pmv, TCP, HSP, CSP; plug-in component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
adaptivemap = HBAdaptiveComfortMap(model=assigngridsviews, epw=localizer.LPathEPW, ddy=epwtoddy, north=neg_3)  # -> report, op_temp, condition, deg_neut, TCP, HSP, CSP; plug-in component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
utcimap = HBUTCIComfortMap(model=assigngridsviews, epw=localizer.LPathEPW, ddy=epwtoddy, north=neg_3, run_settings=recipesettings, run=and_3)  # -> report, utci, condition, category, TCP, HSP, CSP; plug-in component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

# ---- group: Data and Mesh
item_78 = ListItem(List=list_of_study_times_m_d_h, Index=display_hour, Wrap=True)
filter_99 = StreamFilter(
    Gate=display_metric,
    Stream1=pmvmap.temperature,
    Stream2=adaptivemap.op_temp,
    Stream3=utcimap.utci,
    Stream4=pmvmap.condition,
    Stream5=adaptivemap.condition,
    Stream6=utcimap.condition,
    Stream7=pmvmap.pmv,
    Stream8=adaptivemap.deg_neut,
    Stream9=utcimap.category,
    Stream10=pmvmap.TCP,
    Stream11=adaptivemap.TCP,
    Stream12=utcimap.TCP,
    Stream13=pmvmap.HSP,
    Stream14=adaptivemap.HSP,
    Stream15=utcimap.HSP,
    Stream16=pmvmap.CSP,
    Stream17=adaptivemap.CSP,
    Stream18=utcimap.CSP)
expression_38 = Expression(x=display_metric, Expression="IF(x<10,True,False)")
split_7 = TextSplit(Text=item_78, Separators=",")
rep_3 = ReplaceText(Text=item_78, Find=",", Replace=".", RecursiveReplace=False)
item_79 = ListItem(List=split_7, Index=0, Wrap=True)  # -> Item, Item1, Item2
addition_2 = Addition(A=item_79.Item2, B="1")
thermalmtx = HBReadThermalMatrix(comf_result=filter_99, load=expression_38)  # -> comf_mtx; plug-in component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
analysisperiod_2 = LBAnalysisPeriod(
    start_month=item_79.Item,
    start_day=item_79.Item1,
    start_hour=item_79.Item2,
    end_month=item_79.Item,
    end_day=item_79.Item1,
    end_hour=addition_2)  # -> period, hoys, dates; plug-in component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
expression_39 = Expression(x=display_metric, Expression="IF(x≤6,0,IF(x=7,1,IF(x=8,2,3)))")
vizthermalmap = HBVisualizeThermalMap(comf_mtx=thermalmtx, mesh=flatten(gridrooms.mesh), period=analysisperiod_2.period)  # -> report, mesh, legend, title, colors, values; plug-in component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
filter_100 = StreamFilter(Gate=expression_38, Stream0=filter_99, Stream1=vizthermalmap.values)
units_60 = LBUnitConverter(values=filter_100, from_u="C", to_u="F")  # -> all_u, values; plug-in component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
merge_36 = Merge(Data1="1", Data2=max_10, Data3=max_11, Data4="5")
merge_37 = Merge(Data1="-1", Data2=min_10, Data3=min_11, Data4="-5")
item_80 = ListItem(List=merge_37, Index=expression_39, Wrap=True)
item_81 = ListItem(List=merge_36, Index=expression_39, Wrap=True)
dom_5 = ConstructDomain(DomainStart=0, DomainEnd="100")
filter_101 = StreamFilter(Gate=report_units_selection, Stream0=filter_100, Stream1=units_60.values)
dom_6 = ConstructDomain(DomainStart=min_9, DomainEnd=max_9)
dom_7 = ConstructDomain(DomainStart=item_80, DomainEnd=item_81)
remap = RemapNumbers(Value=filter_101, Source=dom_6, Target=Domain(0, 1))  # -> Mapped, Clipped
remap_2 = RemapNumbers(Value=filter_100, Source=dom_7, Target=Domain(0, 1))  # -> Mapped, Clipped
remap_3 = RemapNumbers(Value=filter_100, Source=dom_5, Target=Domain(0, 1))  # -> Mapped, Clipped
entwine_6 = Entwine(Branch00=remap.Mapped, Branch01=series_8, FlattenInputs=True)
entwine_7 = Entwine(Branch00=remap_2.Mapped, Branch01=series_8, FlattenInputs=True)
entwine_8 = Entwine(Branch00=remap_3.Mapped, Branch01=series_8, FlattenInputs=True)
entwine_9 = Entwine(Branch00=remap_3.Mapped, Branch01=series_8, FlattenInputs=True)
entwine_10 = Entwine(Branch00=remap_3.Mapped, Branch01=series_8, FlattenInputs=True)
gradient = Gradient(
    LowerLimit=0,
    UpperLimit=1,
    Parameter=entwine_6,
    stops=[0: RGB(75, 107, 169), 0.25: RGB(173, 203, 249), 0.5: RGB(255, 255, 0), 0.75: RGB(234, 126, 0), 1: RGB(234, 38, 0)])
gradient_2 = Gradient(LowerLimit=0, UpperLimit=1, Parameter=entwine_7, stops=[0: RGB(9, 140, 255), 0.5: RGB(255, 255, 255), 1: RGB(255, 0, 0)])
gradient_3 = Gradient(
    LowerLimit=0,
    UpperLimit=1,
    Parameter=entwine_8,
    stops=[0: RGB(0, 0, 0), 0.25: RGB(128, 0, 128), 0.5: RGB(255, 0, 0), 0.75: RGB(255, 255, 0), 1: RGB(255, 255, 255)])
gradient_4 = Gradient(LowerLimit=0, UpperLimit=1, Parameter=entwine_9, stops=[0: RGB(255, 255, 255), 1: RGB(255, 0, 0)])
gradient_5 = Gradient(LowerLimit=0, UpperLimit=1, Parameter=entwine_10, stops=[0: RGB(255, 255, 255), 1: RGB(9, 140, 255)])
bang_8 = ExplodeTree(Data=gradient)  # -> Branch0, Branch1
bang_9 = ExplodeTree(Data=gradient_2)  # -> Branch0, Branch1
bang_10 = ExplodeTree(Data=gradient_3)  # -> Branch0, Branch1
bang_11 = ExplodeTree(Data=gradient_4)  # -> Branch0, Branch1
bang_12 = ExplodeTree(Data=gradient_5)  # -> Branch0, Branch1
faceb = FaceBoundaries(Mesh=gridrooms.mesh)  # -> flatten(Boundaries)
filter_102 = StreamFilter(
    Gate=display_metric,
    Stream1=bang_8.Branch0,
    Stream2=bang_8.Branch0,
    Stream3=bang_8.Branch0,
    Stream4=bang_9.Branch0,
    Stream5=bang_9.Branch0,
    Stream6=bang_9.Branch0,
    Stream7=bang_9.Branch0,
    Stream8=bang_9.Branch0,
    Stream9=bang_9.Branch0,
    Stream10=bang_10.Branch0,
    Stream11=bang_10.Branch0,
    Stream12=bang_10.Branch0,
    Stream13=bang_11.Branch0,
    Stream14=bang_11.Branch0,
    Stream15=bang_11.Branch0,
    Stream16=bang_12.Branch0,
    Stream17=bang_12.Branch0,
    Stream18=bang_12.Branch0)
area_9 = Area(Geometry=faceb)  # -> Area, Centroid
mspray = MeshSpray(Mesh=gridrooms.mesh, Points=area_9.Centroid, Colours=filter_102, SprayMode=11)

# ---- group: Display Options (continued)
time = Panel(item_78)

# ---- group: Export Thermal Comfort Images
metric = Panel("""Operative_Temperature_PMV
Operative_Temperature_Adaptive
Universal_Thermal_Comfort_Index_UTCI
Condition_PMV
Condition_Adaptive
Condition_UTCI
PMV_PMV
Degrees_from_Neutral_Adaptive
Category_UTCI
Thermal_Comfort_Percent_PMV
Thermal_Comfort_Percent_Adaptive
Thermal_Comfort_Percent_UTCI
Heat_Sensation_Percent_PMV
Heat_Sensation_Percent_Adaptive
Heat_Sensation_Percent_UTCI
Cold_Sensation_Percent_PMV
Cold_Sensation_Percent_Adaptive
Cold_Sensation_Percent_UTCI""")
item_82 = ListItem(List=metric, Index=display_metric, Wrap=True)
filter_103 = StreamFilter(Gate=expression_38, Stream0="Annual", Stream1=rep_3)
gate_2 = StreamGate(Stream=capture_screen_image_of_all_study_times, Gate=extract_option)  # -> Target0, Target1
concat_23 = Concatenate(FragmentA=concat_6, FragmentB=item_82, FragmentC=filter_103, JoinSeparator="_")
gate_3 = StreamGate(Stream=gate_2.Target0, Gate=expression_38)  # -> Target0, Target1
gate_4 = StreamGate(Stream=gate_2.Target1, Gate=expression_38)  # -> Target0, Target1
fly_5 = Ladybug_fly(inputSliders=display_hour, fly=gate_3.Target0)  # -> Vviiiiiiiiiizzz; plug-in component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
fly_6 = Ladybug_fly(inputSliders=[option, display_hour], fly=gate_2.Target1)  # -> Vviiiiiiiiiizzz; plug-in component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
fly_7 = Ladybug_fly(inputSliders=option, fly=gate_4.Target1)  # -> Vviiiiiiiiiizzz; plug-in component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
captureview_2 = LBCaptureView(file_name=concat_23, folder=image_location, height=image_resolution, capture=capture_screen_image_of_all_study_times)  # -> file; plug-in component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

# ---- group: Legend
merge_38 = Merge(
    Data1=" ",
    Data2=" ",
    Data3=" ",
    Data4=" ",
    Data5="+",
    Data6="+",
    Data7="+",
    Data8="+",
    Data9=" ",
    Data10="+",
    Data11=" ")  # -> flatten(Result)
repeat_10 = RepeatData(Data=dom_6, Length="3")
repeat_11 = RepeatData(Data=dom_7, Length="6")
item_83 = ListItem(List=merge_38, Index=display_metric, Wrap=True)
repeat_12 = RepeatData(Data=dom_5, Length="9")
merge_39 = Merge(Data1=repeat_10, Data2=repeat_11, Data3=repeat_12)
dedomain = DeconstructDomain(Domain=merge_39)  # -> Start, End
recgrid = Rectangular(Plane=PlaneXY(0, 0, 0), SizeX="20", SizeY="20", ExtentX="11", ExtentY="1")  # -> Cells, Points
filter_104 = StreamFilter(
    Gate=display_metric,
    Stream1=bang_8.Branch1,
    Stream2=bang_8.Branch1,
    Stream3=bang_8.Branch1,
    Stream4=bang_9.Branch1,
    Stream5=bang_9.Branch1,
    Stream6=bang_9.Branch1,
    Stream7=bang_9.Branch1,
    Stream8=bang_9.Branch1,
    Stream9=bang_9.Branch1,
    Stream10=bang_10.Branch1,
    Stream11=bang_10.Branch1,
    Stream12=bang_10.Branch1,
    Stream13=bang_11.Branch1,
    Stream14=bang_11.Branch1,
    Stream15=bang_11.Branch1,
    Stream16=bang_12.Branch1,
    Stream17=bang_12.Branch1,
    Stream18=bang_12.Branch1)
repeat_13 = RepeatData(Data="%", Length="9")
merge_40 = Merge(Data1=" ", Data2=dedomain.Start)  # -> flatten(Result)
merge_41 = Merge(Data1=" ", Data2=dedomain.End)  # -> flatten(Result)
merge_42 = Merge(
    Data1=" ",
    Data2=item_14,
    Data3=item_14,
    Data4=item_14,
    Data5=" ",
    Data6=" ",
    Data7=" ",
    Data8=" ",
    Data9=item_14,
    Data10=" ",
    Data11=repeat_13)  # -> flatten(Result)
boundary_5 = BoundarySurfaces(Edges=recgrid.Cells)
item_84 = ListItem(List=merge_41, Index=display_metric, Wrap=True)
item_85 = ListItem(List=merge_40, Index=display_metric, Wrap=True)
mesh = MeshBrep(
    Brep=boundary_5,
    Settings={GridMaxCount=0, GridMinCount=16, JaggedSeams=False, MaxEdgeLength=0, MinEdgeLength=0.0001, MinTolerance=0, Refine=True, RefineAngle=0, RelativeTolerance=0.65, SimplePlanes=True, Tolerance=0})
rep_4 = ReplaceText(Text=merge_38, Find="+", Replace=" ", RecursiveReplace=False)
item_86 = ListItem(List=merge_42, Index=display_metric, Wrap=True)
mjoin = MeshJoin(Meshes=flatten(mesh))
area_10 = Area(Geometry=flatten(recgrid.Cells))  # -> Area, Centroid
item_87 = ListItem(List=rep_4, Index=display_metric, Wrap=True)
multiplication_18 = Multiplication(A="20", B="11.5")
concat_24 = Concatenate(FragmentA=item_87, FragmentB=item_85, FragmentC=item_86)
concat_25 = Concatenate(FragmentA=item_83, FragmentB=item_84, FragmentC=item_86, FragmentD="  ", FragmentE="(", FragmentF=item_82, FragmentG=")")
mspray_2 = MeshSpray(Mesh=mjoin, Points=area_10.Centroid, Colours=filter_104, SprayMode=0)  # -> flatten(Mesh)
subtraction_4 = Subtraction(A="20", B="12")
pt_2 = ConstructPoint(XCoordinate="50", YCoordinate="50", ZCoordinate="50")
division_29 = Division(A=subtraction_4, B="2")
subtraction_5 = Subtraction(A="50", B="40")
addition_3 = Addition(A="50", B=multiplication_18)
item_88 = ListItem(List=concat_25, Index=0, Wrap=True)
expression_40 = Expression(x=display_metric, Expression="IF(x=0,1,0)")
merge_43 = Merge(Data1=subtraction_5, Data2=addition_3)
subtraction_6 = Subtraction(A="50", B=division_29)
merge_44 = Merge(Data1=concat_24, Data2=item_88)
pt_3 = ConstructPoint(XCoordinate=merge_43, YCoordinate=subtraction_6, ZCoordinate="50")
filter_105 = StreamFilter(Gate=expression_40, Stream0=merge_44)
meshtoscreen = RenderMeshToScreen(Mesh=mspray_2, Location=pt_2, ScaleFactor=1, Depth=0.95, Fixed=True, m_scWithvp=False)
texttoscreen = RenderTextToScreen(Text=filter_105, Location=pt_3, Size="12", Color=RGB(0, 0, 0), m_scWithvp=False)

# ---- group: Node Tags
expression_41 = Expression(x=display_metric, Expression="IF(x≤6,0,1)")
filter_106 = StreamFilter(Gate=expression_41, Stream0=filter_101, Stream1=filter_100)
panel_111 = Panel("""12
1
300
30
0.3""")
format = Format(Format=panel_31, Culture=1033, Data0=filter_106)
item_89 = ListItem(List=panel_111, Index=units_6.Code, Wrap=True)
filter_107 = StreamFilter(Gate=show_node_values, Stream0=area_9.Centroid)
filter_108 = StreamFilter(Gate=show_node_values, Stream0=format)
tag = TextTag3D(Location=filter_107, Text=filter_108, Size=item_89, Colour=ColourSwatch(SwatchColor=RGB(0, 0, 0)), Justification=5)

# ---- group: Solar Panels
simple_inverter = Honeybee_simple_Inverter(inverterName="Inverter", inverterEfficiency="0.9", inverterCost="100")  # -> readMe, HB_inverter; plug-in component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
panel_112 = Panel("1")
panel_113 = Panel("0.20")
panel_114 = Panel("B:\02 Practice Areas\C Design Analytics\Tools\Open Studio Measures\AddSimplePVtoSpecifiedShadingSurfaces")
add_simple_pv_to_shading_surfaces_by_typ = AddSimplePVToSpecifiedShadingSurfaces(measure_path=panel_114, fraction_surfacearea_with_pv="1", value_for_cell_efficiency="0.2")  # -> report, measure; "add_simple_pv_to_shading_surfaces_by_type"; plug-in component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
expression_42 = Expression(x=decision_8_renewable_energy, Expression="if(x=1,1,if(x=3,1,0))")
filter_109 = StreamFilter(Gate=expression_42, Stream1=add_simple_pv_to_shading_surfaces_by_typ.measure)

# ----
merge_45 = Merge(Data1=reduce_space_infiltration_by_percentage.measure, Data2=filter_109)
merge_46 = Merge(Data1=reduce_space_infiltration_by_percentage.measure, Data2=filter_109)

# ----
# Column Headers
panel_115 = Panel("/")
panel_116 = Panel("""Heating
Cooling""")
panel_117 = Panel("""People Sensible Heat Addition
Lights Sensible Heat Addition
Equipment Sensible Heat Addition
Window Heat Addition
Interzone Air Transfer Heat Addition
Infiltration Heat Addition
Opaque Surface Conduction and Other Heat Addition	
Equipment Sensible Heat Removal
Window Heat Removal
Interzone Air Transfer Heat Removal
Infiltration Heat Removal
Opaque Surface Conduction and Other Heat Removal""")
panel_118 = Panel("""North
East
South
West""")
panel_119 = Panel(""" 
 
 
 """)
panel_120 = Panel("""Wall
Wall_2
Roof
Exposed Floor
Slab on Grade
Glass""")
panel_121 = Panel("""SHGC
VLT
LSG""")
filter_110 = StreamFilter(Gate=parametric_wwr_option, Stream0=panel_118, Stream1=panel_119)
filter_111 = StreamFilter(Gate=parametric_shading_ratio_option, Stream0=panel_118, Stream1=panel_119)
concat_26 = Concatenate(FragmentA="(", FragmentB="%", FragmentC=")")
concat_27 = Concatenate(FragmentA="(", FragmentB=item_17, FragmentC=")")
concat_28 = Concatenate(FragmentA="(", FragmentB=item_18, FragmentC=")")
concat_29 = Concatenate(FragmentA="(", FragmentB="$", FragmentC=")")
concat_30 = Concatenate(FragmentA="(", FragmentB=item_21, FragmentC=")")
concat_31 = Concatenate(FragmentA="(", FragmentB=item_15, FragmentC=")")
repeat_14 = RepeatData(Data="WWR", Length="4")
concat_32 = Concatenate(FragmentA=filter_111, FragmentB="Shading Ratio", JoinSeparator=" ")
concat_33 = Concatenate(FragmentA="Vertical Weighted R-Value", FragmentB="(", FragmentC=item_16, FragmentD=")", JoinSeparator=" ")
concat_34 = Concatenate(FragmentA=panel_120, FragmentB="U-Value", FragmentC=concat_31, JoinSeparator=" ")
concat_35 = Concatenate(FragmentA="Glass", FragmentB=panel_121, JoinSeparator=" ")
concat_36 = Concatenate(FragmentA=panel_45, FragmentB="Energy Use", FragmentC=concat_27, JoinSeparator=" ")
concat_37 = Concatenate(FragmentA="Total", FragmentB="Energy Use", FragmentC=concat_27, JoinSeparator=" ")
concat_38 = Concatenate(FragmentA="Energy Use", FragmentB="Intensity", FragmentC=concat_28, JoinSeparator=" ")
concat_39 = Concatenate(FragmentA="Total", FragmentB="Energy Cost", FragmentC=concat_29, JoinSeparator=" ")
concat_40 = Concatenate(FragmentA="Total", FragmentB="Carbon Emissions", FragmentC=concat_30, JoinSeparator=" ")
concat_41 = Concatenate(FragmentA="(", FragmentB=item_19, FragmentC=")")
concat_42 = Concatenate(FragmentA="(", FragmentB=item_20, FragmentC=")")
concat_43 = Concatenate(FragmentA=filter_110, FragmentB=repeat_14, FragmentC="Nominal", FragmentD=concat_26, JoinSeparator=" ")
concat_44 = Concatenate(FragmentA=panel_118, FragmentB=repeat_14, FragmentC="Actual", FragmentD=concat_26, JoinSeparator=" ")
rep_5 = ReplaceText(Text=concat_41, Find="k", RecursiveReplace=False)
panel_122 = Panel("""Electricity 
Gas 
Additional Fuel 
District Cooling 
District Heating """)
concat_45 = Concatenate(FragmentA="Peak", FragmentB=panel_116, FragmentC=concat_41, JoinSeparator=" ")
concat_46 = Concatenate(FragmentA="Peak", FragmentB=panel_116, FragmentD=concat_42, JoinSeparator=" ")
concat_47 = Concatenate(FragmentA="Peak", FragmentB=panel_116, FragmentC="Hour", JoinSeparator=" ")
concat_48 = Concatenate(FragmentA=panel_117, FragmentC=rep_5, JoinSeparator=" ")
concat_49 = Concatenate(FragmentA="Peak", FragmentC="Electrical Load", JoinSeparator=" ")
concat_50 = Concatenate(A="Peak", B="Electrical Load", C="Intensity", JoinSeparator=" ")
item_90 = ListItem(List=concat_45, Index=0, Wrap=True)  # -> Item, Item1
item_91 = ListItem(List=concat_46, Index=0, Wrap=True)  # -> Item, Item1
item_92 = ListItem(List=concat_47, Index=0, Wrap=True)  # -> Item, Item1
concat_51 = Concatenate(FragmentA=concat_49, FragmentB="(", FragmentC="W", FragmentD=")")
concat_52 = Concatenate(FragmentA=concat_50, FragmentB="(", FragmentC="W", FragmentD=panel_115, FragmentE=item_22, FragmentF=")")
concat_53 = Concatenate(FragmentA=panel_122, FragmentB="(", FragmentC=item_17, FragmentD=")")
concat_54 = Concatenate(FragmentA=panel_116, FragmentB="Unmet Hours", JoinSeparator=" ")

# ---- group: WWR Panels (continued)
filter_112 = StreamFilter(Gate=parametric_wwr_option, Stream0=concat_43, Stream1=panel_103)
setpanel_12 = SetPanelProperties(Panel=connected_20, NickName=filter_112, Color=filter_88)

# ---- group: Shading Panels (continued)
filter_113 = StreamFilter(Gate=parametric_shading_ratio_option, Stream0=concat_32, Stream1=panel_105)
setpanel_13 = SetPanelProperties(Panel=connected_22, NickName=filter_113, Color=filter_89)

# ----
concat_55 = Concatenate(FragmentA=filter_111, FragmentB="Shading Type", JoinSeparator=" ")
concat_56 = Concatenate(
    FragmentA=panel_122,
    FragmentB="Virtual Rate",
    FragmentC="(",
    FragmentD="$",
    FragmentE=panel_115,
    FragmentF=item_17,
    FragmentG=")")

# ---- group: Result Variable Headers
merge_47 = Merge(
    Data1=flatten(concat_37),
    Data2=flatten(concat_53),
    Data3=flatten(concat_38),
    Data4=flatten(concat_36),
    Data5=flatten(concat_39),
    Data6=flatten(concat_56),
    Data7=flatten(concat_40),
    Data8=flatten(item_90.Item),
    Data9=flatten(item_91.Item),
    Data10=flatten(item_92.Item),
    Data11=flatten(concat_48),
    Data12=flatten(item_90.Item1),
    Data13=flatten(item_91.Item1),
    Data14=flatten(item_92.Item1),
    Data15=flatten(concat_48),
    Data16=flatten(concat_51),
    Data17=flatten(concat_52))

# ---- group: QA/QC Headers
merge_48 = Merge(Data1=flatten(panel_52), Data2=flatten(concat_54))

# ----
weave = Weave(Pattern=[0, 1, 0, 1, 0, 1, 0, 1], Stream0=concat_55, Stream1=concat_32, NullGaps=False)

# ---- group: Input Variable Headers
merge_49 = Merge(
    Data1=flatten(concat_43),
    Data2=flatten("Building WWR Actual (%)"),
    Data3=flatten(concat_44),
    Data4=flatten(weave),
    Data5=flatten(concat_33),
    Data6=flatten(concat_34),
    Data7=flatten(concat_35),
    Data8=flatten(concat_21))

# ----
merge_50 = Merge(Data1=merge_48, Data2=merge_47, Data3=merge_49)  # -> graft(Result)

merge_51 = Merge(Data1=merge_48, Data2=merge_47, Data3=merge_49)

# ---- group: Solar Hot Water
panel_123 = Panel("""SolarCollector:FlatPlate:Water,
 Collector 1,                            !- Name
 SolarDWH,  !- Solar Collector Performance Name
 X,                      !- Surface Name
 Node 88,                   !- Inlet Node Name
 Node 93,                  !- Outlet Node Name
 0.00005;                                !- Maximum Flow Rate (m3/s)

SolarCollectorPerformance:FlatPlate,
  SolarDWH,  !- Name
  Y,                  !- Gross Area {m2}
  WATER,                   !- Test Fluid
  0.0000388,               !- Test Flow Rate {m3/s}
  INLET,                   !- Test Correlation Type
  0.691,                   !- Coefficient 1 of Efficiency Equation {dimensionless}
  -3.396,                  !- Coefficient 2 of Efficiency Equation {W/m2-K}
  -0.00193,                !- Coefficient 3 of Efficiency Equation {W/m2-K2}
  -0.1939,                 !- Coefficient 2 of Incident Angle Modifier
  -0.0055;                 !- Coefficient 3 of Incident Angle Modifier""")
expression_43 = Expression(x=decision_8_renewable_energy, Expression="if(x=2,1,0)")
filter_114 = StreamFilter(Gate=expression_43)
or = GateOr(A=expression_43, B=expression_42)
filter_115 = StreamFilter(Gate=expression_43, Stream1=filter_27)

# ----
rep_6 = ReplaceText(Text=panel_123, Find="X", Replace=item_55, RecursiveReplace=False)

# ---- group: Solar Hot Water Placeholder
panel_124 = Panel("DummyFlatPlateCollector")
objparams_23 = IB_ObjParams(Name=panel_124, DataFieldSetType="Ironbug.HVAC.IB_PipeAdiabatic_FieldSet")
pipeadiabatic = Ironbug_PipeAdiabatic(Parameters_=objparams_23, dupNum=False)
filter_116 = StreamFilter(Gate=expression_43, Stream1=pipeadiabatic)

# ---- group: Model Visualization
filter_117 = StreamFilter(Gate=visualize_model, Stream1=model.model, Stream2=adiabaticbytype_2)
entwine_11 = Entwine(
    Branch00=ColourSwatch(SwatchColor=RGB(166, 166, 166)),
    Branch01=ColourSwatch(SwatchColor=RGB(255, 255, 255)),
    Branch02=ColourSwatch(SwatchColor=RGB(128, 128, 128)),
    Branch03=ColourSwatch(SwatchColor=RGBA(191, 182, 48, 232)),
    Branch04=ColourSwatch(SwatchColor=RGB(48, 96, 191)),
    Branch05=ColourSwatch(SwatchColor=RGB(29, 57, 115)),
    Branch06=ColourSwatch(SwatchColor=RGBA(189, 232, 255, 20)),
    Branch07=ColourSwatch(SwatchColor=RGBA(117, 207, 255, 100)),
    Branch08=ColourSwatch(SwatchColor=RGBA(117, 255, 225, 100)),
    Branch09=ColourSwatch(SwatchColor=RGB(61, 54, 39)),
    Branch010=ColourSwatch(SwatchColor=RGB(145, 106, 20)),
    Branch011=ColourSwatch(SwatchColor=RGB(76, 76, 76)),
    FlattenInputs=True)

# ----
vizbytype_2 = HBVisualizeByType(hb_objs=filter_117)  # -> walls, interior_walls, roofs, ceilings, exterior_floors, interior_floors, air_walls, apertures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; plug-in component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
faceb_2 = FaceBoundaries(Mesh=vizbytype_2.roofs)
boundary_6 = BoundarySurfaces(Edges=faceb_2)
join_2 = BrepJoin(Breps=flatten(boundary_6))  # -> Breps, Closed
fmerge_3 = MergeFaces(Brep=join_2.Breps)  # -> Breps, Before, After
area_11 = Area(Geometry=fmerge_3.Breps)  # -> Area, Centroid

# ---- group: Model Visualization (continued)
entwine_12 = Entwine(
    Branch00=vizbytype_2.walls,
    Branch01=vizbytype_2.interior_walls,
    Branch02=vizbytype_2.roofs,
    Branch03=vizbytype_2.ceilings,
    Branch04=vizbytype_2.exterior_floors,
    Branch05=vizbytype_2.interior_floors,
    Branch06=vizbytype_2.air_walls,
    Branch07=vizbytype_2.apertures,
    Branch08=vizbytype_2.interior_apertures,
    Branch09=vizbytype_2.doors,
    Branch010=vizbytype_2.interior_doors,
    Branch011=vizbytype_2.outdoor_shades,
    FlattenInputs=True)
tstat_2 = TreeStatistics(Tree=entwine_12)  # -> Paths, Length, Count
item_93 = ListItem(List=tstat_2.Paths, Index=display_elements, Wrap=True)
branch_3 = TreeBranch(Tree=entwine_12, Path=item_93, MaintainPaths=True)
branch_4 = TreeBranch(Tree=entwine_11, Path=item_93, MaintainPaths=True)
mcol = MeshColours(Mesh=branch_3, Colours=branch_4)
preview_3 = CustomPreview(Geometry=branch_3, Shader=branch_4)

# ---- group: Visual Checks
text_scale_factors = Panel("""36
3
1000
100
1""")
item_94 = ListItem(List=text_scale_factors, Index=scale_factor_selection, Wrap=True)
gate_5 = StreamGate(Stream=filter_117, Gate=ep_display)  # -> Target0, Target1, Target2, Target3
panel_125 = Panel("""False
False
False
True""")
item_95 = ListItem(List=panel_125, Index=ep_display, Wrap=True)

# ----
multiplication_19 = Multiplication(A=text_scale, B=item_94)

# ---- group: Visual Checks (continued)
labelrooms = HBLabelRooms(rooms_model=flatten(gate_5.Target1), attribute=roomattr, txt_height=multiplication_19)  # -> label_text, base_pts, labels, wire_frame; plug-in component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
lablefaces = HBLabelFaces(hb_objs=flatten([gate_5.Target2, gate_5.Target3]), attribute=faceattr, sub_faces=item_95, txt_height=multiplication_19)  # -> label_text, base_pts, labels, wire_frame; plug-in component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
geo = Geometry([labelrooms.labels, lablefaces.labels])

# ---- group: Solar Hot Water (continued)
c_script = CSharpScript(idf=filter_114, dummyName=panel_124, subType="SolarCollector:FlatPlate:Water", subName="Collector 1")  # -> out, idfFilePath; inputs idf: String, dummyName: String, subName: String
# ---------- c_script: C# usings ----------
using System.IO;
using System.Linq;
using System.Data;
using System.Drawing;
using System.Reflection;
using System.Windows.Forms;
using System.Xml;
using System.Xml.Linq;
using System.Runtime.InteropServices;
using System.Text.RegularExpressions;

using Rhino.DocObjects;
using Rhino.Collections;
using GH_IO;
using GH_IO.Serialization;
# ---------- c_script: C# ----------
    if (string.IsNullOrEmpty(idf))
      return;
    string text = System.IO.File.ReadAllText(idf);
    // replace dummyobj with new object in plantloop
    var reg = @"\sPipe:Adiabatic,[a-zA-Z\s\w!-]+Component[a-zA-Z\s\w]+" + dummyName;
    text = Regex.Replace(text, reg, subType + ", " + subName);
    // remove dummyobj
    reg = @"(?<! )Pipe:Adiabatic,[\n\s]+" + dummyName + @",[a-zA-Z\s\w\!\,\-\;\n]+Outlet Node Name";
    text = Regex.Replace(text, reg, string.Empty);
    System.IO.File.WriteAllText(idf, text);
    _idfFilePath = idf;
# ---------- end c_script ----------
rep_7 = ReplaceText(Text=rep_6, Find="Y", Replace=area_11.Area, RecursiveReplace=False)
filter_118 = StreamFilter(Gate=expression_43, Stream1=rep_7)

# ----
merge_52 = Merge(
    Data2=energy_cost,
    Data3=energy_cost_2,
    Data4=energy_cost_3,
    Data5=energy_cost_4,
    Data6=energy_cost_5,
    Data8=filter_20,
    Data9=flatten(filter_118))
modeltoosm = HBModelToOSM(
    model=model_2.model,
    epw_file=localizer.LPathEPW,
    sim_par=simpar,
    add_str=merge_52,
    folder=file_directory_finder,
    write=filter_29,
    run="2")  # -> report, jsons, osw, osm, idf, sql, zsz, rdd, html; plug-in component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
modeltoosm_2 = HBModelToOSM(
    model=model.model,
    epw_file=localizer.LPathEPW,
    sim_par=simpar,
    measures=merge_46,
    add_str=merge_52,
    folder=file_directory_finder,
    write=filter_28,
    run="2")  # -> report, jsons, osw, osm, idf, sql, zsz, rdd, html; plug-in component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
savetofile = IB_SaveToFile(NewFilePath=modeltoosm.osm, _write=filter_29, OverrideMode=False, writeMode=0)
filter_119 = StreamFilter(Gate=run_mode, Stream0=modeltoosm.osm, Stream1=savetofile)
runosm = HBRunOSM(osm=filter_119, run=filter_26)  # -> report, idf, sql, zsz, rdd, html; plug-in component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
runidf = HBRunIDF(idf=c_script.idfFilePath, epw_file=set_climate_file, run=filter_115)  # -> report, sql, zsz, rdd, html; plug-in component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
filter_120 = StreamFilter(Gate=read_mode, Stream0=runosm.html, Stream1=concat_4)
results_calculator = ResultsCalculator(
    units=report_units_selection,
    electricity_carbon=electricity_co₂_kwh,
    gas_co2_kwh=gas_co₂_kwh,
    additional_fuel_co2_kwh=additional_fuel_co₂_kwh,
    district_cooling_co2_kwh=district_cooling_co₂_kwh,
    district_heating_co2_kwh=district_heating_co₂_kwh,
    dhw_source=expression_5,
    annual_dhw_result=filter_93,
    exterior_lighting_result=filter_19,
    elevator_result=filter_68,
    misc_1_name=misc_end_use_1_name,
    misc_end_use_source=misc_1_fuel_source,
    misc_end_use=misc_end_use_1_energy_kwh,
    misc_2_name=misc_end_use_2_name,
    misc_end_use_source_2=misc_2_fuel_source,
    misc_end_use_2=misc_end_use_2_energy_kwh,
    address_of_result_file=filter_120)  # -> timestamp, building_area, unmet_hours, building_wwr, north_wwr, east_wwr, south_wwr, west_wwr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

# ---- group: Normalize Peak Loads
expression_44 = Expression(x=results_calculator.peak_heating, y=results_calculator.building_area, Expression="x/y*1000")
expression_45 = Expression(x=results_calculator.peak_cooling, y=results_calculator.building_area, Expression="x/y*1000")

# ---- group: Demand Intensity
division_30 = Division(A=results_calculator.peak_electricity, B=results_calculator.building_area)

# ---- group: EUI
division_31 = Division(A=results_calculator.total_annual_energy_consumption, B=results_calculator.building_area)

# ---- group: Cost Use Intensity
division_32 = Division(A=results_calculator.total_annual_energy_cost, B=results_calculator.building_area)

# ---- group: Carbon Intensity
division_33 = Division(A=results_calculator.total_annual_carbon_emission, B=results_calculator.building_area)

# ---- group: Baseline Input Variables
multiplication_20 = Multiplication(A="0.4", B=convert_from_decimal_to)
division_34 = Division(A="0.7", B=bang_7.Branch0)
merge_53 = Merge(
    Data1=flatten(multiplication_20),
    Data2=flatten(multiplication_20),
    Data3=flatten(multiplication_20),
    Data4=flatten(multiplication_20),
    Data5=flatten(results_calculator.building_wwr),
    Data6=flatten(results_calculator.north_wwr),
    Data7=flatten(results_calculator.west_wwr),
    Data8=flatten(results_calculator.south_wwr),
    Data9=flatten(results_calculator.east_wwr),
    Data10=flatten("0"),
    Data11=flatten("0"),
    Data12=flatten("0"),
    Data13=flatten("0"),
    Data14=flatten("0"),
    Data15=flatten("0"),
    Data16=flatten("0"),
    Data17=flatten("0"),
    Data18=flatten(results_calculator.vertical_weighted_r_value),
    Data20=flatten(bang_5.Branch0),
    Data21=flatten(bang_5.Branch0),
    Data22=flatten(bang_5.Branch1),
    Data23=flatten(bang_5.Branch2),
    Data24=flatten(bang_5.Branch2),
    Data25=flatten(bang_5.Branch6),
    Data26=flatten(bang_7.Branch0),
    Data27=flatten("0.7"),
    Data28=flatten(division_34),
    Data29=flatten(panel_97))

# ---- group: Baseline Output Variables
merge_54 = Merge(
    Data1=flatten(results_calculator.total_annual_energy_consumption),
    Data2=flatten(results_calculator.annual_energy_consumption_by_source),
    Data3=flatten(division_31),
    Data4=flatten(results_calculator.annual_energy_consumption_by_end_use),
    Data5=flatten(results_calculator.total_annual_energy_cost),
    Data6=flatten(results_calculator.virtual_fuel_rates),
    Data7=flatten(results_calculator.total_annual_carbon_emission),
    Data8=flatten(results_calculator.peak_heating),
    Data9=flatten(expression_44),
    Data10=flatten(results_calculator.peak_heating_hour),
    Data11=flatten(results_calculator.peak_heating_breakdown),
    Data12=flatten(results_calculator.peak_cooling),
    Data13=flatten(expression_45),
    Data14=flatten(results_calculator.peak_cooling_hour),
    Data15=flatten(results_calculator.peak_cooling_breakdown),
    Data16=flatten(results_calculator.peak_electricity),
    Data17=flatten(division_30))

# ---- group: Baseline QA/QC Variables
merge_55 = Merge(
    Data1=flatten(concat_2),
    Data2=flatten(filter_120),
    Data3=flatten(results_calculator.timestamp),
    Data4=flatten(results_calculator.unmet_hours))

# ----
merge_56 = Merge(Data1=merge_55, Data2=merge_54, Data3=merge_53)  # -> graft(Result)

# ---- group: Proposed Input Variables
merge_57 = Merge(Data1=north_wwr, Data2=west_wwr, Data3=south_wwr, Data4=east_wwr)  # -> flatten(Result)
multiplication_21 = Multiplication(A=merge_57, B=convert_from_decimal_to)
item_96 = ListItem(List=multiplication_21, Index=0, Wrap=True)  # -> Item, Item1, Item2, Item3

# ----
# Write Parametric Alternatives to Excel
toggle_6 = BooleanToggle(False)
toggle_7 = BooleanToggle(True)
addition_4 = Addition(A=option, B="1")
wo = WriteOptions(
    FilePath=filter_30,
    ClearDataOverwrite=toggle_6,
    SaveAfterWrite=toggle_7,
    CloseAfterWrite=toggle_7,
    ColumnStartPosition=1,
    RowStartPosition=1)  # -> UserMessages, WriteOptions
filter_121 = StreamFilter(Gate=run_current_option_only, Stream0=run_all_options, Stream1=run_current_option_only)
toggle_8 = BooleanToggle(False)
filter_122 = StreamFilter(Gate=run_mode_3, Stream0=filter_121, Stream1=Button(), Stream2=toggle_2)
writexl = WriteToExcel(
    Run=write_column_headers_to_file,
    ExcelWorksheet=filter_31,
    WriteOptions=wo.WriteOptions,
    ColumnnsOrRows=toggle_8,
    DataToWriteIntoColumns=merge_50)

filter_123 = StreamFilter(Gate=run_mode_3, Stream0=toggle_7, Stream1=toggle_6, Stream2=toggle_7)
filter_124 = StreamFilter(Gate=run_current_option_only, Stream0=[run_all_options, toggle_7], Stream1=run_current_option_only)

panel_126 = Panel("""0
4""")
toggle_9 = BooleanToggle(True)
item_97 = ListItem(List=panel_126, Index=baseline, Wrap=True)
addition_5 = Addition(A="1", B=rotation, C=item_97)
wo_2 = WriteOptions(
    FilePath=filter_30,
    ClearDataOverwrite=Toggle(False),
    SaveAfterWrite=toggle_9,
    CloseAfterWrite=toggle_9,
    ColumnStartPosition=1,
    RowStartPosition=addition_5)  # -> UserMessages, WriteOptions
toggle_10 = BooleanToggle(False)
filter_125 = StreamFilter(Gate=metadata_results, Stream1=run_0_baseline_simulation)
filter_126 = StreamFilter(Gate=run_mode_2, Stream0=run_0_baseline_simulation, Stream2=toggle)
writexl_2 = WriteToExcel(
    Run=filter_125,
    ExcelWorksheet=filter_32,
    WriteOptions=wo.WriteOptions,
    ColumnnsOrRows=toggle_10,
    DataToWriteIntoColumns=merge_50)
writexl_3 = WriteToExcel(
    Run=filter_126,
    ExcelWorksheet=filter_32,
    WriteOptions=wo_2.WriteOptions,
    ColumnnsOrRows=toggle_10,
    DataToWriteIntoColumns=merge_56)

filter_127 = StreamFilter(Gate=run_mode_3, Stream0=filter_124, Stream1=toggle_6, Stream2=toggle_7)

wo_3 = WriteOptions(
    FilePath=filter_30,
    ClearDataOverwrite=toggle_6,
    SaveAfterWrite=filter_123,
    CloseAfterWrite=filter_127,
    ColumnStartPosition=1,
    RowStartPosition=addition_4)  # -> UserMessages, WriteOptions

# ---- group: Heat Pump Water Heater
expression_46 = Expression(x=decision_7_dhw_system, Expression="if(x=4,1,0)")
concat_57 = Concatenate(FragmentA="Central", FragmentB=item_59.Item, JoinSeparator=" ")
filter_128 = StreamFilter(Gate=expression_46, Stream0=concat_57, Stream1=concat_13)
concat_58 = Concatenate(FragmentA=filter_128, FragmentB="Tank")
objparams_24 = IB_ObjParams(Name=concat_58, TankVolume="-9999", DataFieldSetType="Ironbug.HVAC.IB_WaterHeaterMixed_FieldSet")  # -> graft(HVACObjParams)
coilhtn_dx1_2 = IB_CoilHeatingDXSingleSpeed(dupNum=False)
fanonoff_3 = IB_FanOnOff(dupNum=False)
objparams_25 = IB_ObjParams(Name=filter_128, DataFieldSetType="Ironbug.HVAC.IB_WaterHeaterHeatPump_FieldSet")  # -> graft(HVACObjParams)

# ---- group: Visualize Energy Results
roomenergyresult = HBReadRoomEnergyResult(sql=rep)  # -> cooling, heating, lighting, electric_equip, gas_equip, process, hot_water, fan_electric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; plug-in component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
roomcomfortresult = HBReadRoomComfortResult(sql=rep)  # -> oper_temp, air_temp, rad_temp, rel_humidity; plug-in component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
faceresult = HBReadFaceResult(sql=rep)  # -> face_indoor_temp, face_outdoor_temp, face_energy_flow; plug-in component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
# Visualize Energy Results
expression_47 = Expression(x=visualize_results, Expression="IF(x<5,0,1)")
filter_129 = StreamFilter(Gate=visualize_result_set, Stream1=filter_23, Stream2=concat_2)
expression_48 = Expression(x=visualize_result_set, Expression="IF(x=0,False,True)")
concat_59 = Concatenate(
    FragmentA=file_directory_finder,
    FragmentB=filter_129,
    FragmentC="\",
    FragmentD="OpenStudio",
    FragmentE="\",
    FragmentF=filter_129,
    FragmentG=".hbjson")
loadobjects = HBLoadObjects(hb_file=concat_59, load=expression_48)  # -> report, hb_objs; plug-in component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
deconstructmodel = HBDeconstructModel(model=loadobjects.hb_objs)  # -> rooms, faces, apertures, doors, shades; plug-in component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
merge_58 = Merge(Data1="100", Data2=max, Data3=max_2, Data4=max_3, Data5=max_4, Data6=max_5, Data7=max_6, Data8=max_7)
merge_59 = Merge(Data1="0", Data2=min, Data3=min_2, Data4=min_3, Data5=min_4, Data6=min_5, Data7=min_6, Data8=min_7)
item_98 = ListItem(List=merge_59, Index=visualize_results, Wrap=True)
item_99 = ListItem(List=merge_58, Index=visualize_results, Wrap=True)
decnstrobj_2 = HBDeconstructObject(hb_obj=deconstructmodel.rooms)  # -> faces, apertures, doors, shades; plug-in component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
expression_49 = Expression(x=visualize_results, Expression="IF(x>5,0,IF(x=6,1,(IF(x=7,2,3))))")
facesbytype = HBFacesByType(hb_objs=decnstrobj_2.faces)  # -> walls, interior_walls, roofs, ceilings, exterior_floors, interior_floors, air_walls, apertures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; plug-in component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
legendpar = LBLegendParameters(min=item_98, max=item_99, continuous_leg=Toggle(True), num_decimals="1")  # -> leg_par; plug-in component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
merge_60 = Merge(Data1=facesbytype.walls, Data2=facesbytype.roofs, Data3=facesbytype.exterior_floors, Data4=facesbytype.apertures)
merge_61 = Merge(Data1=facesbytype.walls, Data2=facesbytype.roofs, Data3=facesbytype.exterior_floors)
filter_130 = StreamFilter(Gate=expression_49, Stream1=merge_60, Stream2=merge_61, Stream3=facesbytype.apertures)
gate_6 = StreamGate(Stream=legendpar, Gate=expression_47)  # -> Target0, Target1

# ---- group: Visualize Energy Results / Energy/EUI Calculation
applyper = LBApplyAnalysisPeriod(data=roomenergyresult.cooling, period=analysisperiod.period)  # -> data; plug-in component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
applyper_2 = LBApplyAnalysisPeriod(data=roomenergyresult.heating, period=analysisperiod.period)  # -> data; plug-in component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
applyper_3 = LBApplyAnalysisPeriod(data=roomenergyresult.lighting, period=analysisperiod.period)  # -> data; plug-in component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
applyper_4 = LBApplyAnalysisPeriod(data=roomenergyresult.electric_equip, period=analysisperiod.period)  # -> data; plug-in component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
applyper_5 = LBApplyAnalysisPeriod(data=roomenergyresult.fan_electric, period=analysisperiod.period)  # -> data; plug-in component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
applyper_6 = LBApplyAnalysisPeriod(data=roomenergyresult.pump_electric, period=analysisperiod.period)  # -> data; plug-in component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
xdata = LBDeconstructData(data=applyper)  # -> header, values; plug-in component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
xdata_2 = LBDeconstructData(data=applyper_2)  # -> header, values; plug-in component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
xdata_3 = LBDeconstructData(data=applyper_3)  # -> header, values; plug-in component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
xdata_4 = LBDeconstructData(data=applyper_4)  # -> header, values; plug-in component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
xdata_5 = LBDeconstructData(data=applyper_5)  # -> header, values; plug-in component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
xdata_6 = LBDeconstructData(data=applyper_6)  # -> header, values; plug-in component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
division_35 = Division(A=xdata_2.values, B=heating_cop)
division_36 = Division(A=xdata.values, B=cooling_cop)
split_8 = TextSplit(Text=xdata_3.header)
addition_6 = Addition(A=division_36, B=division_35, C=xdata_3.values, D=xdata_4.values, E=xdata_5.values, F=xdata_6.values)
item_100 = ListItem(List=split_8, Index=0, Wrap=True)  # -> Item, Item1, Item2
constrheader = LBConstructHeader(data_type="Energy", unit="kWh", metadata=graft(item_100.Item2))  # -> header; plug-in component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
data_2 = LBConstructData(header=constrheader, values=addition_6)  # -> data; plug-in component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

# ----
baltemp = HBBalanceTemperature(cooling=roomenergyresult.cooling, heating=roomenergyresult.heating, temperature=importepw.dry_bulb_temperature)  # -> bal_day_load, bal_temp; plug-in component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

# ---- group: DHW Preheat Loop Heat Exchanger
expression_50 = Expression(x=decision_6_hvac_system, Expression="if(x=13,1,if(x=14,1,0))")

# ----
expression_51 = Expression(x=decision_9_ventilation, Expression="if(x=3,1,if(x=4,1,0))")
objparams_26 = IB_ObjParams(
    Name="Rooftop Heat Exchanger",
    SensibleEffectivenessat100CoolingAirFlow="0.75",
    SensibleEffectivenessat100HeatingAirFlow="0.75",
    SensibleEffectivenessat75CoolingAirFlow="0.75",
    SensibleEffectivenessat75HeatingAirFlow="0.75",
    DataFieldSetType="Ironbug.HVAC.IB_HeatExchangerAirToAirSensibleAndLatent_FieldSet")
panel_127 = Panel("""FakeFan
MakeUpAirFan""")
panel_128 = Panel("""0.0001
1500""")
toggle_11 = BooleanToggle(True)
panel_129 = Panel("""Exhaust/Infiltration Loop
Exhaust/Central Make-Up Air Loop
DOAS with Exhaust and Central Heat Recovery
DOAS with Facade Heat Recovery""")
outputparams_2 = Ironbug_OutputParams(
    SystemNodeMassFlowRate=toggle_11,
    SystemNodeStandardDensityVolumeFlowRate=toggle_11,
    SystemNodeTemperature=toggle_11,
    outputFrequency=1)
f2c_4 = Ladybug_F2C(F="70")  # -> C; plug-in component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
objparams_27 = IB_ObjParams(MaximumFlowRate=cfm2m3s, Name="Exhaust Fan", DataFieldSetType="Ironbug.HVAC.IB_FanConstantVolume_FieldSet")  # -> graft(HVACObjParams)
heatexchanger_air = Ironbug_HeatExchangerAirToAirSensibleAndLatent(Parameters_=objparams_26, dupNum=False)
spm_scheduled_2 = Ironbug_SetpointManagerScheduled(Temperature=f2c_4, dupNum=False)
item_101 = ListItem(List=panel_129, Index=decision_9_ventilation, Wrap=True)
fanconstant_2 = Ironbug_FanConstantVolume(Parameters_=objparams_27, dupNum=False)
filter_131 = StreamFilter(Gate=expression_51, Stream1=heatexchanger_air)
filter_132 = StreamFilter(Gate=expression_51, Stream1=spm_scheduled_2)
probe = Ironbug_Probe(Parameters_=outputparams_2, dupNum=False)
toggle_12 = BooleanToggle(True)
oasystem = Ironbug_OutdoorAirSystem(ExhaustStream=fanconstant_2, HeatRecovery_=filter_131, IntakeStream=filter_132)
objparams_28 = IB_ObjParams(DesignReturnAirFlowFractionofSupplyAirFlow="0", Name=item_101, DataFieldSetType="Ironbug.HVAC.IB_AirLoopHVAC_FieldSet")
duplicate_11 = Ironbug_Duplicate(Reference=probe, Amount=lng_7)  # -> Objects, port
objparams_29 = IB_ObjParams(
    AllOutdoorAirinCooling=toggle_12,
    AllOutdoorAirinHeating=toggle_12,
    DesignOutdoorAirFlowRate=cfm2m3s,
    MinimumSystemAirFlowRatio="1",
    TypeofLoadtoSizeOn="VentilationRequirement",
    DataFieldSetType="Ironbug.HVAC.IB_SizingSystem_FieldSet")  # -> graft(HVACObjParams)
sizingsystem = Ironbug_SizingSystem(Parameters_=objparams_29, dupNum=False)  # -> simplify(SizingSystem)

item_102 = ListItem(List=panel_39, Index=expression_51, Wrap=True)
subtraction_7 = Subtraction(A=roof_coverage, B=item_54, C=item_102)
sqrt_3 = SquareRoot(Value=subtraction_7)
scale_3 = Scale(Geometry=fmerge_3.Breps, Center=area_11.Centroid, Factor=sqrt_3)  # -> Geometry, Transform
move_5 = Move(Geometry=scale_3.Geometry, Motion=Z_2)  # -> Geometry, Transform
filter_133 = StreamFilter(Gate=expression_23, Stream0=move_5.Geometry, Stream1=trim)
hb_epcontextsrf = HoneybeeEPContextSurfaces(shdSurfaces=flatten(scale_3.Geometry))  # -> HBContext; inputs shdSurfaces: list of Brep, justBoundingBox: Boolean
# ---------- hb_epcontextsrf: Python ----------
"""
prepare shading/context geometries

    Args:
        northVectorOrRotation: A vector that shows North or a number that shows
                               the rotation of the North from the Y axis
        bldgMasses: List of closed Breps as thermal zones.
    Returns:
        report: ...
        thermalZones: Thermal zone's geometries for visualiza
"""

ghenv.Component.Name = 'Honeybee EP context Surfaces'
ghenv.Component.NickName = 'HB_EPContextSrf'
ghenv.Component.Message = 'VER 0.0.66\nJUL_07_2020'
ghenv.Component.IconDisplayMode = ghenv.Component.IconDisplayMode.application
ghenv.Component.Category = "HB-Legacy"
ghenv.Component.SubCategory = "10 | Energy | Energy"
#compatibleHBVersion = VER 0.0.57\nNOV_04_2016
#compatibleLBVersion = VER 0.0.59\nFEB_01_2015
ghenv.Component.AdditionalHelpFromDocStrings = "2"

import rhinoscriptsyntax as rs
import Rhino as rc
import scriptcontext as sc
import os
import System
import Grasshopper.Kernel as gh
import uuid

tolerance = sc.doc.ModelAbsoluteTolerance
import math


def main(shdSurfaces, EPTransSchedule, meshingSettings, justBoundingBox):
    
    # import the classes
    if sc.sticky.has_key('honeybee_release'):

        try:
            if not sc.sticky['honeybee_release'].isCompatible(ghenv.Component): return -1
            if sc.sticky['honeybee_release'].isInputMissing(ghenv.Component): return -1
        except:
            warning = "You need a newer version of Honeybee to use this compoent." + \
            " Use updateHoneybee component to update userObjects.\n" + \
            "If you have already updated userObjects drag Honeybee_Honeybee component " + \
            "into canvas and try again."
            w = gh.GH_RuntimeMessageLevel.Warning
            ghenv.Component.AddRuntimeMessage(w, warning)
            return -1
        
        # don't customize this part
        hb_EPSrf = sc.sticky["honeybee_EPSurface"]
        hb_EPSHDSurface = sc.sticky["honeybee_EPShdSurface"]
        hb_RADMaterialAUX = sc.sticky["honeybee_RADMaterialAUX"]
        hb_EPObjectsAux = sc.sticky["honeybee_EPObjectsAUX"]()
        HBScheduleList = sc.sticky["honeybee_ScheduleLib"].keys()

        ########################################################################
        #----------------------------------------------------------------------#
        shdBreps = []
        # create bounding box of shading geometries
        if justBoundingBox:
            for brep in shdSurfaces:
                if brep.Faces.Count>1 or not brep.Faces[0].IsPlanar(sc.doc.ModelAbsoluteTolerance):
                    shdBreps.append(brep.GetBoundingBox(True).ToBrep())
                else:
                    shdBreps.append(brep)
        else:
            shdBreps = shdSurfaces
        
        shadingClasses = []
        shadingMeshPreview = []
        
        if meshingSettings == None:
            mp = rc.Geometry.MeshingParameters.Minimal
            mp.SimplePlanes = True
        else:
            mp = meshingSettings
        
        def getRadMaterialName(radMaterial):
            nameStr = radMaterial.split(" ")[2]
            name =  nameStr.split("\n")[0]
            return name
        
        for brepCount, brep in enumerate(shdBreps):
            if brep != None:
                isPlanar = True
                # check planarity
                for face in brep.Faces:
                    if not face.IsPlanar(tolerance):
                        isPlanar = False
                        break
                
                shadingBreps = []
                if not isPlanar:
                    meshArray = rc.Geometry.Mesh.CreateFromBrep(brep, mp)
                    for mesh in meshArray:
                        for meshFace in range(mesh.Faces.Count):
                            vertices = list(mesh.Faces.GetFaceVertices(meshFace))[1:]
                            vertices = vertices + [sc.doc.ModelAbsoluteTolerance]
                            # create the brep from mesh
                            shdBrep = rc.Geometry.Brep.CreateFromCornerPoints(*vertices)
                            shadingBreps.append(shdBrep)
                else:
                    for face in brep.Faces:
                        shadingBreps.append(face.DuplicateFace(False))
                
                for faceCount, shdBrep in enumerate(shadingBreps):
                        thisShading = hb_EPSHDSurface(shdBrep, 1000*brepCount + faceCount, 'shdSrf_' + `brepCount` + '_' + `faceCount` + "_" + str(uuid.uuid4()))
                        
                        # add transmittance schedule if any
                        if EPTransSchedule!=None:
                            schedule= EPTransSchedule.upper()
                            if schedule!=None and not schedule.lower().endswith(".csv") and schedule not in HBScheduleList:
                                msg = "Cannot find " + schedule + " in Honeybee schedule library."
                                print msg
                                ghenv.Component.AddRuntimeMessage(gh.GH_RuntimeMessageLevel.Warning, msg)
                                return -1
                            elif schedule!=None and schedule.lower().endswith(".csv"):
                                # check if csv file is existed
                                if not os.path.isfile(schedule):
                                    msg = "Cannot find the shchedule file: " + schedule
                                    print msg
                                    ghenv.Component.AddRuntimeMessage(gh.GH_RuntimeMessageLevel.Warning, msg)
                                    return -1
                            
                            thisShading.TransmittanceSCH = schedule
                        
                        # add the Rad Material if any
                        if RADMaterial!=None:
                            # if it is just the name of the material make sure it is already defined
                            if len(RADMaterial.split(" ")) == 1:
                                # if the material is not in the library add it to the library
                                if not hb_RADMaterialAUX.isMatrialExistInLibrary(RADMaterial):
                                    warningMsg = "Can't find " + RADMaterial + " in RAD Material Library.\n" + \
                                                "Add the material to the library and try again."
                                    ghenv.Component.AddRuntimeMessage(gh.GH_RuntimeMessageLevel.Warning, warningMsg)
                                    return
                                
                                try:
                                    thisShading.setRADMaterial(RADMaterial)
                                except Exception, e:
                                    print e
                                    warningMsg = "You are using an old version of Honeybee_Honeybee! Update your files and try again."
                                    print warningMsg
                                    ghenv.Component.AddRuntimeMessage(gh.GH_RuntimeMessageLevel.Warning, warningMsg)
                                    return
                                
                                addedToLib = True
                            else:
                                
                                # try to add the material to the library
                                addedToLib, thisShading.RadMaterial = hb_RADMaterialAUX.analyseRadMaterials(RADMaterial, True)
                                
                            if addedToLib==False:
                                warningMsg = "Failed to add " + RADMaterial + " to the Library."
                                ghenv.Component.AddRuntimeMessage(gh.GH_RuntimeMessageLevel.Warning, warningMsg)
                                return
                        
                        # add shading to the list
                        shadingClasses.append(thisShading)
                
        # add to the hive
        hb_hive = sc.sticky["honeybee_Hive"]()
        HBContext  = hb_hive.addToHoneybeeHive(shadingClasses, ghenv.Component)
        return HBContext
        ################################################################################################
    else:
        print "You should first let Honeybee to fly..."
        w = gh.GH_RuntimeMessageLevel.Warning
        ghenv.Component.AddRuntimeMessage(w, "You should first let Honeybee to fly...")
        return -1
        

if _shdSurfaces and _shdSurfaces[0]!=None:
    # add cleaning function
    result= main(_shdSurfaces, EPTransSchedule_, meshingSettings_, justBoundingBox_)
    
    if result != -1: HBContext = result
# ---------- end hb_epcontextsrf ----------
shade_7 = HBShade(geo=move_5.Geometry, name=item_55)  # -> report, shades; plug-in component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
area_12 = Area(Geometry=scale_3.Geometry)  # -> Area, Centroid
null_11 = NullItem(Item=shade_7.shades)  # -> NullFlags, InvalidFlags, Description
expression_52 = Expression(x="1000", y=area_12.Area, z=panel_113, u="360", v=panel_112, Expression="(0.85*(x*y*z))/(u*v)")
cull_15 = CullPattern(List=shade_7.shades, CullPattern=invert(null_11.NullFlags))
round_3 = Round(Number=expression_52)  # -> Nearest, Floor, Ceiling

# ---- group: Solar Panels (continued)
pvgen = Honeybee_Generator_PV(
    name="PV Array",
    HBSurfaces=flatten(hb_epcontextsrf),
    cellsEfficiency=panel_113,
    NoParallel=round_3.Floor,
    Noseries=panel_112,
    powerOutputPerModule="360",
    PVInverter=simple_inverter.HB_inverter)  # -> readMe, PV_HBSurfaces; plug-in component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
generationsystem = Honeybee_generationsystem(GeneratorSystemName="PV Array", PVHBSurfaces=pvgen.PV_HBSurfaces)  # -> readMe, HBGeneratorSystem; plug-in component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
filter_134 = StreamFilter(Gate=expression_42, Stream1=generationsystem.HBGeneratorSystem)

# ---- group: Solar Hot Water (continued)
filter_135 = StreamFilter(Gate=or, Stream1=cull_15)

# ----
or_2 = GateOr(A=expression_51, B=expression_31)
item_103 = ListItem(List=panel_53, Index=expression_51, Wrap=True)
duplicate_12 = Ironbug_Duplicate(Reference=spm_scheduled_2, Amount=lng_7)  # -> Objects, port

# ---- group: Central Boiler Plant
existing_boiler = Expression(x=decision_6_hvac_system, Expression="if(x=7,\"New Electric Boiler\",\"Existing Gas Boiler\")")
expression_53 = Expression(x=decision_6_hvac_system, Expression="if(x=7,\"Electricity\",\"NaturalGas\")")
panel_130 = Panel("""0
0
0.02
0.02
0.04
0.015
0""")
item_104 = ListItem(List=panel_130, Index=0, Wrap=True)
addition_7 = Addition(A="0.7", B=item_104)
expression_54 = Expression(x=decision_6_hvac_system, y=addition_7, Expression="if(x=7,1,y)")
objparams_30 = IB_ObjParams(Name="Existing DWH Loop Connection", DataFieldSetType="Ironbug.HVAC.IB_HeatExchangerFluidToFluid_FieldSet")
concat_60 = Concatenate(FragmentA=existing_boiler, FragmentB="Pump", JoinSeparator=" ")
heatexchangerfluid = Ironbug_HeatExchangerFluidToFluid(Parameters_=objparams_30, dupNum=False)  # -> AtDemand, graft(AtSupply)
expression_55 = Expression(x=decision_6_hvac_system, Expression="if(x<8,1,0)")
expression_56 = Expression(x=decision_7_dhw_system, Expression="if(x=0,1,0)")
objparams_31 = IB_ObjParams(
    FuelType=expression_53,
    Name=existing_boiler,
    NominalThermalEfficiency=expression_54,
    NormalizedBoilerEfficiencyCurve=filter_70,
    SizingFactor="3",
    DataFieldSetType="Ironbug.HVAC.IB_BoilerHotWater_FieldSet")
pipeadiabatic_2 = Ironbug_PipeAdiabatic(dupNum=False)
objparams_32 = IB_ObjParams(Name=concat_60, DataFieldSetType="Ironbug.HVAC.IB_PumpConstantSpeed_FieldSet")
objparams_33 = IB_ObjParams(Name=concat_60, DataFieldSetType="Ironbug.HVAC.IB_PumpVariableSpeed_FieldSet")
expression_57 = Expression(x=decision_6_hvac_system, Expression="if(x=1,1,if(x=7,1,0))")
boilerhw = Ironbug_BoilerHotWater(Parameters=objparams_31, dupNum=False)
pumpvariable = Ironbug_PumpVariableSpeed(Parameters_=objparams_33, dupNum=False)
pumpconstant = Ironbug_PumpConstantSpeed(Parameters_=objparams_32, dupNum=False)
filter_136 = StreamFilter(Gate=expression_55, Stream0=pipeadiabatic_2, Stream1=duplicate_5.WaterSide_CoilHeatingWater)
filter_137 = StreamFilter(Gate=expression_56, Stream0=pipeadiabatic_2, Stream1=heatexchangerfluid.AtDemand)
concat_61 = Concatenate(FragmentA=existing_boiler, FragmentB="Loop", JoinSeparator=" ")
plantbranches = PlantBranches(Branch1=boilerhw, mapBranchToLoop=False)
spm_scheduled_3 = Ironbug_SetpointManagerScheduled(Temperature="67", dupNum=False)
objparams_34 = IB_ObjParams(Name=concat_61, DataFieldSetType="Ironbug.HVAC.IB_PlantLoop_FieldSet")
filter_138 = StreamFilter(Gate=expression_57, Stream0=pumpconstant, Stream1=pumpvariable)
merge_62 = Merge(Data1=flatten(filter_138), Data2=flatten(plantbranches), Data3=flatten(spm_scheduled_3))

# ---- group: Window AC Units
window_unit_capacity = Panel("12000")
panel_131 = Panel("""0.2
1""")
btu2wh = Ladybug_BTU2Wh(BTU=window_unit_capacity)  # -> Wh; plug-in component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
item_105 = ListItem(List=panel_131, Index=0, Wrap=True)
multiplication_22 = Multiplication(A=btu2wh, B=cull, C=item_105)
panel_132 = Panel("Dummy Coil")
repeat_15 = RepeatData(Data="0", Length=lng_7)
objparams_35 = IB_ObjParams(RatedTotalCoolingCapacity=multiplication_22, DataFieldSetType="Ironbug.HVAC.IB_CoilCoolingDXSingleSpeed_FieldSet")  # -> graft(HVACObjParams)
coilclndx1_2 = IB_CoilCoolingDXSingleSpeed(Parameters_=objparams_35, dupNum=False)
expression_58 = Expression(x=decision_6_hvac_system, Expression="if(x<8,1,0)")

# ----
objparams_36 = IB_ObjParams(Name=panel_132, RatedCapacity=repeat_15, DataFieldSetType="Ironbug.HVAC.IB_CoilHeatingWater_FieldSet")  # -> graft(HVACObjParams)
coilhtnwater = IB_CoilHeatingWater(Parameters_=objparams_36, dupNum=False)  # -> AirSide_CoilHeatingWater, graft(WaterSide_CoilHeatingWater)

# ---- group: Central Boiler Plant (continued)
filter_139 = StreamFilter(Gate=expression_58, Stream1=coilhtnwater.WaterSide_CoilHeatingWater)
plantbranches_2 = PlantBranches(B1=filter_136, B2=filter_137, B3=filter_139, mapBranchToLoop=False)
hwloop = Ironbug_HotWaterPlantLoop(Supply=merge_62, Demand=plantbranches_2, Parameters=objparams_34, dupNum=False)

# ---- group: Window AC Units (continued)
pt_airconditioner = IB_ZoneHVACPackagedTerminalAirConditioner(HeatingCoil=coilhtnwater.AirSide_CoilHeatingWater, CoolingCoil=coilclndx1_2, dupNum=False)
filter_140 = StreamFilter(Gate=expression_58, Stream1=pt_airconditioner)

# ---- group: If Old Boiler Loop Still Used for DHW Even with HVAC Change
expression_59 = Expression(x=decision_7_dhw_system, Expression="if(x=0,1,0)")
filter_141 = StreamFilter(Gate=expression_59, Stream1=hwloop)

# ---- group: Energy Recovery at Facade
objparams_37 = IB_ObjParams(
    Name="Facade Heat Exchanger",
    SensibleEffectivenessat100CoolingAirFlow="0.75",
    SensibleEffectivenessat100HeatingAirFlow="0.75",
    SensibleEffectivenessat75CoolingAirFlow="0.75",
    SensibleEffectivenessat75HeatingAirFlow="0.75",
    DataFieldSetType="Ironbug.HVAC.IB_HeatExchangerAirToAirSensibleAndLatent_FieldSet")
objparams_38 = IB_ObjParams(
    ExhaustAirFlowRate=cfm2m3s,
    SupplyAirFlowRate=cfm2m3s,
    DataFieldSetType="Ironbug.HVAC.IB_ZoneHVACEnergyRecoveryVentilator_FieldSet")  # -> graft(HVACObjParams)
objparams_39 = IB_ObjParams(MaximumFlowRate=cfm2m3s, Name="Exhaust Fan", DataFieldSetType="Ironbug.HVAC.IB_FanOnOff_FieldSet")  # -> graft(HVACObjParams)
fanonoff_4 = Ironbug_FanOnOff(Parameters_=objparams_39, dupNum=False)
heatexchanger_air_2 = Ironbug_HeatExchangerAirToAirSensibleAndLatent(Parameters_=objparams_37, dupNum=False)
expression_60 = Expression(x=decision_9_ventilation, Expression="if(x>4,1,0)")

# ---- group: Water Source Heat Pump Condensor Loop
objparams_40 = IB_ObjParams(FuelType="Electricity", NominalThermalEfficiency="1.0", DataFieldSetType="Ironbug.HVAC.IB_BoilerHotWater_FieldSet")
f2c_5 = Ladybug_F2C(F="90")  # -> C; plug-in component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
f2c_6 = Ladybug_F2C(F="60")  # -> C; plug-in component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
evapfluidcooler2 = Ironbug_EvaporativeFluidCoolerTwoSpeed(dupNum=False)
boiler_2 = Ironbug_BoilerHotWater(Parameters_=objparams_40, dupNum=False)
spm_dual = Ironbug_SetpointManagerScheduledDualSetpoint(HighTemperature=f2c_5, LowTemperature=f2c_6, dupNum=False)
spm_dual_2 = Ironbug_SetpointManagerScheduledDualSetpoint(HighTemperature=f2c_5, LowTemperature=f2c_6, dupNum=False)
ironbug_pipeadiabatic = Ironbug_PipeAdiabatic(dupNum=False)
merge_63 = Merge(Data1=simplify(evapfluidcooler2), Data2=simplify(spm_dual))
merge_64 = Merge(Data1=simplify(flatten(boiler_2)), Data2=simplify(flatten(spm_dual_2)))
objparams_41 = IB_ObjParams(LoopType="Condenser", SizingOption="Coincident", DataFieldSetType="Ironbug.HVAC.IB_SizingPlant_FieldSet")
concat_62 = Concatenate(FragmentA="Heat Pump Loop", FragmentB="Pump", JoinSeparator=" ")
objparams_42 = IB_ObjParams(Name=concat_62, PumpControlType="Intermittent", DataFieldSetType="Ironbug.HVAC.IB_PumpVariableSpeed_FieldSet")
pumpvariable_2 = Ironbug_PumpVariableSpeed(Parameters_=objparams_42, dupNum=False)
ironbug_pipeadiabatic_2 = Ironbug_PipeAdiabatic(dupNum=False)
ironbug_pipeadiabatic_3 = Ironbug_PipeAdiabatic(dupNum=False)
plantbranches_3 = PlantBranches(B1=merge_63, B2=merge_64, B3=ironbug_pipeadiabatic, mapBranchToLoop=False)
objparams_43 = IB_ObjParams(
    FluidType="Water",
    LoadDistributionScheme="UniformLoad",
    MaximumLoopTemperature="300",
    MinimumLoopTemperature=f2c_6,
    Name="Heat Pump Loop",
    DataFieldSetType="Ironbug.HVAC.IB_PlantLoop_FieldSet")
ironbug_sizingplant = Ironbug_SizingPlant(Parameters_=objparams_41, dupNum=False)
merge_65 = Merge(
    Data1=simplify(pumpvariable_2),
    Data2=simplify(plantbranches_3),
    Data3=simplify(ironbug_pipeadiabatic_3),
    Data4=simplify(spm_dual))

# ---- group: DHW Preheat Loop Heat Exchanger (continued)
objparams_44 = IB_ObjParams(
    Name="DHW Preheat Heat Exchanger",
    OperationMaximumTemperatureLimit=f2c_5,
    DataFieldSetType="Ironbug.HVAC.IB_HeatExchangerFluidToFluid_FieldSet")
heatexchangerfluid_2 = Ironbug_HeatExchangerFluidToFluid(Parameters_=objparams_44, dupNum=False)  # -> AtDemand, graft(AtSupply)
filter_142 = StreamFilter(Gate=expression_50, Stream1=heatexchangerfluid_2.AtDemand)
filter_143 = StreamFilter(Gate=expression_50, Stream1=heatexchangerfluid_2.AtSupply)

# ---- group: Ground Source Heat Pump Ground Loop
panel_133 = Panel("""-14.583933,               !- G-Function Ln(T/Ts) Value 1
    -1.972435,                !- G-Function G Value 1
    -14.459771,               !- G-Function Ln(T/Ts) Value 2
    -1.918855,                !- G-Function G Value 2
    -14.335609,               !- G-Function Ln(T/Ts) Value 3
    -1.859847,                !- G-Function G Value 3
    -14.211447,               !- G-Function Ln(T/Ts) Value 4
    -1.795084,                !- G-Function G Value 4
    -14.087285,               !- G-Function Ln(T/Ts) Value 5
    -1.724279,                !- G-Function G Value 5
    -13.963123,               !- G-Function Ln(T/Ts) Value 6
    -1.647199,                !- G-Function G Value 6
    -13.838961,               !- G-Function Ln(T/Ts) Value 7
    -1.563689,                !- G-Function G Value 7
    -13.714800,               !- G-Function Ln(T/Ts) Value 8
    -1.473689,                !- G-Function G Value 8
    -13.590638,               !- G-Function Ln(T/Ts) Value 9
    -1.377264,                !- G-Function G Value 9
    -13.466476,               !- G-Function Ln(T/Ts) Value 10
    -1.274618,                !- G-Function G Value 10
    -13.342314,               !- G-Function Ln(T/Ts) Value 11
    -1.166121,                !- G-Function G Value 11
    -13.218152,               !- G-Function Ln(T/Ts) Value 12
    -1.052323,                !- G-Function G Value 12
    -13.093990,               !- G-Function Ln(T/Ts) Value 13
    -0.933960,                !- G-Function G Value 13
    -12.969828,               !- G-Function Ln(T/Ts) Value 14
    -0.811952,                !- G-Function G Value 14
    -12.845666,               !- G-Function Ln(T/Ts) Value 15
    -0.687385,                !- G-Function G Value 15
    -12.721504,               !- G-Function Ln(T/Ts) Value 16
    -0.561478,                !- G-Function G Value 16
    -12.597342,               !- G-Function Ln(T/Ts) Value 17
    -0.435532,                !- G-Function G Value 17
    -12.473181,               !- G-Function Ln(T/Ts) Value 18
    -0.310858,                !- G-Function G Value 18
    -12.349019,               !- G-Function Ln(T/Ts) Value 19
    -0.188706,                !- G-Function G Value 19
    -12.224857,               !- G-Function Ln(T/Ts) Value 20
    -0.070175,                !- G-Function G Value 20
    -12.100695,               !- G-Function Ln(T/Ts) Value 21
    0.043861,                 !- G-Function G Value 21
    -11.976533,               !- G-Function Ln(T/Ts) Value 22
    0.152817,                 !- G-Function G Value 22
    -11.852371,               !- G-Function Ln(T/Ts) Value 23
    0.256421,                 !- G-Function G Value 23
    -11.728209,               !- G-Function Ln(T/Ts) Value 24
    0.354716,                 !- G-Function G Value 24
    -11.604047,               !- G-Function Ln(T/Ts) Value 25
    0.448017,                 !- G-Function G Value 25
    -11.479885,               !- G-Function Ln(T/Ts) Value 26
    0.536839,                 !- G-Function G Value 26
    -11.355724,               !- G-Function Ln(T/Ts) Value 27
    0.621812,                 !- G-Function G Value 27
    -11.231562,               !- G-Function Ln(T/Ts) Value 28
    0.703595,                 !- G-Function G Value 28
    -11.107400,               !- G-Function Ln(T/Ts) Value 29
    0.782798,                 !- G-Function G Value 29
    -10.983238,               !- G-Function Ln(T/Ts) Value 30
    0.859943,                 !- G-Function G Value 30
    -10.859076,               !- G-Function Ln(T/Ts) Value 31
    0.935443,                 !- G-Function G Value 31
    -10.734914,               !- G-Function Ln(T/Ts) Value 32
    1.009606,                 !- G-Function G Value 32
    -10.610752,               !- G-Function Ln(T/Ts) Value 33
    1.082655,                 !- G-Function G Value 33
    -10.486590,               !- G-Function Ln(T/Ts) Value 34
    1.154746,                 !- G-Function G Value 34
    -10.362428,               !- G-Function Ln(T/Ts) Value 35
    1.225994,                 !- G-Function G Value 35
    -10.238267,               !- G-Function Ln(T/Ts) Value 36
    1.296483,                 !- G-Function G Value 36
    -10.114105,               !- G-Function Ln(T/Ts) Value 37
    1.366279,                 !- G-Function G Value 37
    -9.989943,                !- G-Function Ln(T/Ts) Value 38
    1.435438,                 !- G-Function G Value 38
    -9.865781,                !- G-Function Ln(T/Ts) Value 39
    1.504008,                 !- G-Function G Value 39
    -9.741619,                !- G-Function Ln(T/Ts) Value 40
    1.572032,                 !- G-Function G Value 40
    -9.617457,                !- G-Function Ln(T/Ts) Value 41
    1.639551,                 !- G-Function G Value 41
    -9.493295,                !- G-Function Ln(T/Ts) Value 42
    1.706601,                 !- G-Function G Value 42
    -9.369133,                !- G-Function Ln(T/Ts) Value 43
    1.773217,                 !- G-Function G Value 43
    -9.244971,                !- G-Function Ln(T/Ts) Value 44
    1.839433,                 !- G-Function G Value 44
    -9.120809,                !- G-Function Ln(T/Ts) Value 45
    1.905279,                 !- G-Function G Value 45
    -8.996648,                !- G-Function Ln(T/Ts) Value 46
    1.970785,                 !- G-Function G Value 46
    -8.872486,                !- G-Function Ln(T/Ts) Value 47
    2.035979,                 !- G-Function G Value 47
    -8.748324,                !- G-Function Ln(T/Ts) Value 48
    2.100886,                 !- G-Function G Value 48
    -8.624162,                !- G-Function Ln(T/Ts) Value 49
    2.165530,                 !- G-Function G Value 49
    -8.500000,                !- G-Function Ln(T/Ts) Value 50
    2.273322,                 !- G-Function G Value 50
    -7.800000,                !- G-Function Ln(T/Ts) Value 51
    2.617322,                 !- G-Function G Value 51
    -7.200000,                !- G-Function Ln(T/Ts) Value 52
    2.913796,                 !- G-Function G Value 52
    -6.500000,                !- G-Function Ln(T/Ts) Value 53
    3.270114,                 !- G-Function G Value 53
    -5.900000,                !- G-Function Ln(T/Ts) Value 54
    3.632967,                 !- G-Function G Value 54
    -5.200000,                !- G-Function Ln(T/Ts) Value 55
    4.270751,                 !- G-Function G Value 55
    -4.500000,                !- G-Function Ln(T/Ts) Value 56
    5.385970,                 !- G-Function G Value 56
    -3.963000,                !- G-Function Ln(T/Ts) Value 57
    6.614535,                 !- G-Function G Value 57
    -3.270000,                !- G-Function Ln(T/Ts) Value 58
    9.514729,                 !- G-Function G Value 58
    -2.864000,                !- G-Function Ln(T/Ts) Value 59
    11.884430,                !- G-Function G Value 59
    -2.577000,                !- G-Function Ln(T/Ts) Value 60
    13.917405,                !- G-Function G Value 60
    -2.171000,                !- G-Function Ln(T/Ts) Value 61
    17.276215,                !- G-Function G Value 61
    -1.884000,                !- G-Function Ln(T/Ts) Value 62
    19.987269,                !- G-Function G Value 62
    -1.191000,                !- G-Function Ln(T/Ts) Value 63
    27.202388,                !- G-Function G Value 63
    -0.497000,                !- G-Function Ln(T/Ts) Value 64
    34.744246,                !- G-Function G Value 64
    -0.274000,                !- G-Function Ln(T/Ts) Value 65
    36.928229,                !- G-Function G Value 65
    -0.051000,                !- G-Function Ln(T/Ts) Value 66
    38.950610,                !- G-Function G Value 66
    0.196000,                 !- G-Function Ln(T/Ts) Value 67
    40.938405,                !- G-Function G Value 67
    0.419000,                 !- G-Function Ln(T/Ts) Value 68
    42.516547,                !- G-Function G Value 68
    0.642000,                 !- G-Function Ln(T/Ts) Value 69
    43.874104,                !- G-Function G Value 69
    0.873000,                 !- G-Function Ln(T/Ts) Value 70
    45.060864,                !- G-Function G Value 70
    1.112000,                 !- G-Function Ln(T/Ts) Value 71
    46.062146,                !- G-Function G Value 71
    1.335000,                 !- G-Function Ln(T/Ts) Value 72
    46.806423,                !- G-Function G Value 72
    1.679000,                 !- G-Function Ln(T/Ts) Value 73
    47.649018,                !- G-Function G Value 73
    2.028000,                 !- G-Function Ln(T/Ts) Value 74
    48.218660,                !- G-Function G Value 74
    2.275000,                 !- G-Function Ln(T/Ts) Value 75
    48.496086,                !- G-Function G Value 75
    3.003000,                 !- G-Function Ln(T/Ts) Value 76
    48.956674;                !- G-Function G Value 76""")
panel_134 = Panel("Ground Source Heat Pump Loop")
groundhxvertical = Ironbug_GroundHeatExchangerVertical(GFunctions=panel_133, dupNum=False)
concat_63 = Concatenate(FragmentA=panel_134, FragmentB="Pump", JoinSeparator=" ")
pipeadiabatic_3 = Ironbug_PipeAdiabatic(dupNum=False)
pipeadiabatic_4 = Ironbug_PipeAdiabatic(dupNum=False)
f2c_7 = Ladybug_F2C(F="70")  # -> C; plug-in component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
objparams_45 = IB_ObjParams(Name=concat_63, DataFieldSetType="Ironbug.HVAC.IB_PumpVariableSpeed_FieldSet")
objparams_46 = IB_ObjParams(Name=panel_134, DataFieldSetType="Ironbug.HVAC.IB_PlantLoop_FieldSet")
plantbranches_4 = PlantBranches(Branch1=groundhxvertical, Branch=pipeadiabatic_4, mapBranchToLoop=False)
plantbranches_5 = PlantBranches(B1=duplicate_6.ToWaterLoop, B2=duplicate_7.ToWaterLoop, B3=filter_142, B4=pipeadiabatic_3, mapBranchToLoop=False)
spm_scheduled_4 = Ironbug_SetpointManagerScheduled(Temperature=f2c_7, dupNum=False)
pumpvariable_3 = Ironbug_PumpVariableSpeed(Parameters_=objparams_45, dupNum=False)
merge_66 = Merge(Data1=pumpvariable_3, Data2=plantbranches_4, Data3=spm_scheduled_4)
condenserwaterloop = Ironbug_CondenserWaterPlantLoop(Supply=merge_66, Demand=plantbranches_5, Parameters_=objparams_46, dupNum=False)

# ---- group: Water Source Heat Pump Condensor Loop (continued)
plantbranches_6 = PlantBranches(B1=duplicate.ToWaterLoop, B2=duplicate_2.ToWaterLoop, B3=filter_142, B4=ironbug_pipeadiabatic_2, mapBranchToLoop=False)
condenserwaterloop_2 = Ironbug_CondenserWaterPlantLoop(Supply=merge_65, Demand=plantbranches_6, SizingLoop=ironbug_sizingplant, Parameters_=objparams_43, dupNum=False)

# ----
merge_67 = Merge(Data1=flatten(filter_141), Data2=flatten(condenserwaterloop_2))
merge_68 = Merge(Data1=flatten(filter_141), Data2=flatten(condenserwaterloop))
filter_144 = StreamFilter(
    Gate=decision_6_hvac_system,
    Stream0=hwloop,
    Stream1=hwloop,
    Stream2=hwloop,
    Stream3=hwloop,
    Stream4=hwloop,
    Stream5=hwloop,
    Stream6=hwloop,
    Stream7=hwloop,
    Stream8=filter_141,
    Stream9=filter_141,
    Stream10=filter_141,
    Stream11=filter_141,
    Stream12=merge_67,
    Stream13=merge_67,
    Stream14=merge_68,
    Stream15=merge_68)
hvac_central_plant = Data(filter_144)

item_106 = ListItem(List=panel_127, Index=or_2, Wrap=True)
item_107 = ListItem(List=panel_128, Index=or_2, Wrap=True)

addition_8 = Addition(A=item_107, B=item_103)

# ---- group: Energy Recovery at Facade (continued)
objparams_47 = IB_ObjParams(MaximumFlowRate=cfm2m3s, Name=item_106, PressureRise="500", DataFieldSetType="Ironbug.HVAC.IB_FanOnOff_FieldSet")  # -> graft(HVACObjParams)
fanonoff_5 = Ironbug_FanOnOff(Parameters_=objparams_47, dupNum=False)
zoneerv = Ironbug_ZoneHVACEnergyRecoveryVentilator(
    HeatingExchanger=heatexchanger_air_2,
    SupplyFan=fanonoff_5,
    ExhaustFan=fanonoff_4,
    Parameters_=objparams_38,
    dupNum=False)  # -> flatten(ZoneHVACEnergyRecoveryVentilator)
filter_145 = StreamFilter(Gate=expression_60, Stream1=zoneerv)

# ----
merge_69 = Merge(Data1=simplify(graft(filter_140)), Data2=simplify(graft(filter_84)), Data3=simplify(graft(filter_145)))
zoneequipmentgroup = Ironbug_ZoneEquipmentGroup(ZoneEquipments=merge_69)  # -> flatten(ZoneEquipmentGroup)
thermalzone_2 = IB_ThermalZone(
    _HBRooms=bang.Branch0,
    AirTerminals_=duplicate_10.Objects,
    ZoneEquipments_=zoneequipmentgroup,
    Parameters_=objparams_9,
    IsAirTerminalPriorToZoneEquipments=True,
    dupNum=False)

# ---- group: Heat Pump Water Heater (continued)
filter_146 = StreamFilter(Gate=expression_46, Stream0=thermalzone, Stream1=thermalzone_2)
waterheatermixed_2 = IB_WaterHeaterMixed(AmbientTemperatureThermalZone_=filter_146, Parameters_=objparams_24, dupNum=False)
waterheaterheatpump = IB_WaterHeaterHeatPump(WaterHeaterMixed=waterheatermixed_2, Fan_=fanonoff_3, dupNum=False)

# ----
waterheaterheatpump_2 = IB_WaterHeaterHeatPump(WaterHeaterMixed=waterheatermixed_2, Fan_=fanonoff_3, Parameters_=objparams_25, dupNum=False)

objparams_48 = IB_ObjParams(
    MaximumFlowRate=cfm2m3s,
    Name=item_106,
    PressureRise=addition_8,
    DataFieldSetType="Ironbug.HVAC.IB_FanConstantVolume_FieldSet")  # -> graft(HVACObjParams)
fanconstant_3 = Ironbug_FanConstantVolume(Parameters_=objparams_48, dupNum=False)
entwine_13 = Entwine(
    Branch00=oasystem,
    Branch01=duplicate_11.Objects,
    Branch02=fanconstant_3,
    Branch03=duplicate_12.Objects,
    FlattenInputs=True)
airloopbranches = AirLoopBranches(Branch1=graft(thermalzone_2))
flip_2 = FlipMatrix(Data=entwine_13)  # -> simplify(Data)
airloop = Ironbug_AirLoopHVAC(Supply=flip_2, Demand=airloopbranches, SizingSystem=sizingsystem, Parameters_=objparams_28, dupNum=False)

noairloop = Ironbug_NoAirLoop(OSZones=thermalzone_2)
filter_147 = StreamFilter(Gate=expression_34, Stream0=airloop, Stream1=noairloop)

# ---- group: DHW Plant Loop
concat_64 = Concatenate(FragmentA=panel_63, FragmentB="Pump", JoinSeparator=" ")
filter_148 = StreamFilter(
    Gate=decision_7_dhw_system,
    Stream0=heatexchangerfluid.AtSupply,
    Stream1=boiler,
    Stream2=boiler,
    Stream3=waterheaterheatpump_2,
    Stream4=waterheaterheatpump_2,
    Stream5=waterheatermixed)
pipeadiabatic_5 = Ironbug_PipeAdiabatic(dupNum=False)
outputparams_3 = IB_OutputParams(SystemNodeTemperature=Toggle(True), outputFrequency=1)
objparams_49 = IB_ObjParams(
    DesignLoopExitTemperature=filter_40,
    LoopDesignTemperatureDifference="5",
    LoopType="Heating",
    DataFieldSetType="Ironbug.HVAC.IB_SizingPlant_FieldSet")
plantbranches_7 = PlantBranches(Branch1=wateruseconnections, Branch=pipeadiabatic_5, mapBranchToLoop=False)
expression_61 = Expression(x=decision_7_dhw_system, Expression="if(x>0,1,0)")
merge_70 = Merge(Data1=filter_143, Data2=filter_148)
sizingplant = Ironbug_SizingPlant(Parameters_=objparams_49, dupNum=False)
probe_2 = IB_Probe(Parameters_=outputparams_3, dupNum=False)
plantbranches_8 = PlantBranches(Branch1=filter_116, Branch=merge_70, mapBranchToLoop=False)

# ---- group: DHW Plant Loop / Pump Properties
objparams_50 = IB_ObjParams(
    MotorEfficiency="0.3",
    Name=concat_64,
    PumpControlType="Intermittent",
    RatedPumpHead="29891",
    DataFieldSetType="Ironbug.HVAC.IB_PumpConstantSpeed_FieldSet")

# ----
objparams_51 = IB_ObjParams(Name=concat_64, DataFieldSetType="Ironbug.HVAC.IB_PumpVariableSpeed_FieldSet")

# ---- group: DHW Plant Loop (continued)
pumpconstant_2 = Ironbug_PumpConstantSpeed(Parameters_=objparams_50, dupNum=False)
pumpvariable_4 = Ironbug_PumpVariableSpeed(Parameters_=objparams_51, dupNum=False)
filter_149 = StreamFilter(Gate=expression_61, Stream0=pumpconstant_2, Stream1=pumpvariable_4)
merge_71 = Merge(Data1=filter_149, Data2=plantbranches_8, Data3=spm_scheduled, Data4=probe_2)
hotwaterloop = Ironbug_HotWaterPlantLoop(Supply=merge_71, Demand=plantbranches_7, SizingLoop=sizingplant, Parameters_=objparams, dupNum=False)

# ----
dhw_plant = Data(hotwaterloop)
merge_72 = Merge(Data1=flatten(hvac_central_plant), Data2=flatten(dhw_plant))
hvacsystem = Ironbug_HVACSystem(AirLoops=flatten(filter_147), PlantLoops=flatten(merge_72), VRFSystems=flatten(filter_85))
savetofile_2 = IB_SaveToFile(NewFilePath=modeltoosm_2.osm, HVACSystem=hvacsystem, _write=filter_28, OverrideMode=False, writeMode=0)
filter_150 = StreamFilter(Gate=run_mode, Stream0=modeltoosm_2.osm, Stream1=savetofile_2)
runosm_2 = HBRunOSM(osm=filter_150, epw_file=localizer.LPathEPW, measures=merge_46, translate=filter_27, run=filter_28)  # -> report, idf, sql, zsz, rdd, html; plug-in component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
filter_151 = StreamFilter(Gate=expression_43, Stream0=runosm_2.html, Stream1=runidf.html)
filter_152 = StreamFilter(Gate=read_mode_2, Stream0=filter_151, Stream1=concat_5)
results_calculator_2 = ResultsCalculator(
    units=report_units_selection,
    electricity_carbon=electricity_co₂_kwh,
    gas_co2_kwh=gas_co₂_kwh,
    additional_fuel_co2_kwh=additional_fuel_co₂_kwh,
    district_cooling_co2_kwh=district_cooling_co₂_kwh,
    district_heating_co2_kwh=district_heating_co₂_kwh,
    dhw_source=expression_5,
    annual_dhw_result=filter_94,
    exterior_lighting_result=filter_19,
    elevator_result=filter_68,
    misc_1_name=misc_end_use_1_name,
    misc_end_use_source=misc_1_fuel_source,
    misc_end_use=misc_end_use_1_energy_kwh,
    misc_2_name=misc_end_use_2_name,
    misc_end_use_source_2=misc_2_fuel_source,
    misc_end_use_2=misc_end_use_2_energy_kwh,
    address_of_result_file=filter_152)  # -> timestamp, building_area, unmet_hours, building_wwr, north_wwr, east_wwr, south_wwr, west_wwr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

# ---- group: Normalize Peak Loads
expression_62 = Expression(x=results_calculator_2.peak_heating, y=results_calculator_2.building_area, Expression="x/y*1000")
expression_63 = Expression(x=results_calculator_2.peak_cooling, y=results_calculator_2.building_area, Expression="x/y*1000")

# ---- group: Demand Intensity
division_37 = Division(A=results_calculator_2.peak_electricity, B=results_calculator_2.building_area)

# ---- group: EUI
division_38 = Division(A=results_calculator_2.total_annual_energy_consumption, B=results_calculator_2.building_area)

# ---- group: Cost Use Intensity
division_39 = Division(A=results_calculator_2.total_annual_energy_cost, B=results_calculator_2.building_area)

# ---- group: Carbon Intensity
division_40 = Division(A=results_calculator_2.total_annual_energy_cost, B=results_calculator_2.building_area)

# ---- group: Proposed Output Variables
merge_73 = Merge(
    Data1=flatten(results_calculator_2.total_annual_energy_consumption),
    Data2=flatten(results_calculator_2.annual_energy_consumption_by_source),
    Data3=flatten(division_38),
    Data4=flatten(results_calculator_2.annual_energy_consumption_by_end_use),
    Data5=flatten(results_calculator_2.total_annual_energy_cost),
    Data6=flatten(results_calculator_2.virtual_fuel_rates),
    Data7=flatten(results_calculator_2.total_annual_carbon_emission),
    Data8=flatten(results_calculator_2.peak_heating),
    Data9=flatten(expression_62),
    Data10=flatten(results_calculator_2.peak_heating_hour),
    Data11=flatten(results_calculator_2.peak_heating_breakdown),
    Data12=flatten(results_calculator_2.peak_cooling),
    Data13=flatten(expression_63),
    Data14=flatten(results_calculator_2.peak_cooling_hour),
    Data15=flatten(results_calculator_2.peak_cooling_breakdown),
    Data16=flatten(results_calculator_2.peak_electricity),
    Data17=flatten(division_37))

# ---- group: Proposed QA/QC Variables
# Format Parameters By Columns
merge_74 = Merge(
    Data1=flatten(filter_23),
    Data2=flatten(filter_152),
    Data3=flatten(results_calculator_2.timestamp),
    Data4=flatten(results_calculator_2.unmet_hours))

# ---- group: Proposed Input Variables (continued)
merge_75 = Merge(
    Data1=flatten(item_96.Item),
    Data2=flatten(item_96.Item1),
    Data3=flatten(item_96.Item2),
    Data4=flatten(item_96.Item3),
    Data5=flatten(results_calculator_2.building_wwr),
    Data6=flatten(results_calculator_2.north_wwr),
    Data7=flatten(results_calculator_2.west_wwr),
    Data8=flatten(results_calculator_2.south_wwr),
    Data9=flatten(results_calculator_2.east_wwr),
    Data10=flatten(parametric_engine.north_shading_type),
    Data11=flatten(parametric_engine.north_shading_ratio_2),
    Data12=flatten(parametric_engine.east_shading_type),
    Data13=flatten(parametric_engine.east_sr),
    Data14=flatten(parametric_engine.south_shading_type),
    Data15=flatten(parametric_engine.south_shading_ratio),
    Data16=flatten(parametric_engine.west_shading_type),
    Data17=flatten(parametric_engine.west_shading_ratio_2),
    Data18=flatten(results_calculator_2.vertical_weighted_r_value),
    Data19=flatten(decnstrconstr.u_fac_ip),
    Data20=flatten(wall_2_u_value),
    Data21=flatten(decnstrconstr_2.u_fac_ip),
    Data22=flatten(exposed_floor_u_value),
    Data23=flatten(slab_on_grade_2),
    Data24=flatten(glass_u_value_2),
    Data25=flatten(glass_shgc_3),
    Data26=flatten(filter_67),
    Data27=flatten(division_11),
    Data28=flatten(infiltration_rate))

# ----
merge_76 = Merge(Data1=merge_74, Data2=merge_73, Data3=merge_75, Data4=merge_8)  # -> graft(Result)

writexl_4 = WriteToExcel(
    Run=filter_122,
    ExcelWorksheet=filter_31,
    WriteOptions=wo_3.WriteOptions,
    ColumnnsOrRows=toggle_8,
    DataToWriteIntoColumns=merge_76)

# ---- group: Visualize Energy Results (continued)
filter_153 = StreamFilter(
    Gate=visualize_results,
    Stream1=data_2,
    Stream2=roomenergyresult.cooling,
    Stream3=roomenergyresult.heating,
    Stream4=roomenergyresult.lighting,
    Stream5=faceresult.face_energy_flow,
    Stream6=faceresult.face_energy_flow,
    Stream7=faceresult.face_energy_flow)
normbyflr = HBNormalizeByFloorArea(data=filter_153, model=loadobjects.hb_objs)  # -> total_data, room_data; plug-in component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

# ----
filter_154 = StreamFilter(Gate=normalize_by_floor_area, Stream0=filter_153, Stream1=normbyflr.room_data)

# ---- group: Visualize Energy Results (continued)
toip = LBToIP(data_si=filter_154)  # -> data_ip; plug-in component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
filter_155 = StreamFilter(Gate=report_units_selection, Stream0=filter_154, Stream1=toip)
gate_7 = StreamGate(Stream=filter_155, Gate=expression_47)  # -> Target0, Target1
colorrooms = HBColorRooms(
    data=flatten(gate_7.Target0),
    rooms_model=flatten(deconstructmodel.rooms),
    period=analysisperiod.period,
    legend_par=gate_6.Target0)  # -> report, mesh, wire_frame, legend, title, rooms, colors, values; plug-in component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
colorfaces = HBColorFaces(data=flatten(gate_7.Target1), hb_objs=flatten(filter_130), period=analysisperiod.period, legend_par=gate_6.Target1)  # -> report, mesh, wire_frame, legend, title, faces, colors, values; plug-in component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
bnd = Bounds(Numbers=colorrooms.values)
bnd_2 = Bounds(Numbers=colorfaces.values)
filter_156 = StreamFilter(Gate=expression_47, Stream0=bnd, Stream1=bnd_2)

# ----
metric_range = Panel(filter_156)

# ----
# Construct Energy Balance
# (storage term is hot water)
loadbalance = HBThermalLoadBalance(
    rooms_model=flatten(loadobjects.hb_objs),
    cooling=roomenergyresult.cooling,
    heating=roomenergyresult.heating,
    lighting=roomenergyresult.lighting,
    electric_equip=roomenergyresult.electric_equip,
    people_gain=roomenergyresult.people_gain,
    solar_gain=roomenergyresult.solar_gain,
    infiltration_load=roomenergyresult.infiltration_load,
    mech_vent_load=roomenergyresult.mech_vent_load,
    nat_vent_load=roomenergyresult.nat_vent_load,
    face_energy_flow=faceresult.face_energy_flow)  # -> report, balance, balance_stor, norm_bal, norm_bal_stor; plug-in component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
colrange = LBColorRange(index="19")  # -> colors; plug-in component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
filter_157 = StreamFilter(Gate=view_load_balance_diagram, Stream1=loadbalance.norm_bal_stor)
legendpar_2 = LBLegendParameters(min=min_8, max=max_8, colors=colrange, num_decimals="1", text_height="1.5")  # -> leg_par; plug-in component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
timeop = LBTimeIntervalOperation(data=filter_157)  # -> daily, monthly, mon_per_hr; plug-in component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

toip_2 = LBToIP(data_si=timeop.monthly)  # -> data_ip; plug-in component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
filter_158 = StreamFilter(Gate=report_units_selection, Stream0=timeop.monthly, Stream1=toip_2)

monthlychart = LBMonthlyChart(
    data=filter_158,
    base_pt="-200, 0, 0",
    y_dim="60",
    stack=Toggle(True),
    global_title="Monthly Energy Balance Diagram",
    legend_par=legendpar_2)  # -> report, data_mesh, data_lines, col_lines, legend, borders, labels, y_title, title; plug-in component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

# ==== cluster FileDirectoryFinder
results_location = ClusterInput()  # Location of Excel Results File
option_for_result_placement = ClusterInput()  # Option of Result File Location
text_split = TextSplit(Text=results_location, Separators=".")
list_item = ListItem(List=text_split, Index="0", Wrap=True)
text_split_2 = TextSplit(Text=list_item, Separators=":")
list_item_2 = ListItem(List=text_split_2, Index="1", Wrap=True)
text_split_3 = TextSplit(Text=list_item_2, Separators="\")
list_length = ListLength(List=text_split_3)
subtraction = Subtraction(A=list_length, B="2")
sub_list = SubList(List=text_split_3, Domain=subtraction, Wrap=True)  # -> List, Index
list_item_3 = ListItem(List=text_split_2, Index="0", Wrap=True)
concatenate = Concatenate(FragmentA=list_item_3, FragmentB=":")
text_join = TextJoin(Text=sub_list.List, Join="\")
default = Panel("c:\ladybug\")
concatenate_2 = Concatenate(FragmentA=concatenate, FragmentB=text_join)
stream_filter = StreamFilter(Gate=option_for_result_placement, Stream0=default, Stream1=concatenate_2)  # -> flatten(Stream)
s_0 = ClusterOutput(stream_filter)

# ==== cluster ParametricEngine
custom_variable_1 = ClusterInput()  # Custom variable for parameterization
custom_variable_2 = ClusterInput()  # Custom variable for parameterization
custom_variable_3 = ClusterInput()  # Custom variable for parameterization
custom_variable_4 = ClusterInput()  # Custom variable for parameterization
custom_variable_5 = ClusterInput()  # Custom variable for parameterization
custom_variable_6 = ClusterInput()  # Custom variable for parameterization
custom_variable_7 = ClusterInput()  # Custom variable for parameterization
custom_variable_8 = ClusterInput()  # Custom variable for parameterization
custom_variable_9 = ClusterInput()  # Custom variable for parameterization
custom_variable_10 = ClusterInput()  # Custom variable for parameterization
custom_12 = ClusterInput()
option_to_select = ClusterInput()  # Option to chose
north_shadingtype = ClusterInput()
north_shading_ratio = ClusterInput()  # Value(s) to cross reference
east_shadingtype = ClusterInput()
east_shading_ratio = ClusterInput()  # Value(s) to cross reference
south_shadingtype = ClusterInput()
sourth_shading_ratio = ClusterInput()  # Value(s) to cross reference
west_shadingtype = ClusterInput()
west_shading_ratio = ClusterInput()  # Value(s) to cross reference
custom_11 = ClusterInput()
glazing_method = ClusterInput()  # Specification of glazing input (0=autogenerated, 1=custom surfaces, 2=combination of both)
parsch = ClusterInput()  # Parametric Scheme
shading_parametric_scheme = ClusterInput()  # Shading Parametric Scheme
master_envelopethermal_parametric_scheme = ClusterInput()  # Master Envelope Thermal Parametric Scheme
assembly_parametric_scheme = ClusterInput()  # Assembly Parametric Scheme
glass_parametric_scheme = ClusterInput()  # Glass Parametric Scheme
north_wwr = ClusterInput()  # Value(s) to cross reference
east_wwr = ClusterInput()  # Value(s) to cross reference
sourth_wwr = ClusterInput()  # Value(s) to cross reference
west_wwr = ClusterInput()  # Value(s) to cross reference
wall_u_value = ClusterInput()  # Value(s) to cross reference
wall2_u_value = ClusterInput()  # Value(s) to cross reference
roof_u_value = ClusterInput()  # Value(s) to cross reference
exposed_floor_u_value = ClusterInput()  # Value(s) to cross reference
ground_floor_u_value = ClusterInput()  # Value(s) to cross reference
glass_u_value = ClusterInput()  # Value(s) to cross reference
glass_shgc = ClusterInput()  # Value(s) to cross reference
glass_vlt = ClusterInput()  # Value(s) to cross reference
infiltration_rate = ClusterInput()
global_parametric_scheme = ClusterInput()  # Enter '0' to cross reference all variables. Even by linking some facade properties to reduce the total options, this scheme can still produce a lot of options. Enter '1' to limit the number of alteratives by looking at the various parameters in isolation compared to the base option, which is considered to be the product of the first parameter of each list.
lng = ListLength(List=wall_u_value)
lng_2 = ListLength(List=glass_u_value)
series = Series(Start=0, Step=1, Count=lng)
series_2 = Series(Start=0, Step=1, Count=lng_2)

# ---- group: WWR
filter = StreamFilter(Gate=parsch, Stream0=east_wwr)
filter_2 = StreamFilter(Gate=parsch, Stream0=sourth_wwr)
filter_3 = StreamFilter(Gate=parsch, Stream0=west_wwr)

# ---- group: ST
filter_4 = StreamFilter(Gate=shading_parametric_scheme, Stream0=east_shadingtype)
filter_5 = StreamFilter(Gate=shading_parametric_scheme, Stream0=south_shadingtype)
filter_6 = StreamFilter(Gate=shading_parametric_scheme, Stream0=west_shadingtype)

# ---- group: SR
filter_7 = StreamFilter(Gate=shading_parametric_scheme, Stream0=east_shading_ratio)
filter_8 = StreamFilter(Gate=shading_parametric_scheme, Stream0=sourth_shading_ratio)
filter_9 = StreamFilter(Gate=shading_parametric_scheme, Stream0=west_shading_ratio)

# ---- group: Opaque Selection
expression = Expression(x=master_envelopethermal_parametric_scheme, y=assembly_parametric_scheme, Expression="IF(x=1,2,y)")

# ---- group: Assem Prop
filter_10 = StreamFilter(Gate=expression, Stream0=wall_u_value, Stream1=series, Stream2=series)
filter_11 = StreamFilter(Gate=expression, Stream0=wall2_u_value)
filter_12 = StreamFilter(Gate=expression, Stream0=roof_u_value)
filter_13 = StreamFilter(Gate=expression, Stream0=exposed_floor_u_value)
filter_14 = StreamFilter(Gate=expression, Stream0=ground_floor_u_value)
filter_15 = StreamFilter(Gate=expression, Stream0=infiltration_rate)

# ---- group: Glazing Selection
expression_2 = Expression(x=master_envelopethermal_parametric_scheme, y=glass_parametric_scheme, Expression="IF(x=1,2,y)")

# ---- group: Glaz Prop
filter_16 = StreamFilter(Gate=expression_2, Stream0=glass_u_value, Stream1=series_2)
filter_17 = StreamFilter(Gate=expression_2, Stream0=glass_shgc)
filter_18 = StreamFilter(Gate=expression_2, Stream0=glass_vlt)

# ----
filter_19 = StreamFilter(Gate=expression_2, Stream0=glass_vlt)

# ---- group: Glazing Method Selection
expression_3 = Expression(x=glazing_method, Expression="IF(x=1,1,0)")

# ---- group: Custom Glazing Override
filter_20 = StreamFilter(Gate=expression_3, Stream0=north_wwr, Stream1="0")
filter_21 = StreamFilter(Gate=expression_3, Stream0=filter, Stream1="0")
filter_22 = StreamFilter(Gate=expression_3, Stream0=filter_2, Stream1="0")
filter_23 = StreamFilter(Gate=expression_3, Stream0=filter_3, Stream1="0")

# ----
crossref = CrossReference(
    ListA=filter_20,
    ListB=filter_21,
    ListC=filter_22,
    ListD=filter_23,
    ListE=north_shadingtype,
    ListF=north_shading_ratio,
    ListG=filter_4,
    ListH=filter_7,
    ListI=filter_5,
    ListJ=filter_8,
    ListK=filter_6,
    ListL=filter_9,
    ListM=filter_10,
    ListN=filter_11,
    ListO=filter_12,
    ListP=filter_13,
    ListQ=filter_14,
    ListR=filter_16,
    ListS=filter_17,
    ListT=filter_18,
    ListU=filter_15,
    ListV=custom_variable_1,
    ListW=custom_variable_2,
    ListX=custom_variable_3,
    ListY=custom_variable_4,
    ListZ=custom_variable_5,
    ListAA=custom_variable_6,
    ListAB=custom_variable_7,
    ListAC=custom_variable_8,
    ListAD=custom_variable_9,
    ListAE=custom_variable_10,
    ListAF=custom_11,
    ListAG=custom_12,
    CrossMode=1)  # -> ListA, ListB, ListC, ListD, ListE, ListF, ListG, ListH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; disabled
entwine = Entwine(
    Branch00=filter_20,
    Branch01=filter_21,
    Branch02=filter_22,
    Branch03=filter_23,
    Branch04=north_shadingtype,
    Branch05=north_shading_ratio,
    Branch06=filter_4,
    Branch07=filter_7,
    Branch08=filter_5,
    Branch09=filter_8,
    Branch010=filter_6,
    Branch011=filter_9,
    Branch012=filter_10,
    Branch013=filter_11,
    Branch014=filter_12,
    Branch015=filter_13,
    Branch016=filter_14,
    Branch017=filter_16,
    Branch018=filter_17,
    Branch019=filter_18,
    Branch020=filter_15,
    Branch021=custom_variable_1,
    Branch022=custom_variable_2,
    Branch023=custom_variable_3,
    Branch024=custom_variable_4,
    Branch025=custom_variable_5,
    Branch026=custom_variable_6,
    Branch027=custom_variable_7,
    Branch028=custom_variable_8,
    Branch029=custom_variable_9,
    Branch030=custom_variable_10,
    Branch031=custom_11,
    Branch032=custom_12,
    FlattenInputs=True)
split = SplitTree(Data=entwine, Masks=flatten("{0;0}"))  # -> Positive, Negative
cull_i = CullIndex(List=split.Negative, Indices="0", Wrap=True)
bang = ExplodeTree(Data=entwine)  # -> Branch0, Branch1, Branch2, Branch3, Branch4, Branch5, Branch6, Branch7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
pshift = ShiftPaths(Data=cull_i, Offset=-1)
repeat = RepeatData(Data=wall_u_value, Length=lng)
repeat_2 = RepeatData(Data=wall2_u_value, Length=lng)
repeat_3 = RepeatData(Data=ground_floor_u_value, Length=lng)
repeat_4 = RepeatData(Data=roof_u_value, Length=lng)
repeat_5 = RepeatData(Data=exposed_floor_u_value, Length=lng)
repeat_6 = RepeatData(Data=glass_shgc, Length=lng_2)
repeat_7 = RepeatData(Data=glass_shgc, Length=lng)
repeat_8 = RepeatData(Data=glass_vlt, Length=lng_2)
repeat_9 = RepeatData(Data=glass_vlt, Length=lng)
repeat_10 = RepeatData(Data=glass_u_value, Length=lng_2)
repeat_11 = RepeatData(Data=glass_u_value, Length=lng)
merge = Merge(Data1=split.Positive, Data2=pshift)
replace = ReplaceMembers(Set=crossref.ListM, Find=filter_10, Replace=repeat)
replace_2 = ReplaceMembers(Set=crossref.ListM, Find=filter_10, Replace=repeat_2)
replace_3 = ReplaceMembers(Set=crossref.ListM, Find=filter_10, Replace=repeat_4)
replace_4 = ReplaceMembers(Set=crossref.ListM, Find=filter_10, Replace=repeat_5)
replace_5 = ReplaceMembers(Set=crossref.ListM, Find=filter_10, Replace=repeat_3)

# ---- group: Opaque Envelope
repeat_12 = RepeatData(Data=infiltration_rate, Length=lng)
replace_6 = ReplaceMembers(Set=crossref.ListM, Find=filter_10, Replace=repeat_12)
filter_24 = StreamFilter(Gate=expression, Stream0=crossref.ListQ, Stream1=replace_6, Stream2=replace_6)
filter_25 = StreamFilter(Gate=expression, Stream0=crossref.ListM, Stream1=replace, Stream2=replace)
filter_26 = StreamFilter(Gate=expression, Stream0=crossref.ListO, Stream1=replace_3, Stream2=replace_3)
filter_27 = StreamFilter(Gate=expression, Stream0=crossref.ListP, Stream1=replace_4, Stream2=replace_4)
filter_28 = StreamFilter(Gate=expression, Stream0=crossref.ListQ, Stream1=replace_5, Stream2=replace_5)

# ----
replace_7 = ReplaceMembers(Set=crossref.ListR, Find=filter_16, Replace=repeat_10)
replace_8 = ReplaceMembers(Set=crossref.ListM, Find=filter_10, Replace=repeat_11)
replace_9 = ReplaceMembers(Set=crossref.ListR, Find=filter_16, Replace=repeat_6)
replace_10 = ReplaceMembers(Set=crossref.ListM, Find=filter_10, Replace=repeat_7)
replace_11 = ReplaceMembers(Set=crossref.ListR, Find=filter_16, Replace=repeat_8)
replace_12 = ReplaceMembers(Set=crossref.ListM, Find=filter_10, Replace=repeat_9)
lng_3 = ListLength(List=merge)

# ---- group: WWR
panel = Panel("""{0;1}
{0;2}
{0;3}""")
split_2 = SplitTree(Data=lng_3, Masks=flatten("{0;0}"))  # -> Positive, Negative
item = ListItem(List=panel, Index=0, Wrap=True)  # -> Item, Item1, Item2
replace_13 = ReplacePaths(Data=split_2.Positive, Search="{0;0}", Replace=item.Item)
replace_14 = ReplacePaths(Data=split_2.Positive, Search="{0;0}", Replace=item.Item1)
replace_15 = ReplacePaths(Data=split_2.Positive, Search="{0;0}", Replace=item.Item2)
merge_2 = Merge(Data1=lng_3, Data2=replace_13, Data3=replace_14, Data4=replace_15)
filter_29 = StreamFilter(Gate=parsch, Stream0=lng_3, Stream1=merge_2)

# ---- group: Shading Type
panel_2 = Panel("""{0;6}
{0;8}
{0;10}""")
split_3 = SplitTree(Data=filter_29, Masks=flatten("{0;4}"))  # -> Positive, Negative
item_2 = ListItem(List=panel_2, Index=0, Wrap=True)  # -> Item, Item1, Item2
replace_16 = ReplacePaths(Data=split_3.Positive, Search="{0;4}", Replace=item_2.Item)
replace_17 = ReplacePaths(Data=split_3.Positive, Search="{0;4}", Replace=item_2.Item1)
replace_18 = ReplacePaths(Data=split_3.Positive, Search="{0;4}", Replace=item_2.Item2)
merge_3 = Merge(Data1=filter_29, Data2=replace_16, Data3=replace_17, Data4=replace_18)
filter_30 = StreamFilter(Gate=shading_parametric_scheme, Stream0=filter_29, Stream1=merge_3)

# ---- group: Shading Ratio
panel_3 = Panel("""{0;7}
{0;9}
{0;11}""")
split_4 = SplitTree(Data=filter_30, Masks=flatten("{0;5}"))  # -> Positive, Negative
item_3 = ListItem(List=panel_3, Index=0, Wrap=True)  # -> Item, Item1, Item2
replace_19 = ReplacePaths(Data=split_4.Positive, Search="{0;5}", Replace=item_3.Item)
replace_20 = ReplacePaths(Data=split_4.Positive, Search="{0;5}", Replace=item_3.Item1)
replace_21 = ReplacePaths(Data=split_4.Positive, Search="{0;5}", Replace=item_3.Item2)
merge_4 = Merge(Data1=filter_30, Data2=replace_19, Data3=replace_20, Data4=replace_21)
filter_31 = StreamFilter(Gate=shading_parametric_scheme, Stream0=filter_30, Stream1=merge_4)

# ---- group: WWR
filter_32 = StreamFilter(Gate=parsch, Stream0=crossref.ListA, Stream1=crossref.ListA)
filter_33 = StreamFilter(Gate=parsch, Stream0=crossref.ListB, Stream1=crossref.ListA)
filter_34 = StreamFilter(Gate=parsch, Stream0=crossref.ListC, Stream1=crossref.ListA)
filter_35 = StreamFilter(Gate=parsch, Stream0=crossref.ListD, Stream1=crossref.ListA)

# ---- group: Shading Type
filter_36 = StreamFilter(Gate=shading_parametric_scheme, Stream0=crossref.ListE, Stream1=crossref.ListE)
filter_37 = StreamFilter(Gate=shading_parametric_scheme, Stream0=crossref.ListG, Stream1=crossref.ListE)
filter_38 = StreamFilter(Gate=shading_parametric_scheme, Stream0=crossref.ListI, Stream1=crossref.ListE)
filter_39 = StreamFilter(Gate=shading_parametric_scheme, Stream0=crossref.ListK, Stream1=crossref.ListE)

# ---- group: Shading Ratio
filter_40 = StreamFilter(Gate=shading_parametric_scheme, Stream0=crossref.ListF, Stream1=crossref.ListF)
filter_41 = StreamFilter(Gate=shading_parametric_scheme, Stream0=crossref.ListH, Stream1=crossref.ListF)
filter_42 = StreamFilter(Gate=shading_parametric_scheme, Stream0=crossref.ListJ, Stream1=crossref.ListF)
filter_43 = StreamFilter(Gate=shading_parametric_scheme, Stream0=crossref.ListL, Stream1=crossref.ListF)

# ----
filter_44 = StreamFilter(Gate=expression, Stream0=crossref.ListN, Stream1=replace_2, Stream2=replace_2)

# ---- group: Glazing
filter_45 = StreamFilter(Gate=expression_2, Stream0=crossref.ListR, Stream1=replace_7, Stream2=replace_8)
filter_46 = StreamFilter(Gate=expression_2, Stream0=crossref.ListS, Stream1=replace_9, Stream2=replace_10)
filter_47 = StreamFilter(Gate=expression_2, Stream0=crossref.ListT, Stream1=replace_11, Stream2=replace_12)

# ----
ma = MassAddition(Input=flatten(lng_3))  # -> Result, PartialResults

# ---- group: Opaque Envelope
panel_4 = Panel("""{0;13}
{0;14}
{0;15}
{0;16}""")
split_5 = SplitTree(Data=filter_31, Masks=flatten("{0;12}"))  # -> Positive, Negative
item_4 = ListItem(List=panel_4, Index=0, Wrap=True)  # -> Item, Item1, Item2, Item3
replace_22 = ReplacePaths(Data=split_5.Positive, Search="{0;12}", Replace=item_4.Item)
replace_23 = ReplacePaths(Data=split_5.Positive, Search="{0;12}", Replace=item_4.Item1)
replace_24 = ReplacePaths(Data=split_5.Positive, Search="{0;12}", Replace=item_4.Item2)
replace_25 = ReplacePaths(Data=split_5.Positive, Search="{0;12}", Replace=item_4.Item3)
merge_5 = Merge(Data1=filter_31, Data2=replace_22, Data3=replace_23, Data4=replace_24, Data5=replace_25)
filter_48 = StreamFilter(Gate=expression, Stream0=filter_31, Stream1=merge_5)

# ----
cull_i_2 = CullIndex(List=custom_variable_1, Indices="0", Wrap=True)
lng_4 = ListLength(List=cull_i_2)
series_3 = Series(Start="16", Step=1, Count=lng_4)
cull_i_3 = CullIndex(List=filter_12, Indices="0", Wrap=True)
lng_5 = ListLength(List=cull_i_3)
series_4 = Series(Start="10", Step=1, Count=lng_5)
cull_i_4 = CullIndex(List=filter_16, Indices="0", Wrap=True)
lng_6 = ListLength(List=cull_i_4)
series_5 = Series(Start="13", Step=1, Count=lng_6)
cull_i_5 = CullIndex(List=bang.Branch5, Indices="0", Wrap=True)
lng_7 = ListLength(List=cull_i_5)
series_6 = Series(Start="1", Step=1, Count=lng_7)
cull_i_6 = CullIndex(List=filter_10, Indices="0", Wrap=True)
lng_8 = ListLength(List=cull_i_6)
series_7 = Series(Start="4", Step=1, Count=lng_8)
cull_i_7 = CullIndex(List=custom_variable_3, Indices="0", Wrap=True)
lng_9 = ListLength(List=cull_i_7)
cull_i_8 = CullIndex(List=custom_variable_4, Indices="0", Wrap=True)
lng_10 = ListLength(List=cull_i_8)
series_8 = Series(Start="35", Step=1, Count=lng_9)
series_9 = Series(Start="50", Step=1, Count=lng_10)
cull_i_9 = CullIndex(List=custom_variable_2, Indices="0", Wrap=True)
lng_11 = ListLength(List=cull_i_9)
series_10 = Series(Start="31", Step=1, Count=lng_11)
cull_i_10 = CullIndex(List=custom_variable_5, Indices="0", Wrap=True)
lng_12 = ListLength(List=cull_i_10)
series_11 = Series(Start="54", Step=1, Count=lng_12)
cull_i_11 = CullIndex(List=custom_variable_7, Indices="0", Wrap=True)
lng_13 = ListLength(List=cull_i_11)
cull_i_12 = CullIndex(List=custom_variable_8, Indices="0", Wrap=True)
lng_14 = ListLength(List=cull_i_12)
series_12 = Series(Start="63", Step=1, Count=lng_13)
series_13 = Series(Start="64", Step=1, Count=lng_14)
cull_i_13 = CullIndex(List=custom_variable_6, Indices="0", Wrap=True)
lng_15 = ListLength(List=cull_i_13)
series_14 = Series(Start="57", Step=1, Count=lng_15)
repeat_13 = RepeatData(Data=filter_20, Length=ma.Result)
repeat_14 = RepeatData(Data=filter_15, Length=ma.Result)
repeat_15 = RepeatData(Data=filter_13, Length=ma.Result)
repeat_16 = RepeatData(Data=filter_14, Length=ma.Result)
repeat_17 = RepeatData(Data=filter_11, Length=ma.Result)
repeat_18 = RepeatData(Data=north_shadingtype, Length=ma.Result)
entwine_2 = Entwine(
    Branch00=filter_32,
    Branch01=filter_33,
    Branch02=filter_34,
    Branch03=filter_35,
    Branch04=filter_36,
    Branch05=filter_40,
    Branch06=filter_37,
    Branch07=filter_41,
    Branch08=filter_38,
    Branch09=filter_42,
    Branch010=filter_39,
    Branch011=filter_43,
    Branch012=filter_25,
    Branch013=filter_44,
    Branch014=filter_26,
    Branch015=filter_27,
    Branch016=filter_28,
    Branch017=filter_45,
    Branch018=filter_46,
    Branch019=filter_47,
    Branch020=filter_24,
    Branch021=crossref.ListV,
    Branch022=crossref.ListW,
    Branch023=crossref.ListX,
    Branch024=crossref.ListY,
    Branch025=crossref.ListZ,
    Branch026=crossref.ListAA,
    Branch027=crossref.ListAB,
    Branch028=crossref.ListAC,
    Branch029=crossref.ListAD,
    Branch030=crossref.ListAE,
    Branch031=crossref.ListAF,
    Branch032=crossref.ListAG,
    FlattenInputs=True)
tstat = TreeStatistics(Tree=entwine)  # -> Paths, Length, Count
split_6 = SplitList(List=tstat.Paths, Index="20")  # -> ListA, ListB
panel_5 = Panel("""4
8
5
3""")
partition = PartitionList(List=split_6.ListA, Size=panel_5)
bang_2 = ExplodeTree(Data=partition)  # -> _0000, _0001, _0002, _0003

# ---- group: Glazing
panel_6 = Panel("""{0;18}
{0;19}""")
split_7 = SplitTree(Data=filter_48, Masks=flatten("{0;17}"))  # -> Positive, Negative
item_5 = ListItem(List=panel_6, Index=0, Wrap=True)  # -> Item, Item1, Item2
replace_26 = ReplacePaths(Data=split_7.Positive, Search="{0;17}", Replace=item_5.Item)
replace_27 = ReplacePaths(Data=split_7.Positive, Search="{0;17}", Replace=item_5.Item1)
merge_6 = Merge(Data1=filter_48, Data2=replace_26, Data3=replace_27)
filter_49 = StreamFilter(Gate=shading_parametric_scheme, Stream0=filter_48, Stream1=merge_6)

# ----
dispatch = Dispatch(List=bang_2._0001, DispatchPattern=[True, False])  # -> ListA, ListB
split_8 = SplitList(List=bang_2._0000, Index="1")  # -> ListA, ListB
split_9 = SplitList(List=dispatch.ListA, Index="1")  # -> ListA, ListB
split_10 = SplitList(List=dispatch.ListB, Index="1")  # -> ListA, ListB
split_11 = SplitList(List=bang_2._0002, Index="1")  # -> ListA, ListB
split_12 = SplitList(List=bang_2._0003, Index="1")  # -> ListA, ListB
panel_7 = Panel(filter_49)
repeat_19 = RepeatData(Data="0", Length=ma.Result)
replace_28 = ReplaceItems(List=repeat_19, Item=cull_i_2, Indices=series_3, Wrap=False)
replace_29 = ReplaceItems(List=repeat_19, Item=cull_i_3, Indices=series_4, Wrap=False)
replace_30 = ReplaceItems(List=repeat_19, Item=cull_i_4, Indices=series_5, Wrap=False)
replace_31 = ReplaceItems(List=repeat_19, Item=cull_i_5, Indices=series_6, Wrap=False)
replace_32 = ReplaceItems(List=repeat_19, Item=cull_i_6, Indices=series_7, Wrap=False)
replace_33 = ReplaceItems(List=repeat_19, Item=cull_i_7, Indices=series_8, Wrap=False)
replace_34 = ReplaceItems(List=repeat_19, Item=cull_i_8, Indices=series_9, Wrap=False)
replace_35 = ReplaceItems(List=repeat_19, Item=cull_i_9, Indices=series_10, Wrap=False)
replace_36 = ReplaceItems(List=repeat_19, Item=cull_i_10, Indices=series_11, Wrap=False)
replace_37 = ReplaceItems(List=repeat_19, Item=cull_i_11, Indices=series_12, Wrap=False)
replace_38 = ReplaceItems(List=repeat_19, Item=cull_i_12, Indices=series_13, Wrap=False)
replace_39 = ReplaceItems(List=repeat_19, Item=cull_i_13, Indices=series_14, Wrap=False)
entwine_3 = Entwine(
    Branch00=repeat_13,
    Branch01=repeat_13,
    Branch02=repeat_13,
    Branch03=repeat_13,
    Branch04=repeat_18,
    Branch05=replace_31,
    Branch06=repeat_18,
    Branch07=replace_31,
    Branch08=repeat_18,
    Branch09=replace_31,
    Branch010=repeat_18,
    Branch011=replace_31,
    Branch012=replace_32,
    Branch013=repeat_17,
    Branch014=replace_29,
    Branch015=repeat_15,
    Branch016=repeat_16,
    Branch017=replace_30,
    Branch018=replace_30,
    Branch019=replace_30,
    Branch020=repeat_14,
    Branch021=replace_28,
    Branch022=replace_35,
    Branch023=replace_33,
    Branch024=replace_34,
    Branch025=replace_36,
    Branch026=replace_39,
    Branch027=replace_37,
    Branch028=replace_38,
    Branch029=custom_variable_9,
    Branch030=custom_variable_10,
    Branch031=custom_11,
    Branch032=custom_12,
    FlattenInputs=True)
filter_50 = StreamFilter(Gate=global_parametric_scheme, Stream0=entwine_2, Stream1=entwine_3)
item_6 = ListItem(List=filter_50, Index=expr("x-1", option_to_select), Wrap=True)
bang_3 = ExplodeTree(Data=item_6)  # -> Branch0, Branch1, Branch2, Branch3, Branch4, Branch5, Branch6, Branch7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
lng_16 = ListLength(List=filter_50)  # -> flatten(Length)
item_7 = ListItem(List=lng_16, Index=0, Wrap=True)
ground_floor_u_value_2 = ClusterOutput(bang_3.Branch16)  # Ground_Floor U-Value
infiltration_rate_2 = ClusterOutput(bang_3.Branch20)
wall2_u_value_2 = ClusterOutput(bang_3.Branch13)  # Alternate wall or thermal bridge U-Value
glass_u_value_2 = ClusterOutput(bang_3.Branch17)  # Glass U-Value
floor_u_value = ClusterOutput(bang_3.Branch15)  # Exposed Floor U-Value
roof_u_value_2 = ClusterOutput(bang_3.Branch14)  # Roof U-Value
wall_u_value_2 = ClusterOutput(bang_3.Branch12)  # Wall U-Value
glass_shgc_2 = ClusterOutput(bang_3.Branch18)  # Glass SHGC
custom_10 = ClusterOutput(bang_3.Branch30)
custom_11_2 = ClusterOutput(bang_3.Branch31)
custom_12_2 = ClusterOutput(bang_3.Branch32)
custom_variable_1_2 = ClusterOutput(bang_3.Branch21)  # Custom Variable
custom_variable_2_2 = ClusterOutput(bang_3.Branch22)  # Custom Variable
custom_variable_3_2 = ClusterOutput(bang_3.Branch23)  # Custom Variable
custom_variable_4_2 = ClusterOutput(bang_3.Branch24)  # Custom Variable
custom_variable_5_2 = ClusterOutput(bang_3.Branch25)  # Custom Variable
custom_6 = ClusterOutput(bang_3.Branch26)
custom_7 = ClusterOutput(bang_3.Branch27)
custom_8 = ClusterOutput(bang_3.Branch28)
custom_9 = ClusterOutput(bang_3.Branch29)
glass_vlt_2 = ClusterOutput(bang_3.Branch19)  # Glass VLT
number_of_options = ClusterOutput(item_7)  # Number of Options For Simulation
west_wwr_2 = ClusterOutput(bang_3.Branch3)  # Window to Wall Ratio
north_wwr_2 = ClusterOutput(bang_3.Branch0)  # Window to Wall Ratio
south_wwr = ClusterOutput(bang_3.Branch2)  # Window to Wall Ratio
east_wwr_2 = ClusterOutput(bang_3.Branch1)  # Window to Wall Ratio
west_shading_ratio_2 = ClusterOutput(bang_3.Branch11)  # Shading Ratio
north_shading_type = ClusterOutput(bang_3.Branch4)  # Shading Type
north_shading_ratio_2 = ClusterOutput(bang_3.Branch5)  # Shading Ratio
east_shading_type = ClusterOutput(bang_3.Branch6)  # Shading Type
east_sr = ClusterOutput(bang_3.Branch7)  # Window to Wall Ratio
south_shading_type = ClusterOutput(bang_3.Branch8)  # Shading Type
south_shading_ratio = ClusterOutput(bang_3.Branch9)  # Shading Ratio
west_shading_type = ClusterOutput(bang_3.Branch10)  # Shading Type
branch = TreeBranch(Tree=entwine, Path=bang_2._0000, MaintainPaths=True)
branch_2 = TreeBranch(Tree=entwine, Path=split_8.ListA, MaintainPaths=True)
merge_7 = Merge(Data1="0", Data2=ma.PartialResults)
lng_17 = ListLength(List=ma.PartialResults)
cull_i_14 = CullIndex(List=merge_7, Indices=lng_17, Wrap=True)
series_15 = Series(Start=simplify(graft(cull_i_14)), Step=1, Count=simplify(lng_3))
replace_40 = ReplaceItems(List=repeat_13, Item=lng_3, Indices=series_15, Wrap=False)
tstat_2 = TreeStatistics(Tree=entwine)  # -> Paths, Length, Count
lng_18 = ListLength(List=entwine)
split_13 = SplitList(List=tstat_2.Paths, Index="20")  # -> ListA, ListB
panel_8 = Panel("""4
8
5
3""")
series_16 = Series(Start=0, Step=1, Count=lng_18)
pshift_2 = ShiftPaths(Data=series_16, Offset=-1)
partition_2 = PartitionList(List=split_13.ListA, Size=panel_8)
bang_4 = ExplodeTree(Data=partition_2)  # -> _0000, _0001, _0002, _0003
dispatch_2 = Dispatch(List=bang_4._0001, DispatchPattern=[True, False])  # -> ListA, ListB
branch_3 = TreeBranch(Tree=lng_18, Path=bang_4._0000, MaintainPaths=True)
split_14 = SplitList(List=bang_4._0000, Index="1")  # -> ListA, ListB
split_15 = SplitList(List=dispatch_2.ListA, Index="1")  # -> ListA, ListB
ma_2 = MassAddition(Input=flatten(branch_3))  # -> Result, PartialResults
merge_8 = Merge(Data1="0")
repeat_20 = RepeatData(Data="0", Length="4")
repeat_21 = RepeatData(Data="0", Length="4")
filter_51 = StreamFilter(Gate=parsch, Stream0="0", Stream1=repeat_21)

# ---- group: WWR
panel_9 = Panel("""{0;1}
{0;2}
{0;3}""")
panel_10 = Panel("{0;0}")
item_8 = ListItem(List=panel_9, Index=0, Wrap=True)  # -> Item, Item1, Item2

# ----
split_16 = SplitTree(Data=pshift_2, Masks=flatten(panel_10))  # -> Positive, Negative
lng_19 = ListLength(List=split_16.Negative)
split_17 = SplitTree(Data=entwine, Masks=flatten(panel_10))  # -> Positive, Negative
item_9 = ListItem(List=panel_9, Index=0, Wrap=True)  # -> Item, Item1, Item2
replace_41 = ReplacePaths(Data=split_17.Positive, Search=panel_10, Replace=item_9.Item)
replace_42 = ReplacePaths(Data=split_17.Positive, Search=panel_10, Replace=item_9.Item1)
replace_43 = ReplacePaths(Data=split_17.Positive, Search=panel_10, Replace=item_9.Item2)
merge_9 = Merge(Data1=entwine, Data2=replace_41, Data3=replace_42, Data4=replace_43)
filter_52 = StreamFilter(Gate=parsch, Stream0=entwine, Stream1=merge_9)
larger = LargerThan(FirstNumber=lng_19, SecondNumber="1")  # -> LargerThan, OrEqualTo
dispatch_3 = Dispatch(List=split_16.Negative, DispatchPattern=larger.LargerThan)  # -> ListA, ListB
cull_i_15 = CullIndex(List=dispatch_3.ListA, Indices="0", Wrap=True)
pshift_3 = ShiftPaths(Data=cull_i_15, Offset=-1)
merge_10 = Merge(Data1=split_16.Positive, Data2=lng_19, Data3=dispatch_3.ListB)

# ---- group: WWR (continued)
split_18 = SplitTree(Data=merge_10, Masks=flatten(panel_10))  # -> Positive, Negative
replace_44 = ReplacePaths(Data=split_18.Positive, Search=panel_10, Replace=item_8.Item)
replace_45 = ReplacePaths(Data=split_18.Positive, Search=panel_10, Replace=item_8.Item1)
replace_46 = ReplacePaths(Data=split_18.Positive, Search=panel_10, Replace=item_8.Item2)
merge_11 = Merge(Data1=merge_10, Data2=replace_44, Data3=replace_45, Data4=replace_46)
filter_53 = StreamFilter(Gate=parsch, Stream0=merge_10, Stream1=merge_11)

# ----
replace_47 = ReplacePaths(Data=split_18.Positive, Search=panel_10, Replace=item_8.Item)
replace_48 = ReplacePaths(Data=split_18.Positive, Search=panel_10, Replace=item_8.Item1)
replace_49 = ReplacePaths(Data=split_18.Positive, Search=panel_10, Replace=item_8.Item2)
merge_12 = Merge(Data1=merge_10, Data2=replace_47, Data3=replace_48, Data4=replace_49)

# ---- group: Shading Type
panel_11 = Panel("""{0;6}
{0;8}
{0;10}""")
panel_12 = Panel("{0;4}")
split_19 = SplitTree(Data=filter_53, Masks=flatten(panel_12))  # -> Positive, Negative
item_10 = ListItem(List=panel_11, Index=0, Wrap=True)  # -> Item, Item1, Item2
replace_50 = ReplacePaths(Data=split_19.Positive, Search=panel_12, Replace=item_10.Item)
replace_51 = ReplacePaths(Data=split_19.Positive, Search=panel_12, Replace=item_10.Item1)
replace_52 = ReplacePaths(Data=split_19.Positive, Search=panel_12, Replace=item_10.Item2)
merge_13 = Merge(Data1=filter_53, Data2=replace_50, Data3=replace_51, Data4=replace_52)
filter_54 = StreamFilter(Gate=shading_parametric_scheme, Stream0=filter_53, Stream1=merge_13)

# ----
lng_20 = ListLength(List=merge_10)
split_20 = SplitTree(Data=filter_52, Masks=flatten(panel_12))  # -> Positive, Negative
item_11 = ListItem(List=panel_11, Index=0, Wrap=True)  # -> Item, Item1, Item2

# ---- group: WWR
split_21 = SplitTree(Data=merge_10, Masks=flatten(split_14.ListA))  # -> Positive, Negative
item_12 = ListItem(List=split_14.ListB, Index=0, Wrap=True)  # -> Item, Item1, Item2
replace_53 = ReplacePaths(Data=split_21.Positive, Search=split_14.ListA, Replace=item_12.Item)
replace_54 = ReplacePaths(Data=split_21.Positive, Search=split_14.ListA, Replace=item_12.Item1)
replace_55 = ReplacePaths(Data=split_21.Positive, Search=split_14.ListA, Replace=item_12.Item2)
merge_14 = Merge(Data1=merge_10, Data2=replace_53, Data3=replace_54, Data4=replace_55)
filter_55 = StreamFilter(Gate=parsch, Stream0=merge_10, Stream1=merge_14)

# ----
filter_56 = StreamFilter(Gate=parsch, Stream0=branch, Stream1=merge_14)
tstat_3 = TreeStatistics(Tree=lng_20)  # -> Paths, Length, Count
replace_56 = ReplacePaths(Data=split_20.Positive, Search=panel_12, Replace=item_11.Item)
replace_57 = ReplacePaths(Data=split_20.Positive, Search=panel_12, Replace=item_11.Item1)
replace_58 = ReplacePaths(Data=split_20.Positive, Search=panel_12, Replace=item_11.Item2)
merge_15 = Merge(Data1=filter_52, Data2=replace_56, Data3=replace_57, Data4=replace_58)
split_22 = SplitList(List=tstat_3.Paths, Index="20")  # -> ListA, ListB
filter_57 = StreamFilter(Gate=parsch, Stream0=merge_10, Stream1=repeat_20)
filter_58 = StreamFilter(Gate=shading_parametric_scheme, Stream0=filter_52, Stream1=merge_15)

# ---- group: Shading Ratio
panel_13 = Panel("""{0;7}
{0;9}
{0;11}""")
panel_14 = Panel("{0;5}")
split_23 = SplitTree(Data=filter_54, Masks=flatten(panel_14))  # -> Positive, Negative
item_13 = ListItem(List=panel_13, Index=0, Wrap=True)  # -> Item, Item1, Item2
replace_59 = ReplacePaths(Data=split_23.Positive, Search=panel_14, Replace=item_13.Item)
replace_60 = ReplacePaths(Data=split_23.Positive, Search=panel_14, Replace=item_13.Item1)
replace_61 = ReplacePaths(Data=split_23.Positive, Search=panel_14, Replace=item_13.Item2)
merge_16 = Merge(Data1=filter_54, Data2=replace_59, Data3=replace_60, Data4=replace_61)
filter_59 = StreamFilter(Gate=shading_parametric_scheme, Stream0=filter_54, Stream1=merge_16)

# ---- group: WWR
series_17 = Series(Start="0", Step=1, Count="4")
item_14 = ListItem(List=flatten(lng_20), Index="0", Wrap=True)
item_15 = ListItem(List=tstat_3.Paths, Index=series_17, Wrap=True)
branch_4 = TreeBranch(Tree=lng_20, Path=item_15, MaintainPaths=True)
repeat_22 = RepeatData(Data=item_14, Length="4")  # -> graft(Data)
match = MatchTree(Tree=repeat_22, Guide=branch_4)
filter_60 = StreamFilter(Gate=parsch, Stream0=branch_4, Stream1=match)

# ---- group: Opaque Envelope
series_18 = Series(Start="12", Step=1, Count="5")
item_16 = ListItem(List=flatten(lng_20), Index="12", Wrap=True)
item_17 = ListItem(List=tstat_3.Paths, Index=series_18, Wrap=True)
repeat_23 = RepeatData(Data=item_16, Length="5")  # -> graft(Data)
branch_5 = TreeBranch(Tree=lng_20, Path=item_17, MaintainPaths=True)
match_2 = MatchTree(Tree=repeat_23, Guide=branch_5)
filter_61 = StreamFilter(Gate=expression, Stream0=branch_5, Stream1=match_2)

# ---- group: Glazing
series_19 = Series(Start="17", Step=1, Count="3")
item_18 = ListItem(List=flatten(lng_20), Index="17", Wrap=True)
item_19 = ListItem(List=tstat_3.Paths, Index=series_19, Wrap=True)
repeat_24 = RepeatData(Data=item_18, Length="3")  # -> graft(Data)
branch_6 = TreeBranch(Tree=lng_20, Path=item_19, MaintainPaths=True)
match_3 = MatchTree(Tree=repeat_24, Guide=branch_6)
filter_62 = StreamFilter(Gate=shading_parametric_scheme, Stream0=branch_6, Stream1=match_3)

# ---- group: Shading Type
series_20 = Series(Start="4", Step="2", Count="4")
item_20 = ListItem(List=flatten(lng_20), Index="4", Wrap=True)
item_21 = ListItem(List=tstat_3.Paths, Index=series_20, Wrap=True)
branch_7 = TreeBranch(Tree=lng_20, Path=item_21, MaintainPaths=True)
repeat_25 = RepeatData(Data=item_20, Length="4")  # -> graft(Data)
match_4 = MatchTree(Tree=repeat_25, Guide=branch_7)
filter_63 = StreamFilter(Gate=shading_parametric_scheme, Stream0=branch_7, Stream1=match_4)

# ---- group: Shading Ratio
series_21 = Series(Start="5", Step="2", Count="4")
item_22 = ListItem(List=flatten(lng_20), Index="5", Wrap=True)
item_23 = ListItem(List=tstat_3.Paths, Index=series_21, Wrap=True)
branch_8 = TreeBranch(Tree=lng_20, Path=item_23, MaintainPaths=True)
repeat_26 = RepeatData(Data=item_22, Length="4")  # -> graft(Data)
match_5 = MatchTree(Tree=repeat_26, Guide=branch_8)
filter_64 = StreamFilter(Gate=shading_parametric_scheme, Stream0=branch_8, Stream1=match_5)

# ----
bnd = Bounds(Numbers=filter_57)

# ---- group: Shading Type
panel_15 = Panel("""{0;6}
{0;8}
{0;10}""")
panel_16 = Panel("{0;4}")
split_24 = SplitTree(Data=filter_55, Masks=flatten(split_15.ListA))  # -> Positive, Negative
item_24 = ListItem(List=split_15.ListB, Index=0, Wrap=True)  # -> Item, Item1, Item2
replace_62 = ReplacePaths(Data=split_24.Positive, Search=split_15.ListA, Replace=item_24.Item)
replace_63 = ReplacePaths(Data=split_24.Positive, Search=split_15.ListA, Replace=item_24.Item1)
replace_64 = ReplacePaths(Data=split_24.Positive, Search=split_15.ListA, Replace=item_24.Item2)
merge_17 = Merge(Data1=filter_55, Data2=replace_62, Data3=replace_63, Data4=replace_64)
filter_65 = StreamFilter(Gate=shading_parametric_scheme, Stream0=filter_55, Stream1=merge_17)

# ----
lng_21 = ListLength(List=replace_55)
dedomain = DeconstructDomain(Domain=bnd)  # -> Start, End
split_25 = SplitTree(Data=filter_58, Masks=flatten(panel_14))  # -> Positive, Negative
item_25 = ListItem(List=panel_13, Index=0, Wrap=True)  # -> Item, Item1, Item2
addition = Addition(A=dedomain.End, B=lng_21)
replace_65 = ReplacePaths(Data=split_25.Positive, Search=panel_14, Replace=item_25.Item)
replace_66 = ReplacePaths(Data=split_25.Positive, Search=panel_14, Replace=item_25.Item1)
replace_67 = ReplacePaths(Data=split_25.Positive, Search=panel_14, Replace=item_25.Item2)
repeat_27 = RepeatData(Data=addition, Length="4")
merge_18 = Merge(Data1=filter_58, Data2=replace_65, Data3=replace_66, Data4=replace_67)
branch_9 = TreeBranch(Tree=lng_20, Path=split_22.ListB, MaintainPaths=True)
filter_66 = StreamFilter(Gate=shading_parametric_scheme, Stream0=filter_58, Stream1=merge_18)

# ---- group: Opaque Envelope
panel_17 = Panel("""{0;13}
{0;14}
{0;15}
{0;16}""")
panel_18 = Panel("{0;12}")
split_26 = SplitTree(Data=filter_59, Masks=flatten(panel_18))  # -> Positive, Negative
item_26 = ListItem(List=panel_17, Index=0, Wrap=True)  # -> Item, Item1, Item2, Item3
replace_68 = ReplacePaths(Data=split_26.Positive, Search=panel_18, Replace=item_26.Item)
replace_69 = ReplacePaths(Data=split_26.Positive, Search=panel_18, Replace=item_26.Item1)
replace_70 = ReplacePaths(Data=split_26.Positive, Search=panel_18, Replace=item_26.Item2)
replace_71 = ReplacePaths(Data=split_26.Positive, Search=panel_18, Replace=item_26.Item3)
merge_19 = Merge(Data1=filter_59, Data2=replace_68, Data3=replace_69, Data4=replace_70, Data5=replace_71)
filter_67 = StreamFilter(Gate=expression, Stream0=filter_59, Stream1=merge_19)

# ----
filter_68 = StreamFilter(Gate=shading_parametric_scheme, Stream1=repeat_27)
tstat_4 = TreeStatistics(Tree=merge_10)  # -> Paths, Length, Count

# ---- group: Shading Ratio
panel_19 = Panel("""{0;7}
{0;9}
{0;11}""")
split_27 = SplitTree(Data=filter_65, Masks=flatten("{0;5}"))  # -> Positive, Negative
item_27 = ListItem(List=panel_19, Index=0, Wrap=True)  # -> Item, Item1, Item2
replace_72 = ReplacePaths(Data=split_27.Positive, Search="{0;5}", Replace=item_27.Item)
replace_73 = ReplacePaths(Data=split_27.Positive, Search="{0;5}", Replace=item_27.Item1)
replace_74 = ReplacePaths(Data=split_27.Positive, Search="{0;5}", Replace=item_27.Item2)
merge_20 = Merge(Data1=filter_65, Data2=replace_72, Data3=replace_73, Data4=replace_74)
filter_69 = StreamFilter(Gate=shading_parametric_scheme, Stream0=filter_65, Stream1=merge_20)

# ----
split_28 = SplitTree(Data=filter_66, Masks=flatten(panel_18))  # -> Positive, Negative
merge_21 = Merge(Data1=filter_60, Data2=filter_63, Data3=filter_64, Data4=filter_61, Data5=filter_62, Data6=branch_9)
item_28 = ListItem(List=panel_17, Index=0, Wrap=True)  # -> Item, Item1, Item2, Item3
split_29 = SplitList(List=tstat_4.Paths, Index="20")  # -> ListA, ListB
number_of_options_2 = Panel(merge_21)
replace_75 = ReplacePaths(Data=split_28.Positive, Search=panel_18, Replace=item_28.Item)
replace_76 = ReplacePaths(Data=split_28.Positive, Search=panel_18, Replace=item_28.Item1)
replace_77 = ReplacePaths(Data=split_28.Positive, Search=panel_18, Replace=item_28.Item2)
replace_78 = ReplacePaths(Data=split_28.Positive, Search=panel_18, Replace=item_28.Item3)
branch_10 = TreeBranch(Tree=merge_10, Path=split_29.ListB, MaintainPaths=True)
merge_22 = Merge(Data1=filter_66, Data2=replace_75, Data3=replace_76, Data4=replace_77, Data5=replace_78)
merge_23 = Merge(Data2=branch_10)
filter_70 = StreamFilter(Gate=expression, Stream0=filter_66, Stream1=merge_22)
filter_71 = StreamFilter(Gate=shading_parametric_scheme, Stream1=repeat_27)

# ---- group: Glazing
panel_20 = Panel("""{0;18}
{0;19}""")
panel_21 = Panel("{0;17}")
split_30 = SplitTree(Data=filter_67, Masks=flatten(panel_21))  # -> Positive, Negative
item_29 = ListItem(List=panel_20, Index=0, Wrap=True)  # -> Item, Item1, Item2
replace_79 = ReplacePaths(Data=split_30.Positive, Search=panel_21, Replace=item_29.Item)
replace_80 = ReplacePaths(Data=split_30.Positive, Search=panel_21, Replace=item_29.Item1)
merge_24 = Merge(Data1=filter_67, Data2=replace_79, Data3=replace_80)
filter_72 = StreamFilter(Gate=shading_parametric_scheme, Stream0=filter_67, Stream1=merge_24)

# ----
bnd_2 = Bounds(Numbers=filter_57)

# ---- group: Opaque Envelope
panel_22 = Panel("""{0;13}
{0;14}
{0;15}
{0;16}""")
split_31 = SplitTree(Data=filter_69, Masks=flatten("{0;12}"))  # -> Positive, Negative
item_30 = ListItem(List=panel_22, Index=0, Wrap=True)  # -> Item, Item1, Item2, Item3
replace_81 = ReplacePaths(Data=split_31.Positive, Search="{0;12}", Replace=item_30.Item)
replace_82 = ReplacePaths(Data=split_31.Positive, Search="{0;12}", Replace=item_30.Item1)
replace_83 = ReplacePaths(Data=split_31.Positive, Search="{0;12}", Replace=item_30.Item2)
replace_84 = ReplacePaths(Data=split_31.Positive, Search="{0;12}", Replace=item_30.Item3)
merge_25 = Merge(Data1=filter_69, Data2=replace_81, Data3=replace_82, Data4=replace_83, Data5=replace_84)
filter_73 = StreamFilter(Gate=expression, Stream0=filter_69, Stream1=merge_25)

# ----
lng_22 = ListLength(List=replace_55)
dedomain_2 = DeconstructDomain(Domain=bnd_2)  # -> Start, End
split_32 = SplitTree(Data=filter_70, Masks=flatten(panel_21))  # -> Positive, Negative
item_31 = ListItem(List=panel_20, Index=0, Wrap=True)  # -> Item, Item1, Item2
addition_2 = Addition(A=dedomain_2.End, B=lng_22)
ma_3 = MassAddition(Input=flatten(lng_20))  # -> Result, PartialResults
replace_85 = ReplacePaths(Data=split_32.Positive, Search=panel_21, Replace=item_31.Item)
replace_86 = ReplacePaths(Data=split_32.Positive, Search=panel_21, Replace=item_31.Item1)
merge_26 = Merge(Data1=filter_70, Data2=replace_85, Data3=replace_86)
merge_27 = Merge(Data1=flatten(filter_51), Data2=flatten(ma_3.PartialResults))
repeat_28 = RepeatData(Data="0", Length=ma_3.Result)
lng_23 = ListLength(List=ma_3.PartialResults)
split_33 = SplitList(List=merge_27, Index=lng_23)  # -> ListA, ListB
filter_74 = StreamFilter(Gate=shading_parametric_scheme, Stream0=filter_70, Stream1=merge_26)
filter_75 = StreamFilter(Gate=expression, Stream0=filter_69, Stream1=merge_25)
series_22 = Series(Start=simplify(graft(split_33.ListA)), Step=1, Count=simplify(merge_21))

# ---- group: Glazing
panel_23 = Panel("""{0;18}
{0;19}""")
split_34 = SplitTree(Data=filter_73, Masks=flatten("{0;17}"))  # -> Positive, Negative
item_32 = ListItem(List=panel_23, Index=0, Wrap=True)  # -> Item, Item1, Item2
replace_87 = ReplacePaths(Data=split_34.Positive, Search="{0;17}", Replace=item_32.Item)
replace_88 = ReplacePaths(Data=split_34.Positive, Search="{0;17}", Replace=item_32.Item1)
merge_28 = Merge(Data1=filter_73, Data2=replace_87, Data3=replace_88)
filter_76 = StreamFilter(Gate=shading_parametric_scheme, Stream0=filter_73, Stream1=merge_28)

# ----
replace_89 = ReplaceItems(List=repeat_28, Item=filter_72, Indices=series_22, Wrap=False)
pshift_4 = ShiftPaths(Data=replace_89, Offset=-1)
weave = Weave(Pattern=[0, 1], Stream0=filter_68, Stream1=filter_71, NullGaps=False)
item_33 = ListItem(List=filter_74, Index=pshift_4, Wrap=True)
merge_29 = Merge(Data1=flatten(filter_57), Data2=flatten(weave))
panel_24 = Panel(item_33)
panel_25 = Panel(filter_76)
panel_26 = Panel(ma_3.PartialResults)
panel_27 = Panel(merge_10)

# ==== cluster ResultsCalculator
dhw_source = ClusterInput()  # Input Source
annual_dhw_result = ClusterInput()  # Annual DHW Energy Consumption
exterior_lighting_result = ClusterInput()  # Exterior Lighting Result
elevator_result = ClusterInput()
misc_1_name = ClusterInput()  # Miscellaneous End Use Name
misc_end_use_source = ClusterInput()  # Miscellaneous End Use Source Energy
misc_end_use = ClusterInput()  # Miscellaneous Energy End Use
misc_2_name = ClusterInput()  # Miscellaneous End Use Name
misc_end_use_source_2 = ClusterInput()  # Miscellaneous End Use Source Energy
misc_end_use_2 = ClusterInput()  # Miscellaneous Energy End Use
address_of_result_file = ClusterInput()  # Input the result file address
electricity_carbon = ClusterInput()  # Carbon Emissions per kWh
gas_co2_kwh = ClusterInput()  # Carbon Emissions per kWh
additional_fuel_co2_kwh = ClusterInput()  # Carbon Emissions per kWh
district_cooling_co2_kwh = ClusterInput()  # Carbon Emissions per kWh
district_heating_co2_kwh = ClusterInput()  # Carbon Emissions per kWh
units = ClusterInput()  # Metric or Imperial
file = ReadFile(File=address_of_result_file, PerLineParse=True)

# ---- group: Carbon Factors
merge = Merge(
    Data1=electricity_carbon,
    Data2=gas_co2_kwh,
    Data3=additional_fuel_co2_kwh,
    Data4=district_cooling_co2_kwh,
    Data5=district_heating_co2_kwh)

# ----
python = PythonScript(x=file)  # -> out, a
# ---------- python: Python ----------
import re
if x:
    a=re.sub('<[^>]+>', '', x)
# ---------- end python ----------
trim = TextTrim(Text=python.a, Start=True, End=True)

# ---- group: Vertical Weighted R-Value Calcualtion
mindex = MemberIndex(Set=trim, Member="Opaque Exterior")  # -> Index, Count
mindex_2 = MemberIndex(Set=trim, Member="Opaque Interior")  # -> Index, Count
mindex_3 = MemberIndex(Set=trim, Member="Exterior Fenestration")  # -> Index, Count
mindex_4 = MemberIndex(Set=trim, Member="Interior Fenestration")  # -> Index, Count
addition = Addition(A=mindex.Index, B="15")
multiplication = Multiplication(A="19", B="3")
addition_2 = Addition(A=mindex_3.Index, B="22")
subtraction = Subtraction(A=mindex_2.Index, B=addition)
subtraction_2 = Subtraction(A=mindex_4.Index, B=addition_2, C=multiplication)
series = Series(Start=addition, Step=1, Count=expr("x-1", subtraction))
series_2 = Series(Start=addition_2, Step=1, Count=expr("x-1", subtraction_2))
item = ListItem(List=trim, Index=series, Wrap=True)
item_2 = ListItem(List=trim, Index=series_2, Wrap=True)
partition = PartitionList(List=item, Size="12")
partition_2 = PartitionList(List=item_2, Size="19")
item_3 = ListItem(List=partition, Index=0, Wrap=True)  # -> Item, Item1, Item2, Item3, flatten(Item4), Item5, flatten(Item6), Item7, Item8, flatten(Item9)
item_4 = ListItem(List=partition_2, Index=0, Wrap=True)  # -> Item, Item1, flatten(Item2), Item3, Item4, Item5, Item6, flatten(Item7)
len = TextLength(Text=item_3.Item9)
equals = Equality(FirstNumber=len, SecondNumber="1")  # -> Equality, Inequality
cull = CullPattern(List=item_3.Item4, CullPattern=equals.Equality)
cull_2 = CullPattern(List=item_3.Item6, CullPattern=equals.Equality)
merge_2 = Merge(Data1=cull, Data2=item_4.Item7)
merge_3 = Merge(Data1=cull_2, Data2=item_4.Item2)
u_value = Number(merge_2)
area = Number(merge_3)
wav = WeightedAverage(Input=u_value, Weights=area)
usi2uip = Ladybug_uSI2uIP(U_SI=wav)  # -> U_IP; plug-in component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
filter = StreamFilter(Gate=units, Stream0=wav, Stream1=usi2uip)
division = Division(A="1", B=filter)
vertical_weighted_r_value = ClusterOutput(division)  # Vertical Weighted R-Value

# ----
kwh_to_kbtu = Panel("3.41214163")

# ---- group: Peak Electricity
mindex_5 = MemberIndex(Set=trim, Member="Report: Demand End Use Components Summary")  # -> Index, Count
addition_3 = Addition(A=mindex_5.Index, B="280")
item_5 = ListItem(List=trim, Index=addition_3, Wrap=True)
split = TextSplit(Text=item_5, Separators=",")
item_6 = ListItem(List=split, Index="2", Wrap=True)

# ----
panel = Panel("""1
2
4""")
panel_2 = Panel("""3
4""")
panel_3 = Panel("""{0}
{1}
{4}
{11}""")

# ---- group: Unmet Hours
mindex_6 = MemberIndex(Set=trim, Member="Setpoint Not Met Criteria")  # -> Index, Count
panel_4 = Panel("""24
28""")
addition_4 = Addition(A=mindex_6.Index, B=panel_4)
item_7 = ListItem(List=trim, Index=addition_4, Wrap=True)
split_2 = TextSplit(Text=item_7, Separators=",")
item_8 = ListItem(List=split_2, Index=0, Wrap=True)  # -> Item, Item1, flatten(Item2)
unmet_hours = ClusterOutput(item_8.Item2)  # Unmet Heating and Cooling Hours

# ----
entwine = Entwine(Branch00="3", Branch01=panel, Branch02=panel_2, Branch03="3", FlattenInputs=True)
panel_5 = Panel("""Electricity
Natural Gas
Additional Fuel
District Cooling
District Heating""")

# ---- group: Timestamp
item_9 = ListItem(List=trim, Index="12", Wrap=True)
split_3 = TextSplit(Text=item_9, Separators="YMD=")
item_10 = ListItem(List=split_3, Index="4", Wrap=True)
timestamp = ClusterOutput(item_10)  # Time stamp of when simulation was run

# ----
peak_electricity = ClusterOutput(item_6)  # Peak Electricity in W

# ---- group: PV and Wind Power
mindex_7 = MemberIndex(Set=trim, Member="Electric Loads Satisfied")  # -> Index, Count
panel_6 = Panel("""19
24""")
addition_5 = Addition(A=mindex_7.Index, B=panel_6)
item_11 = ListItem(List=trim, Index=addition_5, Wrap=True)

# ----
ma = MassAddition(Input=item_11)  # -> Result, PartialResults

# ---- group: Energy Calculation
null = NullItem(Item=exterior_lighting_result)  # -> NullFlags, InvalidFlags, Description
null_2 = NullItem(Item=annual_dhw_result)  # -> NullFlags, InvalidFlags, Description
null_3 = NullItem(Item=elevator_result)  # -> NullFlags, InvalidFlags, Description
null_4 = NullItem(Item=misc_end_use)  # -> NullFlags, InvalidFlags, Description
null_5 = NullItem(Item=misc_end_use_2)  # -> NullFlags, InvalidFlags, Description
mindex_8 = MemberIndex(Set=trim, Member="End Uses")  # -> Index, Count
expression = Expression(x=null.NullFlags, y=exterior_lighting_result, Expression="IF(x=True,0,y)")
expression_2 = Expression(x=null_2.NullFlags, y=annual_dhw_result, Expression="IF(x=True,0,y)")
expression_3 = Expression(x=null_3.NullFlags, y=elevator_result, Expression="IF(x=True,0,y)")
expression_4 = Expression(x=null_4.NullFlags, y=misc_end_use, Expression="IF(x=True,0,y)")
expression_5 = Expression(x=null_5.NullFlags, y=misc_end_use_2, Expression="IF(x=True,0,y)")
item_12 = ListItem(List=mindex_8.Index, Index=0, Wrap=True)
panel_7 = Panel("14")
addition_6 = Addition(A=item_12, B="19")
repeat = RepeatData(Data="0", Length="5")
replace = ReplaceItems(List=repeat, Item=expression, Indices="0", Wrap=False)
replace_2 = ReplaceItems(List=repeat, Item=expression_3, Indices="0", Wrap=False)
replace_3 = ReplaceItems(List=repeat, Item=expression_2, Indices=dhw_source, Wrap=False)
replace_4 = ReplaceItems(List=repeat, Item=expression_4, Indices=misc_end_use_source, Wrap=False)
replace_5 = ReplaceItems(List=repeat, Item=expression_5, Indices=misc_end_use_source_2, Wrap=False)
gj_to_kwh_conversion_factor = Panel("277.7778")

# ---- group: PV and Wind Power (continued)
multiplication_2 = Multiplication(A=ma.Result, B=gj_to_kwh_conversion_factor)
neg = Negative(Value=multiplication_2)
replace_6 = ReplaceItems(List=repeat, Item=neg, Indices="0", Wrap=False)

# ----
multiplication_3 = Multiplication(A=panel_7, B="16")

# ---- group: Peak Heating and Cooling
mindex_9 = MemberIndex(Set=trim, Member="Peak Heating Sensible Heat Gain Components")  # -> Index, Count
mindex_10 = MemberIndex(Set=trim, Member="Peak Cooling Sensible Heat Gain Components")  # -> Index, Count
panel_8 = Panel("22")

# ----
subtraction_3 = Subtraction(A=mindex_9.Index, B=mindex_10.Index)
subtraction_4 = Subtraction(A=subtraction_3, B=panel_8)

# ---- group: Energy Calculation (continued)
series_3 = Series(Start=addition_6, Step=1, Count=multiplication_3)
item_13 = ListItem(List=trim, Index=series_3, Wrap=True)
entwine_2 = Entwine(
    Branch03=replace,
    Branch05=replace_2,
    Branch011=replace_3,
    Branch013=replace_6,
    Branch014=replace_4,
    Branch015=replace_5,
    FlattenInputs=True)

# ----
partition_3 = PartitionList(List=item_13, Size="16")  # -> simplify(Chunks)
item_14 = ListItem(List=partition_3, Index=0, Wrap=True)  # -> Item, Item1, Item2, Item3, Item4, Item5, Item6, Item7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
addition_7 = Addition(
    A=item_14.Item3,
    B=item_14.Item4,
    C=item_14.Item5,
    D=item_14.Item6,
    E=item_14.Item7,
    F=item_14.Item8,
    G=item_14.Item9,
    H=item_14.Item10)
merge_4 = Merge(Data1=item_14.Item1, Data2=item_14.Item2, Data3=addition_7, Data4=item_14.Item11, Data5=item_14.Item12)
multiplication_4 = Multiplication(A=merge_4, B=gj_to_kwh_conversion_factor)  # -> simplify(Result)
split_4 = SplitTree(Data=item_14.Item, Masks=flatten(panel_3))  # -> Positive, Negative

# ---- group: Energy Cost
mindex_11 = MemberIndex(Set=trim, Member="EAp2-3. Energy Type Summary")  # -> Index, Count
panel_9 = Panel("""12
19
26
33
40""")
addition_8 = Addition(A=mindex_11.Index, B=panel_9)
item_15 = ListItem(List=trim, Index=addition_8, Wrap=True)
panel_10 = Panel("""0
1
4
2
3""")
item_16 = ListItem(List=item_15, Index=panel_10, Wrap=True)
num = Number(item_16)
nullrep = ReplaceNulls(Items=num, Replacements="0")  # -> Items, Count
division_2 = Division(A=nullrep.Items, B=kwh_to_kbtu)
filter_2 = StreamFilter(Gate=units, Stream0=nullrep.Items, Stream1=division_2)

# ----
virtual_fuel_rates = ClusterOutput(filter_2)  # Virtual Fuel Rates

# ---- group: Peak Heating and Cooling (continued)
addition_9 = Addition(A=mindex_9.Index, B=subtraction_4)
addition_10 = Addition(A=mindex_10.Index, B=subtraction_4)

# ----
series_4 = Series(Start=addition_9, Step=1, Count="19")
series_5 = Series(Start=addition_10, Step=1, Count="19")

# ---- group: Peak Heating and Cooling (continued)
item_17 = ListItem(List=trim, Index=series_4, Wrap=True)
item_18 = ListItem(List=trim, Index=series_5, Wrap=True)
split_5 = SplitList(List=item_17, Index="7")  # -> ListA, ListB
split_6 = SplitList(List=item_18, Index="7")  # -> ListA, ListB
item_19 = ListItem(List=split_5.ListA, Index=0, Wrap=True)  # -> Item, Item1, Item2, Item3, Item4, Item5, Item6
item_20 = ListItem(List=split_6.ListA, Index=0, Wrap=True)  # -> Item, Item1, Item2, Item3, Item4, Item5, Item6
addition_11 = Addition(A=item_20.Item2, B=item_20.Item4, C=item_20.Item6)
addition_12 = Addition(A=item_19.Item1, B=item_19.Item3, C=item_19.Item5)
division_3 = Division(A=addition_12, B="1000")
division_4 = Division(A=addition_11, B="1000")
peak_heating_hour = ClusterOutput(item_19.Item)  # Hour of Peak
peak_cooling_hour = ClusterOutput(item_20.Item)  # Hour of Peak Cooling

# ----
multiplication_5 = Multiplication(A=division_3, B=kwh_to_kbtu)
multiplication_6 = Multiplication(A=split_5.ListB, B=kwh_to_kbtu)
multiplication_7 = Multiplication(A=division_4, B=kwh_to_kbtu)
multiplication_8 = Multiplication(A=split_6.ListB, B=kwh_to_kbtu)

# ---- group: Peak Heating and Cooling (continued)
filter_3 = StreamFilter(Gate=units, Stream0=division_3, Stream1=multiplication_5)
filter_4 = StreamFilter(Gate=units, Stream0=split_5.ListB, Stream1=multiplication_6)
filter_5 = StreamFilter(Gate=units, Stream0=division_4, Stream1=multiplication_7)
filter_6 = StreamFilter(Gate=units, Stream0=split_6.ListB, Stream1=multiplication_8)
peak_heating = ClusterOutput(filter_3)  # Peak Heating
peak_heating_breakdown = ClusterOutput(filter_4)  # Peak Heating Breakdown
peak_cooling = ClusterOutput(filter_5)  # Peak Cooling
peak_cooling_breakdown = ClusterOutput(filter_6)  # Peak Cooling Breakdown

# ---- group: Determine WWR
mindex_12 = MemberIndex(Set=trim, Member="Window-Wall Ratio")  # -> Index, Count
panel_11 = Panel("""36
37
38
39
40""")
addition_13 = Addition(A=mindex_12.Index, B=panel_11)
item_21 = ListItem(List=trim, Index=addition_13, Wrap=True)

# ----
item_22 = ListItem(List=item_21, Index=0, Wrap=True)  # -> Item, Item1, Item2, Item3, Item4

# ---- group: Determine WWR (continued)
north_wwr = ClusterOutput(item_22.Item1)  # Window to Wall Ratio
east_wwr = ClusterOutput(item_22.Item2)  # Window to Wall Ratio
south_wwr = ClusterOutput(item_22.Item3)  # Window to Wall Ratio
building_wwr = ClusterOutput(item_22.Item)  # Total Building Window to Wall Ratio
west_wwr = ClusterOutput(item_22.Item4)  # Window to Wall Ratio

# ---- group: Energy Calculation (continued)
addition_14 = Addition(A=multiplication_4, B=simplify(entwine_2))

# ----
multiplication_9 = Multiplication(A=addition_14, B=kwh_to_kbtu)
multiplication_10 = Multiplication(A=addition_14, B=nullrep.Items)

# ---- group: Carbon
multiplication_11 = Multiplication(A=addition_14, B=merge)
ma_2 = MassAddition(Input=multiplication_11)  # -> flatten(Result), PartialResults
ma_3 = MassAddition(Input=ma_2.Result)  # -> Result, PartialResults
total_annual_carbon_emission = ClusterOutput(ma_3.Result)  # Carbon Emissions from Energy Use
annual_carbon_emissions_by_end_use = ClusterOutput(ma_2.Result)  # Carbon Emissions from Energy Use

# ---- group: Energy Cost (continued)
ma_4 = MassAddition(Input=multiplication_10)  # -> flatten(Result), PartialResults
ma_5 = MassAddition(Input=ma_4.Result)  # -> Result, PartialResults
total_annual_energy_cost = ClusterOutput(ma_5.Result)
annual_energy_cost_by_end_use = ClusterOutput(ma_4.Result)

# ---- group: Building Area
mindex_13 = MemberIndex(Set=trim, Member="Building Area")  # -> Index, Count
addition_15 = Addition(A=mindex_13.Index, B="12")
item_23 = ListItem(List=trim, Index=addition_15, Wrap=True)
panel_12 = Panel("""1
10.7639""")
split_7 = TextSplit(Text=item_23, Separators=",")
item_24 = ListItem(List=panel_12, Index=units, Wrap=True)
item_25 = ListItem(List=split_7, Index="2", Wrap=True)

# ----
multiplication_12 = Multiplication(A=item_25, B=item_24)

# ---- group: Building Area (continued)
building_area = ClusterOutput(multiplication_12)  # Building Area

# ---- group: Energy Calculation (continued)
filter_7 = StreamFilter(Gate=units, Stream0=addition_14, Stream1=multiplication_9)
flip = FlipMatrix(Data=filter_7)
ma_6 = MassAddition(Input=flip)  # -> flatten(Result), PartialResults
annual_energy_consumption_by_source = ClusterOutput(ma_6.Result)

# ----
split_8 = SplitTree(Data=filter_7, Masks=flatten(panel_3))  # -> Positive, Negative
match = MatchTree(Tree=entwine, Guide=split_8.Positive)
cull_i = CullIndex(List=panel_5, Indices=match, Wrap=True)  # -> simplify(List)
cull_i_2 = CullIndex(List=split_8.Positive, Indices=match, Wrap=True)  # -> simplify(List)
ma_7 = MassAddition(Input=split_8.Negative)  # -> Result, PartialResults
merge_5 = Merge(Data1=cull_i_2, Data2=ma_7.Result)  # -> flatten(Result)
concat = Concatenate(FragmentA=split_4.Positive, FragmentB=cull_i, JoinSeparator=" - ")
merge_6 = Merge(Data1=concat, Data2=split_4.Negative)
merge_7 = Merge(Data1=flatten(merge_6), Data2=flatten(misc_1_name), Data3=flatten(misc_2_name))

# ---- group: Energy Calculation (continued)
ma_8 = MassAddition(Input=merge_5)  # -> Result, PartialResults
annual_energy_consumption_by_end_use = ClusterOutput(merge_5)
end_use_headers = ClusterOutput(merge_7)  # End Use Headers

# ----
eval = Evaluate(F="Format(\"{0:0.0}\",x)", x=ma_8.Result)

# ---- group: Energy Calculation (continued)
total_annual_energy_consumption = ClusterOutput(eval)

# ==== cluster InputListGenerator
program_information = ClusterInput()
program_structure = ClusterInput()
program_information_2 = Data(program_information)
program_structure_2 = Number(program_structure)
split = TextSplit(Text=program_information_2, Separators=",")
lng = ListLength(List=split)
repeat = RepeatData(Data=program_structure_2, Length=lng)
flip = FlipMatrix(Data=repeat)  # -> graft(Data)
flip_2 = FlipMatrix(Data=split)  # -> graft(Data)
repeat_2 = RepeatData(Data=flip_2, Length=flip)
pshift = ShiftPaths(Data=repeat_2, Offset="-4")
len = TextLength(Text=pshift)
equals = Equality(FirstNumber=len, SecondNumber="0")  # -> Equality, Inequality
cull = CullPattern(List=pshift, CullPattern=equals.Inequality)
bang = ExplodeTree(Data=cull)  # -> Branch0, Branch1, Branch2, Branch3, Branch4, Branch5, Branch6, Branch7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
zone_name = Data(bang.Branch0)
zone_program = Data(bang.Branch1)
number_of_people_per_area = Data(bang.Branch2)
lighting_density_per_area = Data(bang.Branch3)
equipment_load_per_area = Data(bang.Branch4)
gas_equipment_load_per_area = Data(bang.Branch5)
hot_water_load_per_area = Data(bang.Branch6)
ventilation_per_person = Data(bang.Branch7)
ventilation_per_area = Data(bang.Branch8)
of_lights_with_daylight_control = Data(bang.Branch9)
conditioned = Data(bang.Branch10)
heating_setpoint = Data(bang.Branch11)
heating_setback = Data(bang.Branch12)
cooling_setpoint = Data(bang.Branch13)
cooling_setback = Data(bang.Branch14)
humidify_setpoint = Data(bang.Branch15)
dehumidity_setpoint = Data(bang.Branch16)
occupancy_schedule = Data(bang.Branch17)
activity_schedule = Data(bang.Branch18)
lighting_schedule = Data(bang.Branch19)
equipment_schedule = Data(bang.Branch20)
gas_equipment_schedule = Data(bang.Branch21)
hot_water_schedule = Data(bang.Branch22)
ventilation_schedule = Data(bang.Branch23)
leed_baseline_lpd = Data(bang.Branch25)
leed_baseline_hot_water = Data(bang.Branch28)
leed_baseline_ventilation_per_person = Data(bang.Branch29)
leed_baseline_ventilation_per_area = Data(bang.Branch30)
code_baseline_lpd = Data(bang.Branch32)
code_baseline_hot_water = Data(bang.Branch35)
code_baseline_ventilation_per_person = Data(bang.Branch36)
code_baseline_ventilation_per_area = Data(bang.Branch37)
zone_name_2 = ClusterOutput(zone_name)
zone_program_2 = ClusterOutput(zone_program)
number_of_people_per_area_2 = ClusterOutput(number_of_people_per_area)
lighting_density_per_area_2 = ClusterOutput(lighting_density_per_area)
equipment_load_per_area_2 = ClusterOutput(equipment_load_per_area)
gas_equipment_load_per_area_2 = ClusterOutput(gas_equipment_load_per_area)
hot_water_load_per_area_2 = ClusterOutput(hot_water_load_per_area)
ventilation_per_person_2 = ClusterOutput(ventilation_per_person)
ventilation_per_area_2 = ClusterOutput(ventilation_per_area)
of_lights_with_daylight_control_2 = ClusterOutput(of_lights_with_daylight_control)
conditioned_2 = ClusterOutput(conditioned)
heating_setpoint_2 = ClusterOutput(heating_setpoint)
heating_setback_2 = ClusterOutput(heating_setback)
cooling_setpoint_2 = ClusterOutput(cooling_setpoint)
cooling_setback_2 = ClusterOutput(cooling_setback)
humidify_setpoint_2 = ClusterOutput(humidify_setpoint)
dehumidity_setpoint_2 = ClusterOutput(dehumidity_setpoint)
occupancy_schedule_2 = ClusterOutput(occupancy_schedule)
activity_schedule_2 = ClusterOutput(activity_schedule)
lighting_schedule_2 = ClusterOutput(lighting_schedule)
equipment_schedule_2 = ClusterOutput(equipment_schedule)
gas_equipment_schedule_2 = ClusterOutput(gas_equipment_schedule)
hot_water_schedule_2 = ClusterOutput(hot_water_schedule)
ventilation_schedule_2 = ClusterOutput(ventilation_schedule)
leed_baseline_lpd_2 = ClusterOutput(leed_baseline_lpd)
leed_baseline_hot_water_2 = ClusterOutput(leed_baseline_hot_water)
leed_baseline_ventilation_per_person_2 = ClusterOutput(leed_baseline_ventilation_per_person)
leed_baseline_ventilation_per_area_2 = ClusterOutput(leed_baseline_ventilation_per_area)
code_baseline_lpd_2 = ClusterOutput(code_baseline_lpd)
code_baseline_hot_water_2 = ClusterOutput(code_baseline_hot_water)
code_baseline_ventilation_per_person_2 = ClusterOutput(code_baseline_ventilation_per_person)
code_baseline_ventilation_per_area_2 = ClusterOutput(code_baseline_ventilation_per_area)

# ==== cluster ExteriorEnergy
exterior_equipment_type = ClusterInput()  # The type of the exterior use object such as 'Exterior:Lights' or 'Exterior:FuelEquipment'
name = ClusterInput()  # Name of additional energy use
fuel = ClusterInput()  # The fuel being used by the external use
schedule_name = ClusterInput()  # The name of the schedule from the Honeybee library to apply to the energy end use.
peak_watts = ClusterInput()  # The design energy level in watts
control_option = ClusterInput()  # If specifying exterior lighting, enter 'ScheduleNameOnly’ or ‘AstronomicalClock' to determine how the exterior lights are controlled. The ‘ScheduleNameOnly’ mode dictates that the exterior lights always follow the schedule named in the field above. The ‘AstronomicalClock’ mode dictates that despite what the schedule indicates, the exterior lights will not run when the sun is up. Using the Astronomical Clock mode makes it simple to model exterior lights that are controlled by a photocell or other controller that ensures that outdoor lights will not run during the daytime. However, the Astronomical Clock control works off of the position of the sun and therefore does not operate exactly like a photocell. During the night, the schedule values are still applied in the usual way. If this field is omitted or left blank then the program will default to Schedule Name Only mode.
panel = Panel("""Exterior:Lights,
    NAME,               !- Name
    SCH,          !- Schedule Name
    DLW,        !- Design Level {W}
    LCO,  !- Control Option
    EUS;                !- End-Use Subcategory""")
panel_2 = Panel("""Exterior:FuelEquipment,
    NAME,               !- Name
    FUT,             !- Fuel Use Type
    SCH,          !- Schedule Name
    DLW,        !- Design Level {W}
    EUS;                !- End-Use Subcategory""")
subcategory = ClusterInput()  # User defined subcategory of the external use.

# ---- group: Year Schedule
decomposeepsch = Honeybee_DecomposeEnergyPlusSchedule(schName=schedule_name)  # -> name, schedule, comments; plug-in component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
ins = InsertItems(List=decomposeepsch.schedule, Item=decomposeepsch.name, Indices="1", Wrap=True)

# ----
filter = StreamFilter(Gate=exterior_equipment_type, Stream0=panel, Stream1=panel_2)

# ---- group: Weekly Schedules
decomposeepsch_2 = Honeybee_DecomposeEnergyPlusSchedule(schName=decomposeepsch.schedule)  # -> name, schedule, comments; plug-in component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
null = NullItem(Item=decomposeepsch_2.schedule)  # -> NullFlags, InvalidFlags, Description
panel_3 = Panel("""0
1""")
cull = CullPattern(List=decomposeepsch_2.schedule, CullPattern=invert(null.NullFlags))
cull_i = CullIndex(List=decomposeepsch_2.name, Indices=panel_3, Wrap=True)
num = Number(cull_i)
prune = PruneTree(Tree=cull, Minimum="5", Maximum=0)
null_2 = NullItem(Item=num)  # -> NullFlags, InvalidFlags, Description
cull_2 = CullPattern(List=cull_i, CullPattern=null_2.NullFlags)
ins_2 = InsertItems(List=prune, Item=graft(cull_2), Indices="1", Wrap=True)

# ----
rep = ReplaceText(Text=filter, Find="NAME", Replace=name, RecursiveReplace=False)
rep_2 = ReplaceText(Text=rep, Find="FUT", Replace=fuel, RecursiveReplace=False)
rep_3 = ReplaceText(Text=rep_2, Find="SCH", Replace=schedule_name, RecursiveReplace=False)
rep_4 = ReplaceText(Text=rep_3, Find="DLW", Replace=peak_watts, RecursiveReplace=False)
rep_5 = ReplaceText(Text=rep_4, Find="LCO", Replace=control_option, RecursiveReplace=False)
rep_6 = ReplaceText(Text=rep_5, Find="EUS", Replace=subcategory, RecursiveReplace=False)

# ---- group: Daily Schedules
cset = CreateSet(List=flatten(prune))  # -> Set, Map
cull_i_2 = CullIndex(List=cset.Set, Indices="0", Wrap=True)  # -> flatten(List)
decomposeepsch_3 = Honeybee_DecomposeEnergyPlusSchedule(schName=cull_i_2)  # -> name, schedule, comments; plug-in component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
ins_3 = InsertItems(List=simplify(decomposeepsch_3.schedule), Item=simplify(graft(decomposeepsch_3.name)), Indices="1", Wrap=True)

# ---- group: Append Commas and Semicolons to Text
entwine = Entwine(Branch0X=ins, Branch1X=ins_2, Branch2X=ins_3, FlattenInputs=False)
lng = ListLength(List=entwine)
repeat = RepeatData(Data=",", Length=lng)
replace = ReplaceItems(List=repeat, Item=";", Indices=expr("x-1", lng), Wrap=False)
concat = Concatenate(FragmentA=entwine, FragmentB=replace)

# ---- group: Join
merge = Merge(Data1=flatten(rep_6), Data2=flatten(concat))
join = TextJoin(Text=merge)

# ----
idf_text = ClusterOutput(join)  # Formatted IDF text for the Additional Strings input of the 'Export to OpenStudio' component

# ==== cluster EnergyCost
fuel = ClusterInput()  # Specify the fuel to apply the tariff to
energy_units = ClusterInput()  # Specify the energy units of the fuel costs being used.
monthly_charge = ClusterInput()  # Enter a number for any flat monthly charge to be applied to the energy tariff
unit_energy_cost = ClusterInput()  # Unit energy cost. Input a single number for a flat rate structure. Input a list of unit energy costs for variable time of day rate. The first number will be Off-Peak, the second number will be Peak. An optional third number will be a Midpeak number and a fourth will be used as the Shoulder rate. For seasonally varying rates, import each number or time of day list as a branch in a data tree. If two branches are supplied, the first branch will be winter, the second branch will be summer. Supply four branches if seperate rates are needed for Winter, Spring, Summer, and Autumn. Supply a data tree with twelve branches and one item to provide a monthly variable rate.
energy_cost_time_of_day = ClusterInput()  # Input a list of values that correspond with the number of items in the energy cost list. These values should be the time of day where the unit energy cost rate ends in HH:MM format. There is no need to enter 24:00 at the end of the list for the return to the off-peak rate since the component will automatically add that after the specified end to the peak or shoulder hour. For seasonally variable rates, use the same data tree structure as the energy rate costs to specify the hour where each rate ends. If there is only one flate daily rate, even one per season or month, then there is no need to use this input.
energy_cost_weekends_off_peak = ClusterInput()  # Boolean toggle to 'True' to have the offpeak energy unit rate apply to all weekend hours. If set to 'False', the time of day energy rate specified will be applied.
energy_cost_season = ClusterInput()  # Input a list of values that correspond with the number of branches in the energy cost data tree. These values should be the time of year where the unit energy cost rate ends in MM/DD format. There is no need to enter 12/31 at the end of the list for the return to the winter rate since the component will automatically add that after the end of the specified Summer or Autumn end date. If there is only one season, or if a monthly costs are specified, then there is no need to use this input.
demand_block_limits = ClusterInput()  # Input a list of values that correspond with the number of items in the energy cost list. These values should be the upper limit of the block where the unit energy cost rate ends in the energy units. There is no need to enter 'remaining' at the end of the list for the last number since the component will automatically add that (therefore the block list should be one less item in length than the list of block values). For seasonally variable rates, use the same data tree structure as the energy rate costs to specify the block rate for each season. If there is only one flate daily rate, even one per season or month, then there is no need to use this input.
demand_block_cost = ClusterInput()  # Demand prices. Input a single number for a single demand rate. Input a list of unit demand costs for escalating block demand rates. The numbers should be ordered by increasing block size. For seasonally varying rates, import each number or block list as a branch in a data tree. If two branches are supplied, the first branch will be winter, the second branch will be summer. Supply four branches if seperate rates are needed for Winter, Spring, Summer, and Autumn.
time_of_day_cost = Data(unit_energy_cost)

# ---- group: Monthly Schedule
series = Series(Start="1", Step=1, Count="12")
round = Round(Number=series)  # -> Nearest, Floor, Ceiling
panel = Panel("""31
28
31
30
31
30
31
31
30
31
30
31""")
concat = Concatenate(FragmentA=round.Nearest, FragmentB="/", FragmentC=panel)

# ----
tstat = TreeStatistics(Tree=time_of_day_cost)  # -> Paths, Length, Count
demand_block_cost_2 = Data(demand_block_cost)
expression = Expression(x=tstat.Length, Expression="IF(x=1,0,1)")
expression_2 = Expression(x=tstat.Count, Expression="IF(x=12,3,IF(x=4,2,IF(x=2,1,0)))")
tstat_2 = TreeStatistics(Tree=demand_block_cost_2)  # -> Paths, Length, Count
ma = MassAddition(Input=expression)  # -> Result, PartialResults
expression_3 = Expression(x=tstat_2.Count, Expression="IF(x=4,2,IF(x=2,1,0))")
weekends_off_peak = Boolean(energy_cost_weekends_off_peak)
expression_4 = Expression(x=ma.Result, Expression="IF(x=0,0,1)")

# ---- group: Tariff Parameters Generator
panel_2 = Panel("""UtilityCost:Tariff,
    FTCost,                     ! Name
    FT:Facility,         ! Output Meter Name
    UFC,                          ! Conversion Factor Choice
    ,                             ! Energy Conversion Factor
    ,                             ! Demand Conversion Factor
    TOD,            ! Time of Use Period Schedule Name
    TOY,            ! Season Schedule Name
    ,                             ! Month Schedule Name
    ,                             ! Demand Window Length
    MC;                        ! Monthly Charge or Variable Name""")
fuel_type = Data(fuel)
units = Data(energy_units)
lng = ListLength(List=monthly_charge)
concat_2 = Concatenate(FragmentA=fuel_type, FragmentB="TimeOfDaySchedule")
concat_3 = Concatenate(FragmentA=fuel_type, FragmentB="Monthly")
concat_4 = Concatenate(FragmentA=fuel_type, FragmentB="SeasonSchedule")
panel_3 = Panel("MonthlyCharge")
expression_5 = Expression(x=lng, Expression="IF(x=12,1,0)")
filter = StreamFilter(Gate=expression_4, Stream1=concat_2)
filter_2 = StreamFilter(Gate=expression_2, Stream0=filter, Stream1=filter, Stream2=filter)
filter_3 = StreamFilter(Gate=expression_2, Stream1=concat_4, Stream2=concat_4)
filter_4 = StreamFilter(Gate=expression_5, Stream0=monthly_charge, Stream1=panel_3)
rep = ReplaceText(Text=panel_2, Find="FT", Replace=fuel_type, RecursiveReplace=False)
rep_2 = ReplaceText(Text=rep, Find="UFC", Replace=units, RecursiveReplace=False)
rep_3 = ReplaceText(Text=rep_2, Find="TOD", Replace=filter_2, RecursiveReplace=False)
rep_4 = ReplaceText(Text=rep_3, Find="TOY", Replace=filter_3, RecursiveReplace=False)
rep_5 = ReplaceText(Text=rep_4, Find="MC", Replace=filter_4, RecursiveReplace=False)

# ---- group: Seasonal Schedule
seasonal_end_dates = Data(energy_cost_season)
repeat = RepeatData(Data=",", Length=tstat.Count)
panel_4 = Panel("""1
3
1""")
panel_5 = Panel("""1
2
3
4
1""")
panel_6 = Panel("12/31")
merge = Merge(Data1=flatten(repeat), Data2=flatten(";"))
merge_2 = Merge(Data1=seasonal_end_dates, Data2=panel_6)
filter_5 = StreamFilter(Gate=expression_2, Stream1=panel_4, Stream2=panel_5)
concat_5 = Concatenate(
    FragmentA="  Through: ",
    FragmentB=merge_2,
    FragmentC=", For: AllDays,  Until: 24:00, ",
    FragmentD=filter_5,
    FragmentE=merge)
rep_6 = ReplaceText(Text="  Schedule:Compact, SCHN, number,", Find="SCHN", Replace=concat_4, RecursiveReplace=False)
merge_3 = Merge(Data1=rep_6, Data2=concat_5)
join = TextJoin(Text=merge_3)
filter_6 = StreamFilter(Gate=expression_2, Stream1=join, Stream2=join)

# ---- group: Schedule Selector
filter_7 = StreamFilter(Gate=expression_2, Stream0=panel_6, Stream1=merge_2, Stream2=merge_2, Stream3=concat)

# ---- group: Block Cost
demand_block_limits_2 = Data(demand_block_limits)
repeat_2 = RepeatData(Data="remaining", Length=tstat_2.Count)  # -> graft(Data)
merge_4 = Merge(Data1=simplify(demand_block_limits_2), Data2=simplify(repeat_2))
panel_7 = Panel("  Until: ")
weave = Weave(Pattern=[0, 1], Stream0=merge_4, Stream1=demand_block_cost_2, NullGaps=False)
lng_2 = ListLength(List=weave)
repeat_3 = RepeatData(Data=",  ", Length=expr("x-1", lng_2))
repeat_4 = RepeatData(Data=";", Length=tstat_2.Count)  # -> graft(Data)
merge_5 = Merge(Data1=simplify(repeat_3), Data2=simplify(repeat_4))
concat_6 = Concatenate(FragmentA="  ", FragmentB=weave, FragmentC=merge_5)

# ---- group: Time of Day Energy Cost Schedule
panel_8 = Panel("""3
1
4
2""")
repeat_5 = RepeatData(Data=tstat.Length, Length=expr("x+1", tstat.Count))
panel_9 = Panel("""OffPeak
Peak
MidPeak
Shoulder""")
series_2 = Series(Start=0, Step=1, Count=graft(tstat.Length))
ma_2 = MassAddition(Input=repeat_5)  # -> Result, PartialResults
item = ListItem(List=panel_8, Index=series_2, Wrap=True)  # -> simplify(Item)
item_2 = ListItem(List=panel_9, Index=series_2, Wrap=True)
time_of_day_end_hours = Data(energy_cost_time_of_day)
panel_10 = Panel("3")
repeat_6 = RepeatData(Data=flatten(item), Length=ma_2.Result)
repeat_7 = RepeatData(Data=tstat.Length, Length=expr("x+1", tstat.Count))
panel_11 = Panel("AllDays")
rep_7 = ReplaceText(Text="  Schedule:Compact, SCHN, number,", Find="SCHN", Replace=concat_2, RecursiveReplace=False)
panel_12 = Panel("24:00")
repeat_8 = RepeatData(Data=panel_10, Length=expr("x+1", tstat.Count))  # -> simplify(graft(Data))
partition = PartitionList(List=repeat_6, Size=repeat_5)  # -> simplify(Chunks)
filter_8 = StreamFilter(Gate=weekends_off_peak, Stream1="  For: Weekends, Until: 24:00, 3")
filter_9 = StreamFilter(Gate=weekends_off_peak, Stream0=panel_11, Stream1="Weekdays")
panel_13 = Panel("  Until: ")
panel_14 = Panel(", For: ")
panel_15 = Panel("  Through: ")
panel_16 = Panel(",")
merge_6 = Merge(Data1=time_of_day_end_hours, Data2=panel_12)
panel_17 = Panel(",  ")
filter_10 = StreamFilter(Gate=expression_2, Stream0=tstat.Length, Stream1=repeat_7, Stream2=repeat_7, Stream3=repeat_7)
merge_7 = Merge(Data1=partition, Data2=repeat_8)
repeat_9 = RepeatData(Data=filter_8, Length=expr("x+1", tstat.Count))  # -> simplify(graft(Data))
concat_7 = Concatenate(FragmentA=panel_15, FragmentB=filter_7, FragmentC=panel_14, FragmentD=filter_9, FragmentE=panel_16)  # -> simplify(graft(Result))
repeat_10 = RepeatData(Data=" ", Length=graft(filter_10))  # -> simplify(Data)
concat_8 = Concatenate(FragmentA=panel_13, FragmentB=merge_6, FragmentC=panel_17, FragmentD=merge_7)
match = MatchTree(Tree=concat_7, Guide=repeat_10)
merge_8 = Merge(Data1=match, Data2=repeat_10)
filter_11 = StreamFilter(Gate=expression_2, Stream0=filter_8, Stream1=repeat_9, Stream2=repeat_9, Stream3=repeat_9)
panel_18 = Panel(";")

# ----
merge_9 = Merge(Data1=flatten(item), Data2=flatten(panel_10))
concat_9 = Concatenate(FragmentA=panel_13, FragmentB=merge_6, FragmentC=panel_17, FragmentD=merge_9)

# ---- group: Generate Costs Charges
panel_19 = Panel(""" UtilityCost:Charge:Simple,
    CVN,                 ! Charge Variable Name
    FLTCost,                     ! Tariff Name
    TotalEnergy,                   ! Source Variable
    SEA,                       ! Season
    EnergyCharges,                ! Category Variable Name
    PRC;                      ! Cost per Unit Value or Variable Name""")
panel_20 = Panel("""Jan
Feb
Mar
Apr
May
Jun
Jul
Aug
Sep
Oct
Nov
Dec""")
panel_21 = Panel("Annual")
panel_22 = Panel("""Winter
Summer""")
panel_23 = Panel("""Winter
Spring
Summer
Autumn""")
filter_12 = StreamFilter(Gate=expression_4, Stream0="FlatCharge", Stream1=item_2)
filter_13 = StreamFilter(Gate=expression_2, Stream0=panel_21, Stream1=panel_22, Stream2=panel_23, Stream3=panel_20)  # -> graft(Stream)
crossref = CrossReference(ListA=filter_13, ListB=filter_12, CrossMode=1)  # -> ListA, ListB
rep_8 = ReplaceText(Text=panel_19, Find="FLT", Replace=fuel_type, RecursiveReplace=False)
rep_9 = ReplaceText(Text=rep_8, Find="SV", Replace=item_2, RecursiveReplace=False)
concat_10 = Concatenate(FragmentA=crossref.ListA, FragmentB=crossref.ListB)
rep_10 = ReplaceText(Text=rep_8, Find="CVN", Replace=concat_10, RecursiveReplace=False)
rep_11 = ReplaceText(Text=rep_10, Find="SEA", Replace=crossref.ListA, RecursiveReplace=False)
rep_12 = ReplaceText(Text=rep_11, Find="PRC", Replace=time_of_day_cost, RecursiveReplace=False)  # -> flatten(Result)

panel_24 = Panel("""UtilityCost:Charge:Block,
  BlockDemandChargeSEA,            ! Charge Variable Name
  FLTCost,                     ! Tariff Name
  totalDemand,                  ! Source Variable
  SEA,                       ! Season
  DemandCharges,                ! Category Variable Name
  ,                             ! Remaining Into Variable
  ,                             ! Block Size Multiplier Value or Variable Name""")
filter_14 = StreamFilter(Gate=expression_3, Stream0=panel_21, Stream1=panel_22, Stream2=panel_23)  # -> graft(Stream)
rep_13 = ReplaceText(Text=panel_24, Find="FLT", Replace=fuel_type, RecursiveReplace=False)
rep_14 = ReplaceText(Text=rep_13, Find="SEA", Replace=filter_14, RecursiveReplace=False)

# ----
merge_10 = Merge(Data1=simplify(rep_14), Data2=simplify(concat_6))  # -> flatten(Result)
join_2 = TextJoin(Text=merge_10)
filter_15 = StreamFilter(Gate=expression_3, Stream1=join_2, Stream2=join_2)

# ---- group: Monthly Energy Charge Schedule
repeat_11 = RepeatData(Data=panel_16, Length="11")
merge_11 = Merge(Data1=flatten(repeat_11), Data2=flatten(panel_18))
concat_11 = Concatenate(
    FragmentA=panel_15,
    FragmentB=concat,
    FragmentC=panel_14,
    FragmentD=panel_11,
    FragmentE=panel_16,
    FragmentF=monthly_charge,
    FragmentG=merge_11)  # -> simplify(Result)
rep_15 = ReplaceText(Text="  Schedule:Compact, SCHN, Any Number,", Find="SCHN", Replace=panel_3, RecursiveReplace=False)
merge_12 = Merge(Data1=flatten(rep_15), Data2=flatten(concat_11))
join_3 = TextJoin(Text=merge_12)

# ---- group: Monthly Energy Cost Schedule
repeat_12 = RepeatData(Data=panel_16, Length="11")
merge_13 = Merge(Data1=flatten(repeat_12), Data2=flatten(panel_18))  # -> graft(Result)
concat_12 = Concatenate(
    FragmentA=concat_7,
    FragmentB=simplify(panel_13),
    FragmentC=simplify(panel_12),
    FragmentD=simplify(panel_17),
    FragmentE=simplify(time_of_day_cost),
    FragmentF=simplify(merge_13))
rep_16 = ReplaceText(Text="  Schedule:Compact, SCHN, Any Number,", Find="SCHN", Replace=concat_3, RecursiveReplace=False)
merge_14 = Merge(Data1=flatten(rep_16), Data2=flatten(concat_12))
join_4 = TextJoin(Text=merge_14)

# ----
filter_16 = StreamFilter(Gate=expression_5, Stream1=join_3)
filter_17 = StreamFilter(Gate=expression_2, Stream0=rep_12, Stream1=rep_12, Stream2=rep_12, Stream3=join_4)

# ---- group: Time of Day Energy Cost Schedule (continued)
filter_18 = StreamFilter(Gate=expression_2, Stream0=concat_9, Stream1=concat_8, Stream2=concat_8, Stream3=concat_8)
concat_13 = Concatenate(FragmentA=merge_8, FragmentB=filter_18)

# ----
match_2 = MatchTree(Tree=concat_13, Guide=filter_11)

# ---- group: Time of Day Energy Cost Schedule (continued)
merge_15 = Merge(Data1=match_2, Data2=filter_11)  # -> flatten(Result)
lng_3 = ListLength(List=merge_15)
repeat_13 = RepeatData(Data=panel_16, Length=expr("x-1", lng_3))
merge_16 = Merge(Data1=flatten(repeat_13), Data2=flatten(panel_18))
concat_14 = Concatenate(FragmentA=merge_15, FragmentB=merge_16)
merge_17 = Merge(Data1=rep_7, Data2=concat_14)
join_5 = TextJoin(Text=merge_17)
filter_19 = StreamFilter(Gate=expression_4, Stream1=join_5)
filter_20 = StreamFilter(Gate=expression_2, Stream0=filter_19, Stream1=filter_19, Stream2=filter_19)

# ----
merge_18 = Merge(Data1=rep_5, Data3=filter_17, Data5=filter_6, Data7=filter_20, Data9=filter_15, Data11=filter_16)
join_6 = TextJoin(Text=merge_18)
idf_text = ClusterOutput(join_6)  # Formatted IDF text for the Additional Strings input of the 'Export to OpenStudio' component

# ==== cluster SHWFormat
custom_weekday_sch = ClusterInput()  # Optional override of 24 values
custom_weekend_sch = ClusterInput()  # Optional override of 24 values
units = ClusterInput()
proposed_daily_total = ClusterInput()
baseline_daily_total = ClusterInput()
building_use = ClusterInput()
weekends = ClusterInput()

# ---- group: Convert Daily Volume to m3
proposed_daily_total_2 = Number(proposed_daily_total)
baseline_daily_total_2 = Number(baseline_daily_total)
merge = Merge(Data1=proposed_daily_total_2, Data2=baseline_daily_total_2)
liters_to_m3 = Panel("0.001")
gallons_to_m3 = Panel(".003785412")
units_2 = Number(units)
volume = Number(merge)
multiplication = Multiplication(A=volume, B=liters_to_m3)
multiplication_2 = Multiplication(A=volume, B=gallons_to_m3)
filter = StreamFilter(Gate=units_2, Stream0=multiplication, Stream1=multiplication_2)
custom_daily_hw_m3 = Panel(filter)

# ----
custom_weekday_sch_2 = Number(custom_weekday_sch)
custom_weekend_sch_2 = Number(custom_weekend_sch)
medium_office_building = Panel("""0.05
0.05
0.05
0.05
0.05
0.08
0.07
0.19
0.35
0.38
0.39
0.47
0.57
0.54
0.34
0.33
0.44
0.26
0.21
0.15
0.17
0.08
0.05
0.05""")
building_use_2 = Number(building_use)
weekends_2 = Number(weekends)
null = NullItem(Item=custom_weekday_sch_2)  # -> NullFlags, InvalidFlags, Description
null_2 = NullItem(Item=custom_weekend_sch_2)  # -> NullFlags, InvalidFlags, Description
midrise_apartment = Panel("""0.08
0.04
0.01
0.01
0.04
0.27
0.94
1
0.96
0.84
0.76
0.61
0.53
0.47
0.41
0.47
0.55
0.73
0.86
0.82
0.75
0.61
0.53
0.29""")
item = ListItem(List=null.NullFlags, Index=0, Wrap=True)
item_2 = ListItem(List=null_2.NullFlags, Index=0, Wrap=True)
restaurant = Panel("""0.2
0
0
0
0
0
0.15
0.6
0.55
0.45
0.4
0.45
0.4
0.35
0.3
0.3
0.3
0.4
0.55
0.6
0.5
0.55
0.45
0.25""")
supermarket = Panel("""0.04
0.05
0.05
0.04
0.04
0.04
0.04
0.15
0.23
0.32
0.41
0.57
0.62
0.61
0.5
0.45
0.46
0.47
0.42
0.34
0.33
0.23
0.13
0.08""")
panel = Panel("""0
1
1
1
1
1
1
1
1
1
1
2
2
2
2
1
1
1
1
0""")
item_3 = ListItem(List=panel, Index=building_use_2, Wrap=True)
filter_2 = StreamFilter(Gate=item_3, Stream0=medium_office_building, Stream1=midrise_apartment, Stream2=restaurant, Stream3=supermarket)
repeat = RepeatData(Data="0", Length="24")

filter_3 = StreamFilter(Gate=item, Stream0=custom_weekday_sch_2, Stream1=filter_2)

# ---- group: Calculate Peak Flow Based on Schedule
ma = MassAddition(Input=filter_3)  # -> Result, PartialResults
division = Division(A=custom_daily_hw_m3, B=ma.Result)
division_2 = Division(A=division, B="3600")
peak_flow_m3_s = Panel(division_2)

# ----
filter_4 = StreamFilter(Gate=weekends_2, Stream0=repeat, Stream1=filter_3)

filter_5 = StreamFilter(Gate=item_2, Stream0=custom_weekend_sch_2, Stream1=filter_4)
weekday_schedule = Number(filter_3)
weekend_schedule = Number(filter_5)
item_4 = ListItem(List=peak_flow_m3_s, Index=0, Wrap=True)  # -> Item, Item1
proposed_peak_flow = Number(item_4.Item)
baseline_peak_flow = Number(item_4.Item1)
weekday_schedule_2 = ClusterOutput(weekday_schedule)
weekend_schedule_2 = ClusterOutput(weekend_schedule)
proposed_peak_flow_2 = ClusterOutput(proposed_peak_flow)
baseline_peak_flow_2 = ClusterOutput(baseline_peak_flow)

# ==== cluster IronbugSHWDefinitions
units = ClusterInput()
fuel = ClusterInput()
supply_temp = ClusterInput()
proposed_peak_flow = ClusterInput()
proposed_efficiency = ClusterInput()
baseline_peak_flow = ClusterInput()
baseline_efficiency = ClusterInput()
weekday_schedule = ClusterInput()
weekend_schedule = ClusterInput()
tank_units = ClusterInput()
tank_volume = ClusterInput()
units_2 = Number(units)
fuel_2 = Data(fuel)
weekend_schedule_2 = Number(weekend_schedule)
tank_units_2 = Number(tank_units)
supply_temp_2 = Number(supply_temp)
proposed_peak_flow_2 = Number(proposed_peak_flow)
baseline_peak_flow_2 = Number(baseline_peak_flow)
baseline_efficiency_2 = Number(baseline_efficiency)
weekday_schedule_2 = Number(weekday_schedule)
proposed_efficiency_2 = Number(proposed_efficiency)
tank_volume_2 = Number(tank_volume)
merge = Merge(Data1=proposed_efficiency_2, Data2=baseline_efficiency_2)
f2c = Ladybug_F2C(F=supply_temp_2)  # -> C; plug-in component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
filter = StreamFilter(Gate=units_2, Stream0=supply_temp_2, Stream1=f2c)

# ---- group: Schedules
# Hot Supply Temp Sched
toggle = BooleanToggle(True)
toggle_2 = BooleanToggle(True)
toggle_3 = BooleanToggle(True)
schedulerule = Ironbug_ScheduleRule(Values=weekday_schedule_2, Parameters_=<missing>, dupNum=False)
schedulerule_2 = Ironbug_ScheduleRule(Values=weekend_schedule_2, Parameters_=<missing>, dupNum=False)
schedulerule_3 = Ironbug_ScheduleRule(Values=filter, Parameters_=<missing>, dupNum=False)
merge_2 = Merge(Data1=flatten(schedulerule), Data2=flatten(schedulerule_2))
panel = Panel("DHW")

# ----
panel_2 = Panel("Temperature")
panel_3 = Panel("""Proposed
Baseline""")

# ---- group: Water Heater Properties
expression = Expression(x=tank_volume_2, Expression="IF(x=0,0,1)")
filter_2 = StreamFilter(Gate=expression, Stream1=tank_volume_2)
liters_to_m3 = Panel("0.001")
gallons_to_m3 = Panel(".003785412")
multiplication = Multiplication(A=filter_2, B=liters_to_m3)
multiplication_2 = Multiplication(A=filter_2, B=gallons_to_m3)
filter_3 = StreamFilter(Gate=tank_units_2, Stream0=multiplication, Stream1=multiplication_2, Stream2=filter_2)
concat = Concatenate(FragmentA=panel_3, FragmentB="Heater")
item = ListItem(List=<missing>, Index=0, Wrap=True)  # -> Item, Item1

# ---- group: Loop Properties
panel_4 = Panel("Optimal")
panel_5 = Panel("0.000440")
concat_2 = Concatenate(FragmentA=panel_3, FragmentB="SHW Loop")
panel_6 = Panel("10")
item_2 = ListItem(List=<missing>, Index=0, Wrap=True)  # -> Item, Item1

# ---- group: Pump Properties
panel_7 = Panel("Intermittent")
panel_8 = Panel("29891")
concat_3 = Concatenate(FragmentA=panel_3, FragmentB="SHW Pump")
panel_9 = Panel("0.3")
item_3 = ListItem(List=<missing>, Index=0, Wrap=True)  # -> Item, Item1

# ----
panel_10 = Panel("Heating")
panel_11 = Panel("5")
sizingplant = Ironbug_SizingPlant(Parameters_=<missing>, dupNum=False)
wateruseload = Ironbug_WaterUseEquipmentDefinition(PeakFlowRate=proposed_peak_flow_2, Parameters_=<missing>, dupNum=False)

# ---- group: Proposed
waterheatermixed = Ironbug_WaterHeaterMixed(Parameters_=item.Item, dupNum=False)
wateruseequipment = Ironbug_WaterUseEquipment(WaterUseLoad=wateruseload, Parameters_=<missing>, dupNum=False)
wateruseconnections = Ironbug_WaterUseConnections(WaterUseEquipment=wateruseequipment, Parameters_=<missing>, dupNum=False)
pipeadiabatic = Ironbug_PipeAdiabatic(dupNum=False)
plantbranches = PlantBranches(B1=wateruseconnections, B2=pipeadiabatic, mapBranchToLoop=False)
pumpconstant = Ironbug_PumpConstantSpeed(Parameters_=item_3.Item, dupNum=False)
plantbranches_2 = PlantBranches(B1=pipeadiabatic, B2=waterheatermixed, mapBranchToLoop=False)
pipeadiabatic_2 = Ironbug_PipeAdiabatic(dupNum=False)
merge_3 = Merge(Data1=flatten(pipeadiabatic), Data2=flatten(plantbranches), Data3=flatten(pipeadiabatic))  # -> flatten(Result)
merge_4 = Merge(Data1=pumpconstant, Data2=plantbranches_2, Data3=pipeadiabatic_2, Data4=<missing>)
hotwaterloop = Ironbug_HotWaterPlantLoop(Supply=merge_4, Demand=merge_3, SizingLoop=sizingplant, Parameters_=item_2.Item, dupNum=False)

# ---- group: Baseline
wateruseload_2 = Ironbug_WaterUseEquipmentDefinition(PeakFlowRate=baseline_peak_flow_2, dupNum=False)
waterheatermixed_2 = Ironbug_WaterHeaterMixed(Parameters_=item.Item1, dupNum=False)
wateruseequipment_2 = Ironbug_WaterUseEquipment(WaterUseLoad=wateruseload_2, Parameters_=<missing>, dupNum=False)
wateruseconnections_2 = Ironbug_WaterUseConnections(WaterUseEquipment=wateruseequipment_2, Parameters_=<missing>, dupNum=False)
plantbranches_3 = PlantBranches(B1=wateruseconnections_2, B2=pipeadiabatic, mapBranchToLoop=False)
pumpconstant_2 = Ironbug_PumpConstantSpeed(Parameters_=item_3.Item1, dupNum=False)
pipeadiabatic_3 = Ironbug_PipeAdiabatic(dupNum=False)
plantbranches_4 = PlantBranches(B1=pipeadiabatic, B2=waterheatermixed_2, mapBranchToLoop=False)
merge_5 = Merge(Data1=flatten(pipeadiabatic), Data2=flatten(plantbranches_3), Data3=flatten(pipeadiabatic))  # -> flatten(Result)
merge_6 = Merge(Data1=pumpconstant_2, Data2=plantbranches_4, Data3=pipeadiabatic_3, Data4=<missing>)
hotwaterloop_2 = Ironbug_HotWaterPlantLoop(Supply=merge_6, Demand=merge_5, SizingLoop=sizingplant, Parameters_=item_2.Item1, dupNum=False)

# ----
baseline_shw_system = ClusterOutput(hotwaterloop_2)  # Attach to Baseline HVAC System Plant Loops
proposed_shw_system = ClusterOutput(hotwaterloop)  # Attach to Proposed HVAC System Plant Loops

# ==== cluster ProgramTypeInputsCalculator
heating_setpoint = ClusterInput()
heating_setback = ClusterInput()
cooling_setpoint = ClusterInput()
cooling_setback = ClusterInput()
humidity_setpoint = ClusterInput()
dehumidifysetback = ClusterInput()
occupancy_schedule = ClusterInput()  # Schedule override with name of schedule. If nothing is suppled, default schedule will be used
activity_schedule = ClusterInput()  # Schedule override with name of schedule. If nothing is suppled, default schedule will be used
lighting_schedule = ClusterInput()  # Schedule override with name of schedule. If nothing is suppled, default schedule will be used
equipment_schedule = ClusterInput()  # Schedule override with name of schedule. If nothing is suppled, default schedule will be used
gas_equipment_schedule = ClusterInput()  # Schedule override with name of schedule. If nothing is suppled, default schedule will be used
hot_water_schedule = ClusterInput()  # Schedule override with name of schedule. If nothing is suppled, default schedule will be used
ventilation_schedule = ClusterInput()  # Schedule override with name of schedule. If nothing is suppled, default schedule will be used
units = ClusterInput()
zone_name = ClusterInput()  # Optional name of zones. If not provided, zones will be named with the program type.
zone_program = ClusterInput()
leed_baseline = ClusterInput()
code_baseline = ClusterInput()
number_of_people_per_area = ClusterInput()
lighting_density_per_area = ClusterInput()
equipment_load_per_area = ClusterInput()
gas_equipment_load_per_area = ClusterInput()
hot_water_load_per_area = ClusterInput()
ventilation_per_person = ClusterInput()
ventilation_per_area = ClusterInput()
of_lights_with_daylight_control = ClusterInput()
conditioned = ClusterInput()
heating_setpoint_2 = Data(heating_setpoint)
heating_setback_2 = Data(heating_setback)
cooling_setpoint_2 = Data(cooling_setpoint)
cooling_setback_2 = Data(cooling_setback)
humidity_setpoint_2 = Data(humidity_setpoint)
dehumidifysetback_2 = Data(dehumidifysetback)
units_2 = Data(units)
zone_name_2 = Data(zone_name)
zone_program_2 = Data(zone_program)
leed_baseline_standard = Data(leed_baseline)
code_baseline_standard = Data(code_baseline)
number_of_people_per_area_2 = Data(number_of_people_per_area)
lighting_density_per_area_2 = Data(lighting_density_per_area)
equipment_load_per_area_2 = Data(equipment_load_per_area)
gas_equipment_load_per_area_2 = Data(gas_equipment_load_per_area)
hot_water_load_per_area_2 = Data(hot_water_load_per_area)
ventilation_per_person_2 = Number(ventilation_per_person)
ventilation_per_area_2 = Number(ventilation_per_area)
of_lights_with_daylight_control_2 = Data(of_lights_with_daylight_control)
conditioned_2 = Data(conditioned)
rep = ReplaceText(Text=zone_program_2, Find=leed_baseline_standard, Replace=code_baseline_standard, RecursiveReplace=False)
split = TextSplit(Text=zone_program_2, Separators="::")
len = TextLength(Text=zone_name_2)
merge = Merge(Data1=zone_program_2, Data2=rep)
lng = ListLength(List=split)
expression = Expression(x=len, Expression="IF(x=0,1,0)")
item = ListItem(List=split, Index=expr("x-1", lng), Wrap=True)
filter = StreamFilter(Gate=expression, Stream0=zone_name_2, Stream1=item)
deconstrprogram = HBDeconstructProgramType(program=merge)  # -> people, lighting, electric_equip, gas_equip, hot_water, infiltration, ventilation, setpoint; plug-in component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

# ---- group: Ventilation Schedule
decnstrsetpoint = HBDeconstructSetpoint(setpoint=deconstrprogram.setpoint)  # -> name, heating_sch, cooling_sch, humid_setpt, dehumid_setpt; plug-in component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
analysisperiod = LBAnalysisPeriod(start_month=1, start_day=1, start_hour=0)  # -> period, hoys, dates; plug-in component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
schtodata = HBScheduleToData(schedule=decnstrsetpoint.heating_sch, analysis_period=analysisperiod.period)  # -> data; plug-in component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
xdata = LBDeconstructData(data=schtodata)  # -> header, values; plug-in component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
bnd = Bounds(Numbers=xdata.values)
dedomain = DeconstructDomain(Domain=bnd)  # -> Start, End
expression_2 = Expression(x=xdata.values, y=dedomain.Start, Expression="IF(x=y,0,1)")
concat = Concatenate(FragmentA=item, FragmentB=" VENTILATION_SCH")
fixedintervalschedule = HBFixedIntervalSchedule(values=expression_2, analysis_period=analysisperiod.period, name=concat, type_limit="On-Off")  # -> report, flatten(schedule); plug-in component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
applyroomsch = HBApplyRoomSchedules(room_or_program=flatten(zone_program_2), ventilation_sch=fixedintervalschedule.schedule)  # -> report, mod_obj; plug-in component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

# ---- group: Unit Labels
panel = Panel("""people
W
W
W""")
panel_2 = Panel("""m³/s
CFM""")
panel_3 = Panel("""m²
ft²""")
panel_4 = Panel("""L/h
gpm""")
panel_5 = Panel("""°C
°F""")
item_2 = ListItem(List=panel_5, Index=units_2, Wrap=True)
item_3 = ListItem(List=panel_3, Index=units_2, Wrap=True)
item_4 = ListItem(List=panel_2, Index=units_2, Wrap=True)
item_5 = ListItem(List=panel_4, Index=units_2, Wrap=True)
concat_2 = Concatenate(FragmentA=panel, FragmentB=item_3, JoinSeparator="/")
concat_3 = Concatenate(FragmentA=item_4, FragmentB="person", JoinSeparator="/")
concat_4 = Concatenate(FragmentA=item_4, FragmentB=item_3, JoinSeparator="/")
concat_5 = Concatenate(FragmentA=item_5, FragmentB=item_3, JoinSeparator="/")
merge_2 = Merge(Data1=concat_2, Data2=concat_5, Data3=concat_4, Data4=concat_3)
panel_6 = Panel(merge_2)

# ----
decnstrpeople = HBDeconstructPeople(people=deconstrprogram.people)  # -> name, ppl_per_area, occupancy_sch, activity_sch; plug-in component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
decnstrlighting = HBDeconstructLighting(lighting=deconstrprogram.lighting)  # -> name, watts_per_area, schedule, radiant_fract, visible_fract, return_fract, baseline; plug-in component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
decnstrequipment = HBDeconstructEquipment(equip=deconstrprogram.electric_equip)  # -> name, watts_per_area, schedule, radiant_fract, latent_fract, lost_fract, is_gas; plug-in component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
decnstrequipment_2 = HBDeconstructEquipment(equip=deconstrprogram.gas_equip)  # -> name, watts_per_area, schedule, radiant_fract, latent_fract, lost_fract, is_gas; plug-in component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
decnstrhotwater = HBDeconstructHotWater(hot_water=deconstrprogram.hot_water)  # -> name, flow_per_area, schedule, target_temp, sensible_fract, latent_fract; plug-in component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
decnstrventilation = HBDeconstructVentilation(vent=deconstrprogram.ventilation)  # -> name, flow_per_person, flow_per_area, flow_per_zone, ach, schedule; plug-in component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
entwine = Entwine(
    Branch00=decnstrpeople.ppl_per_area,
    Branch01=decnstrlighting.watts_per_area,
    Branch02=decnstrequipment.watts_per_area,
    Branch03=decnstrequipment_2.watts_per_area,
    FlattenInputs=True)
ft2_to_m2 = Panel("10.7639")
division = Division(A=decnstrventilation.flow_per_area, B=ft2_to_m2)
units_3 = LBUnitConverter(values=decnstrhotwater.flow_per_area, from_u="L/h-m2", to_u="gph/ft2")  # -> all_u, values; plug-in component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
units_4 = LBUnitConverter(values=decnstrventilation.flow_per_person, from_u="m3/s", to_u="cfm")  # -> all_u, values; plug-in component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
units_5 = LBUnitConverter(values=division, from_u="m3/s", to_u="cfm")  # -> all_u, values; plug-in component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
nullrep = ReplaceNulls(Items=entwine, Replacements="0")  # -> Items, Count
filter_2 = StreamFilter(Gate=units_2, Stream0=ventilation_per_person_2, Stream1=units_4.values)
filter_3 = StreamFilter(Gate=units_2, Stream0=ventilation_per_area_2, Stream1=units_5.values)
division_2 = Division(A=nullrep.Items, B=ft2_to_m2)
division_3 = Division(A=units_3.values, B="60")

# ---- group: Schedules
entwine_2 = Entwine(
    Branch00=decnstrpeople.occupancy_sch,
    Branch01=decnstrpeople.activity_sch,
    Branch02=decnstrlighting.schedule,
    Branch03=decnstrequipment.schedule,
    Branch04=decnstrequipment_2.schedule,
    Branch05=decnstrhotwater.schedule,
    Branch06=fixedintervalschedule.schedule,
    FlattenInputs=True)
entwine_3 = Entwine(
    Branch00=occupancy_schedule,
    Branch01=activity_schedule,
    Branch02=lighting_schedule,
    Branch03=equipment_schedule,
    Branch04=gas_equipment_schedule,
    Branch05=hot_water_schedule,
    Branch06=ventilation_schedule,
    FlattenInputs=True)
item_6 = ListItem(List=entwine_2, Index=0, Wrap=True)
len_2 = TextLength(Text=entwine_3)
split_2 = TextSplit(Text=item_6, Separators=":")
equals = Equality(FirstNumber=len_2, SecondNumber="0")  # -> Equality, Inequality
item_7 = ListItem(List=split_2, Index="1", Wrap=True)
split_3 = TextSplit(Text=item_7, Separators="[")
item_8 = ListItem(List=split_3, Index=0, Wrap=True)
trim = TextTrim(Text=item_8, Start=True, End=True)
nullrep_2 = ReplaceNulls(Items=trim, Replacements="Always Off")  # -> Items, Count
p_n_c = PickNChoose(Pattern=flatten(equals.Equality), Stream0=flatten(entwine_3), Stream1=flatten(nullrep_2.Items))

# ---- group: Setpoints
item_9 = ListItem(List=deconstrprogram.setpoint, Index=0, Wrap=True)
entwine_4 = Entwine(
    Branch00=heating_setpoint_2,
    Branch01=heating_setback_2,
    Branch02=cooling_setpoint_2,
    Branch03=cooling_setback_2,
    FlattenInputs=True)
rep_2 = ReplaceText(Text=item_9, Find=":", Replace=" ", RecursiveReplace=False)
units_6 = LBUnitConverter(values=entwine_4, from_u="F", to_u="C")  # -> all_u, values; plug-in component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
split_4 = TextSplit(Text=rep_2, Separators=" ")
panel_7 = Panel("""11
14""")
filter_4 = StreamFilter(Gate=units_2, Stream0=entwine_4, Stream1=units_6.values)
item_10 = ListItem(List=split_4, Index=panel_7, Wrap=True)  # -> graft(Item)
num = Number(filter_4)
repeat = RepeatData(Data=item_10, Length="2")
null = NullItem(Item=num)  # -> NullFlags, InvalidFlags, Description
trim_2 = TextTrim(Text=repeat, Start=True, End=True)
p_n_c_2 = PickNChoose(Pattern=flatten(null.NullFlags), Stream0=flatten(num), Stream1=flatten(trim_2))

# ----
filter_5 = StreamFilter(Gate=units_2, Stream0=nullrep.Items, Stream1=division_2)
filter_6 = StreamFilter(Gate=units_2, Stream0=decnstrhotwater.flow_per_area, Stream1=division_3)
nullrep_3 = ReplaceNulls(Items=ventilation_per_person_2, Replacements=filter_2)  # -> Items, Count
nullrep_4 = ReplaceNulls(Items=ventilation_per_area_2, Replacements=filter_3)  # -> Items, Count
lng_2 = ListLength(List=decnstrhotwater.flow_per_area)
lng_3 = ListLength(List=filter_2)
lng_4 = ListLength(List=filter_3)
repeat_2 = RepeatData(Data=filter_6, Length=lng_2)
repeat_3 = RepeatData(Data=nullrep_3.Items, Length=lng_3)
repeat_4 = RepeatData(Data=nullrep_4.Items, Length=lng_4)
min = Minimum(A=filter_2, B=repeat_3)
min_2 = Minimum(A=filter_3, B=repeat_4)
tstat = TreeStatistics(Tree=repeat_2)  # -> Paths, Length, Count
replace = ReplacePaths(Data=repeat_2, Search=tstat.Paths, Replace="{0;4}")
item_11 = ListItem(List=min, Index=0, Wrap=True)  # -> Item, Item1
item_12 = ListItem(List=min_2, Index=0, Wrap=True)  # -> Item, Item1
merge_3 = Merge(Data1=filter_5, Data2=replace)
entwine_5 = Entwine(
    Branch00=number_of_people_per_area_2,
    Branch01=lighting_density_per_area_2,
    Branch02=equipment_load_per_area_2,
    Branch03=gas_equipment_load_per_area_2,
    Branch04=hot_water_load_per_area_2,
    FlattenInputs=True)
num_2 = Number(entwine_5)
item_13 = ListItem(List=merge_3, Index=0, Wrap=True)  # -> Item, Item1
null_2 = NullItem(Item=num_2)  # -> NullFlags, InvalidFlags, Description
panel_8 = Panel("""1
4""")

# ---- group: Format for Display
panel_9 = Panel("""1
6""")
split_5 = TextSplit(Text=fixedintervalschedule.schedule, Separators=":")
cull_i = CullIndex(List=p_n_c, Indices=panel_9, Wrap=True)
item_14 = ListItem(List=split_5, Index="1", Wrap=True)
split_6 = TextSplit(Text=item_14, Separators="[")
item_15 = ListItem(List=split_6, Index=0, Wrap=True)
trim_3 = TextTrim(Text=item_15, Start=True, End=True)  # -> flatten(Result)
merge_4 = Merge(Data1=flatten(cull_i), Data2=flatten(trim_3))

# ----
p_n_c_3 = PickNChoose(Pattern=flatten(null_2.NullFlags), Stream0=flatten(num_2), Stream1=flatten(item_13.Item))
p_n_c_4 = PickNChoose(Pattern=flatten(null_2.NullFlags), Stream0=flatten(num_2), Stream1=flatten(item_13.Item1))
item_16 = ListItem(List=flatten(item_13.Item), Index=panel_8, Wrap=True)
item_17 = ListItem(List=flatten(item_13.Item1), Index=panel_8, Wrap=True)
item_18 = ListItem(List=fixedintervalschedule.schedule, Index=0, Wrap=True)
replace_2 = ReplaceItems(List=p_n_c_3, Item=item_16, Indices=panel_8, Wrap=False)
replace_3 = ReplaceItems(List=p_n_c_4, Item=item_17, Indices=panel_8, Wrap=False)
merge_5 = Merge(Data1=flatten(p_n_c_3), Data2=flatten(nullrep_3.Items), Data3=flatten(nullrep_4.Items))
merge_6 = Merge(Data1=flatten(replace_2), Data2=flatten(item_11.Item), Data3=flatten(item_12.Item))
merge_7 = Merge(Data1=flatten(replace_3), Data2=flatten(item_11.Item1), Data3=flatten(item_12.Item1))
i = ClusterOutput(item_18)
conversion_factors = Panel("""10.76391
10.76391
10.76391
10.76391
2444.75
0.000472
0.00508""")

# ---- group: Inputs
panel_10 = Panel("""Number of People Per Area
Lighting Density Per Area
Equipment Power Density
Gas Power Density
Hot Water Density
Ventilation Per Person
Ventilation Per Area""")
concat_6 = Concatenate(FragmentA=panel_10, FragmentB=" ", FragmentC=" (", FragmentD=merge_2, FragmentE=")")  # -> flatten(Result)

# ----
nullrep_5 = ReplaceNulls(Items=merge_6, Replacements="0")  # -> Items, Count
nullrep_6 = ReplaceNulls(Items=merge_7, Replacements="0")  # -> Items, Count
nullrep_7 = ReplaceNulls(Items=merge_5, Replacements="0")  # -> Items, Count
multiplication = Multiplication(A=nullrep_7.Items, B=conversion_factors)
multiplication_2 = Multiplication(A=nullrep_5.Items, B=conversion_factors)
multiplication_3 = Multiplication(A=nullrep_6.Items, B=conversion_factors)
filter_7 = StreamFilter(Gate=units_2, Stream0=nullrep_7.Items, Stream1=multiplication)
filter_8 = StreamFilter(Gate=units_2, Stream0=nullrep_5.Items, Stream1=multiplication_2)
filter_9 = StreamFilter(Gate=units_2, Stream0=nullrep_6.Items, Stream1=multiplication_3)
merge_8 = Merge(
    Data1=flatten(filter),
    Data2=flatten(zone_program_2),
    Data3=flatten(filter_7),
    Data4=flatten(of_lights_with_daylight_control_2),
    Data5=flatten(conditioned_2),
    Data6=flatten(p_n_c_2),
    Data7=flatten(humidity_setpoint_2),
    Data8=flatten(dehumidifysetback_2),
    Data9=flatten(p_n_c),
    Data10=flatten(filter_8),
    Data11=flatten(filter_9))
join = TextJoin(Text=merge_8, Join=",")
code_baseline_loads = Data(nullrep_6.Items)
leed_baseline_loads = Data(nullrep_5.Items)
program_properties = Data(join)
load_catagories = Data(concat_6)
loads = Data(nullrep_7.Items)
load_catagories_2 = ClusterOutput(load_catagories)
loads_2 = ClusterOutput(loads)
leed_baseline_loads_2 = ClusterOutput(leed_baseline_loads)
code_baseline_loads_2 = ClusterOutput(code_baseline_loads)
program_schedules = ClusterOutput(merge_4)
program_properties_2 = ClusterOutput(program_properties)

# ==== cluster WinMod
surfaces = ClusterInput()  # List of surfaces to exclude windows from
window_surfaces = ClusterInput()  # List of Window Surfaces
md_slider = MDSlider(SliderMode=0, slider_value=Point(0.5, 0.5, 0.5), x_domain=Domain(0, 1), y_domain=Domain(0, 1), z_domain=Domain(0, 1))
debrep = DeconstructBrep(Brep=surfaces)  # -> flatten(Faces), Edges, Vertices
evalsrf = EvaluateSurface(Surface=debrep.Faces, Point=md_slider)  # -> Point, Normal, Frame
division = Division(A=".125", B="2")
rev = Reverse(Vector=evalsrf.Normal)
amp = Amplitude(Vector=evalsrf.Normal, Amplitude=division)
amp_2 = Amplitude(Vector=rev, Amplitude=".125")
move = Move(Geometry=surfaces, Motion=amp)  # -> Geometry, Transform
extr = Extrude(Base=move.Geometry, Direction=amp_2)
area = Area(Geometry=window_surfaces)  # -> Area, Centroid
brepsinc = PointInBreps(Brep=extr, Point=area.Centroid, Strict=False)  # -> Inside, Index
cull = CullPattern(List=window_surfaces, CullPattern=invert(brepsinc.Inside))
bool = Boolean(invert(brepsinc.Inside))
windows = ClusterOutput(cull)  # List of windows after exclusion
boolean_pattern = ClusterOutput(bool)  # Boolean pattern for reducing surfaces

# ==== cluster Sort
surfaces = ClusterInput()  # Enter list of surfaces to seperate by orientation
north_vector_rotation = ClusterInput()  # North Arrow Rotation in Degrees (Clockwise)
md_slider = MDSlider(SliderMode=0, slider_value=Point(0.5, 0.5, 0.5), x_domain=Domain(0, 1), y_domain=Domain(0, 1), z_domain=Domain(0, 1))
srf = Surface(surfaces)
evalsrf = EvaluateSurface(Surface=reparameterize(srf), Point=md_slider)  # -> Point, Normal, UDirection, VDirection, Frame
series = Series(Start=0, Step="90", Count="4")
vdis = VectorDisplay(Anchor=evalsrf.Point, Vector=evalsrf.Normal)
addition = Addition(A=north_vector_rotation, B="45", C=series)
rad = Radians(Degrees=addition)
Y = UnitY(Factor=1)
rotate = Rotate(Geometry=Y, Angle=rad, Plane=PlaneXY(0, 0, 0))  # -> Geometry, Transform
angle = Angle(VectorA=graft(evalsrf.Normal), VectorB=rotate.Geometry)  # -> Angle, Reflex
deg = Degrees(Radians=angle.Angle)
item = ListItem(List=deg, Index=0, Wrap=True)  # -> Item, Item1, Item2, Item3
addition_2 = Addition(A=item.Item2, B=item.Item3)
addition_3 = Addition(A=item.Item, B=item.Item3)
addition_4 = Addition(A=item.Item1, B=item.Item2)
addition_5 = Addition(A=item.Item, B=item.Item1)
entwine = Entwine(Branch00=addition_3, Branch01=addition_2, Branch02=addition_4, Branch03=addition_5, FlattenInputs=True)
similar = Similarity(FirstNumber=entwine, SecondNumber="90", Threshold=0.1)  # -> Similarity, AbsoluteDifference
cull = CullPattern(List=srf, CullPattern=similar.Similarity)
bang = ExplodeTree(Data=cull)  # -> flatten(Branch0), flatten(Branch1), flatten(Branch2), flatten(Branch3)
north_surfaces = ClusterOutput(bang.Branch0)  # Surfaces Facing North
east_surfaces = ClusterOutput(bang.Branch1)  # Surfaces Facing East
south_surfaces = ClusterOutput(bang.Branch2)  # Surfaces Facing South
west_surfaces = ClusterOutput(bang.Branch3)  # Surfaces Facing West

# ==== cluster Shade
window_surfaces = ClusterInput()  # Enter list of surfaces to make shading devices for
shade_type = ClusterInput()  # Enter 0 for horizontal, 1 for vertical, 2 for combined
shade_ratio = ClusterInput()  # Ratio of window height/width to project
srf = Surface(window_surfaces)
num = Number(shade_ratio)
edges = BrepEdges(Brep=srf)  # -> Naked, Interior, NonManifold
md_slider = MDSlider(
    SliderMode=0,
    slider_value=Point(0.5, 0.5002603531, 0.5),
    x_domain=Domain(0, 1),
    y_domain=Domain(0, 1),
    z_domain=Domain(0, 1))
curvepoint = PointOnCurve(edges.Naked, parameter=0.504)
evalsrf = EvaluateSurface(Surface=reparameterize(srf), Point=md_slider)  # -> Point, Normal, Frame
pdecon = Deconstruct(Point=curvepoint)  # -> XComponent, YComponent, ZComponent
sort = SortList(Keys=pdecon.ZComponent, ValuesA=edges.Naked)  # -> Keys, ValuesA
item = ListItem(List=sort.ValuesA, Index=0, Wrap=True)  # -> flatten(Item), Item1, Item2, flatten(Item3)
dim = Dimensions(Surface=srf)  # -> UDimension, VDimension
len = Length(Curve=item.Item)
division = Division(A=len, B=dim.VDimension)
round = Round(Number=division)  # -> Nearest, Floor, Ceiling
divide = DivideCurve(Curve=item.Item, Count=round.Nearest, Kinks=False)  # -> Points, Tangents, Parameters
division_2 = Division(A=dim.UDimension, B=flatten(round.Nearest))
line = LineSDL(Start=divide.Points, Direction=Vector(0, 0, 1), Length=graft(dim.VDimension))
multiplication = Multiplication(A=dim.VDimension, B=num)
multiplication_2 = Multiplication(A=division_2, B=num)
amp = Amplitude(Vector=evalsrf.Normal, Amplitude=multiplication)
amp_2 = Amplitude(Vector=evalsrf.Normal, Amplitude=multiplication_2)
extr = Extrude(Base=line, Direction=graft(amp_2))  # -> flatten(Extrusion)
extr_2 = Extrude(Base=item.Item3, Direction=amp)  # -> flatten(Extrusion)
filter = StreamFilter(Gate=shade_type, Stream0=extr_2, Stream1=extr, Stream2=[extr_2, extr])
shade_surfaces = ClusterOutput(filter)  # Shade Surfaces

# ==== cluster BE_GeometryElementSeperator: Takes any Brep geometry and seperates surfaces by orientation so floor, wall, and roof elements can be operated on independently.
brep = ClusterInput()  # Brep or Surfaces to Sort
roof_angle = ClusterInput()  # Angle from Vertical the Defines Roof Surface

# ---- group: For some reason, this fixes some errors
debrep = DeconstructBrep(Brep=brep)  # -> Faces, Edges, Vertices
join = BrepJoin(Breps=debrep.Faces)  # -> Breps, Closed
debrep_2 = DeconstructBrep(Brep=join.Breps)  # -> flatten(Faces), Edges, Vertices

# ---- group: Redraw Surfaces to Reset UV Coordinates
edges = BrepEdges(Brep=debrep_2.Faces)  # -> Naked, Interior, NonManifold
join_2 = JoinCurves(Curves=edges.Naked, Preserve=False)
boundary = BoundarySurfaces(Edges=join_2)  # -> flatten(Surfaces)
flip = Flip(Surface=boundary, Guide=debrep_2.Faces)  # -> Surface, Result

# ---- group: Normal of Surfaces
md_slider = MDSlider(SliderMode=0, slider_value=Point(0.5, 0.5, 0.5), x_domain=Domain(0, 1), y_domain=Domain(0, 1), z_domain=Domain(0, 1))
evalsrf = EvaluateSurface(Surface=reparameterize(flip.Surface), Point=md_slider)  # -> Point, Normal, Frame
devec = DeconstructVector(Vector=evalsrf.Normal)  # -> XComponent, YComponent, ZComponent

# ---- group: Floor Test
equals = Equality(FirstNumber=devec.ZComponent, SecondNumber="-1")  # -> Equality, Inequality
cull = CullPattern(List=flip.Surface, CullPattern=equals.Equality)

# ---- group: Non-Floor Surfaces
cull_2 = CullPattern(List=flip.Surface, CullPattern=invert(equals.Equality))
cull_3 = CullPattern(List=evalsrf.Normal, CullPattern=invert(equals.Equality))
cull_4 = CullPattern(List=evalsrf.Frame, CullPattern=invert(equals.Equality))

# ---- group: Wall vs Roof Test
cull_5 = CullPattern(List=devec.ZComponent, CullPattern=invert(equals.Equality))
rad = Radians(Degrees=roof_angle)
sin = Sine(Value=rad)
dom = ConstructDomain(DomainStart=sin, DomainEnd="1")
inc = Includes(Value=cull_5, Domain=dom)  # -> Includes, Deviation

# ---- group: Walls
cull_6 = CullPattern(List=cull_2, CullPattern=invert(inc.Includes))
cull_7 = CullPattern(List=cull_3, CullPattern=invert(inc.Includes))
cull_8 = CullPattern(List=cull_4, CullPattern=invert(inc.Includes))

# ---- group: Roofs
cull_9 = CullPattern(List=cull_2, CullPattern=inc.Includes)
cull_10 = CullPattern(List=cull_3, CullPattern=inc.Includes)
cull_11 = CullPattern(List=cull_4, CullPattern=inc.Includes)

# ----
wall_normal = ClusterOutput(cull_8)  # Normal of Wall Surface
wall_frame = ClusterOutput(cull_7)  # Planes Coincident with the Wall Surface (to orient labels)
roof_normal = ClusterOutput(cull_11)  # Normal of Roof Surface
roof_frame = ClusterOutput(cull_10)  # Planes Coincident with the Roof Surfaces Surface
wall_surfaces = ClusterOutput(cull_6)  # Vertical Wall Surfaces
roof_surfaces = ClusterOutput(cull_9)  # Horizontal Roof Surfaces
floor_surfaces = ClusterOutput(cull)  # Horizontal Floor Surfaces

# ==== cluster Router
data = ClusterInput()
data_2 = Data(data)
null = NullItem(Item=data_2)  # -> NullFlags, InvalidFlags, Description
cull = CullPattern(List=data_2, CullPattern=invert(null.NullFlags))
lng = ListLength(List=cull)
expression = Expression(x=lng, Expression="IF(x=0,0,1)")
gate = ClusterOutput(expression)  # Gate filter index

# ==== cluster VRFCondenser
panel = Panel("""-0.0152378
1.097486087
-26.23815416
203.8006305""")
panel_2 = Panel("""-0.025072619
1.175608912
-18.78718799
140.9991023""")
panel_3 = Panel("""-0.00092121
-0.000576434
0.023133794
-0.000990485
0.012014216
1.215882638""")
panel_4 = Panel("""-2.6368E-05
-2.07506E-06
0.000599901
-0.000122942
-0.027194631
1.620943897""")
panel_5 = Panel("""-0.000128124
-2.97758E-06
0.002269276
0.00036881
0.047833791
-0.0578914""")
panel_6 = Panel("""-0.002355469
-0.000851909
0.097852648
-0.002607191
0.231372228
-3.269056371""")
data = Data(reverse(panel))
objparams = IB_ObjParams(
    InputUnitTypeforX="Temperature",
    MaximumValueofx="23.89",
    MinimumValueofx="16.11",
    OutputUnitType="Temperature",
    DataFieldSetType="Ironbug.HVAC.Curves.IB_CurveCubic_FieldSet")
objparams_2 = IB_ObjParams(
    InputUnitTypeforX="Temperature",
    InputUnitTypeforY="Temperature",
    MaximumValueofx="23.89",
    MaximumValueofy="2.2",
    MinimumValueofx="16.11",
    MinimumValueofy="-20",
    OutputUnitType="Dimensionless",
    DataFieldSetType="Ironbug.HVAC.Curves.IB_CurveBiquadratic_FieldSet")
objparams_3 = IB_ObjParams(
    InputUnitTypeforX="Temperature",
    InputUnitTypeforY="Temperature",
    MaximumValueofx="23.89",
    MaximumValueofy="13.33",
    MinimumValueofx="16.11",
    MinimumValueofy="-4.4",
    OutputUnitType="Dimensionless",
    DataFieldSetType="Ironbug.HVAC.Curves.IB_CurveBiquadratic_FieldSet")
data_2 = Data(reverse(panel_2))
objparams_4 = IB_ObjParams(
    InputUnitTypeforX="Temperature",
    MaximumValueofx="23.89",
    MinimumValueofx="13.89",
    Name="CapRatioBoundary",
    OutputUnitType="Temperature",
    DataFieldSetType="Ironbug.HVAC.Curves.IB_CurveCubic_FieldSet")
data_3 = Data(reverse(panel_3))
data_4 = Data(reverse(panel_4))
objparams_5 = IB_ObjParams(
    InputUnitTypeforX="Temperature",
    InputUnitTypeforY="Temperature",
    MaximumValueofx="23.89",
    MaximumValueofy="39.44",
    MinimumValueofx="13.89",
    MinimumValueofy="10",
    OutputUnitType="Dimensionless",
    DataFieldSetType="Ironbug.HVAC.Curves.IB_CurveBiquadratic_FieldSet")
objparams_6 = IB_ObjParams(
    InputUnitTypeforX="Temperature",
    InputUnitTypeforY="Temperature",
    MaximumValueofx="23.89",
    MaximumValueofy="47.78",
    MinimumValueofx="13.89",
    MinimumValueofy="21.11",
    OutputUnitType="Dimensionless",
    DataFieldSetType="Ironbug.HVAC.Curves.IB_CurveBiquadratic_FieldSet")
data_5 = Data(reverse(panel_5))
data_6 = Data(reverse(panel_6))
curvebiquadratic = Ironbug_CurveBiquadratic(Coefficients=data_3, Parameters_=objparams_2, dupNum=False)
curvebiquadratic_2 = Ironbug_CurveBiquadratic(Coefficients=data_4, Parameters_=objparams_3, dupNum=False)
curvecubic = Ironbug_CurveCubic(Coefficients=data, Parameters_=objparams, dupNum=False)
curvebiquadratic_3 = Ironbug_CurveBiquadratic(Coefficients=data_5, Parameters_=objparams_5, dupNum=False)
curvebiquadratic_4 = Ironbug_CurveBiquadratic(Coefficients=data_6, Parameters_=objparams_6, dupNum=False)
curvecubic_2 = Ironbug_CurveCubic(Coefficients=data_2, Parameters_=objparams_4, dupNum=False)
panel_7 = Panel("""-0.025072619
1.175608912
-18.78718799
140.9991023""")
panel_8 = Panel("""-0.0152378
1.097486087
-26.23815416
203.8006305""")
panel_9 = Panel("""-0.001119743
0.000374598
0.028950942
0.001886356
-0.04764714
0.488199939""")
panel_10 = Panel("""-0.000750228
6.38702E-05
-0.006854615
0.003579938
-0.110796694
1.880215219""")
panel_11 = Panel("""-0.000425267
0.000578568
0.001056848
0.000487506
-0.015829034
0.675618194""")
panel_12 = Panel("""-0.000778721
0.00048802
-0.025729463
0.003212795
-0.094102151
1.658467551""")
objparams_7 = IB_ObjParams(
    InputUnitTypeforX="Temperature",
    MaximumValueofx="23.89",
    MinimumValueofx="13.89",
    Name="EIRRatioBoundary",
    OutputUnitType="Temperature",
    DataFieldSetType="Ironbug.HVAC.Curves.IB_CurveCubic_FieldSet")
objparams_8 = IB_ObjParams(
    InputUnitTypeforX="Temperature",
    MaximumValueofx="23.89",
    MinimumValueofx="16.11",
    OutputUnitType="Temperature",
    DataFieldSetType="Ironbug.HVAC.Curves.IB_CurveCubic_FieldSet")
objparams_9 = IB_ObjParams(
    InputUnitTypeforX="Temperature",
    InputUnitTypeforY="Temperature",
    MaximumValueofx="23.89",
    MaximumValueofy="47.78",
    MinimumValueofx="13.89",
    MinimumValueofy="21.11",
    OutputUnitType="Dimensionless",
    DataFieldSetType="Ironbug.HVAC.Curves.IB_CurveBiquadratic_FieldSet")
objparams_10 = IB_ObjParams(
    InputUnitTypeforX="Temperature",
    InputUnitTypeforY="Temperature",
    MaximumValueofx="23.89",
    MaximumValueofy="13.33",
    MinimumValueofx="16.11",
    MinimumValueofy="-4.44",
    OutputUnitType="Dimensionless",
    DataFieldSetType="Ironbug.HVAC.Curves.IB_CurveBiquadratic_FieldSet")
objparams_11 = IB_ObjParams(
    InputUnitTypeforX="Temperature",
    InputUnitTypeforY="Temperature",
    MaximumValueofx="23.89",
    MaximumValueofy="39.44",
    MinimumValueofx="13.89",
    MinimumValueofy="10",
    OutputUnitType="Dimensionless",
    DataFieldSetType="Ironbug.HVAC.Curves.IB_CurveBiquadratic_FieldSet")
objparams_12 = IB_ObjParams(
    InputUnitTypeforX="Temperature",
    InputUnitTypeforY="Temperature",
    MaximumValueofx="23.89",
    MaximumValueofy="2.22",
    MinimumValueofx="16.11",
    MinimumValueofy="-20",
    OutputUnitType="Dimensionless",
    DataFieldSetType="Ironbug.HVAC.Curves.IB_CurveBiquadratic_FieldSet")
data_7 = Data(reverse(panel_9))
data_8 = Data(reverse(panel_10))
data_9 = Data(reverse(panel_11))
data_10 = Data(reverse(panel_12))
data_11 = Data(reverse(panel_7))
data_12 = Data(reverse(panel_8))
curvecubic_3 = Ironbug_CurveCubic(Coefficients=data_11, Parameters_=objparams_7, dupNum=False)
curvebiquadratic_5 = Ironbug_CurveBiquadratic(Coefficients=data_7, Parameters_=objparams_9, dupNum=False)
curvecubic_4 = Ironbug_CurveCubic(Coefficients=data_12, Parameters_=objparams_8, dupNum=False)
curvebiquadratic_6 = Ironbug_CurveBiquadratic(Coefficients=data_8, Parameters_=objparams_10, dupNum=False)
curvebiquadratic_7 = Ironbug_CurveBiquadratic(Coefficients=data_9, Parameters_=objparams_11, dupNum=False)
curvebiquadratic_8 = Ironbug_CurveBiquadratic(Coefficients=data_10, Parameters_=objparams_12, dupNum=False)
panel_13 = Panel("""3.217813168
-6.128396226
5.155371753
-1.246792429""")
panel_14 = Panel("""11.57407407
-40.97222222
48.56481481
-18.16666667""")
panel_15 = Panel("""23.12653687
-75.51556032
82.91286218
-29.52383872""")
panel_16 = Panel("""2.198476343
-8.235891218
10.52584262
-3.488427741""")
panel_17 = Panel("""0.758097958
-1.98189043
2.691540971
-0.470125574""")
objparams_13 = IB_ObjParams(
    InputUnitTypeforX="Dimensionless",
    MaximumValueofx="1.152777778",
    MinimumValueofx="1",
    OutputUnitType="Dimensionless",
    DataFieldSetType="Ironbug.HVAC.Curves.IB_CurveCubic_FieldSet")
objparams_14 = IB_ObjParams(
    InputUnitTypeforX="Dimensionless",
    MaximumValueofx="1",
    MinimumValueofx="0.25",
    OutputUnitType="Dimensionless",
    DataFieldSetType="Ironbug.HVAC.Curves.IB_CurveCubic_FieldSet")
objparams_15 = IB_ObjParams(
    InputUnitTypeforX="Dimensionless",
    MaximumValueofx="1.212962963",
    MinimumValueofx="1",
    OutputUnitType="Dimensionless",
    DataFieldSetType="Ironbug.HVAC.Curves.IB_CurveCubic_FieldSet")
objparams_16 = IB_ObjParams(
    InputUnitTypeforX="Dimensionless",
    MaximumValueofx="1",
    MinimumValueofx="0.25",
    OutputUnitType="Dimensionless",
    DataFieldSetType="Ironbug.HVAC.Curves.IB_CurveCubic_FieldSet")
panel_18 = Panel("""10.80246914
-37.80864198
44.56790123
-16.5617284""")
objparams_17 = IB_ObjParams(
    InputUnitTypeforX="Dimensionless",
    MaximumValueofx="1.3",
    MinimumValueofx="1",
    OutputUnitType="Dimensionless",
    DataFieldSetType="Ironbug.HVAC.Curves.IB_CurveCubic_FieldSet")
objparams_18 = IB_ObjParams(
    InputUnitTypeforX="Dimensionless",
    MaximumValueofx="1.3",
    MinimumValueofx="1",
    OutputUnitType="Dimensionless",
    DataFieldSetType="Ironbug.HVAC.Curves.IB_CurveCubic_FieldSet")
data_13 = Data(reverse(panel_13))
data_14 = Data(reverse(panel_15))
data_15 = Data(reverse(panel_16))
data_16 = Data(reverse(panel_17))
data_17 = Data(reverse(panel_18))
curvecubic_5 = Ironbug_CurveCubic(Coefficients=data_14, Parameters_=objparams_13, dupNum=False)
curvecubic_6 = Ironbug_CurveCubic(Coefficients=data_13, Parameters_=objparams_14, dupNum=False)
curvecubic_7 = Ironbug_CurveCubic(Coefficients=data_15, Parameters_=objparams_15, dupNum=False)
data_18 = Data(reverse(panel_14))
curvecubic_8 = Ironbug_CurveCubic(Coefficients=data_16, Parameters_=objparams_16, dupNum=False)
curvecubic_9 = Ironbug_CurveCubic(Coefficients=data_17, Parameters_=objparams_17, dupNum=False)
curvecubic_10 = Ironbug_CurveCubic(Coefficients=data_18, Parameters_=objparams_18, dupNum=False)
panel_19 = Panel("""1.1
0
0
0
0
0""")
panel_20 = Panel("""0.9
0
0
0
0
0""")
panel_21 = Panel("""-4.62291E-09
1.713E-06
-0.000574329
1.003618227""")
objparams_19 = IB_ObjParams(
    InputUnitTypeforX="Dimensionless",
    MaximumValueofx="1",
    MinimumValueofx="0",
    OutputUnitType="Dimensionless",
    DataFieldSetType="Ironbug.HVAC.Curves.IB_CurveLinear_FieldSet")
objparams_20 = IB_ObjParams(
    InputUnitTypeforX="Distance",
    MaximumValueofx="220.07",
    MinimumValueofx="7.62",
    OutputUnitType="Dimensionless",
    DataFieldSetType="Ironbug.HVAC.Curves.IB_CurveCubic_FieldSet")
panel_22 = Panel("""-6.58003E-10
7.40405E-08
-0.000790038
0.995171846""")
objparams_21 = IB_ObjParams(
    InputUnitTypeforX="Distance",
    MaximumValueofx="220.07",
    MinimumValueofx="7.62",
    OutputUnitType="Dimensionless",
    DataFieldSetType="Ironbug.HVAC.Curves.IB_CurveCubic_FieldSet")
objparams_22 = IB_ObjParams(
    InputUnitTypeforX="Temperature",
    InputUnitTypeforY="Temperature",
    MaximumValueofx="100",
    MaximumValueofy="100",
    MinimumValueofx="-100",
    MinimumValueofy="-100",
    OutputUnitType="Dimensionless",
    DataFieldSetType="Ironbug.HVAC.Curves.IB_CurveBiquadratic_FieldSet")
objparams_23 = IB_ObjParams(
    InputUnitTypeforX="Temperature",
    InputUnitTypeforY="Temperature",
    MaximumValueofx="100",
    MaximumValueofy="100",
    MinimumValueofx="-100",
    MinimumValueofy="-100",
    OutputUnitType="Dimensionless",
    DataFieldSetType="Ironbug.HVAC.Curves.IB_CurveBiquadratic_FieldSet")
panel_23 = Panel("""0.85
0.15""")
data_19 = Data(reverse(panel_21))
data_20 = Data(reverse(panel_22))
curvebiquadratic_9 = Ironbug_CurveBiquadratic(Coefficients=panel_19, Parameters_=objparams_22, dupNum=False)
curvecubic_11 = Ironbug_CurveCubic(Coefficients=data_19, Parameters_=objparams_20, dupNum=False)
curvelinear = Ironbug_CurveLinear(Coefficients=panel_23, Parameters_=objparams_19, dupNum=False)
curvebiquadratic_10 = Ironbug_CurveBiquadratic(Coefficients=panel_20, Parameters_=objparams_23, dupNum=False)
curvecubic_12 = Ironbug_CurveCubic(Coefficients=data_20, Parameters_=objparams_21, dupNum=False)
data_21 = Data(["Current document units is in Meters", "Conversion to Meters will be applied = 1.000", "Current working directory is set to:  c:\ladybug\unnamed\OpenStudio", "Model saved to: c:\ladybug\unnamed\OpenStudio\unnamed.osm", "OSM > IDF: c:/ladybug/unnamed/OpenStudio/unnamed/ModelToIdf/in.idf", "Program Version,EnergyPlus, Version 9.3.0-baff08990c, YMD=2020.08.02 15:15,"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])
panel_24 = Panel(data_21)
heatpumpwasteheatrecovery = ClusterInput()
name = ClusterInput()
cocop = ClusterInput()
hecop = ClusterInput()
ratedtotalcoolingcapacity = ClusterInput()
ratedtotalheatingcapacity = ClusterInput()
objparams_24 = IB_ObjParams(
    CoolingCapacityRatioBoundaryCurve=curvecubic_2,
    CoolingCapacityRatioModifierFunctionofHighTemperatureCurve=curvebiquadratic_4,
    CoolingCapacityRatioModifierFunctionofLowTemperatureCurve=curvebiquadratic_3,
    CoolingCombinationRatioCorrectionFactorCurve=curvecubic_10,
    CoolingEnergyInputRatioBoundaryCurve=curvecubic_3,
    CoolingEnergyInputRatioModifierFunctionofHighPartLoadRatioCurve=curvecubic_5,
    CoolingEnergyInputRatioModifierFunctionofHighTemperatureCurve=curvebiquadratic_5,
    CoolingEnergyInputRatioModifierFunctionofLowPartLoadRatioCurve=curvecubic_6,
    CoolingEnergyInputRatioModifierFunctionofLowTemperatureCurve=curvebiquadratic_7,
    CoolingPartLoadFractionCorrelationCurve=curvelinear,
    HeatingCapacityRatioBoundaryCurve=curvecubic,
    HeatingCapacityRatioModifierFunctionofHighTemperatureCurve=curvebiquadratic_2,
    HeatingCapacityRatioModifierFunctionofLowTemperatureCurve=curvebiquadratic,
    HeatingCombinationRatioCorrectionFactorCurve=curvecubic_9,
    HeatingEnergyInputRatioBoundaryCurve=curvecubic_4,
    HeatingEnergyInputRatioModifierFunctionofHighPartLoadRatioCurve=curvecubic_7,
    HeatingEnergyInputRatioModifierFunctionofHighTemperatureCurve=curvebiquadratic_6,
    HeatingEnergyInputRatioModifierFunctionofLowPartLoadRatioCurve=curvecubic_8,
    HeatingEnergyInputRatioModifierFunctionofLowTemperatureCurve=curvebiquadratic_8,
    HeatingPartLoadFractionCorrelationCurve=curvelinear,
    HeatPumpWasteHeatRecovery=heatpumpwasteheatrecovery,
    HeatRecoveryCoolingCapacityModifierCurve=curvebiquadratic_10,
    HeatRecoveryCoolingEnergyModifierCurve=curvebiquadratic_9,
    HeatRecoveryHeatingCapacityModifierCurve=curvebiquadratic_10,
    HeatRecoveryHeatingEnergyModifierCurve=curvebiquadratic_9,
    Name=name,
    PipingCorrectionFactorforLengthinCoolingModeCurve=curvecubic_12,
    PipingCorrectionFactorforLengthinHeatingModeCurve=curvecubic_11,
    RatedCoolingCOP=cocop,
    RatedHeatingCOP=hecop,
    RatedTotalCoolingCapacity=ratedtotalcoolingcapacity,
    RatedTotalHeatingCapacity=ratedtotalheatingcapacity,
    DataFieldSetType="Ironbug.HVAC.IB_AirConditionerVariableRefrigerantFlow_FieldSet")
params = ClusterOutput(objparams_24)

# ==== cluster Ft2m
ft = ClusterInput()
multiplication = Multiplication(A=ft, B="0.3048")
m = ClusterOutput(multiplication)

# ==== cluster Area
B = ClusterInput()
debrep = DeconstructBrep(Brep=B)  # -> Faces, Edges, Vertices
area = Area(Geometry=debrep.Faces)  # -> Area, Centroid
pdecon = Deconstruct(Point=area.Centroid)  # -> XComponent, YComponent, ZComponent
sort = SortList(Keys=pdecon.ZComponent, ValuesA=area.Area)  # -> Keys, ValuesA
panel = Panel("""m²
ft²""")
G = ClusterInput()
_0 = ClusterInput()
_1 = ClusterInput()
item = ListItem(List=sort.ValuesA, Index=0, Wrap=True)  # -> flatten(Item)
filter = StreamFilter(Gate=G, Stream0=_0, Stream1=_1)
item_2 = ListItem(List=panel, Index=G, Wrap=True)
ma = MassAddition(Input=item)  # -> Result, PartialResults
division = Division(A=ma.Result, B=filter)
division_2 = Division(A=item, B=filter)
area_2 = ClusterOutput(division)
units = ClusterOutput(item_2)  # Units
area_by_zone = ClusterOutput(division_2)

# ==== cluster BE_PerimeterAndCore: Takes Brep representing a building floor and divides it into core and perimeter zones. It also provides the interior wall surfaces that can be assigned as airwalls. This components works better on complicated geometry with reentrant boundaries than the Honeybee component that does the same function.
brep_of_floor = ClusterInput()  # Brep of floor to generate core and perimeter zones for
perimeter_zone_depth = ClusterInput()  # Depth of perimeter zones in model units
floor_brep = Brep(brep_of_floor)
perimeter_depth = Number(perimeter_zone_depth)
debrep = DeconstructBrep(Brep=floor_brep)  # -> Faces, Edges, Vertices
area = Area(Geometry=debrep.Faces)  # -> Area, Centroid
pdecon = Deconstruct(Point=area.Centroid)  # -> XComponent, YComponent, ZComponent
sort = SortList(Keys=pdecon.ZComponent, ValuesA=debrep.Faces)  # -> Keys, ValuesA
item = ListItem(List=sort.ValuesA, Index=0, Wrap=True)  # -> Item, Item1
edges = BrepEdges(Brep=item.Item)  # -> Naked, Interior, NonManifold
neg = Negative(Value=perimeter_depth)
join = JoinCurves(Curves=edges.Naked, Preserve=False)
offset_l = OffsetLoose(Curve=join, Distance=perimeter_depth)
offset_l_2 = OffsetLoose(Curve=join, Distance=neg)
merge = Merge(Data1=offset_l, Data2=offset_l_2)
scx = SurfaceCurve(Surface=item.Item, Curve=merge)  # -> Curves, Points, UVPoints, Normals, Parameters, Tangents
pshift = ShiftPaths(Data=scx.Curves, Offset="-3")
srfsplit = SurfaceSplit(Surface=item.Item, Curves=pshift)  # -> graft(Fragments)
edges_2 = BrepEdges(Brep=srfsplit)  # -> Naked, Interior, NonManifold
join_2 = JoinCurves(Curves=edges_2.Naked, Preserve=False)
pshift_2 = ShiftPaths(Data=join_2, Offset="-2")
lng = ListLength(List=pshift_2)
tstat = TreeStatistics(Tree=lng)  # -> Paths, Length, Count
larger = LargerThan(FirstNumber=lng, SecondNumber="2")  # -> LargerThan, OrEqualTo
equals = Equality(FirstNumber=lng, SecondNumber="2")  # -> Equality, Inequality
equals_2 = Equality(FirstNumber=lng, SecondNumber="1")  # -> Equality, Inequality
cull = CullPattern(List=tstat.Paths, CullPattern=flatten(equals.Equality))
cull_2 = CullPattern(List=tstat.Paths, CullPattern=flatten(equals_2.Equality))
cull_3 = CullPattern(List=tstat.Paths, CullPattern=flatten(larger.LargerThan))
tbranch = TreeBranch(Tree=pshift_2, Path=cull, MaintainPaths=True, SplitTree=False)
tbranch_2 = TreeBranch(Tree=pshift_2, Path=cull_2, MaintainPaths=True, SplitTree=False)
tbranch_3 = TreeBranch(Tree=pshift_2, Path=cull_3, MaintainPaths=True, SplitTree=False)
item_2 = ListItem(List=tbranch, Index=0, Wrap=True)  # -> Item, Item1
explode = Explode(Curve=item_2.Item, Recursive=True)  # -> Segments, Vertices
explode_2 = Explode(Curve=item_2.Item1, Recursive=True)  # -> Segments, Vertices
pshift_3 = ShiftPaths(Data=tbranch_3, Offset="-2")
pshift_4 = ShiftPaths(Data=tbranch_2, Offset="-2")
explode_3 = Explode(Curve=pshift_3, Recursive=True)  # -> Segments, Vertices
ln = Line(StartPoint=explode.Vertices, EndPoint=explode_2.Vertices)
pshift_5 = ShiftPaths(Data=explode_3.Vertices, Offset=-1)
pshift_6 = ShiftPaths(Data=explode_3.Segments, Offset=-1)
pshift_7 = ShiftPaths(Data=ln, Offset="-3")
lng_2 = ListLength(List=pshift_6)
con = DelaunayEdges(Points=pshift_5, Plane=PlaneXY(0, 0, 0))  # -> Connectivity, Edges
len = Length(Curve=con.Edges)
sort_2 = SortList(Keys=len, ValuesA=con.Edges)  # -> Keys, ValuesA
split = SplitList(List=sort_2.ValuesA, Index=lng_2)  # -> ListA, ListB
bnd = Bounds(Numbers=sort.Keys)
pshift_8 = ShiftPaths(Data=split.ListA, Offset="-2")
merge_2 = Merge(Data1=pshift_4, Data2=pshift_7, Data3=pshift_3, Data4=pshift_8)
dedomain = DeconstructDomain(Domain=bnd)  # -> Start, End
subtraction = Subtraction(A=dedomain.End, B=dedomain.Start)
srfsplit_2 = SurfaceSplit(Surface=item.Item, Curves=merge_2)
pshift_9 = ShiftPaths(Data=srfsplit_2, Offset=-1)
Z = UnitZ(Factor=subtraction)
extr = Extrude(Base=pshift_9, Direction=Z)  # -> flatten(Extrusion)
extr_2 = Extrude(Base=merge_2, Direction=Z)  # -> flatten(Extrusion)
interior_walls = ClusterOutput(extr_2)  # Interior walls that can be defined as airwalls
perimeter_and_core_zones = ClusterOutput(extr)  # Resulting core and perimeter zones

# ==== cluster In2m
in = ClusterInput()
multiplication = Multiplication(A=in, B="0.0254")
m = ClusterOutput(multiplication)
